# Grasshopper definition 190120_Assembly_test.gh (Grasshopper 1.0.7)

# ---- group: parameters
offset_elipse = Slider(22, range=0..100)
divide_elipse = Slider(6, range=0..25)
pt = ConstructPoint(XCoordinate=0, YCoordinate=0, ZCoordinate=Slider(17, range=0..100))
radius_x = Slider(129, range=0..200)
beam_x = Slider(145, range=0..200)
radius_z = Slider(100, range=0..200)
rotation_elipse = Slider(0, range=0..180)
beam_y = Slider(10, range=0..100)
beam_z = Slider(4, range=0..1000)
beam_rotation = Slider(3, range=0..100)
beam_shift_0 = Slider(90, range=0..100)
beam_shift_1 = Slider(62, range=0..100)
neg = Negative(Value=radius_x)
neg_2 = Negative(Value=rotation_elipse)
neg_3 = Negative(Value=offset_elipse)

# ----
of_elipses = Slider(5, range=0..10)
rad = Radians(Degrees=beam_shift_0)
rad_2 = Radians(Degrees=beam_shift_1)

# ---- group: elipse
xz = XZPlane(Origin=pt)
X = UnitX(Factor=[radius_x, neg])
move = Move(Geometry=pt, Motion=X)  # -> Geometry, Transform
xy = XYPlane(Origin=pt)
yz = YZPlane(Origin=pt)
ellipse = Ellipse(Plane=xz, Radius1=radius_x, Radius2=radius_z)  # -> graft(Ellipse), Focus1, Focus2
item = ListItem(List=ellipse.Ellipse, Index=0, Wrap=True)

# ---- group: rotation/offset
dom = ConstructDomain(DomainStart=neg_2, DomainEnd=rotation_elipse)
range = Range(Domain=dom, Steps=of_elipses)  # -> flatten(Range)
rot3d = Rotate3D(Geometry=item, Angle=degrees(range), Center=Point(0, 0, 0), Axis=yz)  # -> flatten(Geometry), Transform
shift = ShiftList(List=rot3d.Geometry, Shift=9, Wrap=True)
dom_2 = ConstructDomain(DomainStart=offset_elipse, DomainEnd=neg_3)
range_2 = Range(Domain=dom_2, Steps=of_elipses)  # -> flatten(Range)
Y = UnitY(Factor=range_2)
move_2 = Move(Geometry=rot3d.Geometry, Motion=Y)  # -> flatten(Geometry), Transform

# ---- group: points on curve
len = Length(Curve=ellipse.Ellipse)
panel = Panel("""0
1""")
panel_2 = Panel("""1
0""")
cull = CullPattern(List=move_2.Geometry, CullPattern=panel)  # -> flatten(List)
shatter = Shatter(Curve=cull, Parameters=rad)
cull_2 = CullPattern(List=move_2.Geometry, CullPattern=panel_2)  # -> flatten(List)
division = Division(A=len, B=divide_elipse)
divlength = DivideLength(Curve=shatter, Length=division)  # -> Points, Tangents, Parameters
pull = PullPoint(Point=divlength.Points, Geometry=cull, Closest=True)  # -> simplify(ClosestPoint), Distance

# ----
shatter_2 = Shatter(Curve=cull_2, Parameters=rad_2)
divlength_2 = DivideLength(Curve=shatter_2, Length=division)  # -> Points, Tangents, Parameters
pull_2 = PullPoint(Point=divlength_2.Points, Geometry=cull, Closest=True)  # -> simplify(ClosestPoint), Distance

# ---- group: planes
pl = ConstructPlane(Origin=divlength_2.Points, XAxis=divlength_2.Tangents, YAxis=Vector(0, 1, 0))  # -> simplify(Plane)
pl_2 = ConstructPlane(Origin=divlength.Points, XAxis=divlength.Tangents, YAxis=Vector(0, 1, 0))  # -> simplify(Plane)
python = GhPythonScript(
    normal_list=pl,
    shifted_list=pl_2,
    o_normal=divlength_2.Points,
    o_shifted=divlength.Points,
    dx=beam_x,
    dy=beam_y,
    dz=beam_z,
    beam_r=beam_rotation)  # -> out, n_list, s_list, temp_geom, temp_beam; inputs normal_list: tree of Plane, shifted_list: tree of Plane, o_normal: tree of Point3d, o_shifted: tree of Point3d
# ---------- python: Python ----------
import rhinoscriptsyntax as rs
import Rhino.Geometry as rg
import math
import clr
clr.AddReference("Grasshopper")
import Grasshopper.Kernel.Data.GH_Path as ghpath
import Grasshopper.DataTree as datatree
import geometry.beam as beam
import System

n_list = []
s_list = []
temp_geom = []
count = 0
beam_list_n = []
beam_list_s = []

for plane_list, origin_list in zip(normal_list.Branches, o_normal.Branches):
    temp_list = []
    for plane, origin in zip(plane_list,origin_list):
        if origin.Z > 0:
            temp_list.append(plane)
            #temp_geom.append(plane)
    n_list.append(temp_list)

for plane_list, origin_list in zip(shifted_list.Branches, o_shifted.Branches):
    temp_list = []
    for plane, origin in zip(plane_list,origin_list):
        if origin.Z > 0:
            temp_list.append(plane)
            temp_geom.append(plane)
    s_list.append(temp_list)

temp_points = []

#for n in n_list:
#    temp_pts = []
#    temp_lines = []
#    for i in n:
#        rg.Plane.Rotate(i, (90*math.pi/180), i.XAxis, i.Origin)
#        rg.Plane.Rotate(i, (beam_r*math.pi/180), i.YAxis, i.Origin)
#        temp_instance = beam.Beam(i, dx, dy, dz)
#        temp_beam = temp_instance.brep_representation()
#        temp_vertices = []
#        temp_vertices = rg.Brep.Vertices.GetValue(temp_beam)
#        boolean = True
#        for v in temp_vertices:
#            if v.Location.Z < 0:
#                boolean = False
#        if boolean:
#            temp_geom.append(temp_beam)
#            temp_line = temp_instance.get_baseline()
#            temp_curve = temp_line.ToNurbsCurve()
#            rs.ScaleObject(temp_curve, i.Origin, (0.9,0.9,0.9))
#            divisions_temp = 4
#            unitizied_domain = 1 / (divisions_temp - 1)
#            t_vals = [ (unitizied_domain * i) for i in range(divisions_temp)]
#            temp_p = [temp_curve.PointAt(t_val) for t_val in t_vals]
#            temp_pts.append(temp_p)
#    temp_points.append(temp_pts)

for s in s_list:
    temp_pts = []
    temp_lines = []
    for i in s:
        rg.Plane.Rotate(i, (90*math.pi/180), i.XAxis, i.Origin)
        rg.Plane.Rotate(i, (beam_r*math.pi/180), i.YAxis, i.Origin)
        temp_instance = beam.Beam(i, dx, dy, dz)
        temp_beam = temp_instance.brep_representation()
        temp_vertices = []
        temp_vertices = rg.Brep.Vertices.GetValue(temp_beam)
        boolean = True
        for v in temp_vertices:
            if v.Location.Z < 0:
                boolean = False
        if boolean:
            temp_geom.append(temp_beam)
            temp_line = temp_instance.get_baseline()
            temp_curve = temp_line.ToNurbsCurve()
            rs.ScaleObject(temp_curve, i.Origin, (0.9,0.9,0.9))
            divisions_temp = 4
            unitizied_domain = 1 / (divisions_temp - 1)
            for i in range divisions_temp:
                temp_p = temp_curve.PointAt(unitized_domain*i)
#                temp_plane = 
            temp_p = [temp_curve.PointAt(t_val) for t_val in t_vals]
            temp_pts.append(temp_p)
    temp_points.append(temp_pts)

for i, p_curve in enumerate(temp_points):
    for j, p_beam in enumerate(p_curve):
        for k, p in enumerate(p_beam):
            print p
            temp_l = rg.Line(p, temp_points[i-1][j][k])
            temp_geom.append(temp_l)
# ---------- end python ----------

# ----
panel_3 = Panel(python.temp_geom)
geo = Geometry(python.temp_geom)
