# Grasshopper definition 190122_Assembly_test.gh (Grasshopper 1.0.7)

# ---- group: parameters
offset_elipse = Slider(22, range=0..100)
divide_elipse = Slider(6, range=0..25)
pt = ConstructPoint(XCoordinate=0, YCoordinate=0, ZCoordinate=Slider(17, range=0..100))
radius_x = Slider(106, range=0..200)
beam_x = Slider(145, range=0..200)
radius_z = Slider(107, range=0..200)
rotation_elipse = Slider(1, range=0..180)
beam_y = Slider(10, range=0..100)
beam_z = Slider(4, range=0..1000)
beam_rotation = Slider(3, range=0..100)
beam_shift_0 = Slider(90, range=0..100)
beam_shift_1 = Slider(59, range=0..100)
neg = Negative(Value=radius_x)
neg_2 = Negative(Value=rotation_elipse)
neg_3 = Negative(Value=offset_elipse)

# ----
of_elipses = Slider(5, range=0..10)
rad = Radians(Degrees=beam_shift_0)
rad_2 = Radians(Degrees=beam_shift_1)

# ---- group: elipse
xz = XZPlane(Origin=pt)
X = UnitX(Factor=[radius_x, neg])
move = Move(Geometry=pt, Motion=X)  # -> Geometry, Transform
xy = XYPlane(Origin=pt)
yz = YZPlane(Origin=pt)
ellipse = Ellipse(Plane=xz, Radius1=radius_x, Radius2=radius_z)  # -> graft(Ellipse), Focus1, Focus2
item = ListItem(List=ellipse.Ellipse, Index=0, Wrap=True)

# ---- group: rotation/offset
dom = ConstructDomain(DomainStart=neg_2, DomainEnd=rotation_elipse)
range = Range(Domain=dom, Steps=of_elipses)  # -> flatten(Range)
rot3d = Rotate3D(Geometry=item, Angle=degrees(range), Center=Point(0, 0, 0), Axis=yz)  # -> flatten(Geometry), Transform
shift = ShiftList(List=rot3d.Geometry, Shift=9, Wrap=True)
dom_2 = ConstructDomain(DomainStart=offset_elipse, DomainEnd=neg_3)
range_2 = Range(Domain=dom_2, Steps=of_elipses)  # -> flatten(Range)
Y = UnitY(Factor=range_2)
move_2 = Move(Geometry=rot3d.Geometry, Motion=Y)  # -> flatten(Geometry), Transform

# ---- group: points on curve
len = Length(Curve=ellipse.Ellipse)
panel = Panel("""0
1""")
panel_2 = Panel("""1
0""")
cull = CullPattern(List=move_2.Geometry, CullPattern=panel)  # -> flatten(List)
shatter = Shatter(Curve=cull, Parameters=rad)
cull_2 = CullPattern(List=move_2.Geometry, CullPattern=panel_2)  # -> flatten(List)
division = Division(A=len, B=divide_elipse)
divlength = DivideLength(Curve=shatter, Length=division)  # -> Points, Tangents, Parameters
pull = PullPoint(Point=divlength.Points, Geometry=cull, Closest=True)  # -> simplify(ClosestPoint), Distance

# ----
shatter_2 = Shatter(Curve=cull_2, Parameters=rad_2)
divlength_2 = DivideLength(Curve=shatter_2, Length=division)  # -> Points, Tangents, Parameters
pull_2 = PullPoint(Point=divlength_2.Points, Geometry=cull, Closest=True)  # -> simplify(ClosestPoint), Distance

# ---- group: planes
pl = ConstructPlane(Origin=divlength_2.Points, XAxis=divlength_2.Tangents, YAxis=Vector(0, 1, 0))  # -> simplify(Plane)
pl_2 = ConstructPlane(Origin=divlength.Points, XAxis=divlength.Tangents, YAxis=Vector(0, 1, 0))  # -> simplify(Plane)
python = GhPythonScript(
    normal_list=pl,
    shifted_list=pl_2,
    dx=beam_x,
    dy=beam_y,
    dz=beam_z,
    beam_r=beam_rotation,
    div_param=Slider(0.84, range=0..1))  # -> out, n_list, s_list, temp_geom, temp_beam, closest_list; inputs normal_list: tree of Plane, shifted_list: tree of Plane, final_pt_list: list of Point3d
# ---------- python: Python ----------
import rhinoscriptsyntax as rs
import Rhino.Geometry as rg
import math
import clr
clr.AddReference("Grasshopper")
import Grasshopper.Kernel.Data.GH_Path as ghpath
import Grasshopper.DataTree as datatree
import geometry.beam as beam
import System

temp_geom = []
int_lines = []
closest_list = []

for plane_list in normal_list.Branches:
    for i in plane_list:
        if i.Origin.Z > 0:
            rg.Plane.Rotate(i, (90*math.pi/180), i.XAxis, i.Origin)
            rg.Plane.Rotate(i, (beam_r*math.pi/180), i.YAxis, i.Origin)
            temp_instance = beam.Beam(i, dx, dy, dz)
            temp_beam = temp_instance.brep_representation()
            temp_vertices = []
            temp_vertices = rg.Brep.Vertices.GetValue(temp_beam)
            boolean = True
            for v in temp_vertices:
                if v.Location.Z < 0:
                    boolean = False
            if boolean:
                #temp_geom.append(temp_beam)
                temp_line = temp_instance.get_baseline()
                temp_curve = temp_line.ToNurbsCurve()
                temp_geom.append(temp_curve)
                int_lines.append(temp_curve)
                rs.ScaleObject(temp_curve, i.Origin, (div_param,div_param,div_param))
                divisions_temp = 4
                unitizied_domain = 1 / (divisions_temp - 1)
                for j in range(divisions_temp):
                    temp_p = temp_curve.PointAt(unitizied_domain*j)
                    temp_vector = rg.Vector3d.Subtract(rg.Vector3d(temp_p), rg.Vector3d(i.Origin))
                    new_plane = rg.Plane(i)
                    rg.Plane.Translate(new_plane, temp_vector)
                    #temp_geom.append(new_plane)

for plane_list in shifted_list.Branches:
    for i in plane_list:
        if i.Origin.Z > 0:
            rg.Plane.Rotate(i, (90*math.pi/180), i.XAxis, i.Origin)
            rg.Plane.Rotate(i, (beam_r*math.pi/180), i.YAxis, i.Origin)
            temp_instance = beam.Beam(i, dx, dy, dz)
            temp_beam = temp_instance.brep_representation()
            temp_vertices = []
            temp_vertices = rg.Brep.Vertices.GetValue(temp_beam)
            boolean = True
            for v in temp_vertices:
                if v.Location.Z < 0:
                    boolean = False
            if boolean:
                #temp_geom.append(temp_beam)
                temp_line = temp_instance.get_baseline()
                temp_curve = temp_line.ToNurbsCurve()
                temp_geom.append(temp_curve)
                int_lines.append(temp_curve)
                rs.ScaleObject(temp_curve, i.Origin, (div_param,div_param,div_param))
                divisions_temp = 4
                unitizied_domain = 1 / (divisions_temp - 1)
                for j in range(divisions_temp):
                    temp_p = temp_curve.PointAt(unitizied_domain*j)
                    temp_vector = rg.Vector3d.Subtract(rg.Vector3d(temp_p), rg.Vector3d(i.Origin))
                    new_plane = rg.Plane(i)
                    rg.Plane.Translate(new_plane, temp_vector)
                    #temp_geom.append(new_plane)

for i in int_lines:
    for j in int_lines:
        if i != j:
            bool, closest_pt0, closest_pt1 = j.ClosestPoints(i)
            closest_list.append(closest_pt0)
            closest_list.append(closest_pt1)
            #temp_geom.append(closest_pt0)

print final_pt_list
# ---------- end python ----------

# ----
cullpt = CullDuplicates(Points=python.closest_list, Tolerance=Slider(4.27, range=0..10), CullMode=3)  # -> flatten(Points), Indices, Valence
python_2 = GhPythonScript()  # -> Out, A
panel_3 = Panel(cullpt.Points)
geo = Geometry(python.temp_geom)
