# Grasshopper definition 190123_Assembly_test.gh (Grasshopper 1.0.7)

# ---- group: parameters
offset_elipse = Slider(22, range=0..100)
divide_elipse = Slider(6, range=0..25)
pt = ConstructPoint(XCoordinate=0, YCoordinate=0, ZCoordinate=Slider(17, range=0..100))
radius_x = Slider(106, range=0..200)
beam_x = Slider(145, range=0..200)
radius_z = Slider(107, range=0..200)
rotation_elipse = Slider(0, range=0..180)
beam_y = Slider(10, range=0..100)
beam_z = Slider(4, range=0..1000)
beam_rotation = Slider(4, range=0..100)
beam_shift_0 = Slider(90, range=0..100)
beam_shift_1 = Slider(59, range=0..100)
neg = Negative(Value=radius_x)
neg_2 = Negative(Value=rotation_elipse)
neg_3 = Negative(Value=offset_elipse)

# ----
of_elipses = Slider(5, range=0..10)
rad = Radians(Degrees=beam_shift_0)
rad_2 = Radians(Degrees=beam_shift_1)

# ---- group: elipse
xz = XZPlane(Origin=pt)
X = UnitX(Factor=[radius_x, neg])
move = Move(Geometry=pt, Motion=X)  # -> Geometry, Transform
xy = XYPlane(Origin=pt)
yz = YZPlane(Origin=pt)
ellipse = Ellipse(Plane=xz, Radius1=radius_x, Radius2=radius_z)  # -> graft(Ellipse), Focus1, Focus2
item = ListItem(List=ellipse.Ellipse, Index=0, Wrap=True)

# ---- group: rotation/offset
dom = ConstructDomain(DomainStart=neg_2, DomainEnd=rotation_elipse)
range = Range(Domain=dom, Steps=of_elipses)  # -> flatten(Range)
rot3d = Rotate3D(Geometry=item, Angle=degrees(range), Center=Point(0, 0, 0), Axis=yz)  # -> flatten(Geometry), Transform
shift = ShiftList(List=rot3d.Geometry, Shift=9, Wrap=True)
dom_2 = ConstructDomain(DomainStart=offset_elipse, DomainEnd=neg_3)
range_2 = Range(Domain=dom_2, Steps=of_elipses)  # -> flatten(Range)
Y = UnitY(Factor=range_2)
move_2 = Move(Geometry=rot3d.Geometry, Motion=Y)  # -> flatten(Geometry), Transform

# ---- group: points on curve
len = Length(Curve=ellipse.Ellipse)
panel = Panel("""0
1""")
panel_2 = Panel("""1
0""")
cull = CullPattern(List=move_2.Geometry, CullPattern=panel)  # -> flatten(List)
shatter = Shatter(Curve=cull, Parameters=rad)
cull_2 = CullPattern(List=move_2.Geometry, CullPattern=panel_2)  # -> flatten(List)
division = Division(A=len, B=divide_elipse)
divlength = DivideLength(Curve=shatter, Length=division)  # -> Points, Tangents, Parameters
pull = PullPoint(Point=divlength.Points, Geometry=cull, Closest=True)  # -> simplify(ClosestPoint), Distance

# ----
shatter_2 = Shatter(Curve=cull_2, Parameters=rad_2)
divlength_2 = DivideLength(Curve=shatter_2, Length=division)  # -> Points, Tangents, Parameters
pull_2 = PullPoint(Point=divlength_2.Points, Geometry=cull, Closest=True)  # -> simplify(ClosestPoint), Distance

# ---- group: planes
pl = ConstructPlane(Origin=divlength_2.Points, XAxis=divlength_2.Tangents, YAxis=Vector(0, 1, 0))  # -> simplify(Plane)
pl_2 = ConstructPlane(Origin=divlength.Points, XAxis=divlength.Tangents, YAxis=Vector(0, 1, 0))  # -> simplify(Plane)
python = GhPythonScript(
    normal_list=pl,
    shifted_list=pl_2,
    dx=beam_x,
    dy=beam_y,
    dz=beam_z,
    beam_r=beam_rotation,
    div_param=Slider(0.84, range=0..1))  # -> out, n_list, s_list, temp_geom, temp_beam, closest_list; inputs normal_list: tree of Plane, shifted_list: tree of Plane, final_pt_list: list of Point3d
# ---------- python: Python ----------
import rhinoscriptsyntax as rs
import Rhino.Geometry as rg
import math
import clr
clr.AddReference("Grasshopper")
import Grasshopper.Kernel.Data.GH_Path as ghpath
import Grasshopper.DataTree as datatree
import geometry.beam as beam
import System

temp_geom = []

curve_list_n = []

for plane_list in normal_list.Branches:
    temp_list = []
    for i in plane_list:
        if i.Origin.Z > 0:
            rg.Plane.Rotate(i, (90*math.pi/180), i.XAxis, i.Origin)
            rg.Plane.Rotate(i, (beam_r*math.pi/180), i.YAxis, i.Origin)
            temp_instance = beam.Beam(i, dx, dy, dz)
            temp_beam = temp_instance.brep_representation()
            temp_vertices = []
            temp_vertices = rg.Brep.Vertices.GetValue(temp_beam)
            boolean = True
            for v in temp_vertices:
                if v.Location.Z < 0:
                    boolean = False
            if boolean:
                #temp_geom.append(temp_beam)
                temp_line = temp_instance.get_baseline()
                temp_curve = temp_line.ToNurbsCurve()
                #temp_geom.append(temp_curve)
                temp_list.append(temp_curve)
    curve_list_n.append(temp_list)

curve_list_s = []

for plane_list in shifted_list.Branches:
    temp_list = []
    for i in plane_list:
        if i.Origin.Z > 0:
            rg.Plane.Rotate(i, (90*math.pi/180), i.XAxis, i.Origin)
            rg.Plane.Rotate(i, (beam_r*math.pi/180), i.YAxis, i.Origin)
            temp_instance = beam.Beam(i, dx, dy, dz)
            temp_beam = temp_instance.brep_representation()
            temp_vertices = []
            temp_vertices = rg.Brep.Vertices.GetValue(temp_beam)
            boolean = True
            for v in temp_vertices:
                if v.Location.Z < 0:
                    boolean = False
            if boolean:
                #temp_geom.append(temp_beam)
                temp_line = temp_instance.get_baseline()
                temp_curve = temp_line.ToNurbsCurve()
                #temp_geom.append(temp_curve)
                temp_list.append(temp_curve)
    curve_list_s.append(temp_list)

temp_geom.append(curve_list_s[1][2])
temp_geom.append(curve_list_s[0][0])
#bool, closest_pt0, closest_pt1 = rg.NurbsCurve.ClosestPoints(curve_list_n[1][0], curve_list_s[0][2])
#temp_geom.append(closest_pt0)
#temp_geom.append(closest_pt1)

#print len(curve_list_s[0])
#
for i, curve in enumerate(curve_list_s):
    for j, line in enumerate(curve):
        bool, closest_pt6, closest_pt7 = rg.NurbsCurve.ClosestPoints(line, curve_list_n[i][j-2])
        temp_line3 = rg.Line(closest_pt6, closest_pt7)
        temp_geom.append(temp_line3)
        if (j+1) < len(curve):
            bool, closest_pt0, closest_pt1 = rg.NurbsCurve.ClosestPoints(line, curve[j-1])
            bool, closest_pt2, closest_pt3 = rg.NurbsCurve.ClosestPoints(line, curve_list_n[i][j-2])
            bool, closest_pt4, closest_pt5 = rg.NurbsCurve.ClosestPoints(curve_list_n[i][j], curve_list_n[i][j-1])
            temp_line0 = rg.Line(closest_pt0, closest_pt1)
            temp_geom.append(temp_line0)
            temp_line1 = rg.Line(closest_pt2, closest_pt3)
            temp_geom.append(temp_line1)
            temp_line2 = rg.Line(closest_pt4, closest_pt5)
            temp_geom.append(temp_line2)
            bool, closest_pt10, closest_pt11 = rg.NurbsCurve.ClosestPoints(line, curve_list_s[i-2][j-1])
            temp_line5 = rg.Line(closest_pt10, closest_pt11)
            temp_geom.append(temp_line5)
        if (i+1) < len(curve_list_n):
            bool, closest_pt8, closest_pt9 = rg.NurbsCurve.ClosestPoints(curve_list_s[i][j], curve_list_n[i+1][j-2])
            temp_line4 = rg.Line(closest_pt8, closest_pt9)
            temp_geom.append(temp_line4)
# ---------- end python ----------

# ----
cullpt = CullDuplicates(Points=python.closest_list, Tolerance=Slider(4.27, range=0..10), CullMode=3)  # -> flatten(Points), Indices, Valence
python_2 = GhPythonScript()  # -> Out, A
item_2 = ListItem(List=cullpt.Points, Index=Slider(100, range=0..100), Wrap=True)
panel_3 = Panel(cullpt.Points)
geo = Geometry(python.temp_geom)
