# Grasshopper definition DragonFromCurve_v3.gh (Grasshopper 1.0.4)
# plug-ins: Python Interpreter

crv = Curve(<curve referenced from the Rhino model>)
crv_2 = Curve(<curve referenced from the Rhino model>)
subtraction = Subtraction(A=Slider(2.6, range=0..10), B=1)
dividecurve = PythonScript(
    curve=crv,
    divisions=Slider(13, range=0..100),
    curvature_factor=Slider(0, range=0..100),
    curve_count=Slider(13, range=0..100),
    spacing=Slider(399.444, range=0..1000),
    curvature_change=Slider(1, range=-1..1))  # -> out, global_points; inputs curve: Curve, divisions: Int32, curve_count: Int32
# ---------- dividecurve: Python ----------
# snippet of code to make this python component look for it's code in the parent folder of the .gh file

import os

ghComp = ghenv.Component
ghDoc = ghComp.OnPingDocument()

file_name = "DivideCurve.py"
gh_file_location = ghDoc.FilePath
parent = os.path.dirname(os.path.realpath(gh_file_location))

file_path = os.path.join(parent, file_name)
print file_path

# hacky-hacky run-fun
execfile(file_path)
# ---------- end dividecurve ----------
number_slider = Slider(270.555, range=0..1000)
multiplication = Multiplication(A=subtraction, B=2)
crv_3 = Curve(<curve referenced from the Rhino model>)
number_slider_2 = Slider(39, range=6..100)
series = Series(Start=0, Step=0, Count=number_slider_2)
subtraction_2 = Subtraction(A=number_slider_2, B=1)
item = ListItem(List=crv_2, Index=series, Wrap=True)
subtraction_3 = Subtraction(A=Slider(2.6, range=0..10), B=1)
division = Division(A=multiplication, B=subtraction_2)
number_slider_3 = Slider(270.555, range=0..1000)
neg = Negative(Value=subtraction)
multiplication_2 = Multiplication(A=subtraction_3, B=2)
number_slider_4 = Slider(37, range=0..100)
series_2 = Series(Start=0, Step=0, Count=number_slider_4)
subtraction_4 = Subtraction(A=number_slider_4, B=1)
item_2 = ListItem(List=crv_3, Index=series_2, Wrap=True)
division_2 = Division(A=multiplication_2, B=subtraction_4)
series_3 = Series(Start=neg, Step=division, Count=number_slider_2)
neg_2 = Negative(Value=subtraction_3)
skipover = PythonScript(point_list=dividecurve.global_points, how_many=Slider(3, range=0..5), side_step=Slider(2, range=0..5))  # -> out, lines; inputs point_list: list, how_many: Int32, side_step: Int32
# ---------- skipover: Python ----------
# snippet of code to make this python component look for it's code in the parent folder of the .gh file

import os

ghComp = ghenv.Component
ghDoc = ghComp.OnPingDocument()

file_name = "SkipOver.py"
gh_file_location = ghDoc.FilePath
parent = os.path.dirname(os.path.realpath(gh_file_location))

file_path = os.path.join(parent, file_name)
print file_path

# hacky-hacky run-fun
execfile(file_path)
# ---------- end skipover ----------
abs = Absolute(Value=series_3)
series_4 = Series(Start=0, Step=number_slider, Count=number_slider_2)
series_5 = Series(Start=neg_2, Step=division_2, Count=number_slider_4)
addition = Addition(A=abs, B=1)
scale_nu = ScaleNU(Geometry=item, Plane=PlaneXY(0, 0, 0), ScaleX=addition, ScaleY=1, ScaleZ=Slider(1.2, range=0..10))  # -> Geometry, Transform
Y = UnitY(Factor=series_4)
abs_2 = Absolute(Value=series_5)
series_6 = Series(Start=0, Step=number_slider_3, Count=number_slider_4)
line = Line(skipover.lines)
move = Move(Geometry=scale_nu.Geometry, Motion=Y)  # -> Geometry, Transform
dragoncurvesimple = PythonScript(
    curves=move.Geometry,
    divisions=Slider(33, range=0..100),
    curvature_factor=Slider(1500.702, range=0..100000),
    curve_count=number_slider_2,
    spacing=number_slider,
    curvature_change=Slider(0.853, range=-1..1),
    divider_bool=Toggle(True))  # -> out, global_points, global_points_flatten, global_line_list, raw_line_list, dir2_raw_line_list; inputs curves: list of Curve, divisions: Int32, curve_count: Int32, divider_bool: Boolean
# ---------- dragoncurvesimple: Python ----------
# snippet of code to make this python component look for it's code in the parent folder of the .gh file

import os

ghComp = ghenv.Component
ghDoc = ghComp.OnPingDocument()

file_name = "DragonCurveAlternative.py"
gh_file_location = ghDoc.FilePath
parent = os.path.dirname(os.path.realpath(gh_file_location))

file_path = os.path.join(parent, file_name)
print file_path

# hacky-hacky run-fun
execfile(file_path)
# ---------- end dragoncurvesimple ----------
dragoncurvesimple_2 = PythonScript(
    curves=move.Geometry,
    divisions=Slider(33, range=0..100),
    curvature_factor=Slider(100, range=0..100),
    curve_count=Slider(30, range=6..100),
    spacing=Slider(270.555, range=0..1000),
    curvature_change=Slider(0.853, range=-1..1),
    complex_divide=Toggle(False))  # -> out, global_points, global_points_flatten, raw_points, raw_line_list, dir2_raw_line_list, bound_crvs, raw_points_curvature, proj_crv; inputs curves: list of Curve, divisions: Int32, curve_count: Int32, complex_divide: Boolean
# ---------- dragoncurvesimple_2: Python ----------
# snippet of code to make this python component look for it's code in the parent folder of the .gh file

import os

ghComp = ghenv.Component
ghDoc = ghComp.OnPingDocument()

file_name = "DragonCurve_v2.py"
gh_file_location = ghDoc.FilePath
parent = os.path.dirname(os.path.realpath(gh_file_location))

file_path = os.path.join(parent, file_name)
print file_path

# hacky-hacky run-fun
execfile(file_path)
# ---------- end dragoncurvesimple_2 ----------
dragoncurveclass = PythonScript(
    curves=move.Geometry,
    divisions=Slider(35, range=0..100),
    curvature_factor=Slider(0.1, range=0..5000),
    curve_count=Slider(30, range=6..100),
    spacing=Slider(270.555, range=0..1000),
    curvature_change=Slider(0.853, range=-1..1),
    complex_divide=Toggle(False))  # -> out, global_points, global_points_flatten, raw_divisions_pts, raw_line_list, dir2_raw_line_list, raw_bound_curves, divisions, DragonCurve_s; inputs curves: list of Curve, divisions: Int32, curve_count: Int32, complex_divide: Boolean
# ---------- dragoncurveclass: Python ----------
# snippet of code to make this python component look for it's code in the parent folder of the .gh file

import os

ghComp = ghenv.Component
ghDoc = ghComp.OnPingDocument()

file_name = "DragonCurve_v3_class.py"
gh_file_location = ghDoc.FilePath
parent = os.path.dirname(os.path.realpath(gh_file_location))

file_path = os.path.join(parent, file_name)
print file_path

# hacky-hacky run-fun
execfile(file_path)
# ---------- end dragoncurveclass ----------
addition_2 = Addition(A=abs_2, B=1)
scale_nu_2 = ScaleNU(Geometry=item_2, Plane=PlaneXY(0, 0, 0), ScaleX=addition_2, ScaleY=1, ScaleZ=Slider(1.2, range=0..10))  # -> Geometry, Transform
panel = Panel(skipover.out)
Y_2 = UnitY(Factor=series_6)
crv_4 = Curve(dragoncurvesimple_2.proj_crv)
move_2 = Move(Geometry=scale_nu_2.Geometry, Motion=Y_2)  # -> Geometry, Transform
dividecurvesimple = PythonScript(
    curves=move_2.Geometry,
    divisions=Slider(25, range=0..100),
    curvature_factor=Slider(6.979, range=0..100),
    curve_count=number_slider_4,
    spacing=number_slider_3,
    curvature_change=Slider(0.853, range=-1..1))  # -> out, global_points, global_line_list, raw_line_list; inputs curves: list of Curve, divisions: Int32, curve_count: Int32
# ---------- dividecurvesimple: Python ----------
# snippet of code to make this python component look for it's code in the parent folder of the .gh file

import os

ghComp = ghenv.Component
ghDoc = ghComp.OnPingDocument()

file_name = "DivideCurveSimple.py"
gh_file_location = ghDoc.FilePath
parent = os.path.dirname(os.path.realpath(gh_file_location))

file_path = os.path.join(parent, file_name)
print file_path

# hacky-hacky run-fun
execfile(file_path)
# ---------- end dividecurvesimple ----------
beamclass = PythonScript()  # -> out, a
# ---------- beamclass: Python ----------
# snippet of code to make this python component look for it's code in the parent folder of the .gh file

import os

ghComp = ghenv.Component
ghDoc = ghComp.OnPingDocument()

file_name = "BeamClass.py"
gh_file_location = ghDoc.FilePath
parent = os.path.dirname(os.path.realpath(gh_file_location))

file_path = os.path.join(parent, file_name)
print file_path

# hacky-hacky run-fun
execfile(file_path)
# ---------- end beamclass ----------
dragoncurvedivider = PythonScript(DragonCurve_s=dragoncurveclass.DragonCurve_s, divisions=dragoncurveclass.divisions)  # -> out, global_points, global_points_flatten, raw_divisions_pts, raw_line_list, dir2_raw_line_list, raw_bound_curves, divisions, DragonCurve_s; inputs DragonCurve_s: list, divisions: Int32
# ---------- dragoncurvedivider: Python ----------
# snippet of code to make this python component look for it's code in the parent folder of the .gh file

import os

ghComp = ghenv.Component
ghDoc = ghComp.OnPingDocument()

file_name = "DragonCurve_Divider.py"
gh_file_location = ghDoc.FilePath
parent = os.path.dirname(os.path.realpath(gh_file_location))

file_path = os.path.join(parent, file_name)
print file_path

# hacky-hacky run-fun
execfile(file_path)
# ---------- end dragoncurvedivider ----------
pt = Point(dragoncurvesimple.global_points_flatten)
line_2 = Line(dragoncurvesimple.raw_line_list)
line_3 = Line(dragoncurvesimple.dir2_raw_line_list)
skipover_2 = PythonScript(point_list=dividecurvesimple.global_points, how_many=Slider(3, range=0..5), side_step=Slider(2, range=0..5))  # -> out, lines; inputs point_list: list, how_many: Int32, side_step: Int32; same code as skipover
pt_2 = Point(dragoncurvesimple_2.raw_points)
pt_3 = Point(dragoncurvesimple_2.raw_points_curvature)
panel_2 = Panel(dividecurvesimple.out)
line_4 = Line(dragoncurvesimple_2.raw_line_list)
line_5 = Line(dragoncurvesimple_2.dir2_raw_line_list)
crv_5 = Curve(dragoncurvesimple_2.bound_crvs)
pt_4 = Point(dragoncurveclass.raw_divisions_pts)
crv_6 = Curve(dragoncurveclass.raw_bound_curves)
line_6 = Line(skipover_2.lines)
panel_3 = Panel(dragoncurveclass.out)
