# Grasshopper definition Joint_Test_Implementation.gh (Grasshopper 0.9.80)
# plug-ins: Python Interpreter

srf = Surface(<surface referenced from the Rhino model>)
srf_2 = Surface(<surface referenced from the Rhino model>)
python = PythonScript(surface=srf, u_div=Slider(74, range=0..100), v_div=Slider(7, range=0..20))  # -> out, line_visualisation, beam_visualisation, hole_visualisation; inputs surface: Surface, u_div: Int32, v_div: Int32
# ---------- python: Python ----------
# snippet of code to make this python component look for it's code in the parent folder of the .gh file

import os

ghComp = ghenv.Component
ghDoc = ghComp.OnPingDocument()

file_name = "simple_surface_divider.py"
gh_file_location = ghDoc.FilePath
parent = os.path.dirname(os.path.realpath(gh_file_location))

file_path = os.path.join(parent, file_name)
# print file_path

single_parent = os.path.dirname(os.path.realpath(parent))
double_parent = os.path.dirname(os.path.realpath(single_parent))
# print parent

# hacky-hacky run-fun
execfile(file_path)
# ---------- end python ----------
python_2 = PythonScript(surface=srf_2, u_div=Slider(74, range=0..100), v_div=Slider(7, range=0..20))  # -> out, line_visualisation, beam_visualisation, hole_visualisation; inputs surface: Surface, u_div: Int32, v_div: Int32; same code as python
dividecurve = PythonScript()  # -> out, global_points, line_1, line_2, beam_breps, spheres_angles, recs, pyramid_list, intersection
# ---------- dividecurve: Python ----------
# snippet of code to make this python component look for it's code in the parent folder of the .gh file

import os

ghComp = ghenv.Component
ghDoc = ghComp.OnPingDocument()

file_name = "posSpace.py"
gh_file_location = ghDoc.FilePath
parent = os.path.dirname(os.path.realpath(gh_file_location))

file_path = os.path.join(parent, file_name)
print file_path

parent = os.path.dirname(os.path.realpath(parent))
parent = os.path.dirname(os.path.realpath(parent))
print parent

# hacky-hacky run-fun
execfile(file_path)
# ---------- end dividecurve ----------
pt = Point(python.hole_visualisation)
pt_2 = Point(python_2.hole_visualisation)
panel = Panel(python.out)
brep = Brep(dividecurve.pyramid_list)
brep_2 = Brep(dividecurve.beam_breps)
brep_3 = Brep(dividecurve.spheres_angles)
brep_4 = Brep(dividecurve.intersection)
crv = Curve([dividecurve.line_1, dividecurve.line_2])
crv_2 = Curve(dividecurve.recs)
panel_2 = Panel(dividecurve.out)
