# Grasshopper definition Ice_ray_ruled.gh (Grasshopper 1.0.4)

crv = Curve([<curve referenced from the Rhino model> x105])
number_slider = Slider(10, range=0..30)
pt = Point(Point(1.601056283e-07, 23.57001996, 0))
pt_2 = Point(Point(66.09158527, 1.45519e-11, 0))
lng = ListLength(List=crv)
pdecon = Deconstruct(Point=pt)  # -> XComponent, YComponent, ZComponent
Z = UnitZ(Factor=number_slider)
series = Series(Start=0, Step=1, Count=lng)
pdecon_2 = Deconstruct(Point=pt_2)  # -> XComponent, YComponent, ZComponent
move = Move(Geometry=pt, Motion=Z)  # -> Geometry, Transform
pt_3 = ConstructPoint(XCoordinate=pdecon.XComponent, YCoordinate=pdecon_2.YComponent, ZCoordinate=0)
move_2 = Move(Geometry=pt_2, Motion=Z)  # -> Geometry, Transform
pt_4 = ConstructPoint(XCoordinate=pdecon_2.XComponent, YCoordinate=pdecon.YComponent, ZCoordinate=0)
ln = Line(StartPoint=move_2.Geometry, EndPoint=pt_4)
ln_2 = Line(StartPoint=pt_3, EndPoint=move.Geometry)
merge = Merge(Data1=ln, Data2=ln_2)
num = Number(series)
graft = GraftTree(Tree=series, IncludeEmptyLists=True, IncludeNullItems=True)
loft = Loft(Curves=merge, Options={Adjust=False, Closed=False, LoftEnds=0, LoftSimp=0, LoftType=0, Rebuild=10, Refit=0.01})
projecting = Projecting(S=loft, A=number_slider, C=crv)
line = Line(flatten(projecting))
graft_2 = GraftTree(Tree=line, IncludeEmptyLists=True, IncludeNullItems=True)
end = EndPoints(Curve=graft_2)  # -> Start, End
end_2 = EndPoints(Curve=line)  # -> Start, End
equals = Equality(FirstNumber=end_2.Start, SecondNumber=end.Start)  # -> Equality, Inequality
equals_2 = Equality(FirstNumber=end_2.Start, SecondNumber=end.End)  # -> Equality, Inequality
equals_3 = Equality(FirstNumber=end_2.End, SecondNumber=end.Start)  # -> Equality, Inequality
equals_4 = Equality(FirstNumber=end_2.End, SecondNumber=end.End)  # -> Equality, Inequality
sift = SiftPattern(List=num, SiftPattern=equals.Equality)  # -> Output0, Output1
sift_2 = SiftPattern(List=graft, SiftPattern=equals_2.Equality)  # -> Output0, Output1
sift_3 = SiftPattern(List=graft, SiftPattern=equals_3.Equality)  # -> Output0, Output1
sift_4 = SiftPattern(List=graft, SiftPattern=equals_4.Equality)  # -> Output0, Output1
merge_2 = Merge(Data1=sift.Output1, Data2=sift_2.Output1, Data3=sift_3.Output1, Data4=sift_4.Output1)
panel = Panel(merge_2)

# ==== cluster Projecting
C = ClusterInput()
A = ClusterInput()
end = EndPoints(Curve=C)  # -> Start, End
multiplication = Multiplication(A=A, B=2)
Z = UnitZ(Factor=multiplication)
S = ClusterInput()
move = Move(Geometry=end.Start, Motion=Z)  # -> Geometry, Transform
move_2 = Move(Geometry=end.End, Motion=Z)  # -> Geometry, Transform
ln = Line(StartPoint=end.End, EndPoint=move_2.Geometry)
ln_2 = Line(StartPoint=end.Start, EndPoint=move.Geometry)
scx = SurfaceCurve(Surface=S, Curve=ln_2)  # -> Curves, Points, UVPoints, Normals, Parameters, Tangents
scx_2 = SurfaceCurve(Surface=S, Curve=ln)  # -> Curves, Points, UVPoints, Normals, Parameters, Tangents
ln_3 = Line(StartPoint=scx.Points, EndPoint=scx_2.Points)
L = ClusterOutput(ln_3)
