# Grasshopper definition LSystem.gh (Grasshopper 1.0.4)
# plug-ins: Python Interpreter

l_system = PythonScript(iteration_count=Slider(10, range=0..25))  # -> out, global_points, global_points_flatten, raw_divisions_pts, raw_line_list, dir2_raw_line_list, raw_bound_curves, divisions, brep, raw_brep; inputs curves: list of Curve, divisions: Int32, curve_count: Int32, complex_divide: Boolean, iteration_count: Int32
# ---------- l_system: Python ----------
# snippet of code to make this python component look for it's code in the parent folder of the .gh file

import os

ghComp = ghenv.Component
ghDoc = ghComp.OnPingDocument()

file_name = "L_system.py"
gh_file_location = ghDoc.FilePath
parent = os.path.dirname(os.path.realpath(gh_file_location))

file_path = os.path.join(parent, file_name)
print file_path

# hacky-hacky run-fun
execfile(file_path)
# ---------- end l_system ----------
panel = Panel(l_system.out)
brep = Brep(l_system.brep)
