# Grasshopper definition possibilitySpace_dev.gh (Grasshopper 0.9.80)
# plug-ins: Python Interpreter

merge = Merge(
    Data1=Slider(40, range=0..250),
    Data2=Slider(40, range=0..250),
    Data3=Slider(40, range=0..250),
    Data4=Slider(40, range=0..250),
    Data5=Slider(40, range=0..250))
dividecurve = PythonScript(variables=merge, angle=Slider(78, range=0..250), constraint_angle=Slider(78, range=0..250))  # -> out, global_points, line_1, line_2, beam_breps, spheres_angles, recs, a; inputs variables: list
# ---------- dividecurve: Python ----------
# snippet of code to make this python component look for it's code in the parent folder of the .gh file

import os

ghComp = ghenv.Component
ghDoc = ghComp.OnPingDocument()

file_name = "posSpace.py"
gh_file_location = ghDoc.FilePath
parent = os.path.dirname(os.path.realpath(gh_file_location))

file_path = os.path.join(parent, file_name)
print file_path

parent = os.path.dirname(os.path.realpath(parent))
parent = os.path.dirname(os.path.realpath(parent))
print parent

# hacky-hacky run-fun
execfile(file_path)
# ---------- end dividecurve ----------
brep = Brep(dividecurve.beam_breps)
brep_2 = Brep(dividecurve.spheres_angles)
crv = Curve([dividecurve.line_1, dividecurve.line_2])
crv_2 = Curve(dividecurve.recs)
panel = Panel(dividecurve.out)
