# Grasshopper definition Reciprocal.gh (Grasshopper 1.0.4)
# plug-ins: Python Interpreter

pt = Point([Point(237.1385873, 0, 5655.458396), Point(-1723.339544, 0, 7228.034437), Point(1222.619573, 0, 7311.905159)])
crv = Curve([<curve referenced from the Rhino model> x3])
reciprocal = PythonScript(curves=crv, spacing=Slider(139, range=0..1000))  # -> out, points, global_points, global_line_list, points_raw, dir2_raw_line_list; inputs curves: list of Curve
# ---------- reciprocal: Python ----------
# snippet of code to make this python component look for it's code in the parent folder of the .gh file

import os

ghComp = ghenv.Component
ghDoc = ghComp.OnPingDocument()

file_name = "CurveDivision.py"
gh_file_location = ghDoc.FilePath
parent = os.path.dirname(os.path.realpath(gh_file_location))

file_path = os.path.join(parent, file_name)
print file_path

# hacky-hacky run-fun
execfile(file_path)
# ---------- end reciprocal ----------
reciprocal_2 = PythonScript(points=reciprocal.global_points, goal_length=Slider(2000, range=0..2000), rotation_angle=Slider(114.5274, range=0..1000))  # -> out, base_planes, lengths, scaled_lines, raw_line_list, boxes; inputs goal_length: Int32, curve_count: Int32, divider_bool: Boolean
# ---------- reciprocal_2: Python ----------
# snippet of code to make this python component look for it's code in the parent folder of the .gh file

import os

ghComp = ghenv.Component
ghDoc = ghComp.OnPingDocument()

file_name = "Reciprocal.py"
gh_file_location = ghDoc.FilePath
parent = os.path.dirname(os.path.realpath(gh_file_location))

file_path = os.path.join(parent, file_name)
print file_path

# hacky-hacky run-fun
execfile(file_path)
# ---------- end reciprocal_2 ----------
pt_2 = Point(reciprocal.points_raw)
brep = Brep(reciprocal_2.boxes)
panel = Panel(reciprocal.out)
