# Grasshopper definition geometry_test_file.gh (Grasshopper 0.9.80)
# plug-ins: Python Interpreter

srf = Surface([<surface referenced from the Rhino model> x4])
srf_2 = Surface([<surface referenced from the Rhino model> x4])
srf_3 = Surface([<surface referenced from the Rhino model> x3])
srf_4 = Surface(<surface referenced from the Rhino model>)
srf_5 = Surface(<surface referenced from the Rhino model>)
srf_6 = Surface(<surface referenced from the Rhino model>)
srf_7 = Surface(<surface referenced from the Rhino model>)
srf_8 = Surface(<surface referenced from the Rhino model>)
surface_keystoning = PythonScript(srf_1=srf_6, srf_2=srf_7, srf_3=srf_8, srf_4=srf_5, srf_set=srf)  # -> out, isocurve_visualisation, blend_crvs_vis, crv_vis, new_surfaces, visualize_uv_switched_crvs; inputs srf_1: Surface, srf_2: Surface, srf_3: Surface, srf_4: Surface, srf_set: list of Surface
# ---------- surface_keystoning: Python ----------
# snippet of code to make this python component look for it's code in the parent folder of the .gh file

import os

ghComp = ghenv.Component
ghDoc = ghComp.OnPingDocument()

file_name = "surface_keystone.py"
gh_file_location = ghDoc.FilePath
parent = os.path.dirname(os.path.realpath(gh_file_location))

file_path = os.path.join(parent, file_name)
# print file_path

single_parent = os.path.dirname(os.path.realpath(parent))
double_parent = os.path.dirname(os.path.realpath(single_parent))
# print parent

# hacky-hacky run-fun
execfile(file_path)
# ---------- end surface_keystoning ----------
merge = Merge(Data1=srf_6, Data2=srf_7, Data3=srf_8, Data4=srf_5, Data5=srf_4)
surface_keystoning_2 = PythonScript(srf_1=srf_6, srf_2=srf_7, srf_3=srf_8, srf_4=srf_5, srf_set=srf_2)  # -> out, isocurve_visualisation, blend_crvs_vis, crv_vis, new_surfaces, visualize_uv_switched_crvs; inputs srf_1: Surface, srf_2: Surface, srf_3: Surface, srf_4: Surface, srf_set: list of Surface; same code as surface_keystoning
merge_2 = Merge()
crv = Curve(surface_keystoning.crv_vis)
crv_2 = Curve(surface_keystoning.visualize_uv_switched_crvs)
srf_9 = Surface(surface_keystoning_2.new_surfaces)
srf_10 = Surface(surface_keystoning.new_surfaces)
panel = Panel(surface_keystoning.out)
srf_11 = Surface(srf_10)
surface_trimming = PythonScript(srf=srf_11, value=Slider(20, range=0..100), v_div=Slider(7, range=0..20))  # -> out, isocurves, temp_surface, hole_visualisation; inputs srf: Surface, value: Int32, v_div: Int32
# ---------- surface_trimming: Python ----------
# snippet of code to make this python component look for it's code in the parent folder of the .gh file

import os

ghComp = ghenv.Component
ghDoc = ghComp.OnPingDocument()

file_name = "surface_offset.py"
gh_file_location = ghDoc.FilePath
parent = os.path.dirname(os.path.realpath(gh_file_location))

file_path = os.path.join(parent, file_name)
# print file_path

single_parent = os.path.dirname(os.path.realpath(parent))
double_parent = os.path.dirname(os.path.realpath(single_parent))
# print parent

# hacky-hacky run-fun
execfile(file_path)
# ---------- end surface_trimming ----------
