# Grasshopper definition geometry_test_file_3.gh (Grasshopper 0.9.80)
# plug-ins: Python Interpreter

srf = Surface(<surface referenced from the Rhino model>)
srf_2 = Surface([<surface referenced from the Rhino model> x6])
srf_3 = Surface(<surface referenced from the Rhino model>)
srf_4 = Surface([<surface referenced from the Rhino model> x3])
srf_5 = Surface([<surface referenced from the Rhino model> x3])
number_slider = Slider(1, range=0..15)
number_slider_2 = Slider(2000, range=0..2000)
sdivide = DivideSurface(Surface=srf, UCount=10, VCount=10)  # -> Points, Normals, Parameters
number_slider_3 = Slider(10, range=0..15)
srf_6 = Surface([<surface referenced from the Rhino model> x3])
srf_7 = Surface([<surface referenced from the Rhino model> x3])
rev = ReverseList(List=srf_4)
rev_2 = ReverseList(List=srf_5)
srf_8 = Surface([<surface referenced from the Rhino model> x3])
srf_9 = Surface([<surface referenced from the Rhino model> x3])
swatch = ColourSwatch(SwatchColor=RGB(255, 255, 161))
srf_10 = Surface([<surface referenced from the Rhino model> x3])
srf_11 = Surface(<surface referenced from the Rhino model>)
srf_12 = Surface(<surface referenced from the Rhino model>)
srf_13 = Surface(<surface referenced from the Rhino model>)
srf_14 = Surface(<surface referenced from the Rhino model>)
srf_15 = Surface(<surface referenced from the Rhino model>)
srf_16 = Surface([<surface referenced from the Rhino model> x3])
preview = CustomPreview(Shader={ambient=RGB(0, 0, 0), diffuse=RGB(255, 105, 180), emission=RGB(76, 32, 54), shine=0.5, specular=RGB(255, 255, 255), transparency=0})
srf_cp = SurfaceClosestPoint(Point=sdivide.Points, Surface=srf_3)  # -> Point, UVPoint, Distance
number_slider_4 = Slider(0, range=0..10)
surface_keystoning = PythonScript(
    srf_set_1=rev,
    srf_set_2=rev_2,
    srf_set=srf_6,
    blend_precision=number_slider,
    v_div=number_slider_3,
    dir=Toggle(True),
    srf_set_or_sets=Toggle(True))  # -> out, isocurve_visualisation, blend_crvs_vis, crv_vis, new_srf_set_keystone, split_crvs, uv_switched_crvs, uv_switched_pts; inputs srf_set_1: list of Surface, srf_set_2: list of Surface, srf_3: Surface, srf_4: Surface, srf_set: list of Surface, blend_precision: Int32, dir: Int32
# ---------- surface_keystoning: Python ----------
# snippet of code to make this python component look for it's code in the parent folder of the .gh file

import os

ghComp = ghenv.Component
ghDoc = ghComp.OnPingDocument()

file_name = "surface_keystone.py"
gh_file_location = ghDoc.FilePath
parent = os.path.dirname(os.path.realpath(gh_file_location))

file_path = os.path.join(parent, file_name)
# print file_path

single_parent = os.path.dirname(os.path.realpath(parent))
double_parent = os.path.dirname(os.path.realpath(single_parent))
# print parent

# hacky-hacky run-fun
execfile(file_path)
# ---------- end surface_keystoning ----------
merge = Merge()
planesrf = PlaneSurface(Plane=PlaneXY(0, 0, 0), XSize=number_slider_2, YSize=number_slider_2)
srf_17 = Surface([<surface referenced from the Rhino model> x4])
srf_18 = Surface([<surface referenced from the Rhino model> x4])
rev_3 = ReverseList(List=srf_18)
merge_2 = Merge(Data1=srf_13, Data2=srf_14, Data3=srf_15, Data4=srf_12, Data5=srf_11)
ln = Line(StartPoint=sdivide.Points, EndPoint=srf_cp.Point)
panel = Panel(srf_cp.UVPoint)
surface_keystoning_2 = PythonScript(srf_set=rev_3, blend_precision=number_slider, v_div=number_slider_3, dir=Toggle(True))  # -> out, isocurve_visualisation, blend_crvs_vis, crv_vis, keystone_srfs, split_crvs, uv_switched_crvs, uv_switched_pts; inputs srf_1: Surface, srf_2: Surface, srf_3: Surface, srf_4: Surface, srf_set: list of Surface, blend_precision: Int32, dir: Int32; same code as surface_keystoning
merge_3 = Merge()
series = Series(Start=0, Step=number_slider_2, Count=Slider(3, range=0..10))
series_2 = Series(Start=0, Step=number_slider_2, Count=Slider(4, range=0..10))
pt = Point(surface_keystoning.uv_switched_pts)
crv = Curve(surface_keystoning.uv_switched_crvs)
number_slider_5 = Slider(5, range=0..10)
X = UnitX(Factor=series)
srf_19 = Surface(srf_10)
Y = UnitY(Factor=series_2)  # -> graft(UnitVector)
srf_20 = Surface(surface_keystoning.new_srf_set_keystone)
surface_keystoning_3 = PythonScript(
    srf_1=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,
    srf_2=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,
    srf_3=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,
    srf_4=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,
    srf_set=srf_19)  # -> out, isocurve_visualisation, blend_crvs_vis, crv_vis, new_surfaces, visualize_uv_switched_crvs; inputs srf_1: Surface, srf_2: Surface, srf_3: Surface, srf_4: Surface, srf_set: list of Surface; same code as surface_keystoning
crv_2 = Curve(surface_keystoning.blend_crvs_vis)
srf_21 = Surface(flatten(surface_keystoning.new_srf_set_keystone))
rev_4 = ReverseList(List=surface_keystoning_2.keystone_srfs)  # -> flatten(List)
panel_2 = Panel(rev_4)
move = Move(Geometry=planesrf, Motion=X)  # -> Geometry, Transform
panel_3 = Panel(surface_keystoning.out)
move_2 = Move(Geometry=move.Geometry, Motion=Y)  # -> flatten(Geometry), Transform
item = ListItem(List=rev_4, Index=number_slider_5, Wrap=True)
item_2 = ListItem(List=srf_21, Index=number_slider_5, Wrap=True)
item_3 = ListItem(List=srf_18, Index=number_slider_5, Wrap=True)
item_4 = ListItem(List=srf_17, Index=number_slider_5, Wrap=True)
srf_22 = Surface([<surface referenced from the Rhino model> x4])
srf_23 = Surface(surface_keystoning_3.new_surfaces)
panel_4 = Panel(surface_keystoning_3.out)
srf_24 = Surface(srf_22)
number_slider_6 = Slider(20, range=0..100)
number_slider_7 = Slider(7, range=0..20)
v_div = Slider(6, range=0..100)
u_div = Slider(5, range=0..100)
merge_4 = Merge(Data1=graft(srf_17), Data2=graft(srf_18), Data3=graft(srf_21), Data4=graft(rev_4))
srf_25 = Surface(srf_6)
srf_26 = Surface()
python = GhPythonScript(surfaces=move_2.Geometry)  # -> out, organized_surfaces; inputs surfaces: list of Surface
# ---------- python: Python ----------
__author__ = "ytakzk"
__version__ = "2019.02.20"

import Rhino.Geometry as rg

organized_surfaces = []

for i, s in enumerate(surfaces):
    
    x = i % 5
    y = int(i / 4)
    
    domain = rg.Interval(0, 4)
    
    if (x + y) % 2 == 1:
        s = s.Reverse(1)
        s.SetDomain(1, domain)
        s = s.Reverse(0)
        s.SetDomain(0, domain)
        
    organized_surfaces.append(s)
# ---------- end python ----------
uvn = UVN(srf=merge_4)
surface_trimming = PythonScript(srf=srf_25, value=number_slider_6, v_div=number_slider_7)  # -> out, isocurves, temp_surface, hole_visualisation; inputs srf: Surface, value: Int32, v_div: Int32
# ---------- surface_trimming: Python ----------
# snippet of code to make this python component look for it's code in the parent folder of the .gh file

import os

ghComp = ghenv.Component
ghDoc = ghComp.OnPingDocument()

file_name = "surface_offset.py"
gh_file_location = ghDoc.FilePath
parent = os.path.dirname(os.path.realpath(gh_file_location))

file_path = os.path.join(parent, file_name)
# print file_path

single_parent = os.path.dirname(os.path.realpath(parent))
double_parent = os.path.dirname(os.path.realpath(single_parent))
# print parent

# hacky-hacky run-fun
execfile(file_path)
# ---------- end surface_trimming ----------
srf_27 = Surface(surface_trimming.temp_surface)
u_div_2 = Number(u_div)
v_div_2 = Number(v_div)
u_div_3 = Slider(6, range=0..100)
python_2 = GhPythonScript(surfaces=srf_2)  # -> out, label, label_pos, tmp, beams, dowels; inputs surfaces: list of Surface
# ---------- python_2: Python ----------
# snippet of code to make this python component look for it's code in the parent folder of the .gh file

import os

ghComp = ghenv.Component
ghDoc = ghComp.OnPingDocument()

file_name = "SurfaceNetwork.py"
gh_file_location = ghDoc.FilePath
parent = os.path.dirname(os.path.realpath(gh_file_location))

single_parent = os.path.dirname(os.path.realpath(parent))
double_parent = os.path.dirname(os.path.realpath(single_parent))

file_path = os.path.join(parent, file_name)
print file_path

# hacky-hacky run-fun
execfile(file_path)
# ---------- end python_2 ----------

# ---- group: old script
python_3 = GhPythonScript(surfaces=srf_24)  # -> out, tmp, pt, a; inputs surfaces: list of Surface; disabled
# ---------- python_3: Python ----------
__author__ = "ytakzk"
__version__ = "2019.02.18"

import rhinoscriptsyntax as rs
import Rhino.Geometry as rg
import copy

class Division(object):
    
    def __init__(self):
        
        self.is_overwritten_with = None
        self.id = id(self)
        self.num = 4

a = []
class Network(object):
    
    @staticmethod
    def get_relation(s1, s2):
        
        domain = rg.Interval(0, 1)
        s1.SetDomain(0, domain)
        s1.SetDomain(1, domain)
        s2.SetDomain(0, domain)
        s2.SetDomain(1, domain)
        
        p1_1 = s1.IsoCurve(0, 0).PointAt(0.5)
        p1_2 = s1.IsoCurve(0, 1).PointAt(0.5)
        p1_3 = s1.IsoCurve(1, 0).PointAt(0.5)
        p1_4 = s1.IsoCurve(1, 1).PointAt(0.5)

        p2_1 = s2.IsoCurve(0, 0).PointAt(0.5)
        p2_2 = s2.IsoCurve(0, 1).PointAt(0.5)
        p2_3 = s2.IsoCurve(1, 0).PointAt(0.5)
        p2_4 = s2.IsoCurve(1, 1).PointAt(0.5)
        
        DIST = 50
       
        if p1_1.DistanceTo(p2_1) < DIST or \
           p1_1.DistanceTo(p2_2) < DIST or \
           p1_2.DistanceTo(p2_1) < DIST or \
           p1_2.DistanceTo(p2_2) < DIST:
            
            # u & u =
            return 'u', 'u'

        if p1_3.DistanceTo(p2_3) < DIST or \
           p1_3.DistanceTo(p2_4) < DIST or \
           p1_4.DistanceTo(p2_3) < DIST or \
           p1_4.DistanceTo(p2_4) < DIST:
            
            # v & v ||
            return 'v', 'v'

        if p1_1.DistanceTo(p2_3) < DIST or \
           p1_2.DistanceTo(p2_4) < DIST or \
           p1_1.DistanceTo(p2_3) < DIST or \
           p1_2.DistanceTo(p2_4) < DIST:
            
            # u & v -|
            return 'u', 'v'

        if p1_3.DistanceTo(p2_1) < DIST or \
           p1_4.DistanceTo(p2_2) < DIST or \
           p1_3.DistanceTo(p2_1) < DIST or \
           p1_4.DistanceTo(p2_2) < DIST:
            
            # v & u |-
            return 'v', 'u'
            
        return None
        
    def __init__(self, surfaces):
        
        self.surfaces = [Surface(s) for s in surfaces]
        
        for _ in range(5):
            
            for i, s1 in enumerate(self.surfaces):
            
                for j, s2 in enumerate(self.surfaces):
                
                    if s1 == s2:
                        continue
                
                    rel = Network.get_relation(s1.surface, s2.surface)
                    if rel:
                    
                        v1 = rel[0]
                        v2 = rel[1]
                    
                        if v1 == 'u' and v2 == 'u':
                            
                            s2.u_div = s1.u_div
                            s1.u_neighbors.append(s2)
                            
                        elif v1 == 'u' and v2 == 'v':
                            
                            s2.u_div = s1.v_div
                            s1.u_neighbors.append(s2)
                            
                        elif v1 == 'v' and v2 == 'u':
                            
                            s2.v_div = s1.u_div
                            s1.v_neighbors.append(s2)
                            
                        elif v1 == 'v' and v2 == 'v':
                            
                            s2.v_div = s1.v_div
                            s1.v_neighbors.append(s2)
    
    def orient_direction(self):
        
        for s in self.surfaces:
            
            # TODO: u-v case
            
            flip_u = False
            for u in s.u_neighbors:
                
                if u.flip_u == True:
                    flip_u = False
                    break
                elif u.flip_u == False:
                    flip_u = True
                    break
                    
            flip_v = False
            for v in s.v_neighbors:
                
                if v.flip_v == True:
                    flip_v = False
                    break
                elif v.flip_v == False:
                    flip_v = True
                    break
                    
            if len(s.u_neighbors) == 1:
                s.flip_u = False
            else:
                s.flip_u = flip_u
                
            if len(s.v_neighbors) == 1:
                s.flip_v = False
            else:
                s.flip_v = flip_v
            
        for s in self.surfaces:
            
            if s.flip_u:
                
                s.surface = s.surface.Reverse(0)
            
            if s.flip_v:
                s.surface = s.surface.Reverse(1)

            domain = rg.Interval(0, 1)
            s.surface.SetDomain(0, domain)
            s.surface.SetDomain(1, domain)

    
class Surface(object):
    
    def __init__(self, surface):
        
        self.surface = surface 
        self.u_div = Division()
        self.v_div = Division()
        self.u_neighbors = []
        self.v_neighbors = []
        self.flip_u = None
        self.flip_v = None
    
    def divide(self):
        
        surface = self.surface #self.__offset_sides_surface(50)
        
        global a
        a.append(surface)
        for u in range(self.u_div.num + 1):
            
            for v in range(self.v_div.num):
                
                if (u % 2 == 0 and v % 2 == 1) or (u % 2 == 1 and v % 2 == 0):
                    continue
                
                # TODO
                if u == 0:
                    uu = 0.1
                elif u == self.u_div.num:
                    uu = u - 0.1 
                else:
                    uu = u
                
                p1 = surface.PointAt(uu/self.u_div.num, v/self.v_div.num)
                p2 = surface.PointAt(uu/self.u_div.num, (v+1)/self.v_div.num)
                
                line = rg.Line(p1, p2)
                a.append(line)
                
    def __offset_sides_surface(self, offset_dis=20):
        """ method that returns a slightly shrunk version of the surface along the v direction
            :param offset_dis:       Offset Distance (default 20)
            :return temp_srf:   The trimmed surface
        """
        sampling_count = 25
    
        temp_surface = copy.deepcopy(self.surface)
    
        temp_surface.SetDomain(1, rg.Interval(0, sampling_count - 1))
        temp_isocurves = [temp_surface.IsoCurve(0, v_val) for v_val in range(sampling_count)]
    
        temp_isocurves_shortened = []
    
        for isocurve in temp_isocurves:
            # getting the length and the domain of every isocurve
            length = isocurve.GetLength()
            start_t, end_t = isocurve.Domain[0], isocurve.Domain[1]
            t_delta = end_t - start_t
            t_differential = t_delta / length
            # calculating how much the offset_dis result in t_val change
            t_shift = t_differential * offset_dis
            start_t_new = start_t + t_shift
            end_t_new = end_t - t_shift
            # splitting the curve at those two new start & end points with and taking the middle piece
            new_isocurve = isocurve.Split([start_t_new, end_t_new])[1]
            temp_isocurves_shortened.append(new_isocurve)
    
        # switching the uv direction back to where it should be! -> rebuilding the surface
        point_list = [[] for i in range(sampling_count)]
        for temp_curve in temp_isocurves_shortened:
            length = temp_curve.GetLength()
            start_t, end_t = temp_curve.Domain[0], temp_curve.Domain[1]
            t_delta = end_t - start_t
            t_differential = t_delta / (sampling_count - 1)
            # calculating how much the offset_dis result in t_val change
            point_set = [temp_curve.PointAt(t_val * t_differential + start_t) for t_val in range(0, sampling_count, 1)]
            for i, point in enumerate(point_set):
                point_list[i].append(rg.Point3d(point))
    
        uv_switched_curves = []
        for point_set in point_list:
            local_isocurve = rg.NurbsCurve.Create(False, 3, point_set)
            uv_switched_curves.append(local_isocurve)
    
        # lofting those isocurves
        loft_type = rg.LoftType.Tight
        s = rg.Brep.CreateFromLoftRebuild(uv_switched_curves, rg.Point3d.Unset, rg.Point3d.Unset, loft_type, False, 50)[0]
        # getting the loft as a nurbssurface out of the resulting brep
        print s.Faces.Item[0].ToNurbsSurface()
    
        domain = rg.Interval(0, 1)
        s.SetDomain(0, domain)
        s.SetDomain(1, domain)

        return s

import random
# debug
#random.shuffle(surfaces)

network = Network(surfaces)
network.orient_direction()

tmp = []
pt = []
unique_divisions = [] 
for s in network.surfaces:
    
    unique_divisions.extend([s.u_div, s.v_div])

    string = 'u%d\nv:%d' % (s.u_div.id, s.v_div.id)
    tmp.append(string)
    pt.append(s.surface.PointAt(0.5, 0.5))
    
    
unique_divisions = list(set(unique_divisions))
for d in unique_divisions:
    
    d.num = 5


for s in network.surfaces:
    
    s.divide()
# ---------- end python_3 ----------

# ----
int = Integer(0)
item_5 = ListItem(List=surface_trimming.temp_surface, Index=0, Wrap=True)
python_4 = PythonScript(surface=surface_trimming.temp_surface, u_div=u_div_2, v_div=v_div_2, start_position=int, add_extra_beam=Toggle(False))  # -> out, beam_visualisation; inputs surface: Surface, u_div: Int32, v_div: Int32
# ---------- python_4: Python ----------
# snippet of code to make this python component look for it's code in the parent folder of the .gh file

import os

ghComp = ghenv.Component
ghDoc = ghComp.OnPingDocument()

file_name = "simple_surface_divider.py"
gh_file_location = ghDoc.FilePath
parent = os.path.dirname(os.path.realpath(gh_file_location))

file_path = os.path.join(parent, file_name)
# print file_path

single_parent = os.path.dirname(os.path.realpath(parent))
double_parent = os.path.dirname(os.path.realpath(single_parent))
# print parent

# hacky-hacky run-fun
execfile(file_path)
# ---------- end python_4 ----------
panel_5 = Panel(python_2.out)

# ---- group: beams on the edges
geo = Geometry(python_2.tmp)

# ---- group: all beams
geo_2 = Geometry(python_2.beams)

# ----
tag = TextTag(Location=python_2.label_pos, Text=python_2.label)
merge_5 = Merge()
pt_2 = Point([<point referenced from the Rhino model> x4])
srf_28 = Surface(srf_24)
srf_29 = Surface(flatten(srf_28))
sdivide_2 = DivideSurface(Surface=srf_29, UCount=10, VCount=10)  # -> Points, Normals, Parameters
brep = Brep(python_4.beam_visualisation)
item_6 = ListItem(Index=0, Wrap=True)
python_5 = PythonScript(x=pt_2)  # -> out, a; inputs x: list of Point3d
# ---------- python_5: Python ----------
import os
print os.name
# ---------- end python_5 ----------
evalsrf = EvaluateSurface(Surface=srf_29, Point=sdivide_2.Parameters)  # -> Point, Normal, Frame
regrading_warp = PythonScript(srf=srf_28, grading_percentage=Slider(1, range=0..1), grading_side=Slider(0, range=0..2))  # -> out, new_srf, crvs, isocrvs; inputs srf: Surface, grading_side: Int32
# ---------- regrading_warp: Python ----------
# snippet of code to make this python component look for it's code in the parent folder of the .gh file

import os

ghComp = ghenv.Component
ghDoc = ghComp.OnPingDocument()

file_name = "surface_warping.py"
gh_file_location = ghDoc.FilePath
parent = os.path.dirname(os.path.realpath(gh_file_location))

single_parent = os.path.dirname(os.path.realpath(parent))
double_parent = os.path.dirname(os.path.realpath(single_parent))

file_path = os.path.join(parent, file_name)
print file_path

# hacky-hacky run-fun
execfile(file_path)
# ---------- end regrading_warp ----------

# ---- group: in reality, must be done manually
python_6 = GhPythonScript(surfaces=regrading_warp.new_srf)  # -> out, organized_surfaces; inputs surfaces: list of Surface
# ---------- python_6: Python ----------
__author__ = "ytakzk"
__version__ = "2019.02.20"

import Rhino.Geometry as rg

organized_surfaces = []

for i, s in enumerate(surfaces):
    
    x = i % 5
    y = int(i / 5)
    
    domain = rg.Interval(0, 1)
    
    if (x + y) % 2 == 1:
        s = s.Reverse(1)
        s.SetDomain(1, domain)
        s = s.Reverse(0)
        s.SetDomain(0, domain)
        
    organized_surfaces.append(s)
# ---------- end python_6 ----------

# ----
surface_trimming_2 = PythonScript(srf=regrading_warp.new_srf, value=number_slider_6, v_div=number_slider_7)  # -> out, isocurves, temp_surface, hole_visualisation; inputs srf: Surface, value: Int32, v_div: Int32; same code as surface_trimming
srf_30 = Surface(graft(surface_trimming_2.temp_surface))
panel_6 = Panel(surface_trimming_2.out)
merge_6 = Merge(Data1=graft(surface_trimming_2.temp_surface), Data2=graft(surface_trimming.temp_surface))
item_7 = ListItem(List=surface_trimming_2.temp_surface, Index=0, Wrap=True)
python_7 = PythonScript(surface=surface_trimming_2.temp_surface, u_div=u_div_3, v_div=v_div_2, start_position=int, add_extra_beam=Toggle(False))  # -> out, hole_visualisation, beam_visualisation; inputs surface: Surface, u_div: Int32, v_div: Int32; same code as python_4
pt_3 = Point(python_7.hole_visualisation)
brep_2 = Brep(python_7.beam_visualisation)
merge_7 = Merge(Data1=brep_2, Data2=brep)
brep_3 = Brep(merge_7)
brep_4 = Brep()
scale = Scale(Geometry=evalsrf.Normal, Center=Point(0, 0, 0), Factor=Slider(100, range=0..1000))  # -> Geometry, Transform
addition = Addition(A=sdivide_2.Points, B=scale.Geometry)
crv_3 = Curve(regrading_warp.crvs)
preview_2 = CustomPreview(Geometry=brep_3, Shader=ColourSwatch(SwatchColor=RGB(255, 255, 255)))
ln_2 = Line(StartPoint=sdivide_2.Points, EndPoint=addition)
panel_7 = Panel(regrading_warp.out)
panel_8 = Panel(python_7.out)

# ==== cluster UVN
srf = ClusterInput()
number_slider = Slider(2, range=0..110)
number_slider_2 = Slider(250, range=0..300)
extract_uv_vec = GhPythonScript(srf=srf)  # -> out, center_pt, u_vec, v_vec, normal; inputs srf: Surface
# ---------- extract_uv_vec: Python ----------
__author__ = "Wenqian"
__version__ = "2019.01.22"

import rhinoscriptsyntax as rs
import Rhino.Geometry as rg

srf.SetDomain(0,rg.Interval(0,1))
srf.SetDomain(1,rg.Interval(0,1))

center_pt = srf.PointAt(0.5,0.5)

u_vec = srf.FrameAt(0.5,0.5)[1].XAxis
v_vec = srf.FrameAt(0.5,0.5)[1].YAxis

normal =srf.NormalAt(0.5,0.5)
# ---------- end extract_uv_vec ----------
multiplication = Multiplication(A=extract_uv_vec.u_vec, B=number_slider_2)
multiplication_2 = Multiplication(A=extract_uv_vec.v_vec, B=number_slider_2)
vdisex = VectorDisplayEx(
    Point=extract_uv_vec.center_pt,
    Vector=multiplication,
    Colour=ColourSwatch(SwatchColor=RGB(255, 0, 0)),
    Width=number_slider)
vdisex_2 = VectorDisplayEx(
    Point=extract_uv_vec.center_pt,
    Vector=multiplication_2,
    Colour=ColourSwatch(SwatchColor=RGB(33, 220, 0)),
    Width=number_slider)
vdisex_3 = VectorDisplayEx(
    Point=extract_uv_vec.center_pt,
    Vector=extract_uv_vec.normal,
    Colour=ColourSwatch(SwatchColor=RGB(255, 255, 255)),
    Width=number_slider)
