# Grasshopper definition surface_mapping_network_2.gh (Grasshopper 1.0.7)

number_slider = Slider(3000, range=0..3000)
number_slider_2 = Slider(3, range=0..10)
planesrf = PlaneSurface(Plane=PlaneXY(0, 0, 0), XSize=number_slider, YSize=number_slider)
series = Series(Start=0, Step=number_slider, Count=number_slider_2)
series_2 = Series(Start=0, Step=number_slider, Count=Slider(4, range=0..10))

# ---- group: cylinder as looping surfaces
cyl = Cylinder(Base=PlaneXY(0, 0, 0), Radius=Slider(3500, range=0..4000), Length=Slider(9000, range=0..10000))
python = GhPythonScript()  # -> out, a
# ---------- python: Python ----------
__author__ = "ytakzk"
__version__ = "2019.02.23"

import Rhino.Geometry as rg

a = []

for i in range(3):
    
    a.append(rg.Interval(i/3, (i + 1)/3))
# ---------- end python ----------
dom² = ConstructDomain²(DomainU=python.a, DomainV=graft(python.a))  # -> flatten(_2DDomain)
subsrf = Isotrim(Surface=reparameterize(cyl), Domain=dom²)
python_2 = GhPythonScript(x=subsrf)  # -> out, cylinder_surfaces; inputs x: list of Surface
# ---------- python_2: Python ----------
__author__ = "ytakzk"
__version__ = "2019.02.23"

import Rhino.Geometry as rg

#for s in x[3:6]:
#
#    s.Reverse(0, True)
#    domain = rg.Interval(0, 1)
#    s.SetDomain(0, domain)

cylinder_surfaces = x
# ---------- end python_2 ----------

# ----
X = UnitX(Factor=series)
Y = UnitY(Factor=series_2)  # -> graft(UnitVector)
move = Move(Geometry=planesrf, Motion=X)  # -> Geometry, Transform
move_2 = Move(Geometry=move.Geometry, Motion=Y)  # -> flatten(Geometry), Transform

# ---- group: keystone surfaces 2
srf = Surface([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])

# ----
srf_2 = Surface(move_2.Geometry)

# ---- group: Jonas's surfaces
srf_3 = Surface([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])
python_3 = GhPythonScript(surfaces=srf_3)  # -> out, a; inputs surfaces: list of Surface
# ---------- python_3: Python ----------
__author__ = "ytakzk"
__version__ = "2019.02.24"

import Rhino.Geometry as rg

a = []

for i, s in enumerate(surfaces):
    
#    domain = rg.Interval(0, 1)
#    
#    if i > 1:
#        s = s.Reverse(0)
#        s.SetDomain(0, domain)
    
    a.append(s)
# ---------- end python_3 ----------

# ----
srf_4 = Surface([<surface referenced from the Rhino model> x39])

# ---- group: in reality, must be done manually
python_4 = GhPythonScript(surfaces=srf_2, u_num=number_slider_2)  # -> out, organized_surfaces; inputs surfaces: list of Surface, u_num: Int32
# ---------- python_4: Python ----------
__author__ = "ytakzk"
__version__ = "2019.02.20"

import Rhino.Geometry as rg

organized_surfaces = []

for i, s in enumerate(surfaces):
    
    x = i % u_num
    y = int(i / u_num)
    
    domain = rg.Interval(0, 1)
    
#    if (x + y) % 2 == 1:
#        s = s.Reverse(1)
#        s.SetDomain(1, domain)
#        s = s.Reverse(0)
#        s.SetDomain(0, domain)

    if y % 2 == 1:
#        s = s.Reverse(1)
#        s.SetDomain(1, domain)
        s = s.Reverse(0)
        s.SetDomain(0, domain)
    
    if x == u_num - 1:
        s = s.Reverse(0)
        s.SetDomain(0, domain)
        
    organized_surfaces.append(s)
# ---------- end python_4 ----------

# ---- group: one surface
item = ListItem(List=srf_2, Index=0, Wrap=True)
srf_5 = Surface(item)

# ----
python_5 = GhPythonScript(surfaces=srf)  # -> out, organized_surfaces; inputs surfaces: list of Surface
# ---------- python_5: Python ----------
__author__ = "ytakzk"
__version__ = "2019.02.25"

import Rhino.Geometry as rg

organized_surfaces = []

for i, s in enumerate(surfaces):
    
#    if i == 0 or i == 1 or i == 5:
#        s.Reverse(0, True)
#        domain = rg.Interval(0, 1)
#        s.SetDomain(0, domain)
    
    organized_surfaces.append(s)
# ---------- end python_5 ----------

# ---- group: keystone surfaces
srf_6 = Surface([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])

# ----
srf_7 = Surface(srf)
item_2 = ListItem(List=srf_7, Index=0, Wrap=True)

# ---- group: local network generation
panel = Panel("""3,0
1,2
4,5""")  # disabled
panel_2 = Panel("""False
False
True""")  # disabled
panel_3 = Panel("""0
2
4""")  # disabled
python_6 = GhPythonScript(surfaces=srf_7, surface_network_index=panel, top_priority_index=panel_3, has_loops=panel_2)  # -> out, beams, dowels, local_networks; inputs surfaces: list of Surface, surface_network_index: list, top_priority_index: list of Int32, has_loops: list of Boolean; disabled
# ---------- python_6: Python ----------
__author__ = "ytakzk"
__version__ = "2019.02.23"

import sys
import Rhino.Geometry as rg

from geometry import LocalNetwork, Surface

dowels = []
beams = []
tmp = []
local_networks = []

if len(surface_network_index) != len(top_priority_index):
    ValueError('surface_network_index must be the same size as top_priority_index')

# network

surface_network_sets = []
priorities = []

for string, priority_index in zip(surface_network_index, top_priority_index):
    
    values = string.split('&')

    surface_network = []
    
    priority_index_v = 0
    
    for v_values in values:

        surface_network_subset = []
        for v, index in enumerate(v_values.split(',')):
            
            index = int(index)

            if index == priority_index:
                
                priority_index_v = v
                
            surface = Surface(surfaces[index])
            surface_network_subset.append(surface)
            
        surface_network.append(surface_network_subset)
    
    priorities.append(priority_index_v)
    
    surface_network_sets.append(surface_network)

for surface_network, has_loop, top_priority_v_index in zip(surface_network_sets, has_loops, priorities):

    local_network = LocalNetwork(surface_network, has_loop, top_priority_v_index)

    local_dowels = local_network.add_three_beams_connection()
    dowels.extend([d.brep_representation() for d in local_dowels])

    local_dowels = local_network.add_two_beams_connection()
    dowels.extend([d.brep_representation() for d in local_dowels])

    local_beams = [b.brep_representation(make_holes=False) for b in local_network.get_flatten_beams()]
    beams.extend(local_beams)
    
    local_networks.append(local_network)
# ---------- end python_6 ----------

# ----
srf_8 = Surface([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])

# ---- group: surface visualization
python_7 = GhPythonScript(s=srf_7)  # -> out, c; inputs s: Surface
# ---------- python_7: Python ----------
__author__ = "ytakzk"
__version__ = "2019.02.26"

import Rhino.Geometry as rg


domain = rg.Interval(0, 1)
s.SetDomain(0, domain)
s.SetDomain(1, domain)

c = s.PointAt(0.5, 0.5)
# ---------- end python_7 ----------
panel_4 = Panel("600")
points = PointList(Points=python_7.c, Size=panel_4)
uvn = UVN(srf=srf_8)

# ----
srf_9 = Surface([<surface referenced from the Rhino model> x6])
srf_10 = Surface(srf_8)

# ---- group: local network generation
panel_5 = Panel("""0, 1, 2, 3
4, 5, 6, 7
8, 9, 10, 11
12, 13, 14, 15
16, 17, 18, 19
20, 21, 22, 23""")
panel_6 = Panel("False")
panel_7 = Panel("0")
python_8 = GhPythonScript(surfaces=srf_10, surface_network_index=panel_5, top_priority_index=panel_7, has_loops=panel_6)  # -> out, beams, dowels, local_networks; inputs surfaces: list of Surface, surface_network_index: list, top_priority_index: list of Int32, has_loops: list of Boolean
# ---------- python_8: Python ----------
__author__ = "ytakzk"
__version__ = "2019.02.23"

import sys
import Rhino.Geometry as rg
import geometry.local_network
import geometry.surface
reload(geometry.local_network)
reload(geometry.surface)
from geometry.local_network import LocalNetwork
from geometry.surface import Surface


dowels = []
beams = []
tmp = []
local_networks = []

if len(surface_network_index) != len(top_priority_index):
    ValueError('surface_network_index must be the same size as top_priority_index')

# network

surface_network_sets = []
priorities = []

for string, priority_index in zip(surface_network_index, top_priority_index):
    
    values = string.split('&')

    surface_network = []
    
    priority_index_v = 0
    
    for v_values in values:

        surface_network_subset = []
        for v, index in enumerate(v_values.split(',')):
            
            index = int(index)

            if index == priority_index:
                
                priority_index_v = v
                
            surface = Surface(surfaces[index])
            surface_network_subset.append(surface)
            
        surface_network.append(surface_network_subset)
    
    priorities.append(priority_index_v)
    
    surface_network_sets.append(surface_network)

for surface_network, has_loop, top_priority_v_index in zip(surface_network_sets, has_loops, priorities):

    local_network = LocalNetwork(surface_network, has_loop, top_priority_v_index)

    local_dowels = local_network.add_three_beams_connection()
    dowels.extend([d.brep_representation() for d in local_dowels])

    local_dowels = local_network.add_two_beams_connection()
    dowels.extend([d.brep_representation() for d in local_dowels])

    local_beams = [b.brep_representation(make_holes=False) for b in local_network.get_flatten_beams()]
    beams.extend(local_beams)
    
    local_networks.append(local_network)
# ---------- end python_8 ----------

# ----
merge = Merge(
    Data1=Slider(100, range=0..500),
    Data2=Slider(100, range=0..500),
    Data3=Slider(100, range=0..500),
    Data4=Toggle(False),
    Data5=Toggle(False),
    Data6=Toggle(False))
merge_2 = Merge(
    Data1=Slider(100, range=0..500),
    Data2=Slider(100, range=0..500),
    Data3=Slider(0.1, range=0..10),
    Data4=Slider(100, range=0..500),
    Data5=Slider(100, range=0..500),
    Data6=Slider(0.1, range=0..10),
    Data7=Slider(100, range=0..500),
    Data8=Slider(100, range=0..500),
    Data9=Slider(0.1, range=0..10),
    Data10=Toggle(False),
    Data11=Toggle(False),
    Data12=Toggle(False))
sort = SortList()  # -> Keys, ValuesA
srf_11 = Surface([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])
item_3 = ListItem(List=srf_8, Index=0, Wrap=True)
srf_12 = Surface(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)
number_slider_3 = Slider(2, range=-10..10)  # disabled
merge_3 = Merge(Data1=Slider(1, range=0..10), Data2=Slider(2, range=0..10), Data3=Slider(0, range=0..10), Data4=Slider(0, range=0..10))
python_9 = GhPythonScript(
    surfaces=srf_11,
    surface_network_index=panel_5,
    top_priority_index=panel_7,
    has_loops=panel_6,
    f_args_para=merge_2,
    f_args_static=merge)  # -> out, beams, dowels, local_networks; inputs surfaces: list of Surface, surface_network_index: list, top_priority_index: list of Int32, has_loops: list of Boolean, f_args_para: list; disabled
# ---------- python_9: Python ----------
__author__ = "ytakzk"
__version__ = "2019.02.23"

import sys
import Rhino.Geometry as rg
import geometry.local_network
import geometry.surface
reload(geometry.local_network)
reload(geometry.surface)
from geometry.local_network import LocalNetwork
from geometry.surface import Surface


dowels = []
beams = []
tmp = []
local_networks = []

f_args = [f_args_static, f_args_para]

if len(surface_network_index) != len(top_priority_index):
    ValueError('surface_network_index must be the same size as top_priority_index')

# network

surface_network_sets = []
priorities = []

local_surfaces = [Surface(srf, u_div = 10, v_div = 3) for srf in surfaces]

local_network = LocalNetwork(local_surfaces, has_loop = False, u_div = 10, v_div = 3, flip = True,  parametric = True, type_args = f_args)
local_network.add_three_beams_connection()
local_network.add_two_beams_connection()

beams = [beam.brep_representation(make_holes = False) for beam in local_network.get_flatten_beams()]
dowels = [beam.brep_representation() for beam in local_network.dowels]
# ---------- end python_9 ----------
equals = Equality(FirstNumber=merge_3, SecondNumber=0)  # -> Equality, Inequality

# ---- group: keystone generation
panel_8 = Panel("""2,3,4
1,0,5""")  # disabled
python_10 = GhPythonScript(surfaces=srf_7, keystone_index_list=panel_8, a=number_slider_3)  # -> out, keystone_surfaces; inputs surfaces: list of Surface, a: Int32; disabled
# ---------- python_10: Python ----------
__author__ = "ytakzk"
__version__ = "2019.02.24"

import System
import Rhino.Geometry as rg
import Grasshopper.Kernel.Data.GH_Path as ghpath
import Grasshopper.DataTree as datatree
from geometry import Keystone

keystone_surfaces = datatree[System.Object]()

# ceonvert string to nested numerical list

index_nested_list = []

for vals in keystone_index_list.split('\n'):
    print vals
    nums = [int(v) for v in vals.split(',')]
    index_nested_list.append(nums)

print index_nested_list

#for i, index_list in enumerate(index_nested_list):
#    
#    surfaces = [surfaces[i] for i in index_list]
#
#    keystone = Keystone(surfaces, split_function=1)
#    _, generated_surfaces = keystone.output()
#    
#    for s in generated_surfaces:
#        path = ghpath(i)
#        keystone_surfaces.Add(s, path)

nested_surfaces = []
for index_list in index_nested_list:
    
    tmp_surfaces = [surfaces[i] for i in index_list]

    nested_surfaces.append(tmp_surfaces)

keystone = Keystone(nested_surfaces, split_function=1, f_args = [[0, 0, .15, .05], [a, 0, .15, .05], []], loc_pat = [0, 1], blend_overlap = 5, dir = True)
_, generated_surfaces = keystone.output()

for i, s_list in enumerate(generated_surfaces):
    path = ghpath(i)
    
    for s in s_list:
        keystone_surfaces.Add(s, path)
# ---------- end python_10 ----------
preview = CustomPreview(
    Geometry=python_10.keystone_surfaces,
    Material={diffuse=RGB(0, 191, 255), emission=RGB(66, 48, 66), shine=0.5, specular=RGB(255, 255, 255), transparency=0.6})  # disabled
uvn_2 = UVN(srf=python_10.keystone_surfaces)  # disabled

# ----
python_11 = GhPythonScript(
    surfaces=srf_12,
    surface_network_index=panel_5,
    top_priority_index=panel_7,
    has_loops=panel_6,
    f_args_para=merge_2,
    f_args_static=merge)  # -> out, beams, dowels, local_networks; inputs surfaces: list of Surface, surface_network_index: list, top_priority_index: list of Int32, has_loops: list of Boolean, f_args_para: list
# ---------- python_11: Python ----------
__author__ = "ytakzk"
__version__ = "2019.02.23"

import sys
import Rhino.Geometry as rg
import geometry.local_network
import geometry.surface
reload(geometry.local_network)
reload(geometry.surface)
from geometry.local_network import LocalNetwork
from geometry.surface import Surface


dowels = []
beams = []
tmp = []
local_networks = []

if len(surface_network_index) != len(top_priority_index):
    ValueError('surface_network_index must be the same size as top_priority_index')

# network

surface_network_sets = []
priorities = []

local_surfaces = [Surface(srf, u_div = 10, v_div = 2) for srf in surfaces]

local_network = LocalNetwork(local_surfaces, has_loop = False, u_div = 10, v_div = 3, flip = True,  parametric = True)
local_network.add_three_beams_connection()
local_network.add_two_beams_connection()

beams = [beam.brep_representation(make_holes = False) for beam in local_network.get_flatten_beams()]
dowels = [beam.brep_representation() for beam in local_network.dowels]
# ---------- end python_11 ----------
sift = SiftPattern(List=merge_3, SiftPattern=equals.Equality)  # -> Output0, Output1
clean = CleanTree(RemoveNulls=True, RemoveInvalid=True, RemoveEmpty=False, Tree=sift.Output0)
ma = MassAddition(Input=clean)  # -> Result, PartialResults
item_4 = ListItem(List=ma.PartialResults, Index=0, Wrap=True)  # -> Item1, Item
division = Division(A=ma.PartialResults, B=item_4.Item1)
python_12 = GhPythonScript(
    surfaces=srf_9,
    surface_network_index=panel_5,
    top_priority_index=panel_7,
    has_loops=panel_6,
    u_div=Slider(10, range=0..100),
    v_div=Slider(2, range=0..10),
    mapping_type=division,
    seam_type=Slider(1, range=0..3),
    flush_beam_count=Slider(4, range=0..10),
    warp_type=Slider(1, range=0..3),
    flip_inflection=True)  # -> out, beams, dowels, local_networks, lines, curve, planes, surface, global_beam_list; inputs surfaces: list of Surface, surface_network_index: list, top_priority_index: list of Int32, has_loops: list of Boolean, u_div: Int32, v_div: Int32, mapping_type: list, seam_type: Int32, flush_beam_count: Int32, warp_type: Int32
# ---------- python_12: Python ----------
__author__ = "ytakzk"
__version__ = "2019.02.23"

import sys
import Rhino.Geometry as rg
import geometry.local_network
import geometry.surface
import geometry.beam_network
reload(geometry.local_network)
reload(geometry.surface)
reload(geometry.beam_network)
from geometry.local_network import LocalNetwork
from geometry.surface import Surface
from geometry.beam_network import BeamNetwork

dowels = []
beams = []
tmp = []
local_networks = []

srf_topo = []
global_beam_list = []
beam_nws = []
for srf in surfaces:
    local_srf_instance = Surface(srf, u_div = u_div, v_div = v_div)
    srf_topo.append(local_srf_instance)

beam_nw = BeamNetwork(srf_topo)
beam_nw.construct_beam_sets()
beam_nw.beam_network()

for dowel in beam_nw.dowels:
    dowels.append(dowel.brep_representation())

for local_beam_list in beam_nw.beam_list:
    for beam in local_beam_list:
        global_beam_list.append(beam.brep_representation(make_holes = False))
# ---------- end python_12 ----------
python_13 = GhPythonScript(
    surfaces=srf_8,
    surface_network_index=panel_5,
    top_priority_index=panel_7,
    has_loops=panel_6,
    u_div=Slider(12, range=0..100),
    v_div=Slider(2, range=0..10),
    mapping_type=division,
    seam_type=Slider(1, range=0..3),
    flush_beam_count=Slider(5, range=0..10),
    warp_type=Slider(2, range=0..3),
    flip_inflection=True)  # -> out, beams, dowels, local_networks, lines, curve, planes, surface, global_beam_list; inputs surfaces: list of Surface, surface_network_index: list, top_priority_index: list of Int32, has_loops: list of Boolean, u_div: Int32, v_div: Int32, mapping_type: list, seam_type: Int32, flush_beam_count: Int32, warp_type: Int32
# ---------- python_13: Python ----------
__author__ = "ytakzk"
__version__ = "2019.02.23"

import sys
import Rhino.Geometry as rg
import geometry.local_network
import geometry.surface
import geometry.beam_network
reload(geometry.local_network)
reload(geometry.surface)
reload(geometry.beam_network)
from geometry.local_network import LocalNetwork
from geometry.surface import Surface
from geometry.beam_network import BeamNetwork

srf_sets = []

for i in range(5):
    nested_loop = []
    for j in range(4):
        new = i * 4 + j
        print new
        local_srf_set = surfaces[new]
        nested_loop.append(local_srf_set)
    srf_sets.append(nested_loop)

print srf_sets

dowels = []
beams = []
tmp = []
local_networks = []


global_beam_list = []
beam_nws = []
for srf_set in srf_sets:
    srf_topo = []
    for srf in srf_set:
        local_srf_instance = Surface(srf, u_div = u_div, v_div = v_div)
        srf_topo.append(local_srf_instance)

    beam_nw = BeamNetwork(srf_topo)
    beam_nw.construct_beam_sets()
    beam_nw.beam_network()

    for dowel in beam_nw.dowels:
        dowels.append(dowel.brep_representation())

    for local_beam_list in beam_nw.beam_list:
        for beam in local_beam_list:
            global_beam_list.append(beam.brep_representation(make_holes = False))
# ---------- end python_13 ----------
crv = Curve(python_13.curve)
pln = Plane(python_13.planes)
line = Line(python_13.lines)
srf_13 = Surface(python_13.surface)
brep = Brep(python_13.global_beam_list)
panel_9 = Panel(python_9.out)
item_5 = ListItem(List=brep, Index=Slider(0, range=0..100), Wrap=True)
srf_14 = Surface(flatten(python_10.keystone_surfaces))  # disabled

# ---- group: surface visualization
uvn_3 = UVN(srf=srf_14)  # disabled
python_14 = GhPythonScript(s=srf_14)  # -> out, c; inputs s: Surface; disabled; same code as python_7
points_2 = PointList(Points=python_14.c, Size=panel_4)  # disabled

# ----
panel_10 = Panel("""0
2
4""")  # disabled
panel_11 = Panel("""1,0
2,3
4,5""")  # disabled
python_15 = GhPythonScript(surfaces=srf_14, surface_network_index=panel_11, top_priority_index=panel_10)  # -> out, beams, dowels, local_networks; inputs surfaces: list of Surface, surface_network_index: list, top_priority_index: list of Int32, has_loops: list of Boolean; disabled
# ---------- python_15: Python ----------
__author__ = "ytakzk"
__version__ = "2019.02.23"

import sys
import Rhino.Geometry as rg

from geometry import LocalNetwork, Surface

dowels = []
beams = []
tmp = []
local_networks = []

if len(surface_network_index) != len(top_priority_index):
    ValueError('surface_network_index must be the same size as top_priority_index')

# network

surface_network_sets = []
priorities = []

for string, priority_index in zip(surface_network_index, top_priority_index):
    
    values = string.split('&')

    surface_network = []
    
    priority_index_v = 0
    
    for v_values in values:

        surface_network_subset = []
        for v, index in enumerate(v_values.split(',')):
            
            index = int(index)

            if index == priority_index:
                
                priority_index_v = v
                
            surface = Surface(surfaces[index])
            surface_network_subset.append(surface)
            
        surface_network.append(surface_network_subset)
    
    priorities.append(priority_index_v)
    
    surface_network_sets.append(surface_network)

print priorities

for surface_network, top_priority_v_index in zip(surface_network_sets, priorities):

    local_network = LocalNetwork(surface_network, False, top_priority_v_index)

    local_dowels = local_network.add_three_beams_connection()
    dowels.extend([d.brep_representation() for d in local_dowels])

    local_dowels = local_network.add_two_beams_connection()
    dowels.extend([d.brep_representation() for d in local_dowels])

    local_beams = [b.brep_representation(make_holes=False) for b in local_network.get_flatten_beams()]
    beams.extend(local_beams)
    
    local_networks.append(local_network)
# ---------- end python_15 ----------
merge_4 = Merge(Data1=python_6.local_networks, Data2=python_15.local_networks)  # disabled

# ---- group: fabrication sequence check
python_16 = GhPythonScript(local_networks=merge_4)  # -> out, beams, dowels; inputs local_networks: list; disabled
# ---------- python_16: Python ----------
__author__ = "ytakzk"
__version__ = "2019.02.24"

import System
import Grasshopper.Kernel.Data.GH_Path as ghpath
import Grasshopper.DataTree as datatree

beams = datatree[System.Object]()

for i, local_network in enumerate(local_networks):
    
    local_beams = [b.brep_representation(make_holes=False) for b in local_network.get_flatten_beams()]
    
    path = ghpath(i)
    
    for b in local_beams:
        beams.Add(b, path)
# ---------- end python_16 ----------
number_slider_4 = Slider(15, range=0..20)  # disabled
item_6 = ListItem(List=python_16.beams, Index=number_slider_4, Wrap=True)  # disabled
preview_2 = CustomPreview(
    Geometry=item_6,
    Material={diffuse=RGB(0, 255, 255), emission=RGB(66, 48, 66), shine=0.5, specular=RGB(255, 255, 255), transparency=0.3})  # disabled

# ----
python_17 = GhPythonScript()  # -> Out, A; disabled

# ==== cluster UVN
srf = ClusterInput()
number_slider = Slider(5, range=0..110)
extract_uv_vec = GhPythonScript(srf=srf)  # -> out, center_pt, u_vec, v_vec, normal; inputs srf: Surface
# ---------- extract_uv_vec: Python ----------
__author__ = "Wenqian"
__version__ = "2019.01.22"

import rhinoscriptsyntax as rs
import Rhino.Geometry as rg

srf.SetDomain(0,rg.Interval(0,1))
srf.SetDomain(1,rg.Interval(0,1))

center_pt = srf.PointAt(0.5,0.5)

u_vec = srf.FrameAt(0.5,0.5)[1].XAxis
v_vec = srf.FrameAt(0.5,0.5)[1].YAxis

normal =srf.NormalAt(0.5,0.5)
# ---------- end extract_uv_vec ----------
multiplication = Multiplication(A=extract_uv_vec.v_vec, B=500)
multiplication_2 = Multiplication(A=extract_uv_vec.normal, B=500)
multiplication_3 = Multiplication(A=extract_uv_vec.u_vec, B=500)
vdisex = VectorDisplayEx(
    Point=extract_uv_vec.center_pt,
    Vector=multiplication_3,
    Colour=ColourSwatch(SwatchColor=RGB(255, 0, 0)),
    Width=number_slider)
vdisex_2 = VectorDisplayEx(
    Point=extract_uv_vec.center_pt,
    Vector=multiplication,
    Colour=ColourSwatch(SwatchColor=RGB(33, 220, 0)),
    Width=number_slider)
vdisex_3 = VectorDisplayEx(
    Point=extract_uv_vec.center_pt,
    Vector=multiplication_2,
    Colour=ColourSwatch(SwatchColor=RGB(255, 255, 255)),
    Width=number_slider)
