# Grasshopper definition GH.gh (Grasshopper 1.0.4)

topconstructioncurve = Curve([<curve referenced from the Rhino model> x4])
bottomcurve = Curve([<curve referenced from the Rhino model> x4])
number_slider = Slider(200, range=100..500)
srf = Surface(graft([<surface referenced from the Rhino model> x4]))
middlecurve = Curve([<curve referenced from the Rhino model> x4])
topcurve = Curve([<curve referenced from the Rhino model> x4])
flip = FlipCurve()  # -> Curve, Flag
len = Length(Curve=middlecurve)
ext = ExtendCurve(Curve=middlecurve, Type=2, Start=number_slider, End=number_slider)
ext_2 = ExtendCurve(Curve=topcurve, Type=2, Start=number_slider, End=number_slider)
division = Division(A=len, B=number_slider)
ext_3 = ExtendCurve(Curve=bottomcurve, Type=2, Start=number_slider, End=number_slider)
division_2 = Division(A=division, B=2)
round = Round(Number=division_2)  # -> Nearest, Floor, Ceiling
merge = Merge(Data1=graft(ext_3), Data2=graft(ext), Data3=graft(ext_2))
multiplication = Multiplication(A=round.Floor, B=2)
subtraction = Subtraction(A=multiplication, B=1)
path_mapper = PathMapper(merge, source="{A;B}", target="{B}")
divide = DivideCurve(Curve=bottomcurve, Count=subtraction, Kinks=False)  # -> Points, Tangents, Parameters
divide_2 = DivideCurve(Curve=topconstructioncurve, Count=subtraction, Kinks=False)  # -> Points, Tangents, Parameters
path_mapper_2 = PathMapper(divide.Points, source="{A;B}", target="{B}")
path_mapper_3 = PathMapper(divide_2.Points, source="{A;B}", target="{B}")
item = ListItem(List=divide.Points, Index=0, Wrap=True)
item_2 = ListItem(List=divide_2.Points, Index=0, Wrap=True)
loft = Loft(Curves=path_mapper, Options={Adjust=False, Closed=False, LoftEnds=0, LoftSimp=0, LoftType=0, Rebuild=25, Refit=0.01})
pdecon = Deconstruct(Point=path_mapper_2)  # -> XComponent, YComponent, ZComponent
pdecon_2 = Deconstruct(Point=path_mapper_3)  # -> XComponent, YComponent, ZComponent
panel = Panel(divide_2.Tangents)
subtraction_2 = Subtraction(A=pdecon_2.XComponent, B=pdecon.XComponent)
subtraction_3 = Subtraction(A=pdecon_2.YComponent, B=pdecon.YComponent)
Z = UnitZ(Factor=1)
vec = VectorXYZ(XComponent=subtraction_2, YComponent=subtraction_3, ZComponent=0)  # -> Vector, Length
pl = ConstructPlane(Origin=divide.Points, XAxis=vec.Vector, YAxis=Z)
path_mapper_4 = PathMapper(pl, source="{A;B}", target="{B}")
lng = ListLength(List=path_mapper_4)
series = Series(Start=0, Step=0, Count=lng)
sec = BrepPlane(Brep=loft, Plane=path_mapper_4)  # -> Curves, Points
path_mapper_5 = PathMapper(sec.Curves, source="{A;B}", target="{A}")
panel_2 = Panel(path_mapper_4)
lng_2 = ListLength(List=path_mapper_5)
addition = Addition(A=lng_2)
division_3 = Division(A=addition, B=2)
round_2 = Round(Number=division_3)  # -> Nearest, Floor, Ceiling
panel_3 = Panel(lng_2)
series_2 = Series(Start=0, Step=2, Count=round_2.Ceiling)
path_mapper_6 = PathMapper(series_2, source="{A;B}", target="{A}")
number_slider_2 = Slider(6, range=1..15)
item_3 = ListItem(List=path_mapper_5, Index=path_mapper_6, Wrap=True)
division_4 = Division(A=number_slider_2, B=2)
lng_3 = ListLength(List=item_3)
divide_3 = DivideCurve(Curve=item_3, Count=number_slider_2, Kinks=False)  # -> Points, Tangents, Parameters
round_3 = Round(Number=division_4)  # -> Nearest, Floor, Ceiling
series_3 = Series(Start=0, Step=1, Count=lng_3)
mod = Modulus(A=series_3, B=2)
graft = GraftTree(Tree=mod, IncludeEmptyLists=True, IncludeNullItems=True)
path_mapper_7 = PathMapper(graft, source="{A;B;C}", target="{A;C}")
series_4 = Series(Start=path_mapper_7, Step=2, Count=round_3.Floor)
path_mapper_8 = PathMapper(series_4, source="{A;B;C}", target="{A;B}")
addition_2 = Addition(A=path_mapper_8, B=1)
item_4 = ListItem(List=divide_3.Points, Index=path_mapper_8, Wrap=True)
item_5 = ListItem(List=divide_3.Points, Index=addition_2, Wrap=True)
subtraction_4 = Subtraction(A=item_4, B=item_5)
addition_3 = Addition(A=item_4, B=item_5)
ln = Line(StartPoint=item_4, EndPoint=item_5)
division_5 = Division(A=addition_3, B=2)
cp = PlaneClosestPoint(Point=division_5, Plane=PlaneXY(0, 0, 0))  # -> Point, UVPoint, Distance
len_2 = Length(Curve=ln)
vec_2 = Vector(subtraction_4)
subtraction_5 = Subtraction(A=division_5, B=cp.Point)
division_6 = Division(A=len_2, B=2)
xprod = CrossProduct(VectorA=vec_2, VectorB=subtraction_5, Unitize=False)  # -> Vector, Length
addition_4 = Addition(A=division_6, B=150)
neg = Negative(Value=addition_4)
xprod_2 = CrossProduct(VectorA=vec_2, VectorB=xprod.Vector, Unitize=False)  # -> Vector, Length
dom = ConstructDomain(DomainStart=neg, DomainEnd=addition_4)
x_axis = Vector(vec_2)
y_axis = Vector(xprod_2.Vector)
pl_2 = ConstructPlane(Origin=division_5, XAxis=x_axis, YAxis=y_axis)
box = DomainBox(Base=pl_2, X=dom, Y=Domain(-60, 60), Z=Domain(-20, 20))
