# Grasshopper definition 190110_tool_calibration.gh (Grasshopper 1.0.7)

size = Slider(100, range=0..100)
pt = Point(Point(0, 0, 0))
angle = Slider(52, range=0..100)
dom = Domain(DomainStart=expr("-x/2", size), DomainEnd=expr("x/2", size))
rectangle = Rectangle(Plane=pt, XSize=dom, YSize=dom, Radius=0)  # -> Rectangle, Length
area = Area(Geometry=rectangle.Rectangle)  # -> Area, Centroid
neg = Negative(Value=angle)
explode = Explode(Curve=rectangle.Rectangle, Recursive=True)  # -> Segments, flatten(Vertices)
ln = Line(StartPoint=explode.Vertices, EndPoint=area.Centroid)  # -> flatten(Line)
pl = PlaneNormal(Origin=explode.Vertices, ZAxis=ln)  # -> flatten(Plane)
deplane = DeconstructPlane(Plane=pl)  # -> Origin, XAxis, YAxis, ZAxis
rot3d = Rotate3D(Geometry=pl, Angle=degrees(neg), Center=explode.Vertices, Axis=deplane.XAxis)  # -> Geometry, Transform
