# Grasshopper definition JoiningParis.gh (Grasshopper 0.9.80)
# plug-ins: Python Interpreter

srf = Surface([<surface referenced from the Rhino model> x2])
srf_2 = Surface([<surface referenced from the Rhino model> x2])
srf_3 = Surface([<surface referenced from the Rhino model> x5])
srf_4 = Surface([<surface referenced from the Rhino model> x5])
srf_5 = Surface([<surface referenced from the Rhino model> x2])
rev = ReverseList(List=srf_4)
srf_6 = Surface([<surface referenced from the Rhino model> x2])
srf_7 = Surface([<surface referenced from the Rhino model> x3])
srf_8 = Surface([<surface referenced from the Rhino model> x3])
srf_9 = Surface(<surface referenced from the Rhino model>)
srf_10 = Surface(<surface referenced from the Rhino model>)
rev_2 = ReverseList(List=srf)
srf_11 = Surface([<surface referenced from the Rhino model> x2])
srf_12 = Surface([<surface referenced from the Rhino model> x2])
srf_13 = Surface([<surface referenced from the Rhino model> x6])
srf_14 = Surface([<surface referenced from the Rhino model> x6])
srf_15 = Surface([<surface referenced from the Rhino model> x2])
srf_16 = Surface([<surface referenced from the Rhino model> x3])
srf_17 = Surface([<surface referenced from the Rhino model> x2])
srf_18 = Surface([<surface referenced from the Rhino model> x3])
srf_19 = Surface(<surface referenced from the Rhino model>)
srf_20 = Surface(<surface referenced from the Rhino model>)
srf_21 = Surface(<surface referenced from the Rhino model>)
srf_22 = Surface(<surface referenced from the Rhino model>)
srf_23 = Surface([<surface referenced from the Rhino model> x6])
srf_24 = Surface([<surface referenced from the Rhino model> x6])
merge = Merge(Data1=graft(srf_7), Data2=graft(srf_8))
merge_2 = Merge(Data1=graft(srf_5), Data2=graft(srf_6))
merge_3 = Merge(Data1=graft(srf_9), Data2=graft(srf_10))
merge_4 = Merge(Data1=graft(srf_11), Data2=graft(srf_12))
merge_5 = Merge(Data1=graft(srf_13), Data2=graft(srf_14))
merge_6 = Merge(Data1=graft(rev_2), Data2=graft(srf_2))
merge_7 = Merge(Data1=graft(srf_16), Data2=graft(srf_18))
merge_8 = Merge(Data1=graft(srf_19), Data2=graft(srf_20))
merge_9 = Merge(Data1=graft(srf_15), Data2=graft(srf_17))
merge_10 = Merge(Data1=graft(srf_21), Data2=graft(srf_22))
merge_11 = Merge(Data1=graft(srf_23), Data2=graft(srf_24))
merge_12 = Merge(Data1=graft(srf_3), Data2=graft(srf_4))
srf_25 = Surface(merge)
srf_26 = Surface(merge_2)
srf_27 = Surface(merge_3)
srf_28 = Surface(merge_4)
srf_29 = Surface(merge_5)
srf_30 = Surface(merge_6)
srf_31 = Surface(merge_9)
srf_32 = Surface(merge_7)
srf_33 = Surface(merge_8)
srf_34 = Surface(merge_10)
srf_35 = Surface(merge_11)
srf_36 = Surface(flatten(merge_12))
number_slider = Slider(15, range=0..15)
rev_3 = ReverseList(List=srf_33)  # -> flatten(List)
panel = Panel(srf_36)
python = PythonScript(srfs=rev_3)  # -> out, a, isocrvs, srfs_set_count; inputs srfs: list of Surface
# ---------- python: Python ----------
execfile("/Users/jonas/Dropbox/0.dfab/Trimester 2/Project I - Gradual Assemblies/Gradual-Assemblies/Code & Design/UV-Field Functions/join_srfs.py")
# ---------- end python ----------
srf_37 = Surface(<surface referenced from the Rhino model>)
python_2 = PythonScript(srfs=srf_37)  # -> out, new_srf_list, point_v_list; inputs srfs: list of Surface
# ---------- python_2: Python ----------
execfile("/Users/jonas/Dropbox/0.dfab/Trimester 2/Project I - Gradual Assemblies/Gradual-Assemblies/Code & Design/Joints/extending_srfs.py")
# ---------- end python_2 ----------
item = ListItem(List=srf, Index=number_slider, Wrap=True)
item_2 = ListItem(List=srf_2, Index=number_slider, Wrap=True)
item_3 = ListItem(List=srf_17, Index=Slider(1, range=0..3), Wrap=True)
pt = Point(python_2.point_v_list)
panel_2 = Panel(python.out)
panel_3 = Panel(python_2.out)
item_4 = ListItem(List=pt, Index=Slider(2, range=0..4), Wrap=True)
srf_38 = Surface(python.a)
