# Grasshopper definition uvFieldFunction.gh (Grasshopper 0.9.80)
# plug-ins: Python Interpreter

function_type = Number(Slider(0, range=0..2))
u_shift_value = Number(Slider(9.3, range=0..20))
amplitude = Number(Slider(6.99, range=0.5..10))
period = Number(Slider(6.6, range=1..50))
iterations = Number(Slider(8, range=1..10))
amplitude_2 = Number(Slider(6.99, range=0.5..10))
u_shift_value_2 = Number(Slider(9.3, range=0..20))
period_2 = Number(Slider(6.6, range=1..50))
iterations_2 = Number(Slider(8, range=1..10))
srf = Surface(<surface referenced from the Rhino model>)
merge = Merge(Data1=amplitude, Data2=period, Data3=iterations, Data4=u_shift_value, Data5=function_type)
list = ValueList({"None": 0, "u swap": 1, "v swap": 2, "uv-swap": 3}, selected="None")
list_2 = ValueList({"None": 0, "Sin": 1, "Surface": 2}, selected="Sin")
merge_2 = Merge(Data1=amplitude_2, Data2=period_2, Data3=iterations_2, Data4=u_shift_value_2)
srf_2 = Surface(<surface referenced from the Rhino model>)
srf_3 = Surface(<surface referenced from the Rhino model>)
num = Number(1)
list_3 = ValueList({"u warp": 0, "v warp": 1, "u & v warp": 2}, selected="u warp")
list_4 = ValueList({"None": 0, "u swap": 1, "v swap": 2, "uv-swap": 3}, selected="uv-swap")
list_5 = ValueList({"None": 0, "Sin": 1, "Surface": 2}, selected="Sin")
srf_4 = Surface(<surface referenced from the Rhino model>)
num_2 = Number()
uvfieldmanipulation = PythonScript(
    surfaces=srf,
    u_divisions=Slider(15, range=10..100),
    v_divisions=Slider(21, range=10..100),
    warp_type=list_2,
    swap_uv=Toggle(False),
    change_direction=list,
    edge_flattening=Toggle(True),
    sin_parameters=merge_2,
    reference_surface=srf_3)  # -> out, global_points, line_1, line_2, beam_breps, spheres_angles, surface, point_list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; inputs surfaces: Surface, warp_type: Int32, swap_uv: Boolean, change_direction: Int32, sin_parameters: list, reference_surface: Surface
# ---------- uvfieldmanipulation: Python ----------
# snippet of code to make this python component look for it's code in the parent folder of the .gh file

import os

ghComp = ghenv.Component
ghDoc = ghComp.OnPingDocument()

file_name = "uvFieldFunction.py"
gh_file_location = ghDoc.FilePath
parent = os.path.dirname(os.path.realpath(gh_file_location))

file_path = os.path.join(parent, file_name)
print file_path

parent = os.path.dirname(os.path.realpath(parent))
parent = os.path.dirname(os.path.realpath(parent))
print parent

# hacky-hacky run-fun
execfile(file_path)
# ---------- end uvfieldmanipulation ----------
num_3 = Number()
uvfieldmanipulation_v2 = PythonScript(
    surfaces=srf_2,
    u_divisions=Slider(10, range=3..100),
    v_divisions=Slider(10, range=3..100),
    warp_type=list_5,
    swap_uv=Toggle(True),
    change_direction=list_4,
    boundary_easing=Toggle(True),
    warp_directions=list_3,
    sin_parameters=merge,
    reference_surface=srf_4)  # -> out, global_points, line_1, line_2, beam_breps, spheres_angles, surface, point_list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; inputs surfaces: Surface, warp_type: Int32, swap_uv: Boolean, change_direction: Int32, sin_parameters: list, reference_surface: Surface
# ---------- uvfieldmanipulation_v2: Python ----------
# snippet of code to make this python component look for it's code in the parent folder of the .gh file

import os

ghComp = ghenv.Component
ghDoc = ghComp.OnPingDocument()

file_name = "uvFieldFunctions_v2.py"
gh_file_location = ghDoc.FilePath
parent = os.path.dirname(os.path.realpath(gh_file_location))

file_path = os.path.join(parent, file_name)
print file_path

parent = os.path.dirname(os.path.realpath(parent))
parent = os.path.dirname(os.path.realpath(parent))
print parent

# hacky-hacky run-fun
execfile(file_path)
# ---------- end uvfieldmanipulation_v2 ----------
crv = Curve(uvfieldmanipulation.isocurves_u)
brep = Brep(uvfieldmanipulation.surface)
pt = Point(uvfieldmanipulation.point_list)
pt_2 = Point(uvfieldmanipulation.pts)
crv_2 = Curve(uvfieldmanipulation_v2.isocurves_u)
brep_2 = Brep(uvfieldmanipulation_v2.surface)
pt_3 = Point(uvfieldmanipulation_v2.point_list)
pt_4 = Point(uvfieldmanipulation_v2.pts)
sdivide = DivideSurface(Surface=brep, UCount=10, VCount=10)  # -> Points, Normals, Parameters
len = Length(Curve=crv_2)
sdivide_2 = DivideSurface(Surface=brep_2, UCount=10, VCount=10)  # -> Points, Normals, Parameters
item = ListItem(List=pt, Index=Slider(410, range=10..2000), Wrap=True)
item_2 = ListItem(List=pt_3, Index=Slider(410, range=10..2000), Wrap=True)
pt_5 = Point(item)
pt_6 = Point(item_2)
panel = Panel(uvfieldmanipulation_v2.out)
