# Grasshopper definition manual_ordering_script.gh (Grasshopper 1.0.4)

# ---- group: guide lines for closing naked edge of the surface
crv = Curve([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])

# ---- group: guide lines controlling dowel direction on the seam
crv_2 = Curve([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])

# ---- group: key stone points
pt = Point(Point(-2569.861777, -5064.998381, 1355.232696))

# ---- group: imput a group of surfaces which have same subdivision
srf = Surface([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])

# ----
u = Slider(0, range=0..100)
v = Slider(0, range=0..1100)
number_slider = Slider(40, range=0..100)
number_slider_2 = Slider(50, range=0..100)
# Step 01: get beam crvs, beam planes,
# dowel crvs within the surface
preview = CustomPreview(
    Geometry=graft(srf),
    Material=Tree({0}: [{diffuse=RGB(255, 0, 0), emission=RGB(66, 48, 66), shine=0.5, specular=RGB(255, 255, 255), transparency=0.7}], {1}: [{diffuse=RGB(255, 215, 0), emission=RGB(76, 76, 76), shine=0.5, specular=RGB(255, 255, 255), transparency=0.7}], {2}: [{diffuse=RGB(173, 255, 47), emission=RGB(76, 76, 76), shine=0.5, specular=RGB(255, 255, 255), transparency=0.7}], {3}: [{diffuse=RGB(0, 255, 255), emission=RGB(76, 76, 76), shine=0.5, specular=RGB(255, 255, 255), transparency=0.7}], {4}: [{diffuse=RGB(148, 0, 211), emission=RGB(76, 76, 76), shine=0.5, specular=RGB(255, 255, 255), transparency=0.7}], {5}: [{diffuse=RGB(255, 20, 147), emission=RGB(76, 76, 76), shine=0.5, specular=RGB(255, 255, 255), transparency=0.7}]))
uvn = UVN(srf=srf)

# ---- group: generate beam crv & beam plane & dowel crv
beam_on_v_crv_with_regrading = GhPythonScript(
    srf=srf,
    seam_crvs=crv_2,
    edge_crvs=crv,
    u_count=Slider(2, range=0..10),
    v_count=Slider(5, range=0..20),
    rebuild_srf=Toggle(True),
    beam_shift=Slider(0.33, range=0..1),
    curvature_factor_u=u,
    curvature_factor_v=v,
    offset_x=number_slider,
    offset_y=number_slider_2)  # -> out, beam_curves, beam_planes, dowel_crvs, assembly_beam_crvs, assembly_beam_plns, temp; inputs srf: Surface, seam_crvs: list of Curve, edge_crvs: list of Curve, u_count: Int32, v_count: Int32, rebuild_srf: Boolean
# ---------- beam_on_v_crv_with_regrading: Python ----------
__author__ = "Wenqian"
__version__ = "2019.02.03"


import Rhino.Geometry as rg
import scriptcontext as sc
import math as ma
import rhinoscriptsyntax as rs
import copy

u_count
v_count

class BeamNet(object):
    """
    generate beam crvs from a srf
    """
    def __init__(self,srf,rebuild_srf,beam_shift,curvature_factor_u,curvature_factor_v,offset_x,offset_y,seam_crv,seam_side,edge_side):
        """
        Attributes:
        srf
        """
        self.srf = srf
        self.c_factor_u = curvature_factor_u*1000
        self.c_factor_v = curvature_factor_v*10000
        self.u_shift = beam_shift
        self.offset_x = offset_x
        self.offset_y = offset_y
        
        # get beams
        self.u_crvs = []
        self.v_crvs = []
        self.beam_crvs = []#nested
        self.beam_planes = []#nested
        self.get_uv()
        self.u_crvs = self.redraw_u_crvs_based_on_curvature()#apply if want to adjust beam length due to curvature
        self.get_beam()
        
        # get dowels
        # specially deal with seam situation and edge situation
        self.seam_crv_temp = seam_crv #it's a list
        self.seam_side = seam_side #it's a list
        self.seam_flag = False
        self.seam_row_index = []
        self.seam_crv = []
        if len(self.seam_side) != 0:
            self.seam_flag = True
            for crv, side in zip(self.seam_crv_temp,self.seam_side):
                if side == 0:
                    self.seam_row_index.append(0)
                    self.seam_crv.append(crv)
                if side == 1:
                    self.seam_row_index.append(len(self.beam_crvs)-1)
                    self.seam_crv.append(crv)
        
        self.edge_side = edge_side #it's a list
        self.edge_flag = False
        self.edge_row_index = [] 
        if len(self.edge_side) != 0:
            self.edge_flag = True
            for side in self.edge_side:
                if side == 0:
                    self.edge_row_index.append(0)
                if side == 1:
                    self.edge_row_index.append(len(self.beam_crvs)-1)
        self.end_dowel_crvs = []#flattened
        self.get_triple_connections()
        if self.seam_flag:
            self.get_seam_connections()

    def get_uv(self):
        
        # get u_count
        total_length= 0
        for i in range(6):
            total_length += self.srf.IsoCurve(1, 0.2 * i).GetLength()
        self.u_count = u_count
        self.beam_length = total_length/6/u_count

        # get v_count
        total_length= 0
        for i in range(6):
            total_length += self.srf.IsoCurve(0, 0.2 * i).GetLength()
        self.v_count = v_count
        self.dowel_length = total_length/6/v_count

        # get v_crvs
        for v in range(self.v_count+1):
            v_crv = self.srf.IsoCurve(1,v/self.v_count)
            if rebuild_srf:
                v_crv = v_crv.Rebuild(50,3,True)
            self.v_crvs.append(v_crv)

        # get u_crvs
        for u in range(self.u_count+1):
            u_crv = self.srf.IsoCurve(0,u/self.u_count)
            if rebuild_srf:
                u_crv = u_crv.Rebuild(50,3,True)
            self.u_crvs.append(u_crv)

    def regrading(self, crvs, count,factor):
        #regrading crvs based on curvature
        crvs_new_params = []#nested
        current_points_nested = []#nested
        for curves in crvs:
            curve_domain = curves.Domain
            curve_domain_length = curve_domain[1] - curve_domain[0]
             
            range_value = curve_domain_length /count 
            domain_list = []
            temp_vector_length_list = []
            for i in range (count + 1):
                local_t = i * range_value
                domain_list.append(local_t)
                local_curvature_vec = rg.Vector3d(curves.CurvatureAt(local_t))
                vector_length = local_curvature_vec.Length
                temp_vector_length_list.append(vector_length)
            
            
            temp_vector_length_partial_sums = []
            temp_point_list = []
            c = 0
            previous_value = 0
            for local_vec_l in (temp_vector_length_list):
                x_value = domain_list[c]
                y_value = previous_value * factor
                local_pt = rg.Point3d(x_value, y_value, 0)
                temp_point_list.append(local_pt)
                temp_vector_length_partial_sums.append(previous_value)
                previous_value += local_vec_l
                c += 1
             
            curvature_crv = rg.Curve.CreateControlPointCurve(temp_point_list, 10)
            temp_points_curvature_crv = curvature_crv.DivideByCount(count, True)
            t_vals = [curvature_crv.PointAt(pt).X for pt in temp_points_curvature_crv]
            current_points = [curves.PointAt(t_val) for t_val in t_vals]
            current_points_nested.append(current_points)
            crvs_new_params.append(t_vals)
        return crvs_new_params, current_points_nested

    def flip_matrix(self, nested_list):
        #flip data in a nested list
        flipped_nested_list = []
        for i in range(len(nested_list[0])):
            new_list = []
            for j in range(len(nested_list)):
                new_list.append(nested_list[j][i])
            flipped_nested_list.append(new_list)
        return flipped_nested_list

    def redraw_u_crvs_based_on_curvature(self):
        pts_on_v_crvs = self.regrading(self.v_crvs,self.u_count,self.c_factor_v)[1] #regrading beam length based on curvatur
        pts_on_u_crvs = self.flip_matrix(pts_on_v_crvs)
        u_crvs_redraw = []
        for pts in pts_on_u_crvs:
            new_u_crv = rg.Curve.CreateControlPointCurve(pts,10)
            u_crvs_redraw.append(new_u_crv.Rebuild(100,3,True))
        return u_crvs_redraw

    def get_plane(self,crv):
        #get planes for beam crvs
        center_pt = crv.PointAt(0.5)
        norm = self.srf.NormalAt(self.srf.ClosestPoint(center_pt)[1],self.srf.ClosestPoint(center_pt)[2])
        xDirection = crv.PointAt(1) - crv.PointAt(0)
        return rg.Plane(center_pt, xDirection,norm)

    def get_beam(self):
        #get beam crvs and planes on v crvs
        u_crvs_new_params = self.regrading(self.u_crvs,self.v_count,self.c_factor_u)[0] #regrading beam position based on curvature
        
        for c in range(self.u_count):
            line_start_params = u_crvs_new_params[c]
            line_end_params = u_crvs_new_params[c+1]
            beam_crvs = []
            beam_planes = []
            for i,p in enumerate(line_start_params[:-1]):
                line_start_pts=[]
                line_end_pts = []
                line_start_pt=self.u_crvs[c].PointAt(p+(line_start_params[i+1]-p)*self.u_shift*(c%2+1)) 
                line_end_pt=self.u_crvs[c+1].PointAt(p+(line_end_params[i+1]-p)*self.u_shift*(c%2+1))
                beam_crv = rg.Line(line_start_pt,line_end_pt)
                beam_crvs.append(beam_crv)
                beam_planes.append(self.get_plane(beam_crv))
                    
            self.beam_crvs.append(beam_crvs)
            self.beam_planes.append(beam_planes)

    def get_rotate_connection_points(self,pt,plane):
        # generate 4 cross points around an anchor point on beam
        plane.XAxis.Unitize()
        plane.YAxis.Unitize()
        p0 = rg.Point3d.Add(pt,plane.YAxis*self.offset_y)
        p1 = rg.Point3d.Add(pt,plane.XAxis*self.offset_x)
        p2 = rg.Point3d.Add(pt,plane.YAxis*-self.offset_y)
        p3 = rg.Point3d.Add(pt,plane.XAxis*-self.offset_x)
        return p0,p1,p2,p3

    def get_a_single_dowel_end_connection(self, crv_top, plane_top, flag_top, crv_bottom, plane_bottom, flag_bottom):
        pts_top = self.get_rotate_connection_points(crv_top.PointAt(flag_top),plane_top)
        pts_down = self.get_rotate_connection_points(crv_bottom.PointAt(flag_bottom),plane_bottom)
        if flag_top == 1:
            return rg.Line(pts_top[3],pts_down[2])
        else:
            return rg.Line(pts_top[1],pts_down[0])

    def add_edge_dowel(self, top_crv, top_pln, top_flag, bottom_crv, bottom_pln, bottom_flag):
        # add an extra dowel if the beam is on a naked edge
        beam_top_flip = copy.deepcopy(top_crv)
        beam_top_flip.Flip()
        beam_top_flip = rg.Line(beam_top_flip.PointAtLength(30),beam_top_flip.PointAtLength(beam_top_flip.Length-30))
        beam_bottom_flip = copy.deepcopy(bottom_crv)
        beam_bottom_flip.Flip()
        beam_bottom_flip = rg.Line(beam_bottom_flip.PointAtLength(30),beam_bottom_flip.PointAtLength(beam_bottom_flip.Length-30))
        return self.get_a_single_dowel_end_connection(beam_top_flip,top_pln,top_flag,beam_bottom_flip,bottom_pln,bottom_flag)

    def get_triple_connections(self):
        j = 0
        for crvs,planes in zip(self.beam_crvs,self.beam_planes):
            # generate connections in each u rows
            beams_top = crvs[:-1]
            planes_top = planes[:-1]
            beams_bottom = crvs[1:]
            planes_bottom = planes[1:]
                
            # for the seam row, get dowels on only inner side end of the beam
            if j in self.seam_row_index:
                for index in self.seam_row_index:
                    if j == index:
                        if j == 0:
                            for i in range(len(beams_top)):
                                self.end_dowel_crvs.append(self.get_a_single_dowel_end_connection(beams_top[i],planes_top[i],1,beams_bottom[i],planes_top[i],1))
                        elif j == len(self.beam_crvs)-1:
                            for i in range(len(beams_top)):
                                self.end_dowel_crvs.append(self.get_a_single_dowel_end_connection(beams_top[i],planes_top[i],0,beams_bottom[i],planes_top[i],0))
            # for other rows, get dowels on both ends of the beam
            else:
                for i in range(len(beams_top)):
                    self.end_dowel_crvs.append(self.get_a_single_dowel_end_connection(beams_top[i],planes_top[i],0,beams_bottom[i],planes_top[i],0))
                    self.end_dowel_crvs.append(self.get_a_single_dowel_end_connection(beams_top[i],planes_top[i],1,beams_bottom[i],planes_top[i],1))
                    
            # for edge row if there is any
            if j in self.edge_row_index:
                for index in self.edge_row_index:
                    if j == index:
                        if j == 0:
                            for i in range(len(beams_top)):
                                self.end_dowel_crvs.append(self.add_edge_dowel(beams_top[i],planes_top[i],1,beams_bottom[i],planes_top[i],1))
                        elif j ==len(self.beam_crvs)-1:
                            for i in range(len(beams_top)):
                                self.end_dowel_crvs.append(self.add_edge_dowel(beams_top[i],planes_top[i],0,beams_bottom[i],planes_top[i],0))
            j += 1

    def get_seam_connections(self):
        # get the edge to be seam connected
        for i in range(len(self.seam_side)):
            crvs = copy.deepcopy(self.beam_crvs[self.seam_row_index[i]])
            plns = copy.deepcopy(self.beam_planes[self.seam_row_index[i]])
            # detect if reverse dowel direction
            if self.seam_crv[i].ClosestPoint(crvs[0].PointAt(0),20000)[1]>self.seam_crv[i].ClosestPoint(crvs[-1].PointAt(0),20000)[1]:
                crvs.reverse()
                plns.reverse()
                plns_flip = [rg.Plane(pln.Origin,pln.XAxis,pln.YAxis*-1) for pln in plns]
                plns = plns_flip
            # generate connections
            beams_top = crvs[:-1]
            planes_top = plns[:-1]
            beams_bottom = crvs[1:]
            planes_bottom = plns[1:] 
            for j in range(len(beams_top)):
                self.end_dowel_crvs.append(self.get_a_single_dowel_end_connection(beams_top[j],planes_top[j],self.seam_side[i],beams_bottom[j],planes_top[j],self.seam_side[i]))


# get surface edge to define special situations
srf.SetDomain(0, rg.Interval(0,1)) 
srf.SetDomain(1, rg.Interval(0,1))

u_0_crv = srf.IsoCurve(0,0)
u_0_crv.Domain = rg.Interval(0,1)
test_pt_0 = u_0_crv.PointAt(0.5)

u_1_crv = srf.IsoCurve(0,1)
u_1_crv.Domain = rg.Interval(0,1)
test_pt_1 = u_1_crv.PointAt(0.5)

# detect seam crv as guide line for seam dowel connection
seam_crv = []
seam_side = []
for c in seam_crvs:
    if c.ClosestPoint(test_pt_0,100)[0]:
        seam_crv.append(c)
        seam_side.append(0)
    if c.ClosestPoint(test_pt_1,100)[0]:
        seam_crv.append(c)
        seam_side.append(1)

# detect edge crv as guide line for edge dowel connection
edge_side = []
for c in edge_crvs:
    if c.ClosestPoint(test_pt_0,100)[0]:
        edge_side.append(0)
    if c.ClosestPoint(test_pt_1,100)[0]:
        edge_side.append(1)

# get beam net
test_beams = BeamNet(srf,rebuild_srf,beam_shift,curvature_factor_u,curvature_factor_v,offset_x,offset_y,seam_crv,seam_side,edge_side)

# output
beam_curves = []
for crvs in test_beams.beam_crvs:
    beam_curves.extend(crvs)

beam_planes = []
for planes in test_beams.beam_planes:
    beam_planes.extend(planes)

dowel_crvs = []
dowel_crvs.extend(test_beams.end_dowel_crvs)

assembly_beam_crvs=[]
assembly_beam_crvs.extend(test_beams.flip_matrix(test_beams.beam_crvs)[0])
assembly_beam_crvs.extend(test_beams.flip_matrix(test_beams.beam_crvs)[-1])

assembly_beam_plns=[]
assembly_beam_plns.extend(test_beams.flip_matrix(test_beams.beam_planes)[0])
assembly_beam_plns.extend(test_beams.flip_matrix(test_beams.beam_planes)[-1])

temp = ['beam average length:',test_beams.beam_length,'dowl average lengh:',test_beams.dowel_length]
# ---------- end beam_on_v_crv_with_regrading ----------

# ----
estimated_beam_length_dowel_length = Panel(beam_on_v_crv_with_regrading.temp)

# ---- group: output for a srf group
# Step 02: get output from each surface group,
# save the data for each group seperately
beam_crvs = Geometry(beam_on_v_crv_with_regrading.beam_curves)
beam_plns = Geometry(beam_on_v_crv_with_regrading.beam_planes)
dowel_crvs = Geometry(beam_on_v_crv_with_regrading.dowel_crvs)
assembly_beam_crv = Geometry(flatten(beam_on_v_crv_with_regrading.assembly_beam_crvs))
assembly_beam_pln = Geometry(flatten(beam_on_v_crv_with_regrading.assembly_beam_plns))

# ----
lng = ListLength(List=flatten(dowel_crvs))
lng_2 = ListLength(List=flatten(beam_crvs))
panel = Panel(lng)
panel_2 = Panel(lng_2)
# Step 03:  merge data from surface groups,
# get dowels at the assembly edge and key stone
merged_beam_crvs_at_assembly_gap = Geometry(flatten(assembly_beam_crv))
merged_beam_plns_at_assembly_gap = Geometry(flatten(assembly_beam_pln))

# ---- group: get dowels at assembly edges between surfaces
dowels_for_assembly = GhPythonScript(
    beam_crvs=merged_beam_crvs_at_assembly_gap,
    beam_planes=merged_beam_plns_at_assembly_gap,
    beam_gap=Slider(480, range=0..1000),
    offset_x=number_slider,
    offset_y=number_slider_2,
    seam_crvs=crv_2,
    edge_crvs=crv,
    key_stone_pts=pt)  # -> out, dowel_crvs, temp; inputs beam_crvs: list of Line, beam_planes: list of Plane, seam_crvs: list of Curve, edge_crvs: list of Curve, key_stone_pts: list of Point3d
# ---------- dowels_for_assembly: Python ----------
__author__ = "Wenqian"
__version__ = "2019.02.03"

import rhinoscriptsyntax as rs
import Rhino.Geometry as rg
import copy


class SeamBeam(object):
    ### seam beams for assembly connections
    
    def __init__(self, crv, plane, edge_flag, edge_side, seam_flag, seam_side, seam_crv, key_stone_flag, key_stone_side):
        self.o_p = plane
        self.crv = crv
        self.edge_flag = edge_flag
        self.edge_side = edge_side
        self.seam_flag = seam_flag
        self.seam_side = seam_side
        self.seam_crv = seam_crv
        self.k_s_flag = key_stone_flag
        self.k_s_side = key_stone_side
        
        self.dowel_crvs = []
        self.match_flag = False

    def get_rotate_connection_points(self,pt,plane):
        # generate 4 cross points around an anchor point on beam
        plane.XAxis.Unitize()
        plane.YAxis.Unitize()
        p0 = rg.Point3d.Add(pt,plane.YAxis*offset_y)
        p1 = rg.Point3d.Add(pt,plane.XAxis*offset_x)
        p2 = rg.Point3d.Add(pt,plane.YAxis*-offset_y)
        p3 = rg.Point3d.Add(pt,plane.XAxis*-offset_x)
        return p0,p1,p2,p3
    
    def get_a_single_dowel_end_connection(self, crv_top, plane_top, flag_top, crv_bottom, plane_bottom, flag_bottom):
        # get a dowel between two beams at an end
        pts_top = self.get_rotate_connection_points(crv_top.PointAt(flag_top),plane_top)
        pts_down = self.get_rotate_connection_points(crv_bottom.PointAt(flag_bottom),plane_bottom)
        if flag_top == 1:
            return rg.Line(pts_top[3],pts_down[2])
        else:
            return rg.Line(pts_top[1],pts_down[0])

    def add_edge_dowel(self, top_crv, top_pln, top_flag, bottom_crv, bottom_pln, bottom_flag):
        # add an extra dowel if the beam is on a naked edge
        beam_top_flip = copy.deepcopy(top_crv)
        beam_top_flip.Flip()
        beam_top_flip = rg.Line(beam_top_flip.PointAtLength(30),beam_top_flip.PointAtLength(beam_top_flip.Length-30))
        beam_bottom_flip = copy.deepcopy(bottom_crv)
        beam_bottom_flip.Flip()
        beam_bottom_flip = rg.Line(beam_bottom_flip.PointAtLength(30),beam_bottom_flip.PointAtLength(beam_bottom_flip.Length-30))
        return self.get_a_single_dowel_end_connection(beam_top_flip,top_pln,top_flag,beam_bottom_flip,bottom_pln,bottom_flag)

    def who_is_on_top(self, pln1, pln2):
        # detect which plane is on top
        test_vec = pln1.ZAxis
        test_vec.Unitize()
        test_dist = abs(pln1.Origin.DistanceTo(pln2.Origin))
        test_pt = rg.Point3d.Add(pln1.Origin, test_vec*test_dist)
        if test_pt.DistanceTo(pln2.Origin) < pln1.Origin.DistanceTo(pln2.Origin):
            return True
        else:
            return False

    def find_mate(self, other_beam):
        # detect if the two beams should be connected
        d0 = self.crv.PointAt(0).DistanceTo(other_beam.crv.PointAt(0))
        d1 = self.crv.PointAt(1).DistanceTo(other_beam.crv.PointAt(1))
        vec_1 = self.o_p.ZAxis
        if self.who_is_on_top(self.o_p, other_beam.o_p):
            vec_2 = rg.Point3d.Subtract(other_beam.crv.PointAt(0.5),self.crv.PointAt(0.5))
        else:
            vec_2 = rg.Point3d.Subtract(self.crv.PointAt(0.5),other_beam.crv.PointAt(0.5))
            
        if d0 < beam_gap and d1 < beam_gap and rg.Vector3d.VectorAngle(vec_1,vec_2) < 0.7:
            self.match_flag = True # if find a match, break loop

    def match(self, other_beam):
        # detect if on seam
        if self.seam_flag:
            self.dowel_crvs.append(self.get_a_single_dowel_end_connection(self.crv, self.o_p, (self.seam_side+1)%2, other_beam.crv, other_beam.o_p, (other_beam.seam_side+1)%2))
            # detect if on key stone
            if self.k_s_flag:
                # this connection is very sensitive. should adjust the number carefully
                pt_start = self.crv.PointAtLength(-20)
                vec_v_start = self.o_p.YAxis
                vec_v_start.Unitize()
                pt_start = rg.Point3d.Add(pt_start, vec_v_start*-50)
                
                pt_end = other_beam.crv.PointAtLength(-20)
                vec_v = other_beam.o_p.YAxis
                vec_v.Unitize()
                pt_end = rg.Point3d.Add(pt_end, vec_v*50)
                self.dowel_crvs.append(rg.Line(pt_start, pt_end))
            else:
                self.get_seam_connection(self.seam_crv, self.crv, self.o_p, self.seam_side, other_beam.seam_crv, other_beam.crv, other_beam.o_p, other_beam.seam_side)
        else:
            self.dowel_crvs.append(self.get_a_single_dowel_end_connection(self.crv, self.o_p, 0, other_beam.crv, other_beam.o_p, 0))
            self.dowel_crvs.append(self.get_a_single_dowel_end_connection(self.crv, self.o_p, 1, other_beam.crv, other_beam.o_p, 1))
            # detect if on edge
            if self.edge_flag:
                self.dowel_crvs.append(self.add_edge_dowel(self.crv, self.o_p,(self.edge_side+1)%2,other_beam.crv, other_beam.o_p,(other_beam.edge_side+1)%2))

    def get_seam_connection(self, seam_crv_top, crv_top, plane_top, flag_top, seam_crv_bottom, crv_bottom, plane_bottom, flag_bottom):
        # detect if reverse dowel direction
        crv_top_temp = copy.deepcopy(crv_top)
        pln_top_temp = copy.deepcopy(plane_top)
        crv_bottom_temp = copy.deepcopy(crv_bottom)
        pln_bottom_temp = copy.deepcopy(plane_bottom)
        if seam_crv_top.ClosestPoint(crv_top_temp.PointAt(flag_top),2000)[1]<seam_crv_bottom.ClosestPoint(crv_bottom_temp.PointAt(flag_bottom),2000)[1]:
            pln_top_flip = rg.Plane(pln_top_temp.Origin,pln_top_temp.XAxis,pln_top_temp.YAxis*-1)
            pln_bottom_flip = rg.Plane(pln_bottom_temp.Origin,pln_bottom_temp.XAxis,pln_bottom_temp.YAxis*-1)
            self.dowel_crvs.append(self.get_a_single_dowel_end_connection(crv_bottom_temp, pln_bottom_flip, flag_bottom, crv_top_temp, pln_top_flip, flag_top))
        else:
            self.dowel_crvs.append(self.get_a_single_dowel_end_connection(crv_top, plane_top, flag_top, crv_bottom, plane_bottom, flag_bottom))


dowel_crvs = []

# get seam beams
seam_beams = []
for c,p in zip(beam_crvs, beam_planes):
    # detect if it is on the naked edge
    edge_flag = False
    edge_side = 0
    for edge_crv in edge_crvs:
        if edge_crv.ClosestPoint(c.PointAt(0),100)[0]:
            edge_flag = True
            edge_side = 0
        elif edge_crv.ClosestPoint(c.PointAt(1),100)[0]:
            edge_flag = True
            edge_side = 1
            
    # detect if it is on the connection seam 
    seam_flag = False
    seam_side = 0
    for crv in seam_crvs:
        crv.Domain = rg.Interval(0,1)
        if c.PointAt(0).DistanceTo(crv.PointAt(crv.ClosestPoint(c.PointAt(0),50)[1])) < 20:
            print c.PointAt(0).DistanceTo(crv.PointAt(crv.ClosestPoint(c.PointAt(0),50)[1]))
            print crv.ClosestPoint(c.PointAt(0),50)[1]
            seam_flag = True
            seam_side = 0
            seam_crv = crv
        elif c.PointAt(1).DistanceTo(crv.PointAt(crv.ClosestPoint(c.PointAt(1),50)[1])) < 20:
            seam_flag = True
            seam_side = 1
            seam_crv = crv
            
    # detect key stone points
    key_stone_flag = False
    key_stone_side = 0
    for pt in key_stone_pts:
        if c.PointAt(0).DistanceTo(pt) < 300:
            key_stone_flag = True
            key_stones_side = 0
        elif c.PointAt(1).DistanceTo(pt) < 300:
            key_stone_flag = True
            key_stones_side = 1
        
        
    seam_beams.append(SeamBeam(c,p,edge_flag,edge_side,seam_flag,seam_side,seam_crv,key_stone_flag,key_stone_side))

# detect matching beams
for s_b_top in seam_beams:
    for s_b_bottom in seam_beams:
        if s_b_top.crv <> s_b_bottom.crv:
            s_b_top.find_mate(s_b_bottom)
            if s_b_top.match_flag:
                if s_b_top.who_is_on_top(s_b_top.o_p, s_b_bottom.o_p):
                    s_b_top.match(s_b_bottom)
                    dowel_crvs.extend(s_b_top.dowel_crvs)
                else:
                    s_b_bottom.match(s_b_top)
                    dowel_crvs.extend(s_b_bottom.dowel_crvs)
                seam_beams.remove(s_b_bottom)
                break
# ---------- end dowels_for_assembly ----------

# ----
dowel_crvs_at_gap = Geometry(flatten(dowels_for_assembly.dowel_crvs))

# ---- group: merged data from all surface groups
merged_dowel_crvs = Geometry(flatten([dowel_crvs, dowel_crvs_at_gap]))
# Step 04: merge data from surface groups, from assembly edge & key stone spots,
# prepare for fabrication (TBC)
merged_beam_crvs = Geometry(beam_crvs)
merged_beam_plns = Geometry(beam_plns)

# ----
lng_3 = ListLength(List=flatten(merged_beam_crvs))
lng_4 = ListLength(List=flatten(merged_dowel_crvs))
panel_3 = Panel(lng_3)
panel_4 = Panel(lng_4)
python = GhPythonScript(dowel_crv=merged_dowel_crvs, radius=Slider(12, range=0..100))  # -> out, dowel, dowel_brep; inputs dowel_crv: Line
# ---------- python: Python ----------
__author__ = "ytakzk"
__version__ = "2019.02.22"

from geometry.dowel import Dowel
import Rhino.Geometry as rg

#center = dowel_crv.PointAt(0.5)
#
#normal = rg.Vector3d(dowel_crv.PointAt(1.0)) - rg.Vector3d(dowel_crv.PointAt(0.0))
#
#plane = rg.Plane(center, normal)

dowel = Dowel(line=dowel_crv, dowel_radius=radius)
dowel_brep = dowel.brep_representation().ToBrep(True, True)
# ---------- end python ----------
points = PointList(Points=flatten(merged_beam_plns), Size=Slider(100, range=0..100))
geo = Geometry(python.dowel_brep)
get_geo = PythonScript(
    beam_plane=merged_beam_plns,
    beam_crv=merged_beam_crvs,
    dowels=python.dowel,
    dowel_breps=python.dowel_brep,
    end_extension=Slider(60, range=0..150))  # -> out, beam, beam_geo; inputs beam_plane: Plane, beam_crv: Line, dowels: list, dowel_breps: list of Brep
# ---------- get_geo: Python ----------
import Rhino.Geometry as rg
import rhinoscriptsyntax as rs

from geometry.beam import Beam
from geometry.dowel import Dowel

dx = beam_crv.Length + 2 * end_extension
dy = 150
dz = 40

beam = Beam(beam_plane, dx, dy, dz)

beam_geo = rg.Box(beam_plane, rg.Interval(-dx * 0.5, dx * 0.5), \
            rg.Interval(-dy * 0.5, dy * 0.5), \
            rg.Interval(-dz * 0.5, dz * 0.5))

for d, dowel_geo in zip(dowels, dowel_breps):

    intersected, _ = rg.Intersect.Intersection.LineBox(d.line, beam_geo, 1.0)

    if intersected:
        beam.add_dowel(d)

beam_geo = beam.brep_representation()
# ---------- end get_geo ----------
panel_5 = Panel("""19
0
14
5""")
preview_2 = CustomPreview(
    Geometry=get_geo.beam_geo,
    Material={diffuse=RGB(0, 0, 205), emission=RGB(66, 48, 66), shine=0.5, specular=RGB(255, 255, 255), transparency=0.7})
panel_6 = Panel(get_geo.beam)
python_2 = GhPythonScript(beams=flatten(get_geo.beam), sequence_list=panel_5)  # -> out, sequenced_beams, sequenced_beam_planes; inputs beams: list, sequence_list: list of Int32
# ---------- python_2: Python ----------
__author__ = "ytakzk"
__version__ = "2019.02.22"

sequenced_beams = []
sequenced_beam_planes = []

for index in sequence_list:
    
    beam = beams[index]
    sequenced_beams.append(beam)
    sequenced_beam_planes.append(beam.base_plane)
# ---------- end python_2 ----------
panel_7 = Panel(get_geo.beam_geo)
points_2 = PointList(Points=flatten(python_2.sequenced_beam_planes), Size=Slider(100, range=0..100))

# ==== cluster UVN
srf = ClusterInput()
number_slider = Slider(5, range=0..110)
extract_uv_vec = GhPythonScript(srf=srf)  # -> out, center_pt, u_vec, v_vec, normal; inputs srf: Surface
# ---------- extract_uv_vec: Python ----------
__author__ = "Wenqian"
__version__ = "2019.01.22"

import rhinoscriptsyntax as rs
import Rhino.Geometry as rg

srf.SetDomain(0,rg.Interval(0,1))
srf.SetDomain(1,rg.Interval(0,1))

center_pt = srf.PointAt(0.5,0.5)

u_vec = srf.FrameAt(0.5,0.5)[1].XAxis
v_vec = srf.FrameAt(0.5,0.5)[1].YAxis

normal =srf.NormalAt(0.5,0.5)
# ---------- end extract_uv_vec ----------
multiplication = Multiplication(A=extract_uv_vec.v_vec, B=500)
multiplication_2 = Multiplication(A=extract_uv_vec.normal, B=500)
multiplication_3 = Multiplication(A=extract_uv_vec.u_vec, B=500)
vdisex = VectorDisplayEx(
    Point=extract_uv_vec.center_pt,
    Vector=multiplication_3,
    Colour=ColourSwatch(SwatchColor=RGB(255, 0, 0)),
    Width=number_slider)
vdisex_2 = VectorDisplayEx(
    Point=extract_uv_vec.center_pt,
    Vector=multiplication,
    Colour=ColourSwatch(SwatchColor=RGB(33, 220, 0)),
    Width=number_slider)
vdisex_3 = VectorDisplayEx(
    Point=extract_uv_vec.center_pt,
    Vector=multiplication_2,
    Colour=ColourSwatch(SwatchColor=RGB(255, 255, 255)),
    Width=number_slider)
