# Grasshopper definition multiple_seed_growth.gh (Grasshopper 1.0.4)

python = GhPythonScript(RECURSIVE_LIMIT=Slider(9, range=1..12), LENGTH=Slider(5, range=0..10), MERGABLE_DIST=Slider(2, range=0..10))  # -> out, pts, lines; inputs RECURSIVE_LIMIT: Int32
# ---------- python: Python ----------
__author__ = "ytakzk"
__version__ = "2019.02.07"

import Rhino.Geometry as rg
import math
import random

"""
TODO LIST
* make 3d (relatively easy)
* avoid more collision (easy)
* apply this topology to beam & dowel system (difficult?)
"""

class Line(object):
    
    def __init__(self, start, end, depth=1, parent=None):
        
        self.start  = start
        self.end    = end
        self.depth  = depth
        self.parent = parent
        self.merge_with = False
        self.terminate  = False
        self.children = []
        
        if parent:
            parent.add_child(self)

    def add_child(self, child):
        
        self.children.append(child)
    
    def remove_child(self, child):
        
        self.children.remove(child)
    
    def get_vector(self):
        
        return rg.Point3d(self.end) - rg.Point3d(self.start)

    def get_line(self):
        
        return rg.Line(self.start, self.end)
    
    def is_crossed_with_lines(self, lines):
        
        # to see if this line acrosses given lines
        
        for l in lines:
            
            if l.parent == self.parent:
                continue
            
            intersected, v1, v2 = rg.Intersect.Intersection.LineLine(l.get_line(), self.get_line())
            
            if intersected and v1 >= 0 and v1 <= 1 and v2 >= 0 and v2 <= 1:
                return True
        
        return False
        
    def next(self):
        
        """
        get next point(s) to grow
        """
        
        if self.parent and self.parent.terminate:
            
            # terminate
            return []
        
        if self.merge_with:
            
            # merge

            middle_start = (rg.Vector3d(self.start) + rg.Vector3d(self.merge_with.start)) * 0.5
            middle_end   = (rg.Vector3d(self.end) + rg.Vector3d(self.merge_with.end)) * 0.5
            vec = middle_end - middle_start
            vec.Unitize()
            vec *= self.get_vector().Length

            merging_pt = rg.Point3d(rg.Vector3d.Add(middle_end, vec))
            return [merging_pt]
        
        # grow
        vec_1 = self.get_vector()
        vec_2 = rg.Vector3d(vec_1)
        
        # these angles can be seen as constraints to grow
        theta_1 = math.radians(5) + random.random() * math.radians(30)
        theta_2 = -(math.radians(5) + random.random() * math.radians(30))
        
        # this rotation axis also can be seen as constraints to grow
        # also make it 3d easily by incling the rotation axis  
        vec_1.Rotate(theta_1, rg.Plane.WorldXY.Normal)
        vec_2.Rotate(theta_2, rg.Plane.WorldXY.Normal)
        
        next_1 = rg.Point3d.Add(self.end, vec_1)
        next_2 = rg.Point3d.Add(self.end, vec_2)
        
        return [next_1, next_2]
    
    def check_if_mergable(self, line):
        
        """
        if a line crosses across this line, they will be merged
        """
        
        if self.parent == line.parent:
            
            return False
        
        if self.end.DistanceTo(line.end) < MERGABLE_DIST:
            
            self.merge_with = line
            line.merge_with = self
            self.terminate  = True
            
            return True
        
        return False

# create the first line
seed_pt = rg.Point3d(0, 0, 0)
start_pt = rg.Point3d(0, LENGTH, 0)
pts = [seed_pt, start_pt]
line = Line(seed_pt, start_pt, 1, None)

# dictionary to store lines according to the depth
lines_by_depth = {}
for l in range(1, RECURSIVE_LIMIT + 1):
    lines_by_depth[l] = []
lines_by_depth[1].append(line)

# growth function (recursive function called depth by depth)
def grow(parent, recursive=1):
    
    if recursive >= RECURSIVE_LIMIT:
        return []

    recursive += 1
    
    # get line candidates
    children = []
    for end_pt in parent.next():

        child = Line(parent.end, end_pt, recursive, parent)
        children.append(child)
    
    return children

lines = []
for i in range(1, RECURSIVE_LIMIT + 1):
    
    # get lines in a certain depth
    ls = lines_by_depth[i]
    
    siblings = []
    
    for j, l1 in enumerate(ls):
        
        for l2 in ls[j+1:]:
            
            # see if the line would be merged or not
            if l1.check_if_mergable(l2):
                break
        
        children = grow(l1, i)
        
        for c in children:
            
            # if the line candidate crosses across the existing lines in the same depth,
            # won't be added.
            # to avoid collisions in overall structure, pass all the existing lines instead of
            # the lines in the same depth
            if not c.is_crossed_with_lines(siblings):
            
                siblings.append(c)

                c.parent.remove_child(c)
                lines_by_depth[i+1].append(c)
                pts.extend([c.start, c.end])
                
    [lines.append(l.get_line()) for l in ls]
# ---------- end python ----------
