# Grasshopper definition network_external_python.gh (Grasshopper 1.0.4)

number_slider = Slider(1200, range=0..1200)
number_slider_2 = Slider(3, range=0..10)
planesrf = PlaneSurface(Plane=PlaneXY(0, 0, 0), XSize=number_slider, YSize=number_slider)
series = Series(Start=0, Step=number_slider, Count=number_slider_2)
series_2 = Series(Start=0, Step=number_slider, Count=Slider(4, range=0..10))
X = UnitX(Factor=series)
Y = UnitY(Factor=series_2)  # -> graft(UnitVector)
move = Move(Geometry=planesrf, Motion=X)  # -> Geometry, Transform
move_2 = Move(Geometry=move.Geometry, Motion=Y)  # -> flatten(Geometry), Transform
srf = Surface(move_2.Geometry)

# ---- group: in reality, must be done manually
python = GhPythonScript(surfaces=srf, u_num=number_slider_2)  # -> out, organized_surfaces; inputs surfaces: list of Surface, u_num: Int32
# ---------- python: Python ----------
__author__ = "ytakzk"
__version__ = "2019.02.20"

import Rhino.Geometry as rg

organized_surfaces = []

for i, s in enumerate(surfaces):
    
    x = i % u_num
    y = int(i / u_num)
    
    domain = rg.Interval(0, 1)
    
#    if (x + y) % 2 == 1:
#        s = s.Reverse(1)
#        s.SetDomain(1, domain)
#        s = s.Reverse(0)
#        s.SetDomain(0, domain)

    if y % 2 == 1:
#        s = s.Reverse(1)
#        s.SetDomain(1, domain)
        s = s.Reverse(0)
        s.SetDomain(0, domain)
    
    if x == u_num - 1:
        s = s.Reverse(0)
        s.SetDomain(0, domain)
        
    organized_surfaces.append(s)
# ---------- end python ----------

# ----
python_2 = GhPythonScript(toggle=Button())  # -> out, a
# ---------- python_2: Python ----------
__author__ = "ytakzk"
__version__ = "2019.01.21"

import geometry.beam as beam
import geometry.dowel as dowel
import geometry.hole as hole
import geometry.joint_holes as joint_holes

if toggle:
    
    reload(beam)
    reload(dowel)
    reload(hole)
    reload(joint_holes)
# ---------- end python_2 ----------
python_3 = GhPythonScript(surfaces=python.organized_surfaces)  # -> out, label, label_pos, dowels, tmp, beams; inputs surfaces: list of Surface
# ---------- python_3: Python ----------
# snippet of code to make this python component look for it's code in the parent folder of the .gh file

import os

ghComp = ghenv.Component
ghDoc = ghComp.OnPingDocument()

file_name = "SurfaceNetwork.py"
gh_file_location = ghDoc.FilePath
parent = os.path.dirname(os.path.realpath(gh_file_location))

single_parent = os.path.dirname(os.path.realpath(parent))
double_parent = os.path.dirname(os.path.realpath(single_parent))

file_path = os.path.join(double_parent, "UR_Control", "geometry", file_name)
print file_path
# print file_path

# print parent

# hacky-hacky run-fun
execfile(file_path)
# ---------- end python_3 ----------
uvn = UVN(srf=python.organized_surfaces)

# ---- group: old script
python_4 = GhPythonScript()  # -> out, tmp, pt, a; inputs surfaces: list of Surface; disabled
# ---------- python_4: Python ----------
__author__ = "ytakzk"
__version__ = "2019.02.18"

import rhinoscriptsyntax as rs
import Rhino.Geometry as rg
import copy

class Division(object):
    
    def __init__(self):
        
        self.is_overwritten_with = None
        self.id = id(self)
        self.num = 4

a = []
class Network(object):
    
    @staticmethod
    def get_relation(s1, s2):
        
        domain = rg.Interval(0, 1)
        s1.SetDomain(0, domain)
        s1.SetDomain(1, domain)
        s2.SetDomain(0, domain)
        s2.SetDomain(1, domain)
        
        p1_1 = s1.IsoCurve(0, 0).PointAt(0.5)
        p1_2 = s1.IsoCurve(0, 1).PointAt(0.5)
        p1_3 = s1.IsoCurve(1, 0).PointAt(0.5)
        p1_4 = s1.IsoCurve(1, 1).PointAt(0.5)

        p2_1 = s2.IsoCurve(0, 0).PointAt(0.5)
        p2_2 = s2.IsoCurve(0, 1).PointAt(0.5)
        p2_3 = s2.IsoCurve(1, 0).PointAt(0.5)
        p2_4 = s2.IsoCurve(1, 1).PointAt(0.5)
        
        DIST = 50
       
        if p1_1.DistanceTo(p2_1) < DIST or \
           p1_1.DistanceTo(p2_2) < DIST or \
           p1_2.DistanceTo(p2_1) < DIST or \
           p1_2.DistanceTo(p2_2) < DIST:
            
            # u & u =
            return 'u', 'u'

        if p1_3.DistanceTo(p2_3) < DIST or \
           p1_3.DistanceTo(p2_4) < DIST or \
           p1_4.DistanceTo(p2_3) < DIST or \
           p1_4.DistanceTo(p2_4) < DIST:
            
            # v & v ||
            return 'v', 'v'

        if p1_1.DistanceTo(p2_3) < DIST or \
           p1_2.DistanceTo(p2_4) < DIST or \
           p1_1.DistanceTo(p2_3) < DIST or \
           p1_2.DistanceTo(p2_4) < DIST:
            
            # u & v -|
            return 'u', 'v'

        if p1_3.DistanceTo(p2_1) < DIST or \
           p1_4.DistanceTo(p2_2) < DIST or \
           p1_3.DistanceTo(p2_1) < DIST or \
           p1_4.DistanceTo(p2_2) < DIST:
            
            # v & u |-
            return 'v', 'u'
            
        return None
        
    def __init__(self, surfaces):
        
        self.surfaces = [Surface(s) for s in surfaces]
        
        for _ in range(5):
            
            for i, s1 in enumerate(self.surfaces):
            
                for j, s2 in enumerate(self.surfaces):
                
                    if s1 == s2:
                        continue
                
                    rel = Network.get_relation(s1.surface, s2.surface)
                    if rel:
                    
                        v1 = rel[0]
                        v2 = rel[1]
                    
                        if v1 == 'u' and v2 == 'u':
                            
                            s2.u_div = s1.u_div
                            s1.u_neighbors.append(s2)
                            
                        elif v1 == 'u' and v2 == 'v':
                            
                            s2.u_div = s1.v_div
                            s1.u_neighbors.append(s2)
                            
                        elif v1 == 'v' and v2 == 'u':
                            
                            s2.v_div = s1.u_div
                            s1.v_neighbors.append(s2)
                            
                        elif v1 == 'v' and v2 == 'v':
                            
                            s2.v_div = s1.v_div
                            s1.v_neighbors.append(s2)
    
    def orient_direction(self):
        
        for s in self.surfaces:
            
            # TODO: u-v case
            
            flip_u = False
            for u in s.u_neighbors:
                
                if u.flip_u == True:
                    flip_u = False
                    break
                elif u.flip_u == False:
                    flip_u = True
                    break
                    
            flip_v = False
            for v in s.v_neighbors:
                
                if v.flip_v == True:
                    flip_v = False
                    break
                elif v.flip_v == False:
                    flip_v = True
                    break
                    
            if len(s.u_neighbors) == 1:
                s.flip_u = False
            else:
                s.flip_u = flip_u
                
            if len(s.v_neighbors) == 1:
                s.flip_v = False
            else:
                s.flip_v = flip_v
            
        for s in self.surfaces:
            
            if s.flip_u:
                
                s.surface = s.surface.Reverse(0)
            
            if s.flip_v:
                s.surface = s.surface.Reverse(1)

            domain = rg.Interval(0, 1)
            s.surface.SetDomain(0, domain)
            s.surface.SetDomain(1, domain)

    
class Surface(object):
    
    def __init__(self, surface):
        
        self.surface = surface 
        self.u_div = Division()
        self.v_div = Division()
        self.u_neighbors = []
        self.v_neighbors = []
        self.flip_u = None
        self.flip_v = None
    
    def divide(self):
        
        surface = self.surface #self.__offset_sides_surface(50)
        
        global a
        a.append(surface)
        for u in range(self.u_div.num + 1):
            
            for v in range(self.v_div.num):
                
                if (u % 2 == 0 and v % 2 == 1) or (u % 2 == 1 and v % 2 == 0):
                    continue
                
                # TODO
                if u == 0:
                    uu = 0.1
                elif u == self.u_div.num:
                    uu = u - 0.1 
                else:
                    uu = u
                
                p1 = surface.PointAt(uu/self.u_div.num, v/self.v_div.num)
                p2 = surface.PointAt(uu/self.u_div.num, (v+1)/self.v_div.num)
                
                line = rg.Line(p1, p2)
                a.append(line)
                
    def __offset_sides_surface(self, offset_dis=20):
        """ method that returns a slightly shrunk version of the surface along the v direction
            :param offset_dis:       Offset Distance (default 20)
            :return temp_srf:   The trimmed surface
        """
        sampling_count = 25
    
        temp_surface = copy.deepcopy(self.surface)
    
        temp_surface.SetDomain(1, rg.Interval(0, sampling_count - 1))
        temp_isocurves = [temp_surface.IsoCurve(0, v_val) for v_val in range(sampling_count)]
    
        temp_isocurves_shortened = []
    
        for isocurve in temp_isocurves:
            # getting the length and the domain of every isocurve
            length = isocurve.GetLength()
            start_t, end_t = isocurve.Domain[0], isocurve.Domain[1]
            t_delta = end_t - start_t
            t_differential = t_delta / length
            # calculating how much the offset_dis result in t_val change
            t_shift = t_differential * offset_dis
            start_t_new = start_t + t_shift
            end_t_new = end_t - t_shift
            # splitting the curve at those two new start & end points with and taking the middle piece
            new_isocurve = isocurve.Split([start_t_new, end_t_new])[1]
            temp_isocurves_shortened.append(new_isocurve)
    
        # switching the uv direction back to where it should be! -> rebuilding the surface
        point_list = [[] for i in range(sampling_count)]
        for temp_curve in temp_isocurves_shortened:
            length = temp_curve.GetLength()
            start_t, end_t = temp_curve.Domain[0], temp_curve.Domain[1]
            t_delta = end_t - start_t
            t_differential = t_delta / (sampling_count - 1)
            # calculating how much the offset_dis result in t_val change
            point_set = [temp_curve.PointAt(t_val * t_differential + start_t) for t_val in range(0, sampling_count, 1)]
            for i, point in enumerate(point_set):
                point_list[i].append(rg.Point3d(point))
    
        uv_switched_curves = []
        for point_set in point_list:
            local_isocurve = rg.NurbsCurve.Create(False, 3, point_set)
            uv_switched_curves.append(local_isocurve)
    
        # lofting those isocurves
        loft_type = rg.LoftType.Tight
        s = rg.Brep.CreateFromLoftRebuild(uv_switched_curves, rg.Point3d.Unset, rg.Point3d.Unset, loft_type, False, 50)[0]
        # getting the loft as a nurbssurface out of the resulting brep
        print s.Faces.Item[0].ToNurbsSurface()
    
        domain = rg.Interval(0, 1)
        s.SetDomain(0, domain)
        s.SetDomain(1, domain)

        return s

import random
# debug
#random.shuffle(surfaces)

network = Network(surfaces)
network.orient_direction()

tmp = []
pt = []
unique_divisions = [] 
for s in network.surfaces:
    
    unique_divisions.extend([s.u_div, s.v_div])

    string = 'u%d\nv:%d' % (s.u_div.id, s.v_div.id)
    tmp.append(string)
    pt.append(s.surface.PointAt(0.5, 0.5))
    
    
unique_divisions = list(set(unique_divisions))
for d in unique_divisions:
    
    d.num = 5


for s in network.surfaces:
    
    s.divide()
# ---------- end python_4 ----------

# ----
panel = Panel(python_3.out)
geo = Geometry(python_3.dowels)

# ---- group: beams on the edges
geo_2 = Geometry(python_3.tmp)

# ---- group: all beams
geo_3 = Geometry(python_3.beams)

# ----
tag = TextTag(Location=python_3.label_pos, Text=python_3.label)

# ==== cluster UVN
srf = ClusterInput()
number_slider = Slider(3, range=0..110)
extract_uv_vec = GhPythonScript(srf=srf)  # -> out, center_pt, u_vec, v_vec, normal; inputs srf: Surface
# ---------- extract_uv_vec: Python ----------
__author__ = "Wenqian"
__version__ = "2019.01.22"

import rhinoscriptsyntax as rs
import Rhino.Geometry as rg

srf.SetDomain(0,rg.Interval(0,1))
srf.SetDomain(1,rg.Interval(0,1))

center_pt = srf.PointAt(0.5,0.5)

u_vec = srf.FrameAt(0.5,0.5)[1].XAxis
v_vec = srf.FrameAt(0.5,0.5)[1].YAxis

normal =srf.NormalAt(0.5,0.5)
# ---------- end extract_uv_vec ----------
number_slider_2 = Slider(200, range=0..300)
vdisex = VectorDisplayEx(Point=extract_uv_vec.center_pt, Vector=<missing>, Colour=ColourSwatch(SwatchColor=RGB(255, 0, 0)), Width=number_slider)
vdisex_2 = VectorDisplayEx(Point=extract_uv_vec.center_pt, Vector=<missing>, Colour=ColourSwatch(SwatchColor=RGB(33, 220, 0)), Width=number_slider)
vdisex_3 = VectorDisplayEx(
    Point=extract_uv_vec.center_pt,
    Vector=<missing>,
    Colour=ColourSwatch(SwatchColor=RGB(255, 255, 255)),
    Width=number_slider)
