# Grasshopper definition surface_mapping_network.gh (Grasshopper 1.0.4)

number_slider = Slider(1200, range=0..1200)
number_slider_2 = Slider(3, range=0..10)
planesrf = PlaneSurface(Plane=PlaneXY(0, 0, 0), XSize=number_slider, YSize=number_slider)
series = Series(Start=0, Step=number_slider, Count=number_slider_2)
series_2 = Series(Start=0, Step=number_slider, Count=Slider(4, range=0..10))
X = UnitX(Factor=series)
Y = UnitY(Factor=series_2)  # -> graft(UnitVector)
move = Move(Geometry=planesrf, Motion=X)  # -> Geometry, Transform
move_2 = Move(Geometry=move.Geometry, Motion=Y)  # -> flatten(Geometry), Transform
srf = Surface(move_2.Geometry)

# ---- group: in reality, must be done manually
python = GhPythonScript(surfaces=srf, u_num=number_slider_2)  # -> out, organized_surfaces; inputs surfaces: list of Surface, u_num: Int32
# ---------- python: Python ----------
__author__ = "ytakzk"
__version__ = "2019.02.20"

import Rhino.Geometry as rg

organized_surfaces = []

for i, s in enumerate(surfaces):
    
    x = i % u_num
    y = int(i / u_num)
    
    domain = rg.Interval(0, 1)
    
#    if (x + y) % 2 == 1:
#        s = s.Reverse(1)
#        s.SetDomain(1, domain)
#        s = s.Reverse(0)
#        s.SetDomain(0, domain)

    if y % 2 == 1:
#        s = s.Reverse(1)
#        s.SetDomain(1, domain)
        s = s.Reverse(0)
        s.SetDomain(0, domain)
    
    if x == u_num - 1:
        s = s.Reverse(0)
        s.SetDomain(0, domain)
        
    organized_surfaces.append(s)
# ---------- end python ----------

# ----
python_2 = GhPythonScript(surfaces=python.organized_surfaces)  # -> out, label, label_pos, tmp, beams, dowels; inputs surfaces: list of Surface
# ---------- python_2: Python ----------
__author__ = "ytakzk"
__version__ = "2019.02.18"

import sys
import random
import rhinoscriptsyntax as rs
import Rhino.Geometry as rg
import copy
import math

dowels = []

# import geometry.beam as Beam
from geometry.joint_holes import JointHoles
#
from geometry.beam import Beam
from itertools import chain

def weave_lists(lhs, rhs):

    if len(lhs) < len(rhs):
        lhs, rhs = rhs, lhs

    weaved_list = []
    i = 0
    while i < len(lhs):

        if i < len(lhs):
            weaved_list.append(lhs[i])

        if i < len(rhs):
            weaved_list.append(rhs[i])
        i += 1
    return weaved_list

tmp = []

# definition of U and V
class Direction(object):

    def __init__(self, direction):

        self.direction = direction

U = Direction('u')
V = Direction('v')

# definition of U0, U1, V0, V1 as the edges of surfaces
class Edge(object):

    def __init__(self, direction, value):

        self.direction = direction
        self.value = value

U0 = Edge(U, 0)
U1 = Edge(U, 1)
V0 = Edge(V, 0)
V1 = Edge(V, 1)

# definition of the edge between two surfaces to store how they are linked each other
class SharedEdge(object):

    def __init__(self, surface_1, surface_2, edge_1, edge_2):

        self.surface_1 = surface_1
        self.surface_2 = surface_2
        self.edge_1 = edge_1
        self.edge_2 = edge_2
        self.dowels_placed = False

    def get_beams(self):

        return self.__get_beams(self.surface_1, self.edge_1), \
               self.__get_beams(self.surface_2, self.edge_2)

    def is_same_direction(self):

        if self.edge_1.direction != self.edge_2.direction:

            return False

        curve_1 = self.surface_1.surface.IsoCurve(1 if self.edge_1.direction == U else 0, self.edge_1.value)
        p1_1  = curve_1.PointAt(0.0)
        p1_2  = curve_1.PointAt(1.0)
        vec_1 = rg.Vector3d(p1_2) - rg.Vector3d(p1_1)

        curve_2 = self.surface_2.surface.IsoCurve(1 if self.edge_2.direction == U else 0, self.edge_2.value)
        p2_1 = curve_2.PointAt(0.0)
        p2_2 = curve_2.PointAt(1.0)
        vec_2 = rg.Vector3d(p2_2) - rg.Vector3d(p2_1)

        return rg.Vector3d.VectorAngle(vec_1, vec_2) < math.pi * 0.5

    def __get_beams(self, surface, edge):

        if edge == V0:

            return [b[0] for i, b in enumerate(surface.beams) if i % 2 == 0]

        elif edge == V1:

            return [b[-1] for i, b in enumerate(surface.beams) if i % 2 == 0]

        elif edge == U0:

            return surface.beams[0], surface.beams[1]

        elif edge == U1:

            return surface.beams[-2], surface.beams[-1]

        else:

            ValueError('edge direction is not a correct value')

# definition of division
class Division(object):

    def __init__(self):

        self.id = id(self)
        self.num = 0
        self.shared_edges = []
        self.network_surfaces = []

    def add_shared_edge(self, shared_edge):

        self.shared_edges.append(shared_edge)
        self.shared_edges = list(set(self.shared_edges))

    def determine_num(self):

        # must be an odd number?
        self.num = 3 if self.get_direction() == V else 7
    
    def get_direction(self):
        
        u_num, v_num = 0, 0

        for e in self.shared_edges:

            if e.edge_1.direction == U:

                u_num += 1

            else:

                v_num += 1

        return U if u_num > v_num else V
    
    def setup_network(self):
        
        direction = self.get_direction()
        
        if direction == U:
            
            return
        
        surface_pairs_dic = {}
        
        for shared_edge in self.shared_edges:
            
            if shared_edge.edge_1.value == 1 and shared_edge.edge_2.value == 0:
                
                surface_pairs_dic[shared_edge.surface_2] = [shared_edge.surface_1, shared_edge.surface_2]
            
            elif shared_edge.edge_1.value == 0 and shared_edge.edge_2.value == 1:
                
                surface_pairs_dic[shared_edge.surface_1] = [shared_edge.surface_2, shared_edge.surface_1]
            
            else:
                
                ValueError('Unexisting pair')
        
        keys = surface_pairs_dic.keys()
        
        network_surfaces = []

        # find the first surface
        for _, (bottom, top) in surface_pairs_dic.iteritems():
            
            if not bottom in keys:
                
                network_surfaces.extend([bottom, top])
                del surface_pairs_dic[top]
                break

        while surface_pairs_dic:
            
            last_surface = network_surfaces[-1]
            
            for _, (bottom, top) in surface_pairs_dic.iteritems():
                
                if bottom == last_surface:
                    
                    network_surfaces.append(top)
                    del surface_pairs_dic[top]
                    break
        
        self.network_surfaces = network_surfaces
    
    def add_dowels(self):
        
        if len(self.network_surfaces) == 0:
            return
        
        # organize beams
        all_beams = None
        
        
        for i, s in enumerate(self.network_surfaces):
            
            if i % 2 == 0:
                
                beams = list(s.beams)
            
            else:
                
                beams = list(reversed(s.beams))
            
            if not all_beams:
                
                all_beams = beams
            
            else:
                
                for all, new_beams in zip(all_beams, beams):
                    
                    all.extend(new_beams)

        # add three beams connetion
        
        for i in range(len(all_beams) - 2):

            left_beams   = all_beams[i]
            middle_beams = all_beams[i + 1]
            right_beams  = all_beams[i + 2]

            if i % 2 == 0:

                for j in range(len(left_beams)):

                    if j < len(middle_beams):
                        left   = left_beams[j]
                        middle = middle_beams[j]
                        right  = right_beams[j]
                        
                        # apply a joint system
                        #
                        #   |
                        # | | |
                        # |   |
                        
                        joint_holes = JointHoles([left, middle, right], 0)
                        dowels.append(joint_holes.dowel)

                    if j > 0:

                        left   = left_beams[j]
                        middle = middle_beams[j-1]
                        right  = right_beams[j]

                        # apply a joint system
                        #
                        # |   |
                        # | | |
                        #   |
                        joint_holes = JointHoles([left, middle, right], 1)
                        dowels.append(joint_holes.dowel)

            else:

                for j in range(len(left_beams)):

                    left   = left_beams[j]
                    middle = middle_beams[j]
                    right  = right_beams[j]

                    # apply a joint system
                    #
                    # |   |
                    # | | |
                    #   |
                    joint_holes = JointHoles([left, middle, right], 1)
                    dowels.append(joint_holes.dowel)
                    
                    if j < len(middle_beams) - 1:
                        # apply a joint system
                        #
                        #   |
                        # | | |
                        # |   |

                        left   = left_beams[j]
                        middle = middle_beams[j+1]
                        right  = right_beams[j]
    
                        joint_holes = JointHoles([left, middle, right], 0)
                        dowels.append(joint_holes.dowel)
        
        # add two beams connection
        
        first_rows = [b[0] for i, b in enumerate(all_beams) if i % 2 == 0]
        
        if len(all_beams[0]) == len(all_beams[1]):
            last_rows = [b[-1] for i, b in enumerate(all_beams) if i % 2 == 1]
        else:
            last_rows = [b[-1] for i, b in enumerate(all_beams) if i % 2 == 0]
        
        for i in range(len(first_rows) - 1):
            
            left, right = first_rows[i], first_rows[i + 1]
            
            # TODO type specification
            joint_holes = JointHoles([left, right], 0, 1)
            dowels.append(joint_holes.dowel)

        for i in range(len(last_rows) - 1):
            
            left, right = last_rows[i], last_rows[i + 1]
            
            # TODO type specification
            joint_holes = JointHoles([left, right], 0, 2)
            dowels.append(joint_holes.dowel)

        
        
class Network(object):

    @staticmethod
    def get_relation(s1, s2):

        # get how two surfaces are linked

        domain = rg.Interval(0, 1)
        s1.SetDomain(0, domain)
        s1.SetDomain(1, domain)
        s2.SetDomain(0, domain)
        s2.SetDomain(1, domain)

        p1_1 = s1.IsoCurve(0, 0).PointAt(0.5) # bottom
        p1_2 = s1.IsoCurve(0, 1).PointAt(0.5) # top
        p1_3 = s1.IsoCurve(1, 0).PointAt(0.5) # left
        p1_4 = s1.IsoCurve(1, 1).PointAt(0.5) # right

        p2_1 = s2.IsoCurve(0, 0).PointAt(0.5) # bottom
        p2_2 = s2.IsoCurve(0, 1).PointAt(0.5) # top
        p2_3 = s2.IsoCurve(1, 0).PointAt(0.5) # left
        p2_4 = s2.IsoCurve(1, 1).PointAt(0.5) # top

        THRESHOLD_DIST = 1

        for loc_1, p1 in zip([V0, V1, U0, U1], [p1_1, p1_2, p1_3, p1_4]):

            for loc_2, p2 in zip([V0, V1, U0, U1], [p2_1, p2_2, p2_3, p2_4]):

                if p1.DistanceTo(p2) < THRESHOLD_DIST:

                    return loc_1, loc_2

        return None

    def __init__(self, surfaces):

        self.surfaces = [Surface(s) for s in surfaces]

        # find the shared edges
        shared_edges = []
        for i, s1 in enumerate(self.surfaces):

            for j, s2 in enumerate(self.surfaces[i+1:]):

                if s1 == s2:
                    continue

                rel = Network.get_relation(s1.surface, s2.surface)
                if rel:

                    edge1 = rel[0]
                    edge2 = rel[1]

                    shared_edge = SharedEdge(s1, s2, edge1, edge2)
                    s1.shared_edges.append(shared_edge)
                    s2.shared_edges.append(shared_edge)
                    shared_edges.append(shared_edge)

        self.shared_edges = shared_edges

        # find a set of surfaces to have the same division class
        self.divisions = []

        for _ in range(3): # we don't need this outmost for-loop if the surfaces are well-ordered

            # TODO: the better solution can be found but anyway it works

            for e in self.shared_edges:

                div_1 = e.surface_1.u_div if e.edge_1.direction == U else e.surface_1.v_div

                if e.edge_2.direction == U:

                    e.surface_2.u_div = div_1
                    e.surface_2.u_div.add_shared_edge(e)
                    self.divisions.append(e.surface_2.u_div)

                else:

                    e.surface_2.v_div = div_1
                    e.surface_2.v_div.add_shared_edge(e)
                    self.divisions.append(e.surface_2.v_div)

        self.divisions = list(set(self.divisions))

        # determine the division number
        for d in self.divisions:
            d.determine_num()

    def seam(self):
        
        for shared_edge in self.shared_edges:

            edge_1 = shared_edge.edge_1
            edge_2 = shared_edge.edge_2

            beams_1, beams_2 = shared_edge.get_beams()

            if edge_1.direction == V and edge_2.direction == V:
                
                # skip it because this is implemented in beam network (Division class)
                pass

            elif edge_1.direction == U and edge_2.direction == U:
                
                # seaming
                
                if  (edge_1.value + edge_2.value) % 2 == 0:

                    # flush condition
                    continue
                return
                beams_1_left, beams_1_right = beams_1
                beams_2_left, beams_2_right = beams_2

                beams = [beams_1_left, beams_1_right, beams_2_left, beams_2_right]

                for i in range(len(beams) - 2):

                    left_beams   = beams[i]
                    middle_beams = beams[i + 1]
                    right_beams  = beams[i + 2]

                    if len(left_beams) > len(middle_beams):

                        for j in range(len(left_beams)):

                            if j < len(middle_beams):
                                left   = left_beams[j]
                                middle = middle_beams[j]
                                right  = right_beams[j]

                                # apply a joint system
                                #
                                #   |
                                # | | |
                                # |   |

                                joint_holes = JointHoles([left, middle, right], 0)
                                dowels.append(joint_holes.dowel)

                            if j > 0:

                                left   = left_beams[j]
                                middle = middle_beams[j-1]
                                right  = right_beams[j]

                                # apply a joint system
                                #
                                # |   |
                                # | | |
                                #   |
                                joint_holes = JointHoles([left, middle, right], 1)
                                dowels.append(joint_holes.dowel)

                    else:

                        for j in range(len(left_beams)):

                            left   = left_beams[j]
                            middle = middle_beams[j]
                            right  = right_beams[j]

                            # apply a joint system
                            #
                            # |   |
                            # | | |
                            #   |
                            joint_holes = JointHoles([left, middle, right], 1)
                            dowels.append(joint_holes.dowel)

                            # apply a joint system
                            #
                            #   |
                            # | | |
                            # |   |

                            left   = left_beams[j]
                            middle = middle_beams[j+1]
                            right  = right_beams[j]

                            joint_holes = JointHoles([left, middle, right], 0)
                            dowels.append(joint_holes.dowel)


            else:

                ValueError('For now we don\'t expect any u-v connection')

class Surface(object):

    def __init__(self, surface):

        self.surface = surface
        self.u_div = Division()
        self.v_div = Division()
        self.shared_edges = []

        self.beams = [] # nested array according to u-v mapping

    def instantiate_beams(self):

        self.beams = []

        surface = self.__offset_sides_surface(50)

        for u in range(self.u_div.num + 1):

            inner_arr = []

            for v in range(self.v_div.num):

                if (u % 2 == 0 and v % 2 == 1) or (u % 2 == 1 and v % 2 == 0):
                    continue

                p1 = surface.PointAt(u/self.u_div.num, v/self.v_div.num)
                p2 = surface.PointAt(u/self.u_div.num, (v+1)/self.v_div.num)


                length = p1.DistanceTo(p2)

                center = rg.Point3d((p1 + p2) / 2)

                _, uu, vv = surface.ClosestPoint(center)

                normal = surface.NormalAt(uu, vv)
                x_axis = rg.Vector3d(p1) - rg.Vector3d(p2)
                x_axis.Unitize()
                y_axis = rg.Vector3d.CrossProduct(normal, x_axis)

                plane = rg.Plane(center, x_axis, normal)

                beam = Beam(plane, length, 180, 40)

                inner_arr.append(beam)

            self.beams.append(inner_arr)

    def joint_generation(self, beam_set, location_set, type = 0):
        pass

    def joint_type(self, type = 0):
        if type == 0:
            pass

    def add_inner_dowels(self):

        """
            * extend the edges of beams
            * add dowels that go through three beams in the same surface
        """
        
        return

        for i in range(len(self.beams) - 2):

            left_beams   = self.beams[i]
            middle_beams = self.beams[i + 1]
            right_beams  = self.beams[i + 2]

            if len(left_beams) > len(middle_beams):

                for j in range(len(left_beams)):

                    if j < len(middle_beams):
                        left   = left_beams[j]
                        middle = middle_beams[j]
                        right  = right_beams[j]

                        # apply a joint system
                        #
                        #   |
                        # | | |
                        # |   |

                        joint_holes = JointHoles([left, middle, right], 0)
                        dowels.append(joint_holes.dowel)

                    if j > 0:

                        left   = left_beams[j]
                        middle = middle_beams[j-1]
                        right  = right_beams[j]

                        # apply a joint system
                        #
                        # |   |
                        # | | |
                        #   |
                        joint_holes = JointHoles([left, middle, right], 1)
                        dowels.append(joint_holes.dowel)

            else:

                for j in range(len(left_beams)):

                    left   = left_beams[j]
                    middle = middle_beams[j]
                    right  = right_beams[j]

                    # apply a joint system
                    #
                    # |   |
                    # | | |
                    #   |
                    joint_holes = JointHoles([left, middle, right], 1)
                    dowels.append(joint_holes.dowel)

                    # apply a joint system
                    #
                    #   |
                    # | | |
                    # |   |

                    left   = left_beams[j]
                    middle = middle_beams[j+1]
                    right  = right_beams[j]

                    joint_holes = JointHoles([left, middle, right], 0)
                    dowels.append(joint_holes.dowel)

#
    def get_flatten_beams(self):

        return list(chain.from_iterable(self.beams))

    def seam_regrades(self, grading_percentage = .5, grading_side = 2, precision = 25):
        """ method that makes the beams move closer to each other at the seams

            :param grading_percentage:  Percent of the surface that is being regraded (default .5)
            :param grading_sides:       Which sides of the surface have to be regraded (0 = left, 1 = right, 2 = both, default)
            :return regraded_srf:       The uv_regraded_srf
        """

        local_srf = copy.deepcopy(self.surface)
        u_extra_precision = int(math.ceil(25 / grading_percentage)) - precision
        half_pi = math.pi / 2.0
        half_pi_over_precision = half_pi / (precision - 1)

        # setting up the base grading t_vals
        ini_t_vals = []
        total_t_vals = u_extra_precision
        for i in range(precision):
            alfa = half_pi_over_precision * i
            local_t_val = math.sin(alfa)
            ini_t_vals.append(local_t_val)
            total_t_vals += local_t_val

        [ini_t_vals.append(1) for i in range(u_extra_precision)]

        # setting up the grading list for the amount of sides
        local_t_val = 0
        if (grading_side == 0):
            # only on the left side
            t_vals = []
            for t_val in ini_t_vals:
                local_t_val += t_val
                t_vals.append(local_t_val)
        elif (grading_side == 1):
            # only on the right side
            t_vals = []
            ini_t_vals.reverse()
            local_ini_t_vals = [0]
            local_ini_t_vals.extend(ini_t_vals[:-1])
            for t_val in local_ini_t_vals:
                local_t_val += t_val
                t_vals.append(local_t_val)
        elif (grading_side == 2):
            # on both sides
            t_vals = []
            local_ini_t_vals = ini_t_vals[:]
            ini_t_vals.reverse()
            local_ini_t_vals.extend(ini_t_vals[:-1])
            for t_val in local_ini_t_vals:
                local_t_val += t_val
                t_vals.append(local_t_val)

        # getting the v isocurves
        val_0, val_1 = t_vals[0], t_vals[-1]
        local_srf.SetDomain(1, rg.Interval(0, precision - 1))
        temp_srf_iscrv_set = [local_srf.IsoCurve(0, v_val) for v_val in range(precision)]
        pt_list = [[] for i in range(len(t_vals))]
        for isocrv in temp_srf_iscrv_set:
            t_start, t_end = isocrv.Domain[0], isocrv.Domain[1]
            t_delta = t_end - t_start
            t_differential = t_delta / val_1
            [pt_list[i].append(isocrv.PointAt(t_start + t_val * t_differential)) for i, t_val in enumerate(t_vals)]

        print pt_list[0]

        # constructing new isocurves
        loft_curves = [rg.NurbsCurve.Create(False, 3, pt_set) for pt_set in pt_list]
        loft_type = rg.LoftType.Tight
        local_srf = rg.Brep.CreateFromLoftRebuild(loft_curves, rg.Point3d.Unset, rg.Point3d.Unset, loft_type, False, 50)[0]
        # getting the loft as a nurbssurface out of the resulting brep
        new_srf = local_srf.Faces.Item[0].ToNurbsSurface()

        domain = rg.Interval(0, 1)
        new_srf.SetDomain(0, domain)
        new_srf.SetDomain(1, domain)

        self.srf = new_srf

    def __offset_sides_surface(self, offset_dis=20, sides = 2, sampling_count = 25):
        """ method that returns a slightly shrunk version of the surface along the v direction
            :param offset_dis:      Offset Distance (default 20)
            :param sides:           Which sides should be offseted (0 = left, 1 = right, 2 = both, default)
            :param sampling_count:  Precision at which the surface should be rebuild
            :return temp_srf:       The trimmed surface
        """
        temp_surface = copy.deepcopy(self.surface)

        temp_surface.SetDomain(1, rg.Interval(0, sampling_count - 1))
        temp_isocurves = [temp_surface.IsoCurve(0, v_val) for v_val in range(sampling_count)]

        temp_isocurves_shortened = []

        for isocurve in temp_isocurves:
            # getting the length and the domain of every isocurve
            length = isocurve.GetLength()
            start_t, end_t = isocurve.Domain[0], isocurve.Domain[1]
            t_delta = end_t - start_t
            t_differential = t_delta / length
            # calculating how much the offset_dis result in t_val change
            t_shift = t_differential * offset_dis
            # creating variations for the different offset options
            start_t_new, end_t_new = start_t, end_t
            if (sides == 0):
                start_t_new = start_t + t_shift
                splits = [start_t_new]
                data_to_consider = 1
            if (sides == 1):
                end_t_new = end_t - t_shift
                splits = [end_t_new]
                data_to_consider = 0
            if (sides == 2):
                start_t_new = start_t + t_shift
                end_t_new = end_t - t_shift
                splits = [start_t_new, end_t_new]
                data_to_consider = 1

            # splitting the curve at the values in the split list, picking the curve based on the split type
            new_isocurve = isocurve.Split(splits)[data_to_consider]
            temp_isocurves_shortened.append(new_isocurve)

        # switching the uv direction back to where it should be! -> rebuilding the surface
        point_list = [[] for i in range(sampling_count)]
        for temp_curve in temp_isocurves_shortened:
            length = temp_curve.GetLength()
            start_t, end_t = temp_curve.Domain[0], temp_curve.Domain[1]
            t_delta = end_t - start_t
            t_differential = t_delta / (sampling_count - 1)
            # calculating how much the offset_dis result in t_val change
            point_set = [temp_curve.PointAt(t_val * t_differential + start_t) for t_val in range(0, sampling_count, 1)]
            for i, point in enumerate(point_set):
                point_list[i].append(rg.Point3d(point))

        uv_switched_curves = []
        for point_set in point_list:
            local_isocurve = rg.NurbsCurve.Create(False, 3, point_set)
            uv_switched_curves.append(local_isocurve)

        # lofting those isocurves
        loft_type = rg.LoftType.Tight
        srf = rg.Brep.CreateFromLoftRebuild(uv_switched_curves, rg.Point3d.Unset, rg.Point3d.Unset, loft_type, False, 50)[0]
        # getting the loft as a nurbssurface out of the resulting brep
        srf = srf.Faces.Item[0].ToNurbsSurface()

        domain = rg.Interval(0, 1)
        srf.SetDomain(0, domain)
        srf.SetDomain(1, domain)

        return srf

# debug
# random.shuffle(surfaces)

# create a network from surfaces
network = Network(surfaces)

# labels of divisions
label = []
label_pos = []
for s in network.surfaces:
    string = 'u%d\nv:%d' % (s.u_div.id, s.v_div.id)
    label.append(string)
    label_pos.append(s.surface.PointAt(0.5, 0.5))

beams = []

# entire workflow
for s in network.surfaces:

    # instantiate beams
    s.instantiate_beams()

    # visualization
    beams.extend([b.brep_representation(make_holes=True) for b in s.get_flatten_beams()])

# surface network

for d in network.divisions:
    
    d.setup_network()
    
    # add dowels in beam networks
    d.add_dowels()

# add dowels to connect contact surfaces
network.seam()

# consider keystones
# ---------- end python_2 ----------
uvn = UVN(srf=python.organized_surfaces)

# ---- group: old script
python_3 = GhPythonScript(surfaces=srf)  # -> out, tmp, pt, a; inputs surfaces: list of Surface; disabled
# ---------- python_3: Python ----------
__author__ = "ytakzk"
__version__ = "2019.02.18"

import rhinoscriptsyntax as rs
import Rhino.Geometry as rg
import copy

class Division(object):
    
    def __init__(self):
        
        self.is_overwritten_with = None
        self.id = id(self)
        self.num = 4

a = []
class Network(object):
    
    @staticmethod
    def get_relation(s1, s2):
        
        domain = rg.Interval(0, 1)
        s1.SetDomain(0, domain)
        s1.SetDomain(1, domain)
        s2.SetDomain(0, domain)
        s2.SetDomain(1, domain)
        
        p1_1 = s1.IsoCurve(0, 0).PointAt(0.5)
        p1_2 = s1.IsoCurve(0, 1).PointAt(0.5)
        p1_3 = s1.IsoCurve(1, 0).PointAt(0.5)
        p1_4 = s1.IsoCurve(1, 1).PointAt(0.5)

        p2_1 = s2.IsoCurve(0, 0).PointAt(0.5)
        p2_2 = s2.IsoCurve(0, 1).PointAt(0.5)
        p2_3 = s2.IsoCurve(1, 0).PointAt(0.5)
        p2_4 = s2.IsoCurve(1, 1).PointAt(0.5)
        
        DIST = 50
       
        if p1_1.DistanceTo(p2_1) < DIST or \
           p1_1.DistanceTo(p2_2) < DIST or \
           p1_2.DistanceTo(p2_1) < DIST or \
           p1_2.DistanceTo(p2_2) < DIST:
            
            # u & u =
            return 'u', 'u'

        if p1_3.DistanceTo(p2_3) < DIST or \
           p1_3.DistanceTo(p2_4) < DIST or \
           p1_4.DistanceTo(p2_3) < DIST or \
           p1_4.DistanceTo(p2_4) < DIST:
            
            # v & v ||
            return 'v', 'v'

        if p1_1.DistanceTo(p2_3) < DIST or \
           p1_2.DistanceTo(p2_4) < DIST or \
           p1_1.DistanceTo(p2_3) < DIST or \
           p1_2.DistanceTo(p2_4) < DIST:
            
            # u & v -|
            return 'u', 'v'

        if p1_3.DistanceTo(p2_1) < DIST or \
           p1_4.DistanceTo(p2_2) < DIST or \
           p1_3.DistanceTo(p2_1) < DIST or \
           p1_4.DistanceTo(p2_2) < DIST:
            
            # v & u |-
            return 'v', 'u'
            
        return None
        
    def __init__(self, surfaces):
        
        self.surfaces = [Surface(s) for s in surfaces]
        
        for _ in range(5):
            
            for i, s1 in enumerate(self.surfaces):
            
                for j, s2 in enumerate(self.surfaces):
                
                    if s1 == s2:
                        continue
                
                    rel = Network.get_relation(s1.surface, s2.surface)
                    if rel:
                    
                        v1 = rel[0]
                        v2 = rel[1]
                    
                        if v1 == 'u' and v2 == 'u':
                            
                            s2.u_div = s1.u_div
                            s1.u_neighbors.append(s2)
                            
                        elif v1 == 'u' and v2 == 'v':
                            
                            s2.u_div = s1.v_div
                            s1.u_neighbors.append(s2)
                            
                        elif v1 == 'v' and v2 == 'u':
                            
                            s2.v_div = s1.u_div
                            s1.v_neighbors.append(s2)
                            
                        elif v1 == 'v' and v2 == 'v':
                            
                            s2.v_div = s1.v_div
                            s1.v_neighbors.append(s2)
    
    def orient_direction(self):
        
        for s in self.surfaces:
            
            # TODO: u-v case
            
            flip_u = False
            for u in s.u_neighbors:
                
                if u.flip_u == True:
                    flip_u = False
                    break
                elif u.flip_u == False:
                    flip_u = True
                    break
                    
            flip_v = False
            for v in s.v_neighbors:
                
                if v.flip_v == True:
                    flip_v = False
                    break
                elif v.flip_v == False:
                    flip_v = True
                    break
                    
            if len(s.u_neighbors) == 1:
                s.flip_u = False
            else:
                s.flip_u = flip_u
                
            if len(s.v_neighbors) == 1:
                s.flip_v = False
            else:
                s.flip_v = flip_v
            
        for s in self.surfaces:
            
            if s.flip_u:
                
                s.surface = s.surface.Reverse(0)
            
            if s.flip_v:
                s.surface = s.surface.Reverse(1)

            domain = rg.Interval(0, 1)
            s.surface.SetDomain(0, domain)
            s.surface.SetDomain(1, domain)

    
class Surface(object):
    
    def __init__(self, surface):
        
        self.surface = surface 
        self.u_div = Division()
        self.v_div = Division()
        self.u_neighbors = []
        self.v_neighbors = []
        self.flip_u = None
        self.flip_v = None
    
    def divide(self):
        
        surface = self.surface #self.__offset_sides_surface(50)
        
        global a
        a.append(surface)
        for u in range(self.u_div.num + 1):
            
            for v in range(self.v_div.num):
                
                if (u % 2 == 0 and v % 2 == 1) or (u % 2 == 1 and v % 2 == 0):
                    continue
                
                # TODO
                if u == 0:
                    uu = 0.1
                elif u == self.u_div.num:
                    uu = u - 0.1 
                else:
                    uu = u
                
                p1 = surface.PointAt(uu/self.u_div.num, v/self.v_div.num)
                p2 = surface.PointAt(uu/self.u_div.num, (v+1)/self.v_div.num)
                
                line = rg.Line(p1, p2)
                a.append(line)
                
    def __offset_sides_surface(self, offset_dis=20):
        """ method that returns a slightly shrunk version of the surface along the v direction
            :param offset_dis:       Offset Distance (default 20)
            :return temp_srf:   The trimmed surface
        """
        sampling_count = 25
    
        temp_surface = copy.deepcopy(self.surface)
    
        temp_surface.SetDomain(1, rg.Interval(0, sampling_count - 1))
        temp_isocurves = [temp_surface.IsoCurve(0, v_val) for v_val in range(sampling_count)]
    
        temp_isocurves_shortened = []
    
        for isocurve in temp_isocurves:
            # getting the length and the domain of every isocurve
            length = isocurve.GetLength()
            start_t, end_t = isocurve.Domain[0], isocurve.Domain[1]
            t_delta = end_t - start_t
            t_differential = t_delta / length
            # calculating how much the offset_dis result in t_val change
            t_shift = t_differential * offset_dis
            start_t_new = start_t + t_shift
            end_t_new = end_t - t_shift
            # splitting the curve at those two new start & end points with and taking the middle piece
            new_isocurve = isocurve.Split([start_t_new, end_t_new])[1]
            temp_isocurves_shortened.append(new_isocurve)
    
        # switching the uv direction back to where it should be! -> rebuilding the surface
        point_list = [[] for i in range(sampling_count)]
        for temp_curve in temp_isocurves_shortened:
            length = temp_curve.GetLength()
            start_t, end_t = temp_curve.Domain[0], temp_curve.Domain[1]
            t_delta = end_t - start_t
            t_differential = t_delta / (sampling_count - 1)
            # calculating how much the offset_dis result in t_val change
            point_set = [temp_curve.PointAt(t_val * t_differential + start_t) for t_val in range(0, sampling_count, 1)]
            for i, point in enumerate(point_set):
                point_list[i].append(rg.Point3d(point))
    
        uv_switched_curves = []
        for point_set in point_list:
            local_isocurve = rg.NurbsCurve.Create(False, 3, point_set)
            uv_switched_curves.append(local_isocurve)
    
        # lofting those isocurves
        loft_type = rg.LoftType.Tight
        s = rg.Brep.CreateFromLoftRebuild(uv_switched_curves, rg.Point3d.Unset, rg.Point3d.Unset, loft_type, False, 50)[0]
        # getting the loft as a nurbssurface out of the resulting brep
        print s.Faces.Item[0].ToNurbsSurface()
    
        domain = rg.Interval(0, 1)
        s.SetDomain(0, domain)
        s.SetDomain(1, domain)

        return s

import random
# debug
#random.shuffle(surfaces)

network = Network(surfaces)
network.orient_direction()

tmp = []
pt = []
unique_divisions = [] 
for s in network.surfaces:
    
    unique_divisions.extend([s.u_div, s.v_div])

    string = 'u%d\nv:%d' % (s.u_div.id, s.v_div.id)
    tmp.append(string)
    pt.append(s.surface.PointAt(0.5, 0.5))
    
    
unique_divisions = list(set(unique_divisions))
for d in unique_divisions:
    
    d.num = 5


for s in network.surfaces:
    
    s.divide()
# ---------- end python_3 ----------

# ----
python_4 = GhPythonScript(toggle=Button())  # -> out, a
# ---------- python_4: Python ----------
__author__ = "ytakzk"
__version__ = "2019.01.21"

import geometry.beam as beam
import geometry.dowel as dowel
import geometry.hole as hole
import geometry.joint_holes as joint_holes

if toggle:
    
    reload(beam)
    reload(dowel)
    reload(hole)
    reload(joint_holes)
# ---------- end python_4 ----------
geo = Geometry(python_2.dowels)
item = ListItem(List=geo, Index=Slider(11, range=0..20), Wrap=True)

# ---- group: beams on the edges
geo_2 = Geometry(python_2.tmp)

# ---- group: all beams
geo_3 = Geometry(python_2.beams)

# ----
tag = TextTag(Location=python_2.label_pos, Text=python_2.label)

# ==== cluster UVN
srf = ClusterInput()
number_slider = Slider(3, range=0..110)
extract_uv_vec = GhPythonScript(srf=srf)  # -> out, center_pt, u_vec, v_vec, normal; inputs srf: Surface
# ---------- extract_uv_vec: Python ----------
__author__ = "Wenqian"
__version__ = "2019.01.22"

import rhinoscriptsyntax as rs
import Rhino.Geometry as rg

srf.SetDomain(0,rg.Interval(0,1))
srf.SetDomain(1,rg.Interval(0,1))

center_pt = srf.PointAt(0.5,0.5)

u_vec = srf.FrameAt(0.5,0.5)[1].XAxis
v_vec = srf.FrameAt(0.5,0.5)[1].YAxis

normal =srf.NormalAt(0.5,0.5)
# ---------- end extract_uv_vec ----------
number_slider_2 = Slider(200, range=0..300)
multiplication = Multiplication(A=extract_uv_vec.v_vec, B=number_slider_2)
multiplication_2 = Multiplication(A=extract_uv_vec.normal, B=number_slider_2)
multiplication_3 = Multiplication(A=extract_uv_vec.u_vec, B=number_slider_2)
vdisex = VectorDisplayEx(
    Point=extract_uv_vec.center_pt,
    Vector=multiplication_3,
    Colour=ColourSwatch(SwatchColor=RGB(255, 0, 0)),
    Width=number_slider)
vdisex_2 = VectorDisplayEx(
    Point=extract_uv_vec.center_pt,
    Vector=multiplication,
    Colour=ColourSwatch(SwatchColor=RGB(33, 220, 0)),
    Width=number_slider)
vdisex_3 = VectorDisplayEx(
    Point=extract_uv_vec.center_pt,
    Vector=multiplication_2,
    Colour=ColourSwatch(SwatchColor=RGB(255, 255, 255)),
    Width=number_slider)
