# Grasshopper definition surface_mapping_network_Embedded.gh (Grasshopper 1.0.4)

number_slider = Slider(3000, range=0..3000)
number_slider_2 = Slider(3, range=0..10)
planesrf = PlaneSurface(Plane=PlaneXY(0, 0, 0), XSize=number_slider, YSize=number_slider)
series = Series(Start=0, Step=number_slider, Count=number_slider_2)
series_2 = Series(Start=0, Step=number_slider, Count=Slider(4, range=0..10))

# ---- group: cylinder as looping surfaces
cyl = Cylinder(Base=PlaneXY(0, 0, 0), Radius=Slider(3500, range=0..4000), Length=Slider(9000, range=0..10000))
python = GhPythonScript()  # -> out, a
# ---------- python: Python ----------
__author__ = "ytakzk"
__version__ = "2019.02.23"

import Rhino.Geometry as rg

a = []

for i in range(3):
    
    a.append(rg.Interval(i/3, (i + 1)/3))
# ---------- end python ----------
dom² = ConstructDomain²(DomainU=python.a, DomainV=graft(python.a))  # -> flatten(_2DDomain)
subsrf = Isotrim(Surface=reparameterize(cyl), Domain=dom²)
python_2 = GhPythonScript(x=subsrf)  # -> out, cylinder_surfaces; inputs x: list of Surface
# ---------- python_2: Python ----------
__author__ = "ytakzk"
__version__ = "2019.02.23"

import Rhino.Geometry as rg

#for s in x[3:6]:
#
#    s.Reverse(0, True)
#    domain = rg.Interval(0, 1)
#    s.SetDomain(0, domain)

cylinder_surfaces = x
# ---------- end python_2 ----------

# ----
X = UnitX(Factor=series)
Y = UnitY(Factor=series_2)  # -> graft(UnitVector)
move = Move(Geometry=planesrf, Motion=X)  # -> Geometry, Transform
move_2 = Move(Geometry=move.Geometry, Motion=Y)  # -> flatten(Geometry), Transform

# ---- group: keystone surfaces 2
srf = Surface([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])

# ----
srf_2 = Surface(move_2.Geometry)

# ---- group: Jonas's surfaces
srf_3 = Surface([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])
python_3 = GhPythonScript(surfaces=srf_3)  # -> out, a; inputs surfaces: list of Surface
# ---------- python_3: Python ----------
__author__ = "ytakzk"
__version__ = "2019.02.24"

import Rhino.Geometry as rg

a = []

for i, s in enumerate(surfaces):
    
#    domain = rg.Interval(0, 1)
#    
#    if i > 1:
#        s = s.Reverse(0)
#        s.SetDomain(0, domain)
    
    a.append(s)
# ---------- end python_3 ----------

# ----
srf_4 = Surface([<surface referenced from the Rhino model> x39])

# ---- group: in reality, must be done manually
python_4 = GhPythonScript(surfaces=srf_2, u_num=number_slider_2)  # -> out, organized_surfaces; inputs surfaces: list of Surface, u_num: Int32
# ---------- python_4: Python ----------
__author__ = "ytakzk"
__version__ = "2019.02.20"

import Rhino.Geometry as rg

organized_surfaces = []

for i, s in enumerate(surfaces):
    
    x = i % u_num
    y = int(i / u_num)
    
    domain = rg.Interval(0, 1)
    
#    if (x + y) % 2 == 1:
#        s = s.Reverse(1)
#        s.SetDomain(1, domain)
#        s = s.Reverse(0)
#        s.SetDomain(0, domain)

    if y % 2 == 1:
#        s = s.Reverse(1)
#        s.SetDomain(1, domain)
        s = s.Reverse(0)
        s.SetDomain(0, domain)
    
    if x == u_num - 1:
        s = s.Reverse(0)
        s.SetDomain(0, domain)
        
    organized_surfaces.append(s)
# ---------- end python_4 ----------

# ---- group: one surface
item = ListItem(List=srf_2, Index=0, Wrap=True)
srf_5 = Surface(item)

# ----
python_5 = GhPythonScript(surfaces=srf)  # -> out, organized_surfaces; inputs surfaces: list of Surface
# ---------- python_5: Python ----------
__author__ = "ytakzk"
__version__ = "2019.02.25"

import Rhino.Geometry as rg

organized_surfaces = []

for i, s in enumerate(surfaces):
    
#    if i == 0 or i == 1 or i == 5:
#        s.Reverse(0, True)
#        domain = rg.Interval(0, 1)
#        s.SetDomain(0, domain)
    
    organized_surfaces.append(s)
# ---------- end python_5 ----------

# ---- group: keystone surfaces
srf_6 = Surface([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])

# ----
srf_7 = Surface(srf)
item_2 = ListItem(List=srf_7, Index=0, Wrap=True)

# ---- group: local network generation
panel = Panel("""3,0
1,2
4,5""")  # disabled
panel_2 = Panel("""False
False
True""")  # disabled
panel_3 = Panel("""0
2
4""")  # disabled
python_6 = GhPythonScript(surfaces=srf_7, surface_network_index=panel, top_priority_index=panel_3, has_loops=panel_2)  # -> out, beams, dowels, local_networks; inputs surfaces: list of Surface, surface_network_index: list, top_priority_index: list of Int32, has_loops: list of Boolean; disabled
# ---------- python_6: Python ----------
__author__ = "ytakzk"
__version__ = "2019.02.23"

import sys
import Rhino.Geometry as rg

from geometry import LocalNetwork, Surface

dowels = []
beams = []
tmp = []
local_networks = []

if len(surface_network_index) != len(top_priority_index):
    ValueError('surface_network_index must be the same size as top_priority_index')

# network

surface_network_sets = []
priorities = []

for string, priority_index in zip(surface_network_index, top_priority_index):
    
    values = string.split('&')

    surface_network = []
    
    priority_index_v = 0
    
    for v_values in values:

        surface_network_subset = []
        for v, index in enumerate(v_values.split(',')):
            
            index = int(index)

            if index == priority_index:
                
                priority_index_v = v
                
            surface = Surface(surfaces[index])
            surface_network_subset.append(surface)
            
        surface_network.append(surface_network_subset)
    
    priorities.append(priority_index_v)
    
    surface_network_sets.append(surface_network)

for surface_network, has_loop, top_priority_v_index in zip(surface_network_sets, has_loops, priorities):

    local_network = LocalNetwork(surface_network, has_loop, top_priority_v_index)

    local_dowels = local_network.add_three_beams_connection()
    dowels.extend([d.brep_representation() for d in local_dowels])

    local_dowels = local_network.add_two_beams_connection()
    dowels.extend([d.brep_representation() for d in local_dowels])

    local_beams = [b.brep_representation(make_holes=False) for b in local_network.get_flatten_beams()]
    beams.extend(local_beams)
    
    local_networks.append(local_network)
# ---------- end python_6 ----------

# ----
srf_8 = Surface([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])

# ---- group: surface visualization
python_7 = GhPythonScript(s=srf_7)  # -> out, c; inputs s: Surface
# ---------- python_7: Python ----------
__author__ = "ytakzk"
__version__ = "2019.02.26"

import Rhino.Geometry as rg


domain = rg.Interval(0, 1)
s.SetDomain(0, domain)
s.SetDomain(1, domain)

c = s.PointAt(0.5, 0.5)
# ---------- end python_7 ----------
panel_4 = Panel("600")
points = PointList(Points=python_7.c, Size=panel_4)
uvn = UVN(srf=srf_8)

# ----
srf_9 = Surface([<surface referenced from the Rhino model> x6])
srf_10 = Surface(srf_8)

# ---- group: local network generation
panel_5 = Panel("""0, 1, 2, 3
4, 5, 6, 7
8, 9, 10, 11
12, 13, 14, 15
16, 17, 18, 19
20, 21, 22, 23""")
panel_6 = Panel("False")
panel_7 = Panel("0")
python_8 = GhPythonScript(surfaces=srf_10, surface_network_index=panel_5, top_priority_index=panel_7, has_loops=panel_6)  # -> out, beams, dowels, local_networks; inputs surfaces: list of Surface, surface_network_index: list, top_priority_index: list of Int32, has_loops: list of Boolean
# ---------- python_8: Python ----------
__author__ = "ytakzk"
__version__ = "2019.02.23"

import sys
import Rhino.Geometry as rg
import geometry.local_network
import geometry.surface
reload(geometry.local_network)
reload(geometry.surface)
from geometry.local_network import LocalNetwork
from geometry.surface import Surface


dowels = []
beams = []
tmp = []
local_networks = []

if len(surface_network_index) != len(top_priority_index):
    ValueError('surface_network_index must be the same size as top_priority_index')

# network

surface_network_sets = []
priorities = []

for string, priority_index in zip(surface_network_index, top_priority_index):
    
    values = string.split('&')

    surface_network = []
    
    priority_index_v = 0
    
    for v_values in values:

        surface_network_subset = []
        for v, index in enumerate(v_values.split(',')):
            
            index = int(index)

            if index == priority_index:
                
                priority_index_v = v
                
            surface = Surface(surfaces[index])
            surface_network_subset.append(surface)
            
        surface_network.append(surface_network_subset)
    
    priorities.append(priority_index_v)
    
    surface_network_sets.append(surface_network)

for surface_network, has_loop, top_priority_v_index in zip(surface_network_sets, has_loops, priorities):

    local_network = LocalNetwork(surface_network, has_loop, top_priority_v_index)

    local_dowels = local_network.add_three_beams_connection()
    dowels.extend([d.brep_representation() for d in local_dowels])

    local_dowels = local_network.add_two_beams_connection()
    dowels.extend([d.brep_representation() for d in local_dowels])

    local_beams = [b.brep_representation(make_holes=False) for b in local_network.get_flatten_beams()]
    beams.extend(local_beams)
    
    local_networks.append(local_network)
# ---------- end python_8 ----------

# ----
srf_11 = Surface([<surface referenced from the Rhino model> x16])
merge = Merge(
    Data1=Slider(100, range=0..500),
    Data2=Slider(40, range=0..500),
    Data3=Slider(35, range=0..500),
    Data4=Toggle(True),
    Data5=Toggle(False),
    Data6=Toggle(False))
srf_12 = Surface([<surface referenced from the Rhino model> x37])
merge_2 = Merge(Data1=srf_11, Data2=srf_8, Data3=srf_12)
merge_3 = Merge(
    Data1=Slider(59, range=0..500),
    Data2=Slider(14, range=0..500),
    Data3=Slider(2.908, range=0..10),
    Data4=Slider(100, range=0..500),
    Data5=Slider(100, range=0..500),
    Data6=Slider(0.1, range=0..10),
    Data7=Slider(100, range=0..500),
    Data8=Slider(100, range=0..500),
    Data9=Slider(0.1, range=0..10),
    Data10=Toggle(True),
    Data11=Toggle(False),
    Data12=Toggle(True))
srf_13 = Surface([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])
sort = SortList()  # -> Keys, ValuesA
srf_14 = Surface([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])
item_3 = ListItem(List=srf_8, Index=0, Wrap=True)
uvn_2 = UVN(srf=srf_11)
python_9 = GhPythonScript(surfaces=srf_13)  # -> out, surface_sets; inputs surfaces: list of Surface
# ---------- python_9: Python ----------
__author__ = "Jonas"
__version__ = "2019.02.28"

surface_count = len(surfaces)
surface_set_count = int(surface_count / 4)

surface_sets = []

for i in range(surface_set_count):
    surface_set = []
    for j in range(4):
        surface_set.append(surfaces[i * 4 + j])
    surface_sets.append(surface_set)
# ---------- end python_9 ----------
number_slider_3 = Slider(2, range=-10..10)  # disabled
merge_4 = Merge(Data1=Slider(1, range=0..10), Data2=Slider(2, range=0..10), Data3=Slider(0, range=0..10), Data4=Slider(0, range=0..10))
python_10 = GhPythonScript(
    surfaces=srf_14,
    surface_network_index=panel_5,
    top_priority_index=panel_7,
    has_loops=panel_6,
    f_args_para=merge_3,
    f_args_static=merge)  # -> out, beams, dowels, local_networks; inputs surfaces: list of Surface, surface_network_index: list, top_priority_index: list of Int32, has_loops: list of Boolean, f_args_para: list, f_args_static: list
# ---------- python_10: Python ----------
__author__ = "ytakzk"
__version__ = "2019.02.23"

import sys
import Rhino.Geometry as rg
import geometry.local_network
import geometry.surface
reload(geometry.local_network)
reload(geometry.surface)
from geometry.local_network import LocalNetwork
from geometry.surface import Surface


dowels = []
beams = []
tmp = []
local_networks = []

f_args = [f_args_static, f_args_para]

if len(surface_network_index) != len(top_priority_index):
    ValueError('surface_network_index must be the same size as top_priority_index')

# network

surface_network_sets = []
priorities = []

local_surfaces = [Surface(srf, u_div = 9, v_div = 2) for srf in surfaces]

print len( local_surfaces)

local_network = LocalNetwork(local_surfaces, has_v_loop = False, flip = True,  parametric = False, type_args = f_args)
local_network.add_three_beams_connection()
local_network.add_two_beams_connection()

beams = [beam.brep_representation(make_holes = False) for beam in local_network.get_flatten_beams()]
dowels = [beam.brep_representation() for beam in local_network.dowels]
# ---------- end python_10 ----------
srf_15 = Surface()
equals = Equality(FirstNumber=merge_4, SecondNumber=0)  # -> Equality, Inequality

# ---- group: keystone generation
panel_8 = Panel("""2,3,4
1,0,5""")  # disabled
python_11 = GhPythonScript(surfaces=srf_7, keystone_index_list=panel_8, a=number_slider_3)  # -> out, keystone_surfaces; inputs surfaces: list of Surface, a: Int32; disabled
# ---------- python_11: Python ----------
__author__ = "ytakzk"
__version__ = "2019.02.24"

import System
import Rhino.Geometry as rg
import Grasshopper.Kernel.Data.GH_Path as ghpath
import Grasshopper.DataTree as datatree
from geometry import Keystone

keystone_surfaces = datatree[System.Object]()

# ceonvert string to nested numerical list

index_nested_list = []

for vals in keystone_index_list.split('\n'):
    print vals
    nums = [int(v) for v in vals.split(',')]
    index_nested_list.append(nums)

print index_nested_list

#for i, index_list in enumerate(index_nested_list):
#    
#    surfaces = [surfaces[i] for i in index_list]
#
#    keystone = Keystone(surfaces, split_function=1)
#    _, generated_surfaces = keystone.output()
#    
#    for s in generated_surfaces:
#        path = ghpath(i)
#        keystone_surfaces.Add(s, path)

nested_surfaces = []
for index_list in index_nested_list:
    
    tmp_surfaces = [surfaces[i] for i in index_list]

    nested_surfaces.append(tmp_surfaces)

keystone = Keystone(nested_surfaces, split_function=1, f_args = [[0, 0, .15, .05], [a, 0, .15, .05], []], loc_pat = [0, 1], blend_overlap = 5, dir = True)
_, generated_surfaces = keystone.output()

for i, s_list in enumerate(generated_surfaces):
    path = ghpath(i)
    
    for s in s_list:
        keystone_surfaces.Add(s, path)
# ---------- end python_11 ----------
preview = CustomPreview(
    Geometry=python_11.keystone_surfaces,
    Material={diffuse=RGB(0, 191, 255), emission=RGB(66, 48, 66), shine=0.5, specular=RGB(255, 255, 255), transparency=0.6})  # disabled
uvn_3 = UVN(srf=python_11.keystone_surfaces)  # disabled

# ----
timer = Timer(TimerInterval=1000, Target=panel_9)
sift = SiftPattern(List=merge_4, SiftPattern=equals.Equality)  # -> Output0, Output1
item_4 = ListItem(List=python_9.surface_sets, Index=2, Wrap=True)
timer_2 = Timer(TimerInterval=100, Target=[item_7, number_slider_4, panel_9])  # disabled
panel_9 = Panel("1")
clean = CleanTree(RemoveNulls=True, RemoveInvalid=True, RemoveEmpty=False, Tree=sift.Output0)
ma = MassAddition(Input=clean)  # -> Result, PartialResults
item_5 = ListItem(List=ma.PartialResults, Index=0, Wrap=True)  # -> Item1, Item
number_slider_4 = Slider(0, range=0..150)
number_slider_5 = Slider(1000, range=0..1000)  # disabled
rec = DataRecorder(panel_9, DataLimit=-10, RecordData=True)  # disabled
division = Division(A=ma.PartialResults, B=item_5.Item1)
python_12 = GhPythonScript(
    surfaces=srf_9,
    surface_network_index=panel_5,
    top_priority_index=panel_7,
    has_loops=panel_6,
    u_div=Slider(10, range=0..100),
    v_div=Slider(2, range=0..10),
    mapping_type=division,
    seam_type=Slider(1, range=0..3),
    flush_beam_count=Slider(4, range=0..10),
    warp_type=Slider(1, range=0..3),
    flip_inflection=True)  # -> out, beams, dowels, local_networks, lines, curve, planes, surface, global_beam_list; inputs surfaces: list of Surface, surface_network_index: list, top_priority_index: list of Int32, has_loops: list of Boolean, u_div: Int32, v_div: Int32, mapping_type: list, seam_type: Int32, flush_beam_count: Int32, warp_type: Int32
# ---------- python_12: Python ----------
__author__ = "ytakzk"
__version__ = "2019.02.23"

import sys
import Rhino.Geometry as rg
import geometry.local_network
import geometry.surface
import geometry.beam_network
reload(geometry.local_network)
reload(geometry.surface)
reload(geometry.beam_network)
from geometry.local_network import LocalNetwork
from geometry.surface import Surface
from geometry.beam_network import BeamNetwork

dowels = []
beams = []
tmp = []
local_networks = []

srf_topo = []
global_beam_list = []
beam_nws = []
for srf in surfaces:
    local_srf_instance = Surface(srf, u_div = u_div, v_div = v_div)
    srf_topo.append(local_srf_instance)

beam_nw = BeamNetwork(srf_topo)
beam_nw.construct_beam_sets()
beam_nw.beam_network()

for dowel in beam_nw.dowels:
    dowels.append(dowel.brep_representation())

for local_beam_list in beam_nw.beam_list:
    for beam in local_beam_list:
        global_beam_list.append(beam.brep_representation(make_holes = False))
# ---------- end python_12 ----------
python_13 = GhPythonScript(
    surfaces=srf_8,
    surface_network_index=panel_5,
    top_priority_index=panel_7,
    has_loops=panel_6,
    u_div=Slider(12, range=0..100),
    v_div=Slider(2, range=0..10),
    mapping_type=division,
    seam_type=Slider(2, range=0..3),
    flush_beam_count=Slider(8, range=0..10),
    warp_type=Slider(3, range=0..3),
    flip_inflection=True)  # -> out, beams, dowels, local_networks, lines, curve, planes, surface, global_beam_list; inputs surfaces: list of Surface, surface_network_index: list, top_priority_index: list of Int32, has_loops: list of Boolean, u_div: Int32, v_div: Int32, mapping_type: list, seam_type: Int32, flush_beam_count: Int32, warp_type: Int32
# ---------- python_13: Python ----------
__author__ = "ytakzk"
__version__ = "2019.02.23"

import sys
import Rhino.Geometry as rg
import geometry.local_network
import geometry.surface
import geometry.beam_network
reload(geometry.local_network)
reload(geometry.surface)
reload(geometry.beam_network)
from geometry.local_network import LocalNetwork
from geometry.surface import Surface
from geometry.beam_network import BeamNetwork

srf_sets = []

for i in range(5):
    nested_loop = []
    for j in range(4):
        new = i * 4 + j
        print new
        local_srf_set = surfaces[new]
        nested_loop.append(local_srf_set)
    srf_sets.append(nested_loop)

print srf_sets

dowels = []
beams = []
tmp = []
local_networks = []


global_beam_list = []
beam_nws = []
for srf_set in srf_sets:
    srf_topo = []
    for srf in srf_set:
        local_srf_instance = Surface(srf, u_div = u_div, v_div = v_div)
        srf_topo.append(local_srf_instance)

    beam_nw = BeamNetwork(srf_topo)
    beam_nw.construct_beam_sets()
    beam_nw.beam_network()

    for dowel in beam_nw.dowels:
        dowels.append(dowel.brep_representation())

    for local_beam_list in beam_nw.beam_list:
        for beam in local_beam_list:
            global_beam_list.append(beam.brep_representation(make_holes = False))
# ---------- end python_13 ----------
crv = Curve(python_13.curve)
pln = Plane(python_13.planes)
line = Line(python_13.lines)
srf_16 = Surface(python_13.surface)
brep = Brep(python_13.global_beam_list)
ma_2 = MassAddition(Input=rec)  # -> Result, PartialResults; disabled
item_6 = ListItem(List=brep, Index=Slider(0, range=0..100), Wrap=True)  # disabled
Z = UnitZ(Factor=number_slider_5)  # disabled
pt = Point(Point(-44338.72393, 3241.429621, 0))  # disabled
tag = TextTag()  # disabled
number_slider_6 = Slider(2.515, range=0..5)  # disabled
number_slider_7 = Slider(15, range=0..20)  # disabled
number_slider_8 = Slider(786.1, range=0..1000)  # disabled
number_slider_9 = Slider(0, range=0..1000)  # disabled
python_14 = GhPythonScript(
    surfaces=item_4,
    surface_network_index=panel_5,
    top_priority_index=panel_7,
    has_loops=panel_6,
    f_args_para=merge_3,
    f_args_static=merge,
    para=Toggle(False))  # -> out, flatten(beams), dowels, local_network, dowel_constraints, beam, flatten(beam_list); inputs surface_network_index: list, top_priority_index: list of Int32, has_loops: list of Boolean, f_args_para: list, f_args_static: list
# ---------- python_14: Python ----------
__author__ = "ytakzk"
__version__ = "2019.02.23"

import sys
import Rhino.Geometry as rg
import geometry.local_network
import geometry.surface
import geometry.dowel
reload(geometry.local_network)
reload(geometry.surface)
reload(geometry.dowel)
from geometry.local_network import LocalNetwork
from geometry.surface import Surface

dowels = []
beams = []
tmp = []
local_networks = []

f_args = [f_args_static, f_args_para]

if len(surface_network_index) != len(top_priority_index):
    ValueError('surface_network_index must be the same size as top_priority_index')

# network

surface_network_sets = []
priorities = []

local_surfaces = [Surface(srf, u_div = 9, v_div = 2) for srf in surfaces]

print len( local_surfaces)

local_network = LocalNetwork(local_surfaces, has_v_loop = False, flip = False,  parametric = para, type_args = [f_args_static, f_args_para])
local_network.add_three_beams_connection()
local_network.add_two_beams_connection()

beam_list = local_network.get_flatten_beams()

beams = [beam.brep_representation(make_holes = False) for beam in beam_list]
#dowel_constraints = []
#for dowel in local_network.dowels:
#    brep = dowel.check_spacing_constraints()
#    print "beam_count : ", dowel.beam_count
#    print brep
#    if not(brep == None):
#        dowel_constraints.extend(brep)

dowels = [dowel.brep_representation() for dowel in local_network.dowels]
# ---------- end python_14 ----------
brep_2 = Brep(python_14.dowels)
srf_17 = Surface(flatten(python_11.keystone_surfaces))  # disabled
panel_10 = Panel(python_14.out)
move_3 = Move(Geometry=pt, Motion=Z)  # -> Geometry, Transform; disabled
item_7 = ListItem(List=python_14.beams, Index=ma_2.Result, Wrap=True)

# ---- group: surface visualization
uvn_4 = UVN(srf=srf_17)  # disabled
python_15 = GhPythonScript(s=srf_17)  # -> out, c; inputs s: Surface; disabled; same code as python_7
points_2 = PointList(Points=python_15.c, Size=panel_4)  # disabled

# ----
item_8 = ListItem(List=python_14.beam_list, Index=number_slider_7, Wrap=True)  # disabled
python_16 = GhPythonScript(ref_pt=move_3.Geometry, z_value=number_slider_6, length=number_slider_8, extension=number_slider_9)  # -> out, a, b; inputs ref_pt: Point3d; disabled
# ---------- python_16: Python ----------
__author__ = "Jonas"
__version__ = "2019.03.01"

import Rhino.Geometry as rg
import geometry.beam
reload(geometry.beam)
from geometry.beam import Beam

plane = rg.Plane(rg.Point3d(ref_pt), rg.Vector3d(1, 0, z_value), rg.Vector3d(0,0,1))
new_beam = Beam(plane, length, 160, 40)

a = new_beam
new_beam.extend(extension)
b = new_beam.brep_representation()
# ---------- end python_16 ----------
item_9 = ListItem(List=python_14.beams, Index=number_slider_7, Wrap=True)  # disabled
item_10 = ListItem(List=python_14.beam_list, Index=number_slider_7, Wrap=True)  # disabled
brep_3 = Brep(python_14.beams)
panel_11 = Panel("""0
2
4""")  # disabled
panel_12 = Panel("""1,0
2,3
4,5""")  # disabled
python_17 = GhPythonScript(beam=python_16.a)  # -> out, a, b, c, d, e, f; disabled
# ---------- python_17: Python ----------
import Rhino.Geometry as rg
import math as m


import geometry.beam
reload (geometry.beam)
from geometry.beam import Beam

def foundation_function(beam, ref_pl = rg.Plane.WorldXY, overlap = 250):
        """ foundation connection

        :param beam:        Which beam to consider
        :param loc:         Location of the t-val on the line representation of the beam to use as your reference point
        :param ref_pl:      The plane that will be used as the baseplane of the structure
        :param length:      Length away from the floor
        :param overlap:     How much overlap between the feet of the beam and the beam itself
        """
        
        print "height of the beam: ", beam.dy
        
        # finding the orientation of the beam
        beam_line = beam.get_baseline()
        pt_0, pt_1 = beam_line.PointAt(0), beam_line.PointAt(1)
        z_height_pl = ref_pl.Origin.Z
        
        # determining which side is closest to the floor
        parallel_to_the_world_xy = False
        if (pt_0.Z > pt_1.Z):
            line_start_pt = pt_0
            line_end_pt = pt_1
            negative_direction = False
        elif (pt_1.Z > pt_0.Z):
            line_start_pt = pt_1
            line_end_pt = pt_0
            negative_direction = True
        else:
            # none run condition
            parallel_to_the_world_xy = True
            print "This one can't have a foundation"
            
        if not(parallel_to_the_world_xy):
            # finding the new end_pt of the beam
            t_val = rg.Intersect.Intersection.LinePlane(beam_line, ref_pl)[1]
            extended_line_end_pt_on_ref_pl = beam_line.PointAt(t_val)
            
            # how much the new_end_pt has to be moved upwards (beam.extension is value related to the overlap required in the joint designs)
            print beam.extension
            
            angle = rg.Vector3d.VectorAngle(rg.Vector3d(line_start_pt - line_end_pt), ref_pl.Normal)
            shift_length = m.tan(angle) * beam.dy / 2 + beam.extension

            # constructing the new base_pt
            mv = rg.Vector3d(line_start_pt - line_end_pt)
            mv.Unitize()
            new_line_end_pt = extended_line_end_pt_on_ref_pl + mv * shift_length
            
            # new beam origin & length
            beam.reset_length(rg.Line(new_line_end_pt, line_start_pt).Length)
            new_beam_o = rg.Point3d((new_line_end_pt + line_start_pt) / 2)
            
            new_beam_line = rg.Line(new_line_end_pt, line_start_pt)
            
            # finding the 3th point defining the new plane
            projected_pt_on_ref_pl = ref_pl.ClosestPoint(line_start_pt)

            # constructing axises
            x_axis = rg.Vector3d(new_line_end_pt - line_start_pt)
            y_axis = rg.Vector3d(projected_pt_on_ref_pl - line_start_pt)

            # checking angles with original beam_plane
            x_axis_o, y_axis_o = beam.base_plane.XAxis, beam.base_plane.YAxis
            x_angle = rg.Vector3d.VectorAngle(x_axis, x_axis_o)
            y_angle = rg.Vector3d.VectorAngle(y_axis, y_axis_o)

            # flipping if need be
            if (x_angle > 1.6):
                x_axis = - x_axis
            if (y_angle > 1.6):
                y_axis = - y_axis

            # defining the new plane
            beam.base_plane = rg.Plane(new_beam_o, x_axis, y_axis)
    
            # defining the footing beams
            mv = rg.Vector3d(beam.base_plane.ZAxis * beam.dz)
            f_pls = [rg.Plane(beam.base_plane) for i in range(2)]
            [f_pl.Translate(rg.Vector3d( (i *2 - 1) * mv + (new_line_end_pt - new_beam_o))) for i, f_pl in enumerate(f_pls)]
    
            dy_foundation, dz_foundation = rg.Interval(-.5 * beam.dy, .5 * beam.dy), rg.Interval(-.5 * beam.dz, .5 * beam.dz)
            if negative_direction:
                dx_foundation = rg.Interval(- 1000, overlap - beam.extension)
            else:
                dx_foundation = rg.Interval(- overlap + beam_.xtension, 2000)
                
            # creating brep representation
            trimming_plane = rg.Plane.WorldXY
            trimming_plane.Translate(rg.Vector3d(projected_pt_on_ref_pl.X, projected_pt_on_ref_pl.Y, 0))
            bounding_box = rg.Box(rg.Plane(trimming_plane), rg.Interval(-10000.0, 10000.0), rg.Interval(-10000.0, 10000.0), rg.Interval(ref_pl.Origin.Z, 10000.0)) 
            raw_f_breps = [rg.Box(pl, dx_foundation, dy_foundation, dz_foundation) for pl in f_pls]
            foundation_breps = [rg.Brep.CreateBooleanIntersection(r_f_brep.ToBrep(), bounding_box.ToBrep(), 1)[0] for r_f_brep in raw_f_breps]
            
            return foundation_breps, new_beam_line, new_line_end_pt, line_start_pt

print beam

e = beam.brep_representation()
a, d, c, f = foundation_function(beam)
b = beam.brep_representation()
# ---------- end python_17 ----------
python_18 = GhPythonScript(x=item_10)  # -> out, a; disabled
# ---------- python_18: Python ----------
__author__ = "Jonas"
__version__ = "2019.02.28"

import rhinoscriptsyntax as rs

a = x.brep_representation()
# ---------- end python_18 ----------
volume = Volume(Geometry=python_17.b)  # -> Volume, Centroid; disabled
brep_4 = Brep(python_17.b)  # disabled
brep_5 = Brep(python_17.a)  # disabled

# ---- group: fabrication sequence check
python_19 = GhPythonScript(local_networks=python_14.local_network)  # -> out, beams, dowels, beam_instances; inputs local_networks: list
# ---------- python_19: Python ----------
__author__ = "ytakzk"
__version__ = "2019.02.24"

import System
import Grasshopper.Kernel.Data.GH_Path as ghpath
import Grasshopper.DataTree as datatree

beams = datatree[System.Object]()
beam_instances = datatree[System.Object]()

for i, local_network in enumerate(local_networks):
    
    local_beams = [b.brep_representation(make_holes=False) for b in local_network.get_flatten_beams()]
    
    local_instances = [b for b in local_network.get_flatten_beams()]
    
    path = ghpath(i)
    
    for b, bi in zip(local_beams, local_instances):
        beams.Add(b, path)
        beam_instances.Add(bi, path)
# ---------- end python_19 ----------
item_11 = ListItem(List=python_19.beams, Index=Slider(20, range=0..20), Wrap=True)
preview_2 = CustomPreview(
    Geometry=item_11,
    Material={diffuse=RGB(0, 255, 255), emission=RGB(66, 48, 66), shine=0.5, specular=RGB(255, 255, 255), transparency=0.3})

# ----
line_2 = Line(python_17.d)  # disabled
pt_2 = Point(python_17.c)  # disabled
brep_6 = Brep(python_17.e)  # disabled
python_20 = GhPythonScript(surfaces=srf_17, surface_network_index=panel_12, top_priority_index=panel_11)  # -> out, beams, dowels, local_networks; inputs surfaces: list of Surface, surface_network_index: list, top_priority_index: list of Int32, has_loops: list of Boolean; disabled
# ---------- python_20: Python ----------
__author__ = "ytakzk"
__version__ = "2019.02.23"

import sys
import Rhino.Geometry as rg

from geometry import LocalNetwork, Surface

dowels = []
beams = []
tmp = []
local_networks = []

if len(surface_network_index) != len(top_priority_index):
    ValueError('surface_network_index must be the same size as top_priority_index')

# network

surface_network_sets = []
priorities = []

for string, priority_index in zip(surface_network_index, top_priority_index):
    
    values = string.split('&')

    surface_network = []
    
    priority_index_v = 0
    
    for v_values in values:

        surface_network_subset = []
        for v, index in enumerate(v_values.split(',')):
            
            index = int(index)

            if index == priority_index:
                
                priority_index_v = v
                
            surface = Surface(surfaces[index])
            surface_network_subset.append(surface)
            
        surface_network.append(surface_network_subset)
    
    priorities.append(priority_index_v)
    
    surface_network_sets.append(surface_network)

print priorities

for surface_network, top_priority_v_index in zip(surface_network_sets, priorities):

    local_network = LocalNetwork(surface_network, False, top_priority_v_index)

    local_dowels = local_network.add_three_beams_connection()
    dowels.extend([d.brep_representation() for d in local_dowels])

    local_dowels = local_network.add_two_beams_connection()
    dowels.extend([d.brep_representation() for d in local_dowels])

    local_beams = [b.brep_representation(make_holes=False) for b in local_network.get_flatten_beams()]
    beams.extend(local_beams)
    
    local_networks.append(local_network)
# ---------- end python_20 ----------
end = EndPoints(Curve=line_2)  # -> Start, End; disabled
python_21 = GhPythonScript(beams=python_19.beam_instances)  # -> out, tmp; inputs beams: tree
# ---------- python_21: Python ----------
__author__ = "ytakzk"
__version__ = "2019.02.26"

import Rhino.Geometry as rg
import os
import json
import compas_timber
from compas_timber.beam import Beam, BeamEnd, BeamSide 
from compas_timber.utilities import *
from compas.geometry import Plane
import math

import geometry.fabricatable_beam as fabricatable_beam
reload(fabricatable_beam)

from geometry.fabricatable_beam import FabricatableBeam

for i, bs in enumerate(beams.Branches):
    
    fabricatable_beams = []
    
    for b in bs:
        
        beam = FabricatableBeam.instantiate_from_beam(b)
        fabricatable_beams.append(beam)
    
    path = ghenv.Component.OnPingDocument().FilePath
    root_dir = os.path.dirname(path)
    FabricatableBeam.write_as_json(fabricatable_beams, name=i + 1, to=root_dir)

beams = FabricatableBeam.read_from_json('./1.json')

transformed_beams = FabricatableBeam.orient_structure(beams, beams[0].base_plane)

[b.create_compas_beam() for b in transformed_beams]

tmp = [b.create_brep() for b in transformed_beams]

lines = [b.get_dowel_lines() for b in transformed_beams]

for ls in lines:
    tmp.extend(ls)
# ---------- end python_21 ----------
panel_13 = Panel(python_21.tmp)
geo = Geometry(python_19.beams)
geo_2 = Geometry(python_21.tmp)
python_22 = GhPythonScript(beams=python_19.beam_instances)  # -> out, a; inputs beams: list
# ---------- python_22: Python ----------
__author__ = "ytakzk"
__version__ = "2019.02.26"

"""Provides a scripting component.
    Inputs:
        x: The x script variable
        y: The y script variable
    Output:
        a: The a output variable"""

__author__ = "mhelmrei"
__version__ = "2018.12.18"

import Rhino.Geometry as rg
import compas_timber
from compas_timber.beam import Beam, BeamEnd, BeamSide 
from compas_timber.utilities import *
from compas.geometry import Plane

import compas.geometry

compas_beams = []

for b in beams:
    
    plane = b.base_plane
    
    start_plane = rg.Plane(plane)
    start_plane.Translate(plane.XAxis * b.dx * 0.5)

    end_plane = rg.Plane(plane)
    end_plane.Translate(-plane.XAxis * b.dx * 0.5)

    e1 = BeamEnd(start_plane.Origin)
    e2 = BeamEnd(end_plane.Origin)
    
    normal = ([plane.ZAxis.X, plane.ZAxis.Y, plane.ZAxis.Z])
    
    compas_beam = Beam(e1, e2, b.dy, b.dz, normal)
    
    compas_beam.end1.cut_pln_explicit = Plane(start_plane.Origin, start_plane.XAxis)
    compas_beam.end2.cut_pln_explicit = Plane(end_plane.Origin, -end_plane.XAxis)
    
    compas_beams.append(compas_beam)
# ---------- end python_22 ----------
preview_3 = CustomPreview(
    Geometry=geo_2,
    Material={diffuse=RGB(30, 144, 255), emission=RGB(66, 48, 66), shine=0.5, specular=RGB(255, 255, 255), transparency=0})
merge_5 = Merge(Data1=python_6.local_networks, Data2=python_20.local_networks)  # disabled

# ---- group: fabrication sequence check
python_23 = GhPythonScript(local_networks=merge_5)  # -> out, beams, dowels; inputs local_networks: list; disabled
# ---------- python_23: Python ----------
__author__ = "ytakzk"
__version__ = "2019.02.24"

import System
import Grasshopper.Kernel.Data.GH_Path as ghpath
import Grasshopper.DataTree as datatree

beams = datatree[System.Object]()

for i, local_network in enumerate(local_networks):
    
    local_beams = [b.brep_representation(make_holes=False) for b in local_network.get_flatten_beams()]
    
    path = ghpath(i)
    
    for b in local_beams:
        beams.Add(b, path)
# ---------- end python_23 ----------
number_slider_10 = Slider(15, range=0..20)  # disabled
item_12 = ListItem(List=python_23.beams, Index=number_slider_10, Wrap=True)  # disabled
preview_4 = CustomPreview(
    Geometry=item_12,
    Material={diffuse=RGB(0, 255, 255), emission=RGB(66, 48, 66), shine=0.5, specular=RGB(255, 255, 255), transparency=0.3})  # disabled

# ----
python_24 = GhPythonScript()  # -> Out, A; disabled

# ==== cluster UVN
srf = ClusterInput()
number_slider = Slider(5, range=0..110)
extract_uv_vec = GhPythonScript(srf=srf)  # -> out, center_pt, u_vec, v_vec, normal; inputs srf: Surface
# ---------- extract_uv_vec: Python ----------
__author__ = "Wenqian"
__version__ = "2019.01.22"

import rhinoscriptsyntax as rs
import Rhino.Geometry as rg

srf.SetDomain(0,rg.Interval(0,1))
srf.SetDomain(1,rg.Interval(0,1))

center_pt = srf.PointAt(0.5,0.5)

u_vec = srf.FrameAt(0.5,0.5)[1].XAxis
v_vec = srf.FrameAt(0.5,0.5)[1].YAxis

normal =srf.NormalAt(0.5,0.5)
# ---------- end extract_uv_vec ----------
multiplication = Multiplication(A=extract_uv_vec.v_vec, B=500)
multiplication_2 = Multiplication(A=extract_uv_vec.normal, B=500)
multiplication_3 = Multiplication(A=extract_uv_vec.u_vec, B=500)
vdisex = VectorDisplayEx(
    Point=extract_uv_vec.center_pt,
    Vector=multiplication_3,
    Colour=ColourSwatch(SwatchColor=RGB(255, 0, 0)),
    Width=number_slider)
vdisex_2 = VectorDisplayEx(
    Point=extract_uv_vec.center_pt,
    Vector=multiplication,
    Colour=ColourSwatch(SwatchColor=RGB(33, 220, 0)),
    Width=number_slider)
vdisex_3 = VectorDisplayEx(
    Point=extract_uv_vec.center_pt,
    Vector=multiplication_2,
    Colour=ColourSwatch(SwatchColor=RGB(255, 255, 255)),
    Width=number_slider)
