# Grasshopper definition 190115_UR_Dowels.gh (Grasshopper 1.0.7)

vector_xyz = VectorXYZ(XComponent=0, YComponent=0, ZComponent=1)  # -> Vector, Length
point = Point(<point referenced from the Rhino model>)
plane_normal = PlaneNormal(Origin=point, ZAxis=vector_xyz.Vector)
pt = Point(Point(0, 0, 0))
pt_2 = Point(Point(0, 0, 0))
bulletclass = GhPythonScript()
# ---------- bulletclass: Python ----------
import Rhino.Geometry as rg
import scriptcontext as sc
import math as m

class Bullet(object):
    """
    simple bullet of clay
    """
    def __init__(self, origin_plane, bullet_radius, bullet_height, origin_bullet_height):
        """
        Args:
        origin_plane(Plane)
        radius(float)
        height(float)
        """
        self.o_plane = origin_plane
        
        
        self.radius = bullet_radius
        self.height = bullet_height
        self.ob_height = origin_bullet_height
        
        self.o_plane.Translate(self.o_plane.ZAxis*self.ob_height)
        self.volume = m.pi*self.radius**2*self.height
        self.cyl = self.generate_geo()
        
    def generate_geo(self):
        
        cyl = rg.Cylinder(rg.Circle(self.o_plane, self.radius), -self.height)
        return cyl
        
#bullet = Bullet(rg.Plane.WorldXY, 1, 1)
#bullet_geo = bullet.cyl

sc.sticky["BulletClass"] = Bullet
# ---------- end bulletclass ----------
python = PythonScript(x_count=Slider(10, range=2..50), z_count=Slider(20, range=2..50), base_layer_count=Slider(2, range=1..50))  # -> out, useful_list, total_list, pipe_list, curve_list, plane_list; inputs x_count: Int32, z_count: Int32, base_layer_count: Int32
# ---------- python: Python ----------
import math
import Rhino.Geometry as rg

## python set variables
# controlling the pd function
x_delta = 10.0
z_delta = 12.0
pd_min = .1
pd_max = .65
pd_range = pd_max - pd_min

# grid spacing for functions
z_space = 1.0
x_space = 1.0

global x_delta, z_delta, pd_min, pd_max, pd_range

# x_count = 6
# z_count = 21

# pigeon parameters

pigeon_height = 15.0
pigeon_width = 18.0
pd_default = .5
default_spacing = 20.0
perp_vec = rg.Vector3d(0,0,1)

## grasshopper informed

x_count = x_count
z_count = z_count

base_layer_count = base_layer_count

## pre-calculations

tau = math.pi * 2
start_x_count = x_count + (z_count - 1 - z_count % 2)
total_list = []
useful_list = []
pipe_list = []
previous_list = []
new_list= []
plane_list = []
curve_list = []


def pdFunction(x_val_unitized, z_val_unitized):
    angle_x = x_val_unitized % x_delta * tau / x_delta
    angle_z = z_val_unitized % z_delta * tau / z_delta
    angle = angle_x + angle_z
    local_pd_unit = (math.sin(angle) + 1.0)/2 # from 0 to 1
    local_pd = local_pd_unit * pd_range
    local_pd += pd_min
    return local_pd

def piping(plane, height):
    radius = pigeon_width / 2.0
    circle = rg.Circle(plane, radius)
    pipe = rg.Cylinder(circle, -height)
    return pipe

for j in range(z_count):
    # previous_list cleaning
    previous_list = new_list
    for point in previous_list:
        print point.Z,
    print "/n"
    new_list = []

    # piramid scheme and filtering
    local_x_count_len = start_x_count - j
    start_useful = (local_x_count_len + (j + 1) % 2 - x_count) / 2
    end_useful = start_useful + x_count - (j + 1) % 2 - 1

    z_val_unitized = j * z_space

    if (j < base_layer_count):
        z_val = pigeon_height * pd_default * j
        z_val_top = pigeon_height * pd_default
        for i in range(local_x_count_len):
            x_val_unitized = (- float(local_x_count_len) / 2 + i)
            x_val = x_val_unitized * default_spacing
            x_val_unitized *= x_space
            base_point = rg.Point3d(x_val, 0, z_val)
            top_point = rg.Point3d(x_val, 0, z_val + z_val_top)
            new_list.append(top_point)
            total_list.append(base_point)
            if (i >= start_useful) and (i <= end_useful):
                useful_list.append(base_point)
                top_plane = rg.Plane(top_point, perp_vec)
                plane_list.append(top_plane)
                pipe_list.append(piping(top_plane, z_val_top))
    else:
        for i in range(local_x_count_len):
            # setting the x_value fot the function
            x_val_unitized = (- float(local_x_count_len) / 2 + i) * x_space
            # calculating the midpoints of the previous top_points
            x_val = (previous_list[i].X + previous_list[i+1].X) / 2
            y_val = (previous_list[i].Y + previous_list[i+1].Y) / 2
            z_val = (previous_list[i].Z + previous_list[i+1].Z) / 2
            pd = pdFunction(x_val_unitized, z_val_unitized)
            print "point" , i, j, ": " , pd, " - ",
            z_val_top_distance = pigeon_height * pd
            print z_val_top_distance
            base_point = rg.Point3d(x_val, y_val, z_val)
            top_point = rg.Point3d(x_val, y_val, z_val + z_val_top_distance)
            new_list.append(top_point)
            total_list.append(base_point)
            if (i >= start_useful) and (i <= end_useful):
                useful_list.append(base_point)
                top_plane = rg.Plane(top_point, perp_vec)
                plane_list.append(top_plane)
                pipe_list.append(piping(top_plane, z_val_top_distance))
    curve = rg.PolylineCurve(new_list)
    curve_list.append(curve)
# ---------- end python ----------
simplegradient = PythonScript(
    start_point=pt,
    x_spacing=Slider(20, range=0..40),
    x_count=Slider(8, range=2..30),
    z_count=Slider(26, range=2..40),
    rel_change_min=Slider(0.05, range=-1..0.65),
    rel_change_max=Slider(0.5, range=-1..0.65),
    baseline_count=Slider(2, range=2..30),
    gradient=Slider(0.1, range=-1..0.65))  # -> out, plane_list, pipe_list, pipes; inputs start_point: Point3d, x_count: Int32, z_count: Int32, z_delta: Int32, x_delta: Int32, baseline_count: Int32, invert: Boolean
# ---------- simplegradient: Python ----------
import math
import Rhino.Geometry as rg

pigeon_height = 15.0
pigeon_width = 18.0

# define in gh

x0 = start_point.X
y0 = start_point.Y
z0 = start_point.Z

base_layer_count = baseline_count
min_pres = rel_change_min
max_pres = rel_change_max

base_gradient = gradient

# defined in python

# x0 = 0
# y0 = 0
# z0 = 0
#
# x_count = 5
# z_count = 20
# base_layer_count = 2
#
# x_spacing = 20.0
#
# min_pres = -.1
# max_pres = .65
#
# base_gradient = .1

# local variables
pres_count = 0
prev_z_value = 0

plane_list = []
pipe_list = []
perp_vec = rg.Vector3d(0,0,1)

def piping(plane, height):
    radius = pigeon_width / 2.0
    circle = rg.Circle(plane, radius)
    pipe = rg.Cylinder(circle, -height)
    return pipe

gradient = -.8 * base_gradient

grading = x_count * x_spacing

for j in range(z_count):
    if (j < base_layer_count):
        pres_count = .5
    else: 
        if (pres_count <= min_pres):
            gradient = 1.2 * base_gradient
        elif (pres_count >= max_pres):
            gradient = -.8 * base_gradient
        pres_count += gradient
    local_z_value = pres_count * pigeon_height
    for i in range(x_count - j%2):
        pre_x = (float(j%2)/2.0 + i + .5) * x_spacing
        pre_x /= grading / 2
        pre_x -= 1
        if pre_x == 0:
            sign = 1
        else:
            sign = pre_x/abs(pre_x)
        x = (abs(pre_x))**1.2 * sign * grading * .45
#        x = math.sin(pre_x) * grading * .4
#        x = (float(j%2)/2.0 + i) * x_spacing
        z = prev_z_value + local_z_value
        local_point = rg.Point3d(x0 + x, y0 + 0, z0 + z)
        local_plane = rg.Plane(local_point, perp_vec)
        plane_list.append(local_plane)
        pipe_list.append(piping(local_plane, local_z_value))
    prev_z_value += local_z_value
# ---------- end simplegradient ----------
simplegradient_2 = PythonScript(
    start_point=pt_2,
    x_spacing=Slider(20, range=0..40),
    x_count=Slider(8, range=2..30),
    z_count=Slider(26, range=2..40),
    rel_change_min=Slider(0.2, range=-1..0.65),
    rel_change_max=Slider(0.5, range=-1..0.65),
    baseline_count=Slider(2, range=2..30),
    gradient=Slider(0.1, range=-1..0.65),
    exp=Slider(1.5, range=1..2),
    second_gradient=Slider(0.35, range=0.1..2))  # -> out, plane_list, pipe_list, pipes; inputs start_point: Point3d, x_count: Int32, z_count: Int32, z_delta: Int32, x_delta: Int32, baseline_count: Int32, invert: Boolean
# ---------- simplegradient_2: Python ----------
import math
import Rhino.Geometry as rg

pigeon_height = 15.0
pigeon_width = 18.0

# define in gh

x0 = start_point.X
y0 = start_point.Y
z0 = start_point.Z

base_layer_count = baseline_count
min_pres = rel_change_min
max_pres = rel_change_max

base_gradient = gradient

# defined in python

# x0 = 0
# y0 = 0
# z0 = 0
#
# x_count = 5
# z_count = 20
# base_layer_count = 2
#
# x_spacing = 20.0
#
# min_pres = -.1
# max_pres = .65
#
# base_gradient = .1

# local variables
pres_count = 0
prev_z_value = 0

plane_list = []
pipe_list = []
perp_vec = rg.Vector3d(0,0,1)

def piping(plane, height):
    radius = pigeon_width / 2.0
    circle = rg.Circle(plane, radius)
    pipe = rg.Cylinder(circle, -height)
    return pipe

gradient = -.8 * base_gradient

grading = x_count * x_spacing

for j in range(z_count):
    if (j < base_layer_count):
        pres_count = .5
    else: 
        if (pres_count <= min_pres):
            gradient = 1.2 * base_gradient
        elif (pres_count >= max_pres):
            gradient = -.8 * base_gradient
        pres_count += gradient
    local_z_value = pres_count * pigeon_height
    for i in range(x_count - j%2):
        pre_x = (float(j%2)/2.0 + i + .5) * x_spacing
        pre_x /= grading / 2
        pre_x -= 1
        if pre_x == 0:
            sign = 1
        else:
            sign = pre_x/abs(pre_x)
        x = (abs(pre_x))**exp * sign * grading * second_gradient
        y = (abs(pre_x))**.25 * grading * .1 * pres_count
#        x = math.sin(pre_x) * grading * .4
#        x = (float(j%2)/2.0 + i) * x_spacing
        z = prev_z_value + local_z_value
        local_point = rg.Point3d(x0 + x, y0 + y, z0 + z)
        local_plane = rg.Plane(local_point, perp_vec)
        plane_list.append(local_plane)
        pipe_list.append(piping(local_plane, local_z_value))
    prev_z_value += local_z_value
# ---------- end simplegradient_2 ----------
pt_3 = Point(python.useful_list)
pt_4 = Point(python.total_list)
brep = Brep(python.pipe_list)

# ---- group: picking_planes
picking_origin = Point(<point referenced from the Rhino model>)
xy_plane = XYPlane(Origin=picking_origin)
unit_z = UnitZ(Factor=Slider(20, range=0..100))
move = Move(Geometry=xy_plane, Motion=unit_z)  # -> Geometry, Transform
ghpython_script = GhPythonScript(origin_plane=move.Geometry, bullet_radius="6", x_no=Slider(5, range=0..10), y_no=Slider(5, range=0..10))  # -> out, picking_planes, size_of_clay, visualize; inputs origin_plane: Plane, bullet_radius: Int32, x_no: Int32, y_no: Int32
# ---------- ghpython_script: Python ----------
__author__ = "jennyd"
__version__ = "2018.11.01"

import Rhino.Geometry as rg

picking_planes = []
buffer = 2
for i in range(x_no):
    for j in range(y_no):
        temp_picking_plane = rg.Plane(origin_plane)
        temp_picking_plane.Translate(rg.Vector3d(i*(bullet_radius*2+buffer),j*(bullet_radius*2+buffer),0))
        picking_planes.append(temp_picking_plane)

size_of_clay = (x_no * (bullet_radius*2+buffer), y_no * (bullet_radius*2+buffer))
print size_of_clay

visualize = [rg.Circle(p, bullet_radius) for p in picking_planes]
rectangle_origin = rg.Plane(origin_plane)
rectangle_origin.Translate(rg.Vector3d(-(bullet_radius+buffer/2),-(bullet_radius+buffer/2),0))
visualize.append(rg.Rectangle3d(rectangle_origin, size_of_clay[0], size_of_clay[1]))
# ---------- end ghpython_script ----------
panel = Panel(ghpython_script.size_of_clay)
picking_planes = Geometry(ghpython_script.picking_planes)

# ----
python_2 = GhPythonScript()  # -> out
# ---------- python_2: Python ----------
__author__ = "ytakzk"
__version__ = "2019.01.15"

import Rhino.Geometry as rg
import scriptcontext as sc

class Beam:
    
    def __init__(self, base_plane, dx, dy, dz):
        
        self.base_plane = base_plane
        self.dx = dx
        self.dy = dy
        self.dz = dz
        self.dowel_list = []
        
    def materialize(self):
        
        # create a beam
        box = rg.Box(self.base_plane,
            rg.Interval(-self.dx*0.5, self.dx*0.5),
            rg.Interval(-self.dy*0.5, self.dy*0.5),
            rg.Interval(-self.dz*0.5, self.dz*0.5)
            )
        
        # create a dowels
        for dowel in self.dowel_list:
            
            d = dowel.get_pipe_with_length()
            
            rg.Circle(d)
        
        return box

class Dowel:
    
    inner_radius = 24
    outer_radius = 26
    
    def __init__(self, base_plane):
        
        self.base_plane = base_plane
        self.beam_list = []
        
    def materialize(self):
        
        pass
        
    def get_pipe_with_length(self, length=9999):
        
        copied_plane = rg.Plane(self.base_plane)
        
        copied_plane.Translate(copied_plane.Normal * -length)
    
        circle = rg.Circle(copied_plane, self.inner_radius)
        return rg.Cylinder(circle, length)

sc.sticky['Dowel'] = Dowel
sc.sticky['Beam'] = Beam
# ---------- end python_2 ----------

# ----
# 0a
# Settings
# Check your IP address and set UR IP address
server_address = ValueList({"192.168.10.12", "192.168.10.11", "192.168.10.10", "192.168.10.2", "127.0.0.1"}, selected="192.168.10.11")
ur_ip = ValueList({"192.168.10.13", "192.168.10.11", "192.168.10.10", "127.0.0.1"}, selected="192.168.10.10")
server_port = Integer(30003)
globals = PythonScript(server_address=server_address, server_port=server_port, ur_ip=ur_ip)  # inputs server_port: Int32
# ---------- globals: Python ----------
from scriptcontext import sticky as st

st["server_address"] = server_address
st["server_port"] = server_port

st["ur_ip"] = ur_ip
# ---------- end globals ----------

# ----
# Check if UR is available
ping = Button()
py = PythonScript(ip=ur_ip, ping=ping)  # -> out
# ---------- py: Python ----------
from scriptcontext import sticky as st
from ur_online_control.communication import is_available


guid = str(ghenv.Component.InstanceGuid)
txt_key = "txt_" + guid
if txt_key not in st:
    st[txt_key] = ""

if ping:
    
    available = is_available(ip)
    
    if available:
        st[txt_key] = "%s is up!" % ip
    else:
        st[txt_key] = "%s is down!" % ip

print st[txt_key]
# ---------- end py ----------
panel_2 = Panel(py)

pt_5 = ConstructPoint(XCoordinate=Slider(64, range=0..100), YCoordinate=Slider(0, range=0..100), ZCoordinate=Slider(3, range=0..100))
pt_6 = ConstructPoint(XCoordinate=Slider(71, range=0..100), YCoordinate=Slider(40, range=0..100), ZCoordinate=Slider(-36, range=-100..101))
pt_7 = ConstructPoint(XCoordinate=Slider(0.1, range=0..1), YCoordinate=Slider(0.9, range=0..1), ZCoordinate=Slider(0.3, range=0..1))
pt_8 = ConstructPoint(XCoordinate=Slider(0.2, range=0..1), YCoordinate=Slider(0.7, range=0..1), ZCoordinate=Slider(0.1, range=0..1))
pt_9 = ConstructPoint(XCoordinate=Slider(93, range=0..100), YCoordinate=Slider(100, range=0..100), ZCoordinate=Slider(40, range=0..100))
pt_10 = ConstructPoint(XCoordinate=Slider(76, range=0..100), YCoordinate=Slider(35, range=0..500), ZCoordinate=Slider(36, range=0..200))
pt_11 = ConstructPoint(XCoordinate=Slider(0.2, range=0..1), YCoordinate=Slider(0.7, range=0..1), ZCoordinate=Slider(0.2, range=0..1))
pt_12 = ConstructPoint(XCoordinate=Slider(0.2, range=-1..1), YCoordinate=Slider(0.8, range=0..1), ZCoordinate=Slider(0.1, range=0..1))
number_slider = Slider(100, range=0..100)
number_slider_2 = Slider(100, range=0..100)
pl = PlaneNormal(Origin=pt_5, ZAxis=pt_7)
pl_2 = PlaneNormal(Origin=pt_6, ZAxis=pt_8)
pl_3 = PlaneNormal(Origin=pt_9, ZAxis=pt_11)
pl_4 = PlaneNormal(Origin=pt_10, ZAxis=pt_12)

bang = Button()
panel_3 = Panel("Unload libraries")
unload = PythonScript(bang=bang)
# ---------- unload: Python ----------
from compas_ghpython import unload_modules

unload_modules("compas")
unload_modules("ur_online_control")
# ---------- end unload ----------

line = LineSDL(Start=pt_6, Direction=pt_8, Length=number_slider)
line_2 = LineSDL(Start=pt_10, Direction=pt_12, Length=number_slider_2)
size_z = Slider(4, range=0..200)
number_slider_3 = Slider(1, range=0..50)
ext = ExtendCurve(Curve=line, Type=0, Start=number_slider, End=number_slider)
ext_2 = ExtendCurve(Curve=line_2, Type=0, Start=number_slider_2, End=number_slider_2)
pt_13 = Point(<point referenced from the Rhino model>)
drill_bit_length = Slider(18.5, range=0..30)

# ---- group: Robot
# 1. load robot model
# 2. set tool
# 3. set basis
list = ValueList({"measurement_tool": 0, "drill_tool": 1, "gripper_tool": 2}, selected="gripper_tool")
tools = Tools(tool_id=list, drill_bit_length=drill_bit_length)
base = PythonScript()  # -> base_frame
# ---------- base: Python ----------
from compas.geometry import Frame

origin = [414.42, -207.44, 85.96]
xaxis = [0.00000, 1.00000, 0.00000]
yaxis = [-1.00000, 0.00000, 0.00000]


base_frame = Frame(list(origin), list(xaxis), list(yaxis))
# ---------- end base ----------
list_2 = ValueList({"UR5", "UR10"}, selected="UR5")
robot = PythonScript(model=list_2, tool=tools, base_frame=base)  # -> robot
# ---------- robot: Python ----------
from ur_online_control.ur.ur10 import UR10
from ur_online_control.ur.ur5 import UR5
from scriptcontext import sticky as st

if model == "UR5":
    robot = UR5()
elif model == "UR10":
    robot = UR10()

if tool:
    robot.set_tool(tool)
if base_frame:
    robot.set_base(base_frame)

st["robot"] = robot
# ---------- end robot ----------

# ----
xy = XYPlane(Origin=pt_13)

# ---- group: picking_plane
geo = Geometry(flatten(picking_planes))

# ---- group: placing_plane
geo_2 = Geometry(flatten(xy))

# ----
py_2 = PythonScript()  # -> path
# ---------- py_2: Python ----------
import sys
import os

ghComp = ghenv.Component
ghDoc = ghComp.OnPingDocument()

# the full path of the gh file
path = ghDoc.FilePath
# the directory of the gh file
path = os.path.dirname(path)

path = os.path.abspath(os.path.join(path, ".."))

print path
# ---------- end py_2 ----------
# 1
# Executing
panel_4 = Panel("Start communication server")
start = Button()
panel_5 = Panel(py_2)
server = PythonScript(path=panel_5, start=start)
# ---------- server: Python ----------
import os
import threading
from scriptcontext import sticky as st

server_address = st["server_address"]
server_port = st["server_port"]
ur_ip = st["ur_ip"]

"""
Change main!!!!
"""
main = os.path.join(path, "communication", "main_dowel_gripping_v1.py")

if os.path.isfile(main):
        
    def myfunc():
        syscall = "python %s %s %s %s" % (main, server_address, server_port, ur_ip)
        os.system(syscall)
    
    if start:
        t = threading.Thread(target=myfunc)
        t.start()
# ---------- end server ----------

speed = Slider(300, range=0..300)

panel_6 = Panel("Get UR connected")
ur = PythonScript(send=start)
# ---------- ur: Python ----------
from scriptcontext import sticky as st
from ur_online_control.ur_driver import URDriver

server_address = st["server_address"]
server_port = st["server_port"]
ur_ip = st["ur_ip"]
robot = st["robot"]

tool_angle_axis = list(robot.tool.tcp_frame.point) + robot.tool.tcp_frame.axis_angle_vector
#robot.tool.tcp_frame.pose_axis_angle_vector
print tool_angle_axis

ur_driver = URDriver(server_address, server_port, tool_angle_axis, ur_ip, "UR")
print ur_driver

if send:
    ur_driver.send()
# ---------- end ur ----------

disconnect = Button()
panel_7 = Panel("Get Grasshopper connected")
client = PythonScript(connect=start, disconnect=disconnect)  # -> connected, client
# ---------- client: Python ----------
import time
from scriptcontext import sticky as st
from Rhino.RhinoApp import WriteLine
from ur_online_control.grasshopper import GHClient, gh_component_timer
import time

server_address = st["server_address"]
server_port = st["server_port"]

guid = str(ghenv.Component.InstanceGuid)

client_key = "client_" + guid
run_key = "run_" + guid

if connect:
    if client_key not in st:
        st[client_key] = GHClient(server_address, server_port)
        client = st[client_key]
        client.connect_to_server()
        client.start()
        
    else:
        if st[client_key].running:
            WriteLine("Client is already connected.")
            
        else:
            st[client_key] = GHClient(server_address, server_port)
            client = st[client_key]
            client.connect_to_server()
            client.start()
"""
else:
    if client_key in st:
        # we need a timer to ask if we have something on the rcv queue
        client = st[client_key]
        #if client.running:
        #    #client.run_inner_while()
        #    gh_component_timer(ghenv, True, 1000)
"""

if disconnect:
    if client_key in st:
        client = st[client_key]
        if client.running:
            client.close()

if client_key in st:
    connected =  st[client_key].running
    client = st[client_key]
    print st[client_key].rcv_queue.qsize()
    print st[client_key].snd_queue.qsize()
else:
    connected = False
# ---------- end client ----------
panel_8 = Panel(client.connected)

# ----
# This component updates on receive
bang_2 = Button()
receive = PythonScript(client=client.client, bang=bang_2)  # -> qsize, client
# ---------- receive: Python ----------
from ur_online_control.communication.msg_identifiers import *
from ur_online_control.utilities.lists import flatten_list
from Rhino.RhinoApp import WriteLine


if client:
    if not client.ghenv:
        client.ghenv = ghenv
    qsize = client.rcv_queue.qsize()
# ---------- end receive ----------
panel_9 = Panel(receive.qsize)

bang_3 = Button()
receive_2 = PythonScript(client=client.client, bang=bang_3)  # -> qsize, client; same code as receive
panel_10 = Panel(receive_2.qsize)

send = PythonScript(client=receive_2.client)  # -> out
# ---------- send: Python ----------
from ur_online_control.communication.msg_identifiers import *
from ur_online_control.utilities.lists import flatten_list

if client:
    qsize = client.rcv_queue.qsize()
    if qsize:
        msg = client.rcv_queue.get()
        print msg
# ---------- end send ----------
panel_11 = Panel(send)
send_2 = PythonScript(client=receive.client)  # -> out; same code as send
panel_12 = Panel(send_2)

# ----
# Direct UR control
get = Button()
get_2 = Button()
pose = PythonScript(get=get_2)  # -> pose_joints
# ---------- pose: Python ----------
from scriptcontext import sticky as st
from ur_online_control.ur_direct import get_current_pose_joints
from ur_online_control.ur.robot import BaseConfiguration

server_address = st["server_address"]
server_port = 30005
ur_ip = st["ur_ip"]
robot = st["robot"]
tool_angle_axis = list(robot.tool.tcp_frame.point) + robot.tool.tcp_frame.axis_angle_vector
print tool_angle_axis

guid = str(ghenv.Component.InstanceGuid)
pose_joints_key = "pose_joints" + guid


if get:
    st[pose_joints_key] = get_current_pose_joints(server_address, server_port, ur_ip, tool_angle_axis)
    
if pose_joints_key not in st:
    pose_joints = []
else:
    pose_joints = BaseConfiguration.from_joints(st[pose_joints_key])
# ---------- end pose ----------
pose_2 = PythonScript(get=get)  # -> pose_cartesian
# ---------- pose_2: Python ----------
from scriptcontext import sticky as st
from ur_online_control.ur_direct import get_current_pose_cartesian

server_address = st["server_address"]
server_port = 30005
ur_ip = st["ur_ip"]
robot = st["robot"]
tool_angle_axis = list(robot.tool.tcp_frame.point) + robot.tool.tcp_frame.axis_angle_vector
print tool_angle_axis

guid = str(ghenv.Component.InstanceGuid)
pose_cartesian_key = "pose_cartesian" + guid


if get:
    st[pose_cartesian_key] = get_current_pose_cartesian(server_address, server_port, ur_ip, tool_angle_axis)

if pose_cartesian_key not in st:
    pose_cartesian = []
else:
    pose_cartesian = st[pose_cartesian_key]
# ---------- end pose_2 ----------
stop = Button()
stop_2 = PythonScript(stop=stop)
# ---------- stop_2: Python ----------
from scriptcontext import sticky as st
from ur_online_control.ur_direct import stop as stop_robot

ur_ip = st["ur_ip"]

if stop:
    stop_robot(ur_ip)
# ---------- end stop_2 ----------
panel_13 = Panel(pose)
panel_14 = Panel(pose_2)

vertical_pose = Number([-152.427, -780.635, 855.229, -1.1958, -1.22046, -1.20201])
py_3 = PythonScript(pose_cartesian=pose_2)  # -> frame_WCS; inputs pose_cartesian: list
# ---------- py_3: Python ----------
import Rhino.Geometry as rg
from scriptcontext import sticky as st
from compas.geometry import Frame
from compas.geometry.xforms import Transformation

robot = st["robot"]



if pose_cartesian:
    frame_RCS = Frame.from_axis_angle_vector(pose_cartesian)
    frame_WCS = robot.get_frame_in_WCS(frame_RCS)
# ---------- end py_3 ----------
draw = Draw(frame=py_3)  # -> G, C
back = Button()
reset = Button()

# ---- group: Define joint positions
base_2 = Slider(-173.869, range=-360..360)
elbow = Slider(90.765, range=-360..360)
wrist2 = Slider(-82.725, range=-360..360)
wrist3 = Slider(91.571, range=-360..360)
shoulder = Slider(-72.967, range=-360..360)
wrist1 = Slider(-115.737, range=-360..360)
ur1_q1_q6 = Data([base_2, shoulder, elbow, wrist1, wrist2, wrist3])

# ----
preview = CustomPreview(Geometry=draw.G, Shader=draw.C)
py_4 = GhPythonScript(joint_values=ur1_q1_q6)  # -> configuration; inputs joint_values: list
# ---------- py_4: Python ----------
import math
from ur_online_control.ur.robot import BaseConfiguration

configuration = BaseConfiguration.from_joints([math.radians(d) for d in joint_values])
# ---------- end py_4 ----------

# ----
# Calculate basis
# Measure basis:
# 1. Clear the recorded poses
# 2. Move robot to origin and press "get pose"
# 3. Move robot to point in positive x-axis and press "get pose"
# 4. Move robot to an other point in your basis and press "get pose"
# (The farer away these positions are, the better)
# 
# 5. Alternatively change the order in the component calc base
# 6. Copy output into base component
list_3 = ValueList({"origin, pt on positive x-axis, pt in xy plane": 0, "origin, pt on positive y-axis, pt in xy plane": 1}, selected="origin, pt on positive x-axis, pt in xy plane")
clear = Button()
rec = PythonScript(msg=pose_2, rec=get, clear=clear)  # -> rec; inputs msg: list
# ---------- rec: Python ----------
from scriptcontext import sticky as st

guid = str(ghenv.Component.InstanceGuid)
recorded_key =  "recorded_" + guid
just_cleared_key = "just_cleared_" + guid

if recorded_key not in st:
    st[recorded_key] = []

if just_cleared_key not in st:
    st[just_cleared_key] = False

if clear:
    st[recorded_key] = []
    st[just_cleared_key] = True
else:
    if len(msg):
        if msg != [None] and not st[just_cleared_key] and rec:
            st[recorded_key].append(msg)
    st[just_cleared_key] = False
        


rec = st[recorded_key]

print rec
# ---------- end rec ----------
calc_base = PythonScript(poses=rec, input_type=list_3)  # -> out; inputs poses: list
# ---------- calc_base: Python ----------
import Rhino.Geometry as rg
import math


if len(poses) > 2:
    
    O = poses[0]
    P1 = poses[1]
    P2 = poses[2]
    
    if input_type == 0:
        # origin, pt on positive x-axis, pt in xy plane
        origin = rg.Point3d(O[0], O[1], O[2])
        pt_on_xaxis = rg.Point3d(P1[0], P1[1], P1[2])
        pt_in_xyplane = rg.Point3d(P2[0], P2[1], P2[2])
        
        xaxis = pt_on_xaxis - origin
        xaxis.Unitize()
        
        v = pt_in_xyplane - origin
        zaxis = rg.Vector3d.CrossProduct(v, xaxis)
        zaxis.Unitize()
        
        # zaxis must look up!
        if math.acos(rg.Vector3d.ZAxis * zaxis) > math.acos(rg.Vector3d.ZAxis * -zaxis):
            zaxis = -zaxis
        
        yaxis = rg.Vector3d.CrossProduct(zaxis, xaxis)
    
    elif input_type == 1:
        # origin, pt on positive y-axis, pt in xy plane
        origin = rg.Point3d(O[0], O[1], O[2])
        pt_on_yaxis = rg.Point3d(P1[0], P1[1], P1[2])
        pt_in_xyplane = rg.Point3d(P2[0], P2[1], P2[2])
        
        yaxis = pt_on_yaxis - origin
        yaxis.Unitize()
        
        v = pt_in_xyplane - origin
        zaxis = rg.Vector3d.CrossProduct(v, yaxis)
        zaxis.Unitize()
        
        # zaxis must look up!
        if math.acos(rg.Vector3d.ZAxis * zaxis) > math.acos(rg.Vector3d.ZAxis * -zaxis):
            zaxis = -zaxis
        
        xaxis = rg.Vector3d.CrossProduct(yaxis, zaxis)
        
        
    print "Copy the following into base component:"
    print " "
    print "origin = [%.2f, %.2f, %.2f]" % tuple(list(origin))
    print "xaxis = [%.5f, %.5f, %.5f]" % tuple(list(xaxis))
    print "yaxis = [%.5f, %.5f, %.5f]" % tuple(list(yaxis))
    

#print rg.Vector3d.CrossProduct(rg.Vector3d.YAxis, rg.Vector3d.ZAxis)
#print rg.Vector3d.CrossProduct(rg.Vector3d.ZAxis, rg.Vector3d.XAxis)
# ---------- end calc_base ----------
panel_15 = Panel(rec)
panel_16 = Panel(calc_base)

# ---- group: Visualise / robot model brep
py_5 = PythonScript(model=list_2)  # -> n
# ---------- py_5: Python ----------
if model == "UR5":
    n = 0
if model == "UR10":
    n = 1

print n
# ---------- end py_5 ----------
ur10_brep = UR10Brep([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])
ur5_brep = UR5Brep([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])
show_brep = BooleanToggle(False)
filter = StreamFilter(Gate=py_5, Stream0=ur5_brep, Stream1=ur10_brep)

# ---- group: Send joint position directly to robot
panel_17 = Panel("move cartesian")
idx = Slider(0, range=0..100)
commands = Data([-0.7378762823, -1.645309655, 1.740348054, -0.3678008479, -0.3738495375, -0.1107411527])
item = ListItem(List=commands, Index=idx, Wrap=True)
list_4 = ValueList({"send all positions": 0, "send only one position": 1}, selected="send only one position")
filter_2 = StreamFilter(Gate=list_4, Stream0=commands, Stream1=item)
movel = PythonScript(commands=filter_2, velocity=Slider(100, range=0..100))  # -> script; inputs commands: list
# ---------- movel: Python ----------
from scriptcontext import sticky as st

script_lines = []
for cmd in commands:
    #q, a=1.4, v=1.05, t=0, r=0)
    x, y, z, ax, ay, az, speed, radius = cmd
    script_lines.append("movel(p%s, v=%f, r=%f)" % (str([x/1000., y/1000., z/1000, ax, ay, az]), speed/1000., radius/1000.))

robot = st["robot"]
tool_angle_axis = list(robot.tool.tcp_frame.point) + robot.tool.tcp_frame.axis_angle_vector
x, y, z, ax, ay, az = tool_angle_axis

script = "def prog():\n"
script += "\ttextmsg(\">> program start\")\n"
script += "\tset_tcp(p%s)\n" % str([x/1000., y/1000., z/1000, ax, ay, az])
script += "".join(["\t%s\n" % line for line in script_lines])
script += "\ttextmsg(\"<< program end\")\n"
script += "end\n"
script += "prog()\n\n"

print script
# ---------- end movel ----------
send_3 = Button()
send_4 = Send(script=movel, send=send_3)
panel_18 = Panel(send_4)

# ----
panel_19 = Panel("move vertical")
movel_2 = PythonScript()  # -> script
# ---------- movel_2: Python ----------
from scriptcontext import sticky as st

robot = st["robot"]
tool_angle_axis = list(robot.tool.tcp_frame.point) + robot.tool.tcp_frame.axis_angle_vector
x, y, z, ax, ay, az = tool_angle_axis

script = "def prog():\n"
script += "\ttextmsg(\">> program start\")\n"
script += "\tset_tcp(p%s)\n" % str([x/1000., y/1000., z/1000, ax, ay, az])
script += "\tcurrent_pose = get_forward_kin()\n"
script += "\tmovel(p[current_pose[0], current_pose[1], current_pose[2], 0, 0, 0], a=0.1, v=0.1)\n"
script += "\ttextmsg(\"<< program end\")\n"
script += "end\n"
script += "prog()\n\n"

print script
# ---------- end movel_2 ----------
send_5 = Button()
send_6 = Send(script=movel_2, send=send_5)
panel_20 = Panel(send_6)

panel_21 = Panel("set digital out")
number = Slider(0, range=0..10)
value = BooleanToggle(False)
digital_out = PythonScript(number=number, value=value)  # -> script; inputs number: Int32, value: Boolean
# ---------- digital_out: Python ----------
script = "def prog():\n"
script += "\ttextmsg(\">> program start\")\n"
script += "\tset_digital_out(%i, %s)\n" % (int(number), str(value))
script += "\ttextmsg(\"<< program end\")\n"
script += "end\n"
script += "prog()\n\n"

print script
# ---------- end digital_out ----------
send_7 = Button()
send_8 = Send(script=digital_out, send=send_7)
panel_22 = Panel(send_8)

# ----
# move incremental in WCS
number_slider_4 = Slider(10, range=-10..10)
list_5 = ValueList({"xaxis", "yaxis", "zaxis"}, selected="yaxis")
movel_3 = PythonScript(step_size=number_slider_4, direction=list_5)  # -> script
# ---------- movel_3: Python ----------
from scriptcontext import sticky as st

robot = st["robot"]
tool_angle_axis = list(robot.tool.tcp_frame.point) + robot.tool.tcp_frame.axis_angle_vector
x, y, z, ax, ay, az = tool_angle_axis

script = "def prog():\n"
script += "\ttextmsg(\">> program start\")\n"
script += "\tset_tcp(p%s)\n" % str([x/1000., y/1000., z/1000, ax, ay, az])
script += "\tcurrent_pose = get_forward_kin()\n"


if direction == "xaxis":
    script += "\tmovel(p[current_pose[0] + %f, current_pose[1], current_pose[2], current_pose[3], current_pose[4], current_pose[5]], t=%f)\n" % (step_size/1000., step_size * 0.1)

elif direction == "yaxis":
    script += "\tmovel(p[current_pose[0], current_pose[1] + %f, current_pose[2], current_pose[3], current_pose[4], current_pose[5]], t=%f)\n" % (step_size/1000., step_size * 0.1)

else: # direction == "zaxis":
    script += "\tmovel(p[current_pose[0], current_pose[1], current_pose[2] + %f, current_pose[3], current_pose[4], current_pose[5]], t=%f)\n" % (step_size/1000., step_size * 0.1)

script += "\ttextmsg(\"<< program end\")\n"
script += "end\n"
script += "prog()\n\n"

print script
# ---------- end movel_3 ----------
send_9 = Button()
send_10 = Send(script=movel_3, send=send_9)
panel_23 = Panel(send_10)

# ----
# move incremental in TCS
get_current_pose = Button()
list_6 = ValueList({"xaxis", "yaxis", "zaxis"}, selected="zaxis")
movel_4 = PythonScript(get=get_current_pose, step_size=Slider(50, range=-10..50), direction=list_6)  # -> script; inputs get: list
# ---------- movel_4: Python ----------
from scriptcontext import sticky as st
from compas.geometry import Frame
from compas.geometry import Point, Vector
from ur_online_control.ur_direct import get_current_pose_cartesian

server_address = st["server_address"]
server_port = 30005
ur_ip = st["ur_ip"]
robot = st["robot"]
tool_angle_axis = list(robot.tool.tcp_frame.point) + robot.tool.tcp_frame.axis_angle_vector
print tool_angle_axis

guid = str(ghenv.Component.InstanceGuid)
pose_cartesian_key = "pose_cartesian" + guid

if get:
    st[pose_cartesian_key] = get_current_pose_cartesian(server_address, server_port, ur_ip, tool_angle_axis)

if pose_cartesian_key not in st:
    pose_cartesian = []
    script = ""
else:
    pose_cartesian = st[pose_cartesian_key]

    robot = st["robot"]
    tool_angle_axis = list(robot.tool.tcp_frame.point) + robot.tool.tcp_frame.axis_angle_vector
    x, y, z, ax, ay, az = tool_angle_axis
    
    script = "def prog():\n"
    script += "\ttextmsg(\">> program start\")\n"
    script += "\tset_tcp(p%s)\n" % str([x/1000., y/1000., z/1000, ax, ay, az])
    script += "\tcurrent_pose = get_forward_kin()\n"
    
#    frame = Frame.from_pose_axis_angle_vector(pose_cartesian)
    frame = Frame.from_axis_angle_vector([ax, ay, az])
    frame.point = [x, y, z]

    if direction == "xaxis":
        next_vector = Vector(*frame.xaxis) * step_size
    elif direction == "yaxis":
        next_vector = Vector(*frame.yaxis) * step_size
    else: # direction == "zaxis":
        next_vector = Vector(*frame.zaxis) * step_size
    
    x, y, z = next_vector
    script += "\tmovel(p[current_pose[0] + %f, current_pose[1] + %f, current_pose[2] + %f, current_pose[3], current_pose[4], current_pose[5]], t=%f)\n" % (x/1000., y/1000., z/1000., step_size * 0.1)
    
    script += "\ttextmsg(\"<< program end\")\n"
    script += "end\n"
    script += "prog()\n\n"
    
    print script
# ---------- end movel_4 ----------
send_11 = Button()
send_12 = Send(script=movel_4, send=send_11)
panel_24 = Panel(send_12)

# ---- group: drilling/placing_planes
size_z_2 = Slider(4, range=0..200)
number_slider_5 = Slider(100, range=0..1000)
number_slider_6 = Slider(0, range=0..100)
pt_14 = ConstructPoint(XCoordinate=0, YCoordinate=number_slider_5, ZCoordinate=number_slider_5)
pt_15 = ConstructPoint(XCoordinate=number_slider_5, YCoordinate=0, ZCoordinate=number_slider_5)
pt_16 = Point(Point(0, 0, 0))
pt_17 = ConstructPoint(XCoordinate=number_slider_6, YCoordinate=number_slider_6, ZCoordinate=number_slider_6)
pt_18 = ConstructPoint(XCoordinate=number_slider_5, YCoordinate=number_slider_5, ZCoordinate=0)
addition = Addition(A=pt_16, B=pt_14)
division = Division(A=addition, B=2)
ln = Line(StartPoint=pt_16, EndPoint=pt_14)
ln_2 = Line(StartPoint=pt_15, EndPoint=pt_18)
xy_2 = XYPlane(Origin=pt_17)
subtraction = Subtraction(A=pt_14, B=pt_16)
yz = YZPlane(Origin=Point(0, 0, 0))
divide = DivideCurve(Curve=ln_2, Count=10, Kinks=False)  # -> Points, Tangents, Parameters
divide_2 = DivideCurve(Curve=ln, Count=10, Kinks=False)  # -> Points, Tangents, Parameters
rotate = Rotate(Geometry=yz, Center=Point(0, 0, 0), From=Vector(0, -1, 0), To=subtraction)  # -> Geometry, Transform
move_2 = Move(Geometry=rotate.Geometry, Motion=division)  # -> Geometry, Transform
ln_3 = Line(StartPoint=divide_2.Points, EndPoint=divide.Points)
panel_25 = Panel(ln_3)

# ----
lng = ListLength(List=ln_3)
subtraction_2 = Subtraction(A=lng, B=4)
division_2 = Division(A=subtraction_2, B=4)
round = Round(Number=division_2)  # -> Nearest, Floor, Ceiling
subtraction_3 = Subtraction(A=lng, B=round.Floor)
python_3 = GhPythonScript(
    beam_base_plane_1=pl,
    dowel_base_plane_1=pl_2,
    beam_base_plane_2=pl_3,
    dowel_base_plane_2=pl_4,
    dx=Slider(145, range=0..1000),
    dy=Slider(10, range=0..10),
    dz=size_z,
    drill_plane=xy_2)  # -> out, beams, moved_beams, top_planes, bottom_planes, gripping_planes, safe_planes, tmp, tree; inputs beam_base_plane_1: Plane, dowel_base_plane_1: Plane, beam_base_plane_2: Plane, dowel_base_plane_2: Plane, drill_plane: Plane
# ---------- python_3: Python ----------
"""
Basic classes for MAS-DFAB 2018-19 T2 GKR Project
"""

__author__ = "masdfab students"
__status__ = "development"
__version__ = "0.0.1"
__date__    = "15 January 2019"

import Rhino.Geometry as rg
import Grasshopper.Kernel.Data.GH_Path as ghpath
import Grasshopper.DataTree as datatree
import System
import math

tmp = []

class Hole:

    """
    Stores the planes for the drilling process.
    """

    def __init__(self, gripping_plane, top_plane, bottom_plane, beam_brep):

        """
        initialization
        :param gripping_plane: gripping_plane plane to grab the beam
        :param top_plane:  top_plane plane to start drilling
        :param bottom_plane:  bottom_plane plane to end drilling
        :param beam_brep: beam brep to be drilled (for debug purpose only)
        """

        self.gripping_plane = gripping_plane
        self.top_plane = top_plane
        self.bottom_plane = bottom_plane
        self.beam_brep = beam_brep

    @staticmethod
    def create_holes(beam, safe_buffer=2.0):

        """
        instanciates the holes in the beam
        :param beam:  beam plane to be drilled
        :param safe_buffer:  buffer length to drill for each side of the beam
        :return [Hole]
        """

        holes = []

        # can be optimized (for now it holds the very middle part of the beam)
        gripping_plane = beam.base_plane

        beam_normal = beam.base_plane.XAxis

        for dowel in beam.dowel_list:

            line = dowel.get_line()

            dowel_plane = dowel.get_plane()
            dowel_normal = dowel_plane.Normal
            angle = rg.Vector3d.VectorAngle(beam_normal, dowel_normal)

            top_frame = rg.Plane(beam.base_plane)
            bottom_frame = rg.Plane(beam.base_plane)

            diff = beam.dy * 0.5 + abs(dowel.inner_radius / math.tan(angle)) + safe_buffer

            top_frame.Translate(beam.base_plane.ZAxis * diff)
            bottom_frame.Translate(-beam.base_plane.ZAxis * diff)

            hole_plane_list = []

            for f in [top_frame, bottom_frame]:

                succeeded, v = rg.Intersect.Intersection.LinePlane(line, f)

                p = line.PointAt(v)
                plane = rg.Plane(dowel_plane)
                plane.Origin = p
                hole_plane_list.append(plane)

                # to direct normals of holes to that of gripping plane
                angle = rg.Vector3d.VectorAngle(gripping_plane.Normal, plane.Normal)
                if math.pi * 0.5 < angle and angle < math.pi * 1.5:
                    plane.Flip()
            
            hole = Hole(gripping_plane=rg.Plane(gripping_plane),
                top_plane=hole_plane_list[0],
                bottom_plane=hole_plane_list[1],
                beam_brep=beam.brep_representation())

            holes.append(hole)

        return holes

    def orient_to_drilling_station(self, target_frame):

        """
        orient a bottom plane to a given frame
        """

        copied = rg.Plane(self.bottom_plane)
        transform = rg.Transform.PlaneToPlane(copied, target_frame)
        self.gripping_plane.Transform(transform)
        self.top_plane.Transform(transform)
        self.bottom_plane.Transform(transform)

        if self.beam_brep:
            self.beam_brep.Transform(transform)

    def get_safe_plane(self, diff=100):

        """
        get a safe plane to drill
        :param diff:  offset for the safe plane
        :return rg.Plane
        """

        safe_plane = rg.Plane(self.top_plane)
        safe_plane.Translate(safe_plane.ZAxis * diff)
        return safe_plane
        
class Beam:

    """
    Beam class containing its size and connecting dowels
    """

    def __init__(self, base_plane, dx, dy, dz):

        """
        initialization
        :param base_plane: base plane which the beam is along with
        :param dx:  the length along the local x-axis (= the length of this beam)
        :param dy:  the length along the local y-axis
        :param dz:  the length along the local z-axis
        """

        self.base_plane = base_plane
        self.dx = dx
        self.dy = dy
        self.dz = dz
        self.dowel_list = []

    def add_dowel(self, dowel):

        """
        add a dowel to this beam
        :param dowel:  the new dowel to be added
        """

        self.dowel_list.append(dowel)
        dowel.beam_list.append(self)

    def remove_duplicates_in_dowel_list(self):

        """
        resolve dowel duplication
        """

        self.dowel_list = list(set(self.dowel_list))

    def brep_representation(self):

        """
        make a brep of this beam with holes
        :return brep object of this beam
        """

        # create a beam
        box = rg.Box(self.base_plane,
            rg.Interval(-self.dx*0.5, self.dx*0.5),
            rg.Interval(-self.dy*0.5, self.dy*0.5),
            rg.Interval(-self.dz*0.5, self.dz*0.5)
            )

        box = box.ToBrep()

        # create a dowels
        for dowel in self.dowel_list:

            pipe = dowel.get_outer_pipe()

            pipe = pipe.ToBrep(True, True)

            tmp_box = rg.Brep.CreateBooleanDifference(box, pipe, 0.1)

            if len(tmp_box) > 0:
                box = tmp_box[0]

        return box

    def get_baseline(self):

        """
        get a line along with z-axis
        :return line object of this beam
        """

        diff = self.base_plane.XAxis * self.dx * 0.5
        p1 = rg.Point3d.Subtract(self.base_plane.Origin, diff)
        p2 = rg.Point3d.Subtract(self.base_plane.Origin, -diff)

        return rg.Line(p1, p2)

    def transform_instance_to_frame(self, target_frame=None):

        """
        in-place transform
        :param target_frame:  target frame to transform according to this base_plane
        """

        Beam.__move_to_frame(self, self.base_plane, target_frame)

    def transform_instance_from_frame_to_frame(self, source_frame, target_frame=None):

        """
        in-place transform
        :param source_frame:  source_frame frame to transform
        :param target_frame:  target frame  to be transformed
        """

        Beam.__move_to_frame(self, source_frame, target_frame)

    def __move_to_frame(beam, source_frame, target_frame=None):

        """
        private method to transform
        """

        if not target_frame:
            target_frame = beam.base_plane

        transform = rg.Transform.PlaneToPlane(source_frame, target_frame)

        beam.base_plane.Transform(transform)

        for dowel in beam.dowel_list:

            if dowel.base_plane:
                dowel.base_plane.Transform(transform)

            if dowel.line:
                dowel.line.Transform(transform)

        return beam


    @staticmethod
    def get_strucutured_data(beams):

        """
        get a data tree of lines with the actual length of each dowel
        :param beams:  beams to be structured
        :return DataTree
        """

        tree = datatree[System.Object]()

        for i, beam in enumerate(beams):
            
            path = ghpath(i)
            
            for dowel in beam.dowel_list:
                
                tree.Add(dowel.get_calculated_line(), path)

        return tree

class Dowel:

    """
    Dowel class with connected beams
    """

    """radius of dowel itself"""
    inner_radius = 1

    """radius to be drilled"""
    outer_radius = 1.2

    def __init__(self, base_plane=None, line=None):

        """
        initialization
        :param base_plane: base plane which the dowel is along with
        :param line: line object that corresponds to the dowel itself

        base_plane and line are exclusive!
        """

        if base_plane and line:
            # TODO throw error
            return

        self.base_plane = base_plane
        self.line = line
        self.beam_list  = []

    def remove_duplicates_in_beam_list(self):

        """
        resolve beam duplication
        """

        return list(set(self.beam_list))
    
    def get_plane(self):

        """
        get the plane on this dowel
        :return rg.Vector3d
        """

        if self.base_plane:
        
            return self.base_plane
        
        else:
            
            p1 = self.line.PointAt(0)
            pc = self.line.PointAt(0.5)
            p2 = self.line.PointAt(1)
            return rg.Plane(pc, rg.Vector3d.Subtract(rg.Vector3d(p1),
                rg.Vector3d(p2)))
        
        
    def get_calculated_line(self):

        """
        get the line with the actual length
        :return rg.Line
        """

        if self.line:
            return self.line

        # get an infinite line
        diff = self.base_plane.Normal * 9999
        p1 = rg.Point3d.Subtract(self.base_plane.Origin, diff)
        p2 = rg.Point3d.Subtract(self.base_plane.Origin, -diff)

        dowel_line = rg.Line(p1, p2)
        
        smallest_val  = 9999
        biggest_val   = -9999
        smallest_beam = None
        biggest_beam  = None
        
        dowel_plane  = self.get_plane()
        dowel_normal = dowel_plane.Normal 

        # get both ends of this dowel
        for beam in self.beam_list:

            beam_line = beam.get_baseline()

            _, dowel_v, beam_v = rg.Intersect.Intersection.LineLine(dowel_line, beam_line)
            
            if dowel_v < smallest_val:
                smallest_val = dowel_v
                smallest_beam = beam
                
            elif biggest_val < dowel_v:
                biggest_val = dowel_v
                biggest_beam = beam

        actual_dowel_line = rg.Line(dowel_line.PointAt(smallest_val), dowel_line.PointAt(biggest_val))

        # entend the dowel        
        angle = rg.Vector3d.VectorAngle(dowel_normal, smallest_beam.base_plane.XAxis)
        exntension_1 = smallest_beam.dz * 0.5 / math.sin(angle)

        angle = rg.Vector3d.VectorAngle(dowel_normal, biggest_beam.base_plane.XAxis)
        exntension_2 = biggest_beam.dz * 0.5 / math.sin(angle)
        
        actual_dowel_line.Extend(exntension_1, exntension_2)
        
        return actual_dowel_line
        
    def brep_representation(self):

        """
        make a brep of this dowel (for now with pseudo end points)
        :return cylinder object of this dowel
        """

        return self.get_inner_pipe()

    def get_line(self):

        """
        get a line object of this dowel
        :return line object
        """

        if self.line:
            return self.line

        # get an infinite line
        diff = self.base_plane.Normal * 9999
        p1 = rg.Point3d.Subtract(self.base_plane.Origin, diff)
        p2 = rg.Point3d.Subtract(self.base_plane.Origin, -diff)

        return rg.Line(p1, p2)

    def get_outer_pipe(self):

        """
        get a cylinder drilled
        :return cylinder object
        """

        return self.__get_pipe(self.outer_radius)

    def get_inner_pipe(self):

        """
        get a cylinder of dowel
        :return cylinder object
        """

        return self.__get_pipe(self.inner_radius)

    def __get_pipe(self, radius):

        """
        private method to create a cylinder
        """

        line = self.get_line()

        _, plane = line.ToNurbsCurve().PerpendicularFrameAt(0)
        circle = rg.Circle(plane, radius)
        return rg.Cylinder(circle, line.Length)

# instanciate objects
beam_1  = Beam(base_plane=beam_base_plane_1, dx=dx, dy=dy, dz=dz)
beam_2  = Beam(base_plane=beam_base_plane_2, dx=dx, dy=dy, dz=dz)
dowel_1 = Dowel(base_plane=dowel_base_plane_1)
dowel_2 = Dowel(base_plane=dowel_base_plane_2)

beam_1.add_dowel(dowel_1)
beam_1.add_dowel(dowel_2)
beam_2.add_dowel(dowel_1)
beam_2.add_dowel(dowel_2)

dowel_2.get_calculated_line()

# visualize the beams positioned in space
beams = [b.brep_representation() for b in [beam_1, beam_2]]

# create holes

gripping_planes = []
top_planes = []
bottom_planes = []
safe_planes = []

holes = Hole.create_holes(beam_1)
for hole in holes:

    hole.orient_to_drilling_station(drill_plane)

    top_planes.append(hole.top_plane)
    bottom_planes.append(hole.bottom_plane)
    gripping_planes.append(hole.gripping_plane)
    safe_planes.append(hole.get_safe_plane())
    
tmp.append(holes[1].beam_brep)
tmp.append(holes[0].beam_brep)

#holes = Hole.create_holes(beam_2)
#for hole in holes:
#
#    hole.orient_to_drilling_station(drill_plane)
#
#    top_planes.append(hole.top_plane)
#    bottom_planes.append(hole.bottom_plane)
#    gripping_planes.append(hole.gripping_plane)
#    safe_planes.append(hole.get_safe_plane())
#    
#tmp.append(holes[1].beam_brep)
#tmp.append(holes[0].beam_brep)
#
#tree = Beam.get_strucutured_data([beam_1, beam_2])

#tree = Beam.get_strucutured_data([holes[0].beam, holes[1].beam])
# ---------- end python_3 ----------
series = Series(Start=0, Step=1, Count=round.Floor)
series_2 = Series(Start=subtraction_3, Step=1, Count=round.Floor)
merge = Merge(Data1=series, Data2=series_2)
item_2 = ListItem(List=ln_3, Index=merge, Wrap=True)

# ---- group: drilling/placing_planes (continued)
line_script_gen = PythonScript(
    origin_plane=move_2.Geometry,
    size_x=Slider(145, range=0..1000),
    size_y=Slider(10, range=0..10),
    size_z=size_z_2,
    lines=item_2,
    rod_d=Slider(1, range=0..50),
    drill_plane=xy_2)  # -> out, test_box, top_pls, bot_pls, safety_pls; inputs origin_plane: list of Plane, size_x: Int32, size_y: Int32, size_z: Int32, lines: list of Line, drill_plane: Plane
# ---------- line_script_gen: Python ----------
# snippet of code to make this python component look for it's code in the parent folder of the .gh file

import os

ghComp = ghenv.Component
ghDoc = ghComp.OnPingDocument()

file_name = "BeamClass.py"
gh_file_location = ghDoc.FilePath
parent = os.path.dirname(os.path.realpath(gh_file_location))

file_path = os.path.join(parent, file_name)
print file_path

# hacky-hacky run-fun
execfile(file_path)
# ---------- end line_script_gen ----------
geo_3 = Geometry(line_script_gen.top_pls)
brep_2 = Brep(line_script_gen.test_box)
geo_4 = Geometry(line_script_gen.bot_pls)
geo_5 = Geometry(line_script_gen.safety_pls)

# ---- group: SHOULD BE CACLUCATED IN HOLE CLASS
Z = UnitZ(Factor=Slider(50, range=0..100))
Z_2 = UnitZ(Factor=Slider(25, range=0..100))
neg = Negative(Value=Z_2)
move_3 = Move(Geometry=python_3.gripping_planes, Motion=Z)  # -> Geometry, Transform
move_4 = Move(Geometry=python_3.gripping_planes, Motion=Z_2)  # -> Geometry, Transform
move_5 = Move(Geometry=python_3.gripping_planes, Motion=neg)  # -> Geometry, Transform

# ----
geo_6 = Geometry(python_3.gripping_planes)
geo_7 = Geometry(python_3.tree)
panel_26 = Panel(line_script_gen.bot_pls)

# ---- group: drill_safety_plane
geo_8 = Geometry(flatten(move_3.Geometry))

# ---- group: start_drill_plane
geo_9 = Geometry(flatten(move_4.Geometry))

# ---- group: end_drill_plane
geo_10 = Geometry(flatten(move_5.Geometry))

# ----
panel_27 = Panel(python_3.safe_planes)
panel_28 = Panel(python_3.top_planes)
panel_29 = Panel(python_3.gripping_planes)
arrange_plane_lists = GhPythonScript(picking_plane=geo, drill_safety_plane=geo_8, start_drill_plane=geo_9, end_drill_plane=geo_10, placing_plane=geo_2)  # -> out, plane_list, number_of_holes_list; inputs picking_plane: list of Plane, drill_safety_plane: list of Plane, start_drill_plane: list of Plane, end_drill_plane: list of Plane, placing_plane: Plane
# ---------- arrange_plane_lists: Python ----------
__author__ = "JesusBarney"
__version__ = "2019.01.16"

import rhinoscriptsyntax as rs
import Rhino.Geometry as rg

plane_list = []
count = 0


#for i,pl in enumerate(picking_plane):
#    plane_list.append(pl)
#    for j,dr in enumerate(drill_safety_plane):
#        plane_list.append(dr)
#        plane_list.append(start_drill_plane[j])
#        plane_list.append(end_drill_plane[j])
#        plane_list.append(dr)
#
#plane_list.append(placing_plane)

number_of_holes_list = []

for i in range(3):

    plane_list.append(picking_plane[i])
    
    number_of_holes = 0
    
    for j, (d, s, e) in enumerate(zip(drill_safety_plane, start_drill_plane, end_drill_plane)):
        plane_list.append(d)
        plane_list.append(s)
        plane_list.append(e)
        number_of_holes = j
        
    plane_list.append(placing_plane)
    
    number_of_holes_list.append(number_of_holes + 1)
# ---------- end arrange_plane_lists ----------
panel_30 = Panel(python_3.tree)

# ---- group: Define commands
python_4 = PythonScript(planes_WCS=arrange_plane_lists.plane_list, dfillet=Slider(0, range=0..100), speed=speed)  # -> flatten(commands); inputs planes_WCS: list, speed: Int32
# ---------- python_4: Python ----------
import Rhino.Geometry as rg
from compas.geometry import Frame
from compas.geometry import Transformation
from compas_ghpython import xdraw_frame
from scriptcontext import sticky as st

robot = st["robot"]
buffer = 1

# TODO this must be optimized! matrix multiplication!
commands = []
for i, plane_WCS in enumerate(planes_WCS):
    tcp_WCS = Frame(plane_WCS.Origin, plane_WCS.XAxis, plane_WCS.YAxis)
    if i == 0 or i == len(planes_WCS) - 1:
        radius = 0.
        
    else:
        # calculate blend radius
        prev, current, next = planes_WCS[i-1].Origin, planes_WCS[i].Origin, planes_WCS[i+1].Origin
        radius = min((prev - current).Length/2 * buffer, (next - current).Length/2 * buffer, dfillet)
    
    tcp_RCS = robot.get_frame_in_RCS(tcp_WCS)
    
    cmd = list(tcp_RCS.point) + tcp_RCS.axis_angle_vector + [speed, radius]
    #cmd = list(tcp_RCS.point) + tcp_RCS.axis_angle_vector + [time, radius]
    commands.append(cmd)
    
    
    
print (commands)
# ---------- end python_4 ----------

# ----
panel_31 = Panel(arrange_plane_lists.plane_list)

continue_fabrication = BooleanToggle(False)
panel_32 = Panel("Send a message")
send_13 = Button()
drilling_commands = Data(python_4)
# 4
send_14 = PythonScript(
    client=client.client,
    send=send_13,
    continue_fabrication=continue_fabrication,
    tool=tools,
    drilling_commands=drilling_commands,
    number_of_holes_list=arrange_plane_lists.number_of_holes_list)  # -> out; inputs continue_fabrication: Int32, drilling_commands: list, number_of_holes_list: list
# ---------- send_14: Python ----------
from ur_online_control.communication.msg_identifiers import *
from ur_online_control.utilities.lists import flatten_list

len_command_drilling = len(drilling_commands[0])
commands_flattened_drilling = flatten_list(drilling_commands)

"""
sand_tool = tool
sand_tool_axis = list(sand_tool.tcp_frame.point) + sand_tool.tcp_frame.axis_angle_vector
"""
"""
vaccuum_tool = tool
vaccuum_tool_axis = list(vaccuum_tool.tcp_frame.point) + vaccuum_tool.tcp_frame.axis_angle_vector
"""
# tool settigns
tool_axis = list(tool.tcp_frame.point) + tool.tcp_frame.axis_angle_vector

### Gravel placment ###
"""
#safe_in_pose_gravel, safe_out_pose_gravel = cmd_gravel_in_out 
pose_gravel = cmd_gravel
"""

#print waiting_times
#print len(io_values)

#===================================================================================
if send and client:
    ### string_fabrication ###
    client.send(MSG_INT, int(continue_fabrication))
    client.send(MSG_FLOAT_LIST, tool_axis) ### set string_tcp ###
    client.send(MSG_INT, len_command_drilling) ### send len of each cmd ###
    client.send(MSG_FLOAT_LIST, commands_flattened_drilling) ### send cmd list ###
    client.send(MSG_FLOAT_LIST, number_of_holes_list) ### send cmd list ###

#===================================================================================
# ---------- end send_14 ----------

panel_33 = Panel(send_14)

# ----
# Visualisation
robot_2 = Data(robot)
planes_wcs = Plane(arrange_plane_lists.plane_list)
pose_joints = Data(pose)

# ---- group: Define plane in WCS, calculate joint positions
pt_19 = Point(Point(648.8632686, 624.689255, -55.48786018))
xy_3 = XYPlane(Origin=pt_19)
select_configuration = Slider(5, range=0..7)
plane_wcs = Plane(xy_3)
inverse = PythonScript(robot=robot_2, plane_WCS=plane_wcs, idx=select_configuration)  # -> configuration; inputs plane_WCS: Plane, idx: Int32
# ---------- inverse: Python ----------
import Rhino.Geometry as rg
from compas.geometry import Frame, Transformation
from compas_ghpython import xdraw_frame

tcp_WCS = Frame(plane_WCS.Origin, plane_WCS.XAxis, plane_WCS.YAxis)

# transform frame to robot coordinate system
tcp_RCS = robot.get_frame_in_RCS(tcp_WCS)

# get the frame of tool0
tool0_RCS = robot.get_tool0_frame_from_tcp_frame(tcp_RCS)

# calculate solutions to frame
solutions = robot.inverse_kinematics(tool0_RCS)

if not len(solutions):
    q = [0,0,0,0,0,0]
else:
    idx = min(len(solutions) - 1, idx)
    q = solutions[idx]
    
print q

configuration = q
# ---------- end inverse ----------

# ---- group: Calculate joint positions for path
# Add init joint states
joint_states = Data([-0.1728179112, -1.415058186, 1.813991282, -1.971940356, -1.571654205, -3.308720436])
init_configuration = Slider(2, range=0..7)
py_6 = PythonScript(robot=robot_2, planes_WCS=planes_wcs, configuration_idx=init_configuration, init_configuration=joint_states)  # -> configurations; inputs planes_WCS: list, configuration_idx: Int32, init_configuration: list
# ---------- py_6: Python ----------
from compas_ghpython import unload_modules
unload_modules('ur_online_control')
import Rhino.Geometry as rg
from compas.geometry import Frame 
from compas.geometry.xforms import Transformation
from compas_ghpython import xdraw_frame
from ur_online_control.ur.kinematics import calculate_configurations_for_path, format_joint_positions


# TODO this must be optimized! matrix multiplication!
frames_tool0_RCS = []
for plane_WCS in planes_WCS:
    tcp_WCS = Frame(plane_WCS.Origin, plane_WCS.XAxis, plane_WCS.YAxis)
    tcp_RCS = robot.get_frame_in_RCS(tcp_WCS)
    frames_tool0_RCS.append(robot.get_tool0_frame_from_tcp_frame(tcp_RCS))
    

#configurations = calculate_configurations_for_path(frames_tool0_RCS, robot.params, init_configuration)
configurations = calculate_configurations_for_path(frames_tool0_RCS, robot, init_configuration)
#print configurations
configurations = configurations[min([configuration_idx, len(configurations) - 1])]

def format(numbers, k=4):
    #numbers = format_joint_positions(numbers)
    return "[" + ", ".join([("%." + str(k) + "f") % n for n in numbers]) + "]"
# ---------- end py_6 ----------
start_2 = Button()
stop_3 = Button()
step = Button()
counter = CountThroughList(L=py_6, start=start_2, stop=stop_3, step=step, step_back=back, reset=reset, interval=100)  # -> item; inputs L: list, start: Boolean, stop: Boolean, step_back: Boolean
# ---------- counter: Python ----------
from scriptcontext import sticky as st
from compas_ghpython import update_component


# store data in component
guid = str(ghenv.Component.InstanceGuid)
counter_key = "counter_" + guid
running_key = "running_" + guid

if counter_key not in st:
    st[counter_key] = 0

if running_key not in st:
    st[running_key] = False

if start:
    st[running_key] = True

if stop:
    st[running_key] = False

if step:
    if st[counter_key] < len(L) - 1:
        st[counter_key] += 1

if step_back:
    if st[counter_key] < len(L) - 1:
        st[counter_key] -= 1

if reset:
    st[counter_key] = 0

if len(L):
    item = L[st[counter_key]]

if st[running_key]:
    if st[counter_key] < len(L) - 1:
        st[counter_key] += 1
        update_component(ghenv, interval)
    else:
        st[counter_key] = 0
        st[running_key] = False
# ---------- end counter ----------

# ---- group: Calculate joint positions for path / Shows joint positions along path
flip = BooleanToggle(True)
l2t = PythonScript(L=py_6, flip=flip)  # -> T; inputs L: list, flip: Boolean
# ---------- l2t: Python ----------
from compas_ghpython import list_to_ghtree
L = [l.joint_values for l in L]

if flip:
    L = zip(*L)
T = list_to_ghtree(L)
# ---------- end l2t ----------
graph = QuickGraph(l2t, SortOrder=0)

# ---- group: Visualise
list_7 = ValueList({"0 forward, from angles": 0, "1 inverse, from one plane": 1, "2 inverse, from multiple planes": 2, "3 forward, from robot": 3}, selected="2 inverse, from multiple planes")
filter_3 = StreamFilter(Gate=list_7, Stream0=py_4, Stream1=inverse, Stream2=counter, Stream3=pose_joints)
configuration = Panel(filter_3)
mesh = Mesh(filter)
draw_2 = PythonScript(robot=robot_2, configuration=filter_3, mesh=mesh, brep=filter, show_brep=show_brep)  # -> meshes, tool0_plane, tcp_plane, robot_brep; inputs mesh: list, brep: list
# ---------- draw_2: Python ----------
from compas_ghpython import unload_modules
unload_modules("ur_online_control")

from compas_ghpython import xdraw_frame
from compas_ghpython import mesh_draw
from compas_ghpython.geometry.xforms import xform_from_transformation
from compas.geometry import Frame
from compas.geometry.xforms import Transformation
from ur_online_control.ur.robot import BaseConfiguration

import Rhino.Geometry as rg
import Rhino

def mesh_update_vertices(mesh, vertices):
    for i in range(len(vertices)):
        mesh.vertex[i].update({'x': vertices[i][0], 'y': vertices[i][1], 'z': vertices[i][2]})

if configuration:
    #print configuration
    #q = BaseConfiguration.from_joints(configuration)
    q = configuration
    print q
    print q.joint_values
    
    print robot.get_forward_transformations(q)
    R0, R1, R2, R3, R4, R5 = robot.get_forward_transformations(q)
    
    tool0_frame2 = robot.tool0_frame.transformed(R5)
    tcp_frame2 = Frame.from_transformation(Transformation.from_frame(tool0_frame2) * robot.transformation_tool0_tcp)
    
    print robot.transformation_tool0_tcp
    print robot.transformation_tcp_tool0
    print robot.transformation_tool0_tcp * robot.transformation_tcp_tool0
    print tcp_frame2
    tcp_frame2 = Frame.from_transformation(Transformation.from_frame(tool0_frame2) * robot.transformation_tcp_tool0)
    print tcp_frame2
    
    tool0_frame, tcp_frame = robot.get_transformed_tool_frames(R5)
    
    tool0_frame = tool0_frame2
    tcp_frame = tcp_frame2
    
    m0, m1, m2, m3, m4, m5 = mesh
    for i in range(6):
        exec("R%drg = xform_from_transformation(R%d)" % (i, i))
        exec("m%d.Transform(R%drg)" % (i, i))
    meshes = [m0, m1, m2, m3, m4, m5]
    print meshes
    mt = robot.tool.get_transformed_model(Transformation.from_frame(tool0_frame))
    
    if mt:
        meshes.extend(map(mesh_draw, mt))
    
    """
    m0, m1, m2, m3, m4, m5, tool0_frame, tcp_frame = robot.get_transformed_model(q)
    mt = robot.get_transformed_tool_model(tcp_frame)
    
    meshes = []
    meshes.append(mesh_draw(m0))
    meshes.append(mesh_draw(m1))
    meshes.append(mesh_draw(m2))
    meshes.append(mesh_draw(m3))
    meshes.append(mesh_draw(m4))
    meshes.append(mesh_draw(m5))
    if mt:
        meshes.append(mesh_draw(mt))
    
    """
    
    tool0_plane = xdraw_frame(tool0_frame)
    tcp_plane = xdraw_frame(tcp_frame)
    
    if show_brep:
        
        b0, b1, b2, b3, b4, b5 = brep
        
        b0.Transform(R0rg)
        b1.Transform(R1rg)
        b2.Transform(R2rg)
        b3.Transform(R3rg)
        b4.Transform(R4rg)
        b5.Transform(R5rg)
        
        robot_brep = [b0, b1, b2, b3, b4, b5]
# ---------- end draw_2 ----------
tcp_plane = Plane(draw_2.tcp_plane)
tool0_plane = Plane(draw_2.tool0_plane)
robot_brep = Brep(draw_2.robot_brep)
draw_3 = RepresentPlaneAsLines(plane=tcp_plane, size=100)  # -> G, C
# ---------- draw_3: Python ----------
import Rhino.Geometry as rg
from System.Drawing import Color

if plane:

    G = []
    G.append(rg.Line(plane.Origin, size * plane.XAxis))
    G.append(rg.Line(plane.Origin, size * plane.YAxis))
    G.append(rg.Line(plane.Origin, size * plane.ZAxis))
    
    C = []
    C.append(Color.FromArgb(255, 0, 0))
    C.append(Color.FromArgb(0, 255, 0))
    C.append(Color.FromArgb(0, 0, 255))
# ---------- end draw_3 ----------
preview_2 = CustomPreview(Geometry=draw_2.meshes, Shader=ColourSwatch(SwatchColor=RGBA(99, 94, 94, 96)))
preview_3 = CustomPreview(Geometry=draw_3.G, Shader=draw_3.C)

# ----
mesh_2 = Mesh(draw_2.meshes)

# ---- group: Send joint position directly to robot
idx_2 = Slider(0, range=0..100)
panel_34 = Panel("move joints")
joint_positions = Data(py_4)
list_8 = ValueList({"send all positions": 0, "send only one position": 1}, selected="send only one position")
item_3 = ListItem(List=joint_positions, Index=idx_2, Wrap=True)
filter_4 = StreamFilter(Gate=list_8, Stream0=joint_positions, Stream1=item_3)
movej = PythonScript(joint_positions=filter_4, velocity=Slider(153, range=0..200))  # -> script; inputs joint_positions: list
# ---------- movej: Python ----------
script_lines = []

for position in joint_positions:
    script_lines.append("movej(%s, v=%f)" % (str(position), velocity/1000.))


script = "def prog():\n"
script += "\ttextmsg(\">> program start\")\n"
script += "".join(["\t%s\n" % line for line in script_lines])
script += "\ttextmsg(\"<< program end\")\n"
script += "end\n"
script += "prog()\n\n"


print script

#script = ""
# ---------- end movej ----------
send_15 = Button()

# ----
send_16 = Send(script=movej, send=send_15)

# ---- group: Send joint position directly to robot (continued)
panel_35 = Panel(send_16)

# ==== cluster Tools

# ---- group: drill_tool
drill_bit_length = ClusterInput()
pt = Point(Point(0, 0, 0))
clay_modified = Geometry([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])
drill_bit_length_2 = Number(drill_bit_length)
X = UnitX(Factor=1)
Y = UnitY(Factor=-1)
brep = Brep(clay_modified)
mesh = Mesh(clay_modified)
ln = Line(StartPoint=pt, EndPoint=X)
ln_2 = Line(StartPoint=pt, EndPoint=Y)
addition = Addition(A=Slider(285, range=0..400), B=drill_bit_length_2)
Z = UnitZ(Factor=addition)
move = Move(Geometry=ln, Motion=Z)  # -> Geometry, Transform
move_2 = Move(Geometry=ln_2, Motion=Z)  # -> Geometry, Transform
crv = Curve(move.Geometry)
crv_2 = Curve(move_2.Geometry)
tool = Tool(meshes=mesh, breps=brep, xline=crv, yline=crv_2)

# ----
tool_id = ClusterInput()

# ---- group: measurement tool
measurement_tool_geo = Geometry([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])
mesh_2 = Mesh(measurement_tool_geo)
mjoin = MeshJoin(Meshes=mesh_2)
tool_2 = PythonScript(meshes=mjoin, brep=measurement_tool_geo)  # -> tool; inputs meshes: list, brep: list
# ---------- tool_2: Python ----------
from ur_online_control.ur.tools import MeasurementTool
from compas.datastructures import Mesh
from compas_rhino.helpers import mesh_from_guid


tool = MeasurementTool()
tool.model = [mesh_from_guid(Mesh, mesh) for mesh in meshes]
#tool.model_xyz = tool.model.xyz
tool.brep = brep
# ---------- end tool_2 ----------

# ----
tool_id_2 = Integer(tool_id)
neg = Negative(Value=Slider(45, range=0..100))
panel = Panel(tool_id_2)

# ---- group: drill_tool / gripper_tool
pt_2 = Point(Point(0, 0, 0))
clay_modified_2 = Geometry([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])
X_2 = UnitX(Factor=1)
Y_2 = UnitY(Factor=-1)
mesh_3 = Mesh(clay_modified_2)
brep_2 = Brep(clay_modified_2)
ln_3 = Line(StartPoint=pt_2, EndPoint=X_2)
ln_4 = Line(StartPoint=pt_2, EndPoint=Y_2)
addition_2 = Addition(A=Slider(110, range=0..400))
Z_2 = UnitZ(Factor=addition_2)
move_3 = Move(Geometry=ln_3, Motion=Z_2)  # -> Geometry, Transform
move_4 = Move(Geometry=ln_4, Motion=Z_2)  # -> Geometry, Transform
crv_3 = Curve(move_3.Geometry)
crv_4 = Curve(move_4.Geometry)

# ----
rot3d = Rotate3D(Geometry=crv_4, Angle=degrees(neg), Center=pt_2, Axis=Vector(0, 0, 1))  # -> Geometry, Transform
rot3d_2 = Rotate3D(Geometry=crv_3, Angle=degrees(neg), Center=pt_2, Axis=Vector(0, 0, 1))  # -> Geometry, Transform

# ---- group: drill_tool / gripper_tool (continued)
tool_3 = Tool(meshes=mesh_3, breps=brep_2, xline=rot3d_2.Geometry, yline=rot3d.Geometry)

# ----
filter = StreamFilter(Gate=tool_id_2, Stream0=tool_2, Stream1=tool, Stream2=tool_3)
py = PythonScript(tool=filter)  # -> tcp_frame, model
# ---------- py: Python ----------
from compas_ghpython import mesh_draw 

tcp_frame = tool.tcp_frame
model = map(mesh_draw, tool.model)
# ---------- end py ----------
tool_4 = Data(filter)
draw = PythonScript(frame=py.tcp_frame)  # -> G, C
# ---------- draw: Python ----------
import Rhino.Geometry as rg
from System.Drawing import Color

if not size:
    size = 100

if frame:
    plane = rg.Plane(rg.Point3d(*list(frame.point)), rg.Vector3d(*list(frame.xaxis)), rg.Vector3d(*list(frame.yaxis)))

    G = []
    G.append(rg.Line(plane.Origin, size * plane.XAxis))
    G.append(rg.Line(plane.Origin, size * plane.YAxis))
    G.append(rg.Line(plane.Origin, size * plane.ZAxis))
    
    C = []
    C.append(Color.FromArgb(255, 0, 0))
    C.append(Color.FromArgb(0, 255, 0))
    C.append(Color.FromArgb(0, 0, 255))
# ---------- end draw ----------
tool_5 = ClusterOutput(tool_4)
preview = CustomPreview(Geometry=draw.G, Shader=draw.C)
preview_2 = CustomPreview(Geometry=py.model, Shader=ColourSwatch(SwatchColor=RGB(141, 170, 178)))

# ==== cluster Send
script = ClusterInput()
send = ClusterInput()
send_2 = PythonScript(script=script, send=send)  # -> out
# ---------- send_2: Python ----------
import socket
from scriptcontext import sticky as st

ur_ip = st["ur_ip"]
ur_port = 30002

if send:
    s = socket.create_connection((ur_ip, ur_port), timeout=0.5) 
    s.send(script)
    s.close()
# ---------- end send_2 ----------
out = ClusterOutput(send_2)

# ==== cluster Draw
size = ClusterInput()
frame = ClusterInput()
draw = PythonScript(frame=frame, size=size)  # -> G, C
# ---------- draw: Python ----------
import Rhino.Geometry as rg
from System.Drawing import Color

if not size:
    size = 100

if frame:
    
    plane = rg.Plane(rg.Point3d(*frame.point), rg.Vector3d(*frame.xaxis), rg.Vector3d(*frame.yaxis))

    G = []
    G.append(rg.Line(plane.Origin, size * plane.XAxis))
    G.append(rg.Line(plane.Origin, size * plane.YAxis))
    G.append(rg.Line(plane.Origin, size * plane.ZAxis))
    
    C = []
    C.append(Color.FromArgb(255, 0, 0))
    C.append(Color.FromArgb(0, 255, 0))
    C.append(Color.FromArgb(0, 0, 255))
# ---------- end draw ----------
G = ClusterOutput(draw.G)
C = ClusterOutput(draw.C)

# ==== cluster Tool
breps = ClusterInput()
meshes = ClusterInput()
meshes_2 = Mesh(meshes)
xline = ClusterInput()
yline = ClusterInput()
mjoin = MeshJoin(Meshes=meshes_2)
tool = PythonScript(meshes=mjoin, breps=breps, xline=xline, yline=yline)  # -> tool; inputs meshes: list of Mesh, breps: list of Brep
# ---------- tool: Python ----------
import Rhino.Geometry as rg
from compas.geometry import Frame
from ur_online_control.ur.tool import Tool
from compas.datastructures import Mesh
from compas_rhino.helpers import mesh_from_guid

xaxis = rg.Line(xline.PointAtStart, xline.PointAtEnd)
yaxis = rg.Line(yline.PointAtStart, yline.PointAtEnd)

if xaxis.From.DistanceTo(yaxis.From) < 0.01:
    origin = xaxis.From
    xaxis = xaxis.Direction
    yaxis = yaxis.Direction
elif xaxis.To.DistanceTo(yaxis.To) < 0.01:
    origin = xaxis.To
    xaxis = -xaxis.Direction
    yaxis = -yaxis.Direction
elif xaxis.From.DistanceTo(yaxis.To) < 0.01:
    origin = xaxis.From
    xaxis = xaxis.Direction
    yaxis = -yaxis.Direction
elif xaxis.To.DistanceTo(yaxis.From) < 0.01:
    origin = xaxis.To
    xaxis = -xaxis.Direction
    yaxis = yaxis.Direction

xaxis.Unitize()
yaxis.Unitize()

print origin
print xaxis
print yaxis

tcp_frame = Frame(origin, xaxis, yaxis)

tool = Tool(tcp_frame)
tool.model = [mesh_from_guid(Mesh, mesh) for mesh in meshes]
#tool.model_xyz = tool.model.xyz
tool.breps = breps
# ---------- end tool ----------
tool_2 = ClusterOutput(tool)
