# Grasshopper definition BeamClassImplementation.gh (Grasshopper 1.0.4)
# plug-ins: Python Interpreter

pt = ConstructPoint(XCoordinate=Slider(-0.142, range=-1..1), YCoordinate=Slider(0.248, range=-1..1), ZCoordinate=Slider(-0.248, range=-1..1))
pt_2 = ConstructPoint(XCoordinate=Slider(-0.142, range=-1..1), YCoordinate=Slider(0.248, range=-1..1), ZCoordinate=Slider(-0.248, range=-1..1))
number_slider = Slider(600, range=0..1000)
pt_3 = Point(Point(-349.5694096, 492.4950717, 0))
line = Line()
pt_4 = Point(Point(0, 0, 0))
xy = XYPlane(Origin=Point(0, 0, 0))
pl = PlaneNormal(Origin=pt_3, ZAxis=pt)
pl_2 = PlaneNormal(Origin=pt_4, ZAxis=pt_2)
pt_5 = Point(Point(0, 0, 0))
pt_6 = ConstructPoint(XCoordinate=0, YCoordinate=number_slider, ZCoordinate=number_slider)
pt_7 = ConstructPoint(XCoordinate=number_slider, YCoordinate=0, ZCoordinate=number_slider)
pt_8 = ConstructPoint(XCoordinate=number_slider, YCoordinate=number_slider, ZCoordinate=0)
addition = Addition(A=pt_5, B=pt_6)
addition_2 = Addition(A=pt_7, B=pt_8)
division = Division(A=addition, B=2)
number_slider_2 = Slider(-500, range=-500..500)
division_2 = Division(A=addition_2, B=2)
ln = Line(StartPoint=pt_5, EndPoint=pt_6)
ln_2 = Line(StartPoint=pt_7, EndPoint=pt_8)
subtraction = Subtraction(A=pt_8, B=pt_7)
xz = XZPlane(Origin=Point(0, 0, 0))
subtraction_2 = Subtraction(A=pt_6, B=pt_5)
yz = YZPlane(Origin=Point(0, 0, 0))
divide = DivideCurve(Curve=ln, Count=10, Kinks=False)  # -> Points, Tangents, Parameters
divide_2 = DivideCurve(Curve=ln_2, Count=10, Kinks=False)  # -> Points, Tangents, Parameters
pt_9 = ConstructPoint(XCoordinate=number_slider_2, YCoordinate=number_slider_2, ZCoordinate=Slider(50, range=0..400))
xy_2 = XYPlane(Origin=Point(0, 0, 0))
ln_3 = Line(StartPoint=divide.Points, EndPoint=divide_2.Points)
rotate = Rotate(Geometry=yz, Center=Point(0, 0, 0), From=Vector(0, -1, 0), To=subtraction_2)  # -> Geometry, Transform
rotate_2 = Rotate(Geometry=yz, Center=Point(0, 0, 0), From=Vector(0, 1, 0), To=subtraction)  # -> Geometry, Transform
move = Move(Geometry=xy_2, Motion=pt_9)  # -> Geometry, Transform
move_2 = Move(Geometry=rotate.Geometry, Motion=division)  # -> Geometry, Transform
move_3 = Move(Geometry=rotate_2.Geometry, Motion=division_2)  # -> Geometry, Transform
line_script_gen = PythonScript(
    origin_plane=[move_3.Geometry, move_2.Geometry],
    o_2=pl_2,
    size_x=Slider(1594, range=0..2000),
    size_y=Slider(172, range=0..200),
    size_z=Slider(100, range=0..200),
    lines=ln_3,
    rod_d=Slider(24, range=0..50),
    drill_plane=move.Geometry)  # -> out, a, b, test_box, test_box_1, test_box_0_lines, test_box_pts_top, test_box_pts_bot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; inputs origin_plane: list of Plane, o_2: Plane, size_x: Int32, size_y: Int32, size_z: Int32, lines: list of Line, drill_plane: Plane
# ---------- line_script_gen: Python ----------
# snippet of code to make this python component look for it's code in the parent folder of the .gh file

import os

ghComp = ghenv.Component
ghDoc = ghComp.OnPingDocument()

file_name = "BeamClass.py"
gh_file_location = ghDoc.FilePath
parent = os.path.dirname(os.path.realpath(gh_file_location))

file_path = os.path.join(parent, file_name)
print file_path

# hacky-hacky run-fun
execfile(file_path)
# ---------- end line_script_gen ----------
pt_10 = Point()
ln_4 = Line(StartPoint=line_script_gen.test_box_pts_top, EndPoint=line_script_gen.test_box_pts_bot)
brep = Brep(line_script_gen.hole_box)
brep_2 = Brep(line_script_gen.test_box_1)
brep_3 = Brep(line_script_gen.test_box_0)
line_2 = Line(line_script_gen.test_box_0_lines)
panel = Panel(line_script_gen.out)
