# Grasshopper definition BeamClass_WIP_cleaning.gh (Grasshopper 1.0.7)

pt = ConstructPoint(XCoordinate=Slider(-0.142, range=-1..1), YCoordinate=Slider(0.248, range=-1..1), ZCoordinate=Slider(-0.248, range=-1..1))
pt_2 = Point(Point(-349.5694096, 492.4950717, 0))
number_slider = Slider(1594, range=0..2000)
number_slider_2 = Slider(100, range=0..200)
number_slider_3 = Slider(100, range=0..200)
pl = PlaneNormal(Origin=pt_2, ZAxis=pt)
file = ReadFile(
    File="C:\Users\nico\Documents\GitHub\Gradual-Assemblies\UR Control\ur_online_control\grasshopper\BeamClass_clean.py",
    PerLineParse=False)
python = GhPythonScript(Code=file, O_plane=pl)  # -> Out, A
python_2 = GhPythonScript(o_plane=pl)  # -> out, a; inputs o_plane: Plane, s_x: Int32, s_y: Int32, s_z: Int32
# ---------- python_2: Python ----------
'''
Created on 14.01.2019
@author: feihln

'''

import Rhino.Geometry as rg
import math as m


class Beam(object):
    """
    Beam class, represention of a wood section

    args:
    -o_plane :  Plane defining the beam orientation,
                origin is in the middle of the beam,
                x_axis is the long axis of the beam,
                y_axis is the second biggest beam size
    -s_x :      size of the beam in x(beam coordinates) direction
    -s_y :      size of the beam in y(beam coordinates) direction
    -s_z :      size of the beam in z(beam coordinates) direction
    """

    def __init__(self, o_plane, s_x = 2000, s_y = 100, s_z = 40):
        self.o_plane = o_plane
        self.size_x = s_x
        self.size_y = s_y
        self.size_z = s_z

        # statement to indicate that no intersections have been calculated yet
        self.intersections_calculated = False
        # statement to indicate that there are no wrongly place holes, False if all dowel placements are possible
        self.bad_points = False
        # List of holes in the beam for dowel insertion
        self.hole_list = []

    def box_interval(self, range, offset = 0):
        """
        defines intervals used to create geometry down the road

        args:
        -range : full range (size)
        -offset :
        """
        value = range * .5 - offset
        return rg.Interval(-value, value)

    def generate_box(self):
        """
        generate a simple box representation of the beam
        (no holes, no end angles)

        """
        self.x_int = self.box_interval(self.size_x)
        self.y_int = self.box_interval(self.size_y)
        self.z_int = self.box_interval(self.size_z)
        beam_box = rg.Box(plane, self.x_int, self.y_int, self.z_int)
        return beam_box
# ---------- end python_2 ----------
python_3 = GhPythonScript(o_plane=pl)  # -> out, a; inputs o_plane: Plane, s_x: Int32, s_y: Int32, s_z: Int32
# ---------- python_3: Python ----------
'''
Created on 14.01.2019
@author: feihln

'''

import Rhino.Geometry as rg
import math as m

class Dowel(object):
    """
    Dowel class, representation of a circular dowel section

    args:
    -line :
    -diameter : diameter of the dowel
    """

    def __init__(self, line, diameter = 24):
        self.r = diameter / 2 #radius
        self.d = diameter #diameter
        self.line = line

        ###fabrication data###
        #added depth to be sure to drill through
        self.safety_cut_depth = 1.0

    def placement_frame_gen(self):
        """
        
        """
        start_pt = self.line.PointAt(0.0)
        end_pt = self.line.PointAt(1.0)
        frame_normal = rg.Vector3d(end_pt - start_pt)

        self.base_pl = rg.Plane(start_pt, frame_normal)
        self.top_pl = rg.Plane(end_pt, frame_normal)

    def brep_representation(self):
        """
        
        """
        flat = rg.PipeCapMode.Flat
        brep = rg.Brep.CreatePipe(rg.LineCurve(self.line), self.rod_r, False, flat, False, .01, .01)
        return brep

class Beam(object):
    """
    Beam class, represention of a wood section

    args:
    -o_plane :  Plane defining the beam orientation,
                origin is in the middle of the beam,
                x_axis is the long axis of the beam,
                y_axis is the second biggest beam size
    -s_x :      size of the beam in x(beam coordinates) direction
    -s_y :      size of the beam in y(beam coordinates) direction
    -s_z :      size of the beam in z(beam coordinates) direction
    """

    def __init__(self, o_plane, s_x = 2000, s_y = 100, s_z = 40):
        self.o_plane = o_plane
        self.size_x = s_x
        self.size_y = s_y
        self.size_z = s_z

        # statement to indicate that no intersections have been calculated yet
        self.intersections_calculated = False
        # statement to indicate that there are no wrongly place holes, False if all dowel placements are possible
        self.bad_points = False
        # List of holes in the beam for dowel insertion
        self.hole_list = []

    def box_interval(self, range, offset = 0):
        """
        defines intervals used to create geometry down the road

        args:
        -range : full range (size)
        -offset :
        """
        value = range * .5 - offset
        return rg.Interval(-value, value)

    def generate_box(self):
        """
        generate a simple box representation of the beam
        (no holes, no end angles)

        """
        self.x_int = self.box_interval(self.size_x)
        self.y_int = self.box_interval(self.size_y)
        self.z_int = self.box_interval(self.size_z)
        beam_box = rg.Box(plane, self.x_int, self.y_int, self.z_int)
        return beam_box

    def beam_line_intersection(self, dowels, coll_off_w = 0, coll_off_l = 0):
        # generating the top & bottom plane of a beam
        self.top_pl, self.bot_pl = rg.Plane(self.o_plane), rg.Plane(self.o_plane)
        move_up = rg.Vector3d(self.o_plane.Normal)
        move_down = rg.Vector3d(self.o_plane.Normal)
        move_up *= .5 * self.size_z
        move_down *= - .5 * self.size_z
        self.top_pl.Translate(move_up)
        self.bot_pl.Translate(move_down)

        # setting up global variables
        self.top_pts, self.bot_pts, self.dowel_ds = [], [], []
        self.local_int_lines = []

        for dowel in dowels:
            line = dowel.line
            r = dowel.r

            temp, top_pt_p = rg.Intersect.Intersection.LinePlane(line, self.top_pl)
            temp, bot_pt_p = rg.Intersect.Intersection.LinePlane(line, self.bot_pl)

            # implementing a scale_up to the geometry to allow for full overlap
            # with the bottom & top plane
            center_pt = rg.Point3d(top_pt_p - bot_pt_p) / 2

            normal = self.o_plane.normal
            vector = rg.Vector3d(top_pt_p - bot_pt_p)
            alfa = m.pi / 2 - rg.Vector3d(vector, normal)
            local_l = self.size_z + r / m.tan(alfa) + self.safety_l

            self.dowel_ds.append(r)
            self.top_pts.append(line.PointAt(top_pt_p))
            self.bot_pts.append(line.PointAt(bot_pt_p))
            self.local_int_lines.append(rg.Line(line.PointAt(top_pt_p),line.PointAt(bot_pt_p)))

        # indicating that the intersections have been calculated
        self.intersections_calculated = True

    def beam_line_intersection_collision(self, coll_off_w = 0, coll_off_l = 0):
        if (self.intersections_calculated):
            x_rec_int = self.interval_gen(self.size_x, coll_off_w)
            y_rec_int = self.interval_gen(self.size_y, coll_off_l)
            rec_up = rg.Rectangle3d(self.o_plane, x_rec_int, y_rec_int)
            rec_down = rg.Rectangle3d(self.o_plane, x_rec_int, y_rec_int)

            for top_pt in self.top_pts:
                value = rec_up.Contains(top_pt, self.top_pl)
                if (value == 2 or value == 0):
                    break
            else:
                self.bad_points = True
            for bot_pt in self.bot_pts:
                value = rec_down.Contains(bot_pt, self.bot_pl)
                if (value == 2 or value == 0):
                    break
            else:
                self.bad_points = True
        else:
            print "beam_line_intersection_collision requires some intersections"

    def beam_dowel_gen(self):
        pass

    def transform_to_other_plane(self, other_plane):
        self.transform_plane = other_plane
        trans = rg.Transform.PlaneToPlane(self.o_plane, other_plane)
        self.lines_transformed = []
        for line in self.local_int_lines:
            line_transformed = rg.LineCurve(line)
            line_transformed.Transform(trans)
            self.lines_transformed.append(line_transformed)

    def brep_subtraction(self, holes, plane = self.o_plane):
        self.brep_repr = self.generate_box(plane)
        for hole in holes:
            self.brep_repr = rg.Brep.CreateBooleanDifference(self.brep_repr, hole, 0.1)[0]
        return box_geom

    def gen_3D_geom(self, plane = self.o_plane):
        if (plane == self.o_plane):
            if (self.intersections_calculated):
                local_box = self.generate_box(self.o_plane)
                dowel = SimpleDowel(self.lines, self.rod_ds)
                dowel_postives = self.brep_subtraction(local_box, dowels)
            else:
                return self.generate_box(self.o_plane)
        else:
            if (self.intersections_calculated):
                return self.generate_box(self.transform_plane)

test_dowels = SimpleDowel(lines, rod_d).brep_representation()

# test_beam = SimpleBeam(origin_plane, size_x, size_y, size_z)
# test_beam.beam_line_intersection(lines)
# test_beam.transform_for_robot(o_2)
#
# for_robot = []
# for_robot.append(o_2)
# for_robot.extend(test_beam.lines_transformed)
#
# for_3Dprint = []
# for_3Dprint.append(test_beam.generate_geom_for_print())
# for_3Dprint.extend(test_beam.lines_transformed)
#
# display_geom.append(test_beam.geom)
# ---------- end python_3 ----------
panel = Panel(python.Out)
panel_2 = Panel(python_2.out)
python_4 = GhPythonScript(o_plane=pl)  # -> out, temp_geom; inputs o_plane: Plane
# ---------- python_4: Python ----------
__author__ = "nico"
__version__ = "2019.01.14"

import Rhino.Geometry as rg
import rhinoscriptsyntax as rs

temp_geom = []

class Beam(object):
    """
    Beam class, represention of a wood section

     args:
     -o_plane :  Plane defining the beam orientation,
                    origin is in the middle of the beam,
                    x_axis is the long axis of the beam,
                    y_axis is the second biggest beam size
    -s_x :      size of the beam in x(beam coordinates) direction
    -s_y :      size of the beam in y(beam coordinates) direction
    -s_z :      size of the beam in z(beam coordinates) direction
    """

    def __init__(self, o_plane, s_x = 2000, s_y = 100, s_z = 40):
        self.o_plane = o_plane
        self.size_x = s_x
        self.size_y = s_y
        self.size_z = s_z
        
        #list to store 
        self.geom = []
        
        # List of holes in the beam for dowel insertion
        self.hole_list = []
        # statement to indicate that no intersections have been calculated yet
        self.intersections_calculated = False
        # statement to indicate that there are no wrongly place holes, False if all dowel placements are possible
        self.bad_holes = False
        

    def generate_box(self):
        """
        generate a simple box representation of the beam
        (no holes, no end angles)
        """
        self.x_int = rg.Interval(-self.size_x/2,self.size_x/2)
        self.y_int = rg.Interval(-self.size_y/2,self.size_y/2)
        self.z_int = rg.Interval(-self.size_z/2,self.size_z/2)
        beam_box = rg.Box(self.o_plane, self.x_int, self.y_int, self.z_int)
        return beam_box
        


test_beam = Beam(o_plane)
temp_geom.append(test_beam.generate_box())


class Dowel(object):
    """
    Dowel class, representation of a circular dowel section

    args:
    -line:
    """
    def __init__(self, line, diameter = 24):
        self.r = diameter / 2 #radius
        self.d = diameter #diameter
        self.line = line
        self.dowel_frames()

    def dowel_frames(self):
        """
        create frames(planes) at each end of the dowel line, 
        that can be used to generate hole in the beam
        """
        vector = rg.Vector3d(self.line.PointAt(1.0)) - rg.Vector3d(self.line.PointAt(1.0))
        frame1 = rg.Plane(self.line.PointAt(0.0), vector)
        frame2 = rg.Plane(self.line.PointAt(1.0), -vector)
        return frame1, frame2

    def dowel_cylinder(self):
        """
        generates a simple cylinder representation of the dowel
        """
        vector = rg.Vector3d(self.line.PointAt(1.0)) - rg.Vector3d(self.line.PointAt(1.0))
        frame1 = rg.Plane(self.line.PointAt(0.0), vector)
        cylinder = rg.Cylinder(rg.Circle(frame1,self.r),vector.Length)
# ---------- end python_4 ----------
geo = Geometry(python_4.temp_geom)
