# Grasshopper definition TestFile.gh (Grasshopper 1.0.4)
# plug-ins: Python Interpreter

panel = Panel("Curve Mapping")

panel_2 = Panel("Placing Angles")

panel_3 = Panel("Distance Between Elements")

panel_4 = Panel("Grid Dimensions")

panel_5 = Panel("Representation Only")

panel_6 = Panel("Curve Managing")
z_delta = Slider(13, range=1..30)
x_delta = Slider(8, range=1..30)

python = PythonScript(
    x_count=Slider(10, range=2..50),
    z_count=Slider(200, range=2..200),
    base_layer_count=Slider(1, range=1..50),
    x_delta=Slider(20, range=0..25),
    z_delta=Slider(1, range=0..25),
    pd_min=Slider(0, range=-1..0.5),
    pd_max=Slider(0.45, range=0.2..0.65),
    x_space=Slider(1, range=0..5),
    z_space=Slider(0.9975, range=0..5),
    deviation_value=Slider(16, range=0..20),
    iteration_count=Slider(7, range=1..50),
    shift_x_bool=Toggle(True),
    perp_bool=Toggle(True))  # -> out, useful_list, total_list, pipe_list, curve_list; inputs x_count: Int32, z_count: Int32, base_layer_count: Int32, iteration_count: Int32, perp_bool: Boolean
# ---------- python: Python ----------
# snippet of code to make this python component look for it's code in the parent folder of the .gh file

import os

ghComp = ghenv.Component
ghDoc = ghComp.OnPingDocument()

file_name = "basePoiintTesting.py"
gh_file_location = ghDoc.FilePath
parent = os.path.dirname(os.path.realpath(gh_file_location))
print parent

file_path = os.path.join(parent, file_name)

# hacky-hacky run-fun
execfile(file_path)
# ---------- end python ----------
crv = Curve(python.curve_list)
pt = Point(Point(0, 0, 0))
pt_2 = Point(python.useful_list)
pt_3 = Point(python.total_list)
brep = Brep(python.pipe_list)
python_2 = PythonScript(
    start_point=pt,
    normal_angle=Slider(90, range=40..90),
    plane_angle=Slider(320, range=0..360),
    x_spacing=Slider(20, range=0..40),
    rel_z_spacing=Slider(0.5, range=0..1),
    x_count=Slider(10, range=0..50),
    z_count=Slider(20, range=0..50),
    bullet_height=Slider(15, range=0..40),
    bullet_width=Slider(18, range=0..40),
    z_delta=z_delta,
    x_delta=x_delta,
    rel_change_min=Slider(0, range=0..1),
    rel_change_max=Slider(1, range=0..1),
    baseline_count=Slider(2, range=0..50),
    alternate=Toggle(True),
    invert=Toggle(True))  # -> out, plane_list, point_list, pipes; inputs start_point: Point3d, x_count: Int32, z_count: Int32, z_delta: Int32, x_delta: Int32, alternate: Boolean, invert: Boolean; same code as python
pline = PolyLine(Vertices=python_2.point_list, Closed=False)
pln = Plane(python_2.plane_list)
panel_7 = Panel(python_2.out)
