# Grasshopper definition flattening.gh (Grasshopper 1.0.4)
# plug-ins: Python Interpreter

x_coordinate = Slider(450, range=-500..1000)
y_coordinate = Slider(180, range=0..1000)
z_coordinate = Slider(-266.5, range=-500..1000)
x_coordinate_2 = Slider(450, range=-500..1000)
y_coordinate_2 = Slider(180, range=0..1000)
# 03
z_coordinate_2 = Slider(-266.5, range=-500..1000)
# 03
number_slider = Slider(1, range=1..50)
pt = ConstructPoint(XCoordinate=x_coordinate, YCoordinate=y_coordinate, ZCoordinate=z_coordinate)
pt_2 = ConstructPoint(XCoordinate=x_coordinate_2, YCoordinate=y_coordinate_2, ZCoordinate=z_coordinate_2)
xy = XYPlane(Origin=Point(0, 0, 0))
xy_2 = XYPlane(Origin=Point(0, 0, 0))
move = Move(Geometry=xy, Motion=pt)  # -> Geometry, Transform
python = PythonScript(
    base_point=pt,
    pd_min=Slider(0.12, range=0..1),
    pd_max=Slider(0.4, range=0..1),
    x_count=Slider(20, range=2..50),
    z_count=Slider(60, range=2..200),
    x_space=Slider(1, range=0..5),
    z_space=Slider(1, range=0..5),
    x_delta=Slider(20, range=2..50),
    z_delta=Slider(50, range=2..200),
    base_layer_count=number_slider,
    perp_bool=Toggle(True),
    shift_x_bool=Toggle(False),
    xdelta=Slider(7, range=1..15),
    zdelta=Slider(15, range=1..40),
    a=Slider(1, range=0..10),
    iteration_count=Slider(1, range=1..7),
    deviation_value=Slider(1, range=0..1),
    angle_scale=Slider(15, range=1..40),
    distance_function=Toggle(True))  # -> out, useful_list, total_list, pipe_list, curve_list, a; inputs base_point: Point3d, x_count: Int32, z_count: Int32, base_layer_count: Int32, perp_bool: Boolean, iteration_count: Int32, distance_function: Boolean
# ---------- python: Python ----------
# snippet of code to make this python component look for it's code in the parent folder of the .gh file
import os

ghComp = ghenv.Component
ghDoc = ghComp.OnPingDocument()

file_name = "flattening_bis.py"
gh_file_location = ghDoc.FilePath
parent = os.path.dirname(os.path.realpath(gh_file_location))

file_path = os.path.join(parent, file_name)

# hacky-hacky run-fun
execfile(file_path)
# ---------- end python ----------
move_2 = Move(Geometry=xy_2, Motion=pt_2)  # -> Geometry, Transform
python_2 = PythonScript(
    base_point=pt_2,
    pd_min=Slider(0.05, range=0..1),
    pd_max=Slider(0.55, range=0..1),
    x_count=Slider(20, range=2..50),
    z_count=Slider(50, range=2..200),
    x_space=Slider(0.5, range=0..5),
    z_space=Slider(0.5, range=0..5),
    x_delta=Slider(20, range=2..50),
    z_delta=Slider(50, range=2..200),
    base_layer_count=Slider(1, range=1..50),
    perp_bool=Toggle(True),
    shift_x_bool=Toggle(False),
    xdelta=Slider(7, range=1..15),
    zdelta=Slider(15, range=1..40),
    a=Slider(1, range=0..10),
    iteration_count=Slider(1, range=1..7),
    deviation_value=Slider(1, range=0..1),
    anlge_scale=Slider(15, range=1..40),
    distance_function=Toggle(False))  # -> out, useful_list, total_list, pipe_list, curve_list, a; inputs base_point: Point3d, x_count: Int32, z_count: Int32, base_layer_count: Int32, perp_bool: Boolean, iteration_count: Int32, distance_function: Boolean
# ---------- python_2: Python ----------
import math
import Rhino.Geometry as rg

global x_delta, z_delta, pd_min, pd_max, pd_range
global top_z, new_list, previous_list, plane_list, curve_list

## python set variables
# controlling the pd function
# x_delta = 10.0
# z_delta = 10.0
# pd_min = .1
# pd_max = .65

# grid spacing for functions
# z_space = .5
# x_space = 1.0

# x_count = 6
# z_count = 21

# pigeon parameters

pigeon_height = 15.0
pigeon_width = 18.0
pd_default = .5
default_spacing = 20.0

## grasshopper informed

x_count = x_count
z_count = z_count

base_layer_count = base_layer_count

perp_bool = perp_bool

pd_range = pd_max - pd_min

# function
iteration_count = iteration_count
deviation_value = deviation_value

## pre-calculations

tau = math.pi * 2

print tau

def topFlatCount(last_point_list):
    z_list = []
    for p in last_point_list:
        z_list.append(p.Z)
    # calculating the height delta in the row
    min_z = min(z_list)
    max_z = max(z_list)
    h_delta = max_z - min_z
    row_count = math.ceil((max_z-min_z) / (pd_range * pigeon_height))
    top_line_z = max_z + row_count * pd_max * pigeon_height
    return int(row_count), top_line_z

def perpVector(point0, point1):
    p0x, p0y, p0z = point0.X, point0.Y, point0.Z
    p1x, p1y, p1z = point1.X, point1.Y, point1.Z
    x_val, y_val, z_val = (p0x + p1x) / 2, (p0y + p1y) / 2, (p0z + p1z) / 2
    if (perp_bool):
        # translate to origin
        x1, y1, z1 = p0x - x_val, p0y - y_val, p0z - z_val
        # rotation around y-axis
        x2, y2, z2 = z1, y1, -x1
        perp_vec = rg.Vector3d(x2, y2, z2)
    else:
        perp_vec = rg.Vector3d(0,0,1)
    return x_val, y_val, z_val, perp_vec

def pdFunction(x_val_unitized, z_val_unitized):
    angle_x = x_val_unitized % x_delta * tau / x_delta
    angle_z = z_val_unitized % z_delta * tau / z_delta
    angle = angle_x + angle_z
    # superposition values
    graded_sin_sum = 0
    for k in range(iteration_count):
        graded_sin_sum += math.sin(deviation_value*angle/float(k + 1))
    graded_sin_sum /= float(iteration_count)
    local_pd_unit = (graded_sin_sum + 1.0)/2
    local_pd = local_pd_unit * pd_range
    local_pd += pd_min
    return local_pd

def piping(plane, height):
    radius = pigeon_width / 2.0
    circle = rg.Circle(plane, radius)
    pipe = rg.Cylinder(circle, -height)
    return pipe

def pointGeneration(top_layer_count):

    # pre calculations
    start_x_count = x_count + (z_count - 1 - z_count % 2) + top_layer_count
    total_list, useful_list, pipe_list, previous_list = [], [], [], []
    new_list, plane_list, curve_list = [], [], []

    for j in range(z_count + top_layer_count):
        # previous_list cleaning
        previous_list = new_list
        new_list = []

        # piramid scheme and filtering
        local_x_count_len = start_x_count - j
        start_useful = (local_x_count_len + (j + 1) % 2 - x_count) / 2
        end_useful = start_useful + x_count - (j + 1) % 2 - 1

        print local_x_count_len, start_useful, end_useful
        z_val_unitized = j * z_space

        print (j < z_count)
        
        if (j < base_layer_count):
            perp_vec = rg.Vector3d(0,0,1)
            z_val = pigeon_height * pd_default * j
            z_val_top = pigeon_height * pd_default
            for i in range(local_x_count_len):
                x_val_unitized = (- float(local_x_count_len) / 2 + i)
                x_val = x_val_unitized * default_spacing
                x_val_unitized *= x_space
                base_point = rg.Point3d(x_val, 0, z_val)
                top_point = rg.Point3d(x_val, 0, z_val + z_val_top)
                new_list.append(top_point)
                total_list.append(base_point)
                if (i >= start_useful) and (i <= end_useful):
                    useful_list.append(base_point)
                    top_plane = rg.Plane(top_point, perp_vec)
                    plane_list.append(top_plane)
                    pipe_list.append(piping(top_plane, z_val_top))
        elif (j < z_count):
            for i in range(local_x_count_len):
                # setting the x_value fot the function
                x_val_unitized = (- float(local_x_count_len) / 2 + i) * x_space
                # calculating the midpoints of the previous top_points
                pt0 = previous_list[i]
                pt2 = previous_list[i+1]
                x_val, y_val, z_val, perp_vec = perpVector(pt0, pt2)
                pd = pdFunction(x_val_unitized, z_val_unitized)
                local_height = pigeon_height * pd
                base_point = rg.Point3d(x_val, y_val, z_val)
                if (shift_x_bool):
                    delta_pt = perp_vec / math.sqrt(perp_vec * perp_vec) * local_height
                else:
                    delta_pt = rg.Point3d(0, 0, local_height)
                top_point = base_point + delta_pt
                new_list.append(top_point)
                total_list.append(base_point)
                if (i >= start_useful) and (i <= end_useful):
                    useful_list.append(base_point)
                    top_plane = rg.Plane(top_point, perp_vec)
                    plane_list.append(top_plane)
                    pipe_list.append(piping(top_plane, local_height))
        else:
            for i in range(local_x_count_len):
                pt0 = previous_list[k]
                pt2 = previous_list[k+1]
                x_val, y_val, z_val, perp_vec = perpVector(pt0, pt2)
                local_height = (top_z - z_val) / division_factor
                base_point = rg.Point3d(x_val, y_val, z_val)
                if (shift_x_bool):
                    delta_pt = perp_vec / math.sqrt(perp_vec * perp_vec) * local_height
                else:
                    delta_pt = rg.Point3d(0, 0, local_height)
                top_point = base_point + delta_pt
                new_list.append(top_point)
                total_list.append(base_point)
                if (i >= start_useful) and (i <= end_useful):
                    useful_list.append(base_point)
                    top_plane = rg.Plane(top_point, perp_vec)
                    plane_list.append(top_plane)
                    pipe_list.append(piping(top_plane, local_height))
        curve = rg.PolylineCurve(new_list)
        curve_list.append(curve)
        return new_list, plane_list, pipe_list

# actual output
last_list, plane_list, pipe_list = pointGeneration(0)

# setting the values for flattening the top off
top_rowCount, top_z = topFlatCount(last_list)

last_list, plane_list, pipe_list = pointGeneration(top_rowCount)

a = plane_list
# ---------- end python_2 ----------
brep = Brep(python.pipe_list)
brep_2 = Brep(python_2.pipe_list)
pln = Plane(python_2.a)
pln_2 = Plane(python.a)
panel = Panel(python.out)
