# Grasshopper definition geometry_test_file_2.gh (Grasshopper 0.9.80)
# plug-ins: Python Interpreter

srf = Surface([<surface referenced from the Rhino model> x4])
srf_2 = Surface([<surface referenced from the Rhino model> x4])
srf_3 = Surface([<surface referenced from the Rhino model> x3])
srf_4 = Surface(<surface referenced from the Rhino model>)
srf_5 = Surface(<surface referenced from the Rhino model>)
srf_6 = Surface(<surface referenced from the Rhino model>)
srf_7 = Surface(<surface referenced from the Rhino model>)
srf_8 = Surface(<surface referenced from the Rhino model>)
merge = Merge(Data1=srf_6, Data2=srf_7, Data3=srf_8, Data4=srf_5, Data5=srf_4)
surface_keystoning = PythonScript(srf_1=srf_6, srf_2=srf_7, srf_3=srf_8, srf_4=srf_5, srf_set=srf_2)  # -> out, isocurve_visualisation, blend_crvs_vis, crv_vis, new_surfaces, visualize_uv_switched_crvs; inputs srf_1: Surface, srf_2: Surface, srf_3: Surface, srf_4: Surface, srf_set: list of Surface
# ---------- surface_keystoning: Python ----------
# snippet of code to make this python component look for it's code in the parent folder of the .gh file

import os

ghComp = ghenv.Component
ghDoc = ghComp.OnPingDocument()

file_name = "surface_keystone.py"
gh_file_location = ghDoc.FilePath
parent = os.path.dirname(os.path.realpath(gh_file_location))

file_path = os.path.join(parent, file_name)
# print file_path

single_parent = os.path.dirname(os.path.realpath(parent))
double_parent = os.path.dirname(os.path.realpath(single_parent))
# print parent

# hacky-hacky run-fun
execfile(file_path)
# ---------- end surface_keystoning ----------
merge_2 = Merge()
srf_9 = Surface(surface_keystoning.new_surfaces)
srf_10 = Surface(srf_3)
surface_keystoning_2 = PythonScript(
    srf_1=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,
    srf_2=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,
    srf_3=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,
    srf_4=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,
    srf_set=srf_10)  # -> out, isocurve_visualisation, blend_crvs_vis, crv_vis, new_surfaces, visualize_uv_switched_crvs; inputs srf_1: Surface, srf_2: Surface, srf_3: Surface, srf_4: Surface, srf_set: list of Surface; same code as surface_keystoning
v_div = Slider(10, range=0..100)
u_div = Slider(5, range=0..100)
srf_11 = Surface(srf_2)
surface_keystoning_3 = PythonScript(
    srf_1=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,
    srf_2=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,
    srf_3=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,
    srf_4=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,
    srf_set=srf_11)  # -> out, isocurve_visualisation, blend_crvs_vis, crv_vis, new_surfaces, visualize_uv_switched_crvs; inputs srf_1: Surface, srf_2: Surface, srf_3: Surface, srf_4: Surface, srf_set: list of Surface; same code as surface_keystoning
v_div_2 = Slider(8, range=0..100)
u_div_2 = Slider(8, range=0..100)
srf_12 = Surface(surface_keystoning_2.new_surfaces)
number_slider = Slider(20, range=0..100)
number_slider_2 = Slider(7, range=0..20)
srf_13 = Surface(surface_keystoning_3.new_surfaces)
number_slider_3 = Slider(20, range=0..100)
number_slider_4 = Slider(7, range=0..20)
srf_14 = Surface(srf_12)
srf_15 = Surface(srf_13)
surface_trimming = PythonScript(srf=srf_10, value=number_slider, v_div=number_slider_2)  # -> out, isocurves, temp_surface, hole_visualisation; inputs srf: Surface, value: Int32, v_div: Int32
# ---------- surface_trimming: Python ----------
# snippet of code to make this python component look for it's code in the parent folder of the .gh file

import os

ghComp = ghenv.Component
ghDoc = ghComp.OnPingDocument()

file_name = "surface_offset.py"
gh_file_location = ghDoc.FilePath
parent = os.path.dirname(os.path.realpath(gh_file_location))

file_path = os.path.join(parent, file_name)
# print file_path

single_parent = os.path.dirname(os.path.realpath(parent))
double_parent = os.path.dirname(os.path.realpath(single_parent))
# print parent

# hacky-hacky run-fun
execfile(file_path)
# ---------- end surface_trimming ----------
surface_trimming_2 = PythonScript(srf=srf_14, value=number_slider, v_div=number_slider_2)  # -> out, isocurves, temp_surface, hole_visualisation; inputs srf: Surface, value: Int32, v_div: Int32; same code as surface_trimming
u_div_3 = Number(u_div)
v_div_3 = Number(v_div)
surface_trimming_3 = PythonScript(srf=srf_11, value=number_slider_3, v_div=number_slider_4)  # -> out, isocurves, temp_surface, hole_visualisation; inputs srf: Surface, value: Int32, v_div: Int32; same code as surface_trimming
surface_trimming_4 = PythonScript(srf=srf_15, value=number_slider_3, v_div=number_slider_4)  # -> out, isocurves, temp_surface, hole_visualisation; inputs srf: Surface, value: Int32, v_div: Int32; same code as surface_trimming
u_div_4 = Number(u_div_2)
v_div_4 = Number(v_div_2)
int = Integer(0)
int_2 = Integer(1)
python = PythonScript(surface=surface_trimming.temp_surface, u_div=u_div_3, v_div=v_div_3, start_position=int)  # -> out, beam_visualisation; inputs surface: Surface, u_div: Int32, v_div: Int32
# ---------- python: Python ----------
# snippet of code to make this python component look for it's code in the parent folder of the .gh file

import os

ghComp = ghenv.Component
ghDoc = ghComp.OnPingDocument()

file_name = "simple_surface_divider.py"
gh_file_location = ghDoc.FilePath
parent = os.path.dirname(os.path.realpath(gh_file_location))

file_path = os.path.join(parent, file_name)
# print file_path

single_parent = os.path.dirname(os.path.realpath(parent))
double_parent = os.path.dirname(os.path.realpath(single_parent))
# print parent

# hacky-hacky run-fun
execfile(file_path)
# ---------- end python ----------
python_2 = PythonScript(surface=surface_trimming_2.temp_surface, u_div=u_div_3, v_div=v_div_3, start_position=int)  # -> out, beam_visualisation; inputs surface: Surface, u_div: Int32, v_div: Int32; same code as python
python_3 = PythonScript(surface=surface_trimming_3.temp_surface, u_div=u_div_4, v_div=v_div_4, start_position=int_2)  # -> out, beam_visualisation; inputs surface: Surface, u_div: Int32, v_div: Int32; same code as python
python_4 = PythonScript(surface=surface_trimming_4.temp_surface, u_div=u_div_4, v_div=v_div_4, start_position=int_2)  # -> out, beam_visualisation; inputs surface: Surface, u_div: Int32, v_div: Int32; same code as python
brep = Brep(python.beam_visualisation)
brep_2 = Brep(python_2.beam_visualisation)
brep_3 = Brep(python_3.beam_visualisation)
brep_4 = Brep(python_4.beam_visualisation)
merge_3 = Merge(Data1=brep, Data2=brep_2)
merge_4 = Merge(Data1=brep_3, Data2=brep_4)
brep_5 = Brep(merge_3)
brep_6 = Brep(merge_4)
