# Grasshopper definition geometry_test_file_3.gh (Grasshopper 0.9.80)
# plug-ins: Python Interpreter

number_slider = Slider(800, range=0..1000)
srf = Surface([<surface referenced from the Rhino model> x4])
srf_2 = Surface([<surface referenced from the Rhino model> x3])
srf_3 = Surface([<surface referenced from the Rhino model> x3])
srf_4 = Surface(<surface referenced from the Rhino model>)
srf_5 = Surface(<surface referenced from the Rhino model>)
srf_6 = Surface(<surface referenced from the Rhino model>)
srf_7 = Surface(<surface referenced from the Rhino model>)
srf_8 = Surface(<surface referenced from the Rhino model>)
srf_9 = Surface([<surface referenced from the Rhino model> x4])
srf_10 = Surface([<surface referenced from the Rhino model> x3])
srf_11 = Surface([<surface referenced from the Rhino model> x3])
swatch = ColourSwatch(SwatchColor=RGB(255, 255, 161))
srf_12 = Surface([<surface referenced from the Rhino model> x3])
srf_13 = Surface(<surface referenced from the Rhino model>)
srf_14 = Surface(<surface referenced from the Rhino model>)
srf_15 = Surface(<surface referenced from the Rhino model>)
srf_16 = Surface(<surface referenced from the Rhino model>)
srf_17 = Surface(<surface referenced from the Rhino model>)
srf_18 = Surface([<surface referenced from the Rhino model> x3])
preview = CustomPreview(Shader={ambient=RGB(0, 0, 0), diffuse=RGB(255, 105, 180), emission=RGB(76, 32, 54), shine=0.5, specular=RGB(255, 255, 255), transparency=0})
surface_keystoning = PythonScript(
    srf_1=srf_6,
    srf_2=srf_7,
    srf_3=srf_8,
    srf_4=srf_5,
    srf_set=srf_2,
    blend_precision=Slider(13, range=0..15),
    v_div=Slider(10, range=0..15),
    dir=Toggle(True))  # -> out, isocurve_visualisation, blend_crvs_vis, crv_vis, keystone_srfs, split_crvs, uv_switched_crvs, uv_switched_pts; inputs srf_1: Surface, srf_2: Surface, srf_3: Surface, srf_4: Surface, srf_set: list of Surface, blend_precision: Int32, dir: Int32
# ---------- surface_keystoning: Python ----------
# snippet of code to make this python component look for it's code in the parent folder of the .gh file

import os

ghComp = ghenv.Component
ghDoc = ghComp.OnPingDocument()

file_name = "surface_keystone.py"
gh_file_location = ghDoc.FilePath
parent = os.path.dirname(os.path.realpath(gh_file_location))

file_path = os.path.join(parent, file_name)
# print file_path

single_parent = os.path.dirname(os.path.realpath(parent))
double_parent = os.path.dirname(os.path.realpath(single_parent))
# print parent

# hacky-hacky run-fun
execfile(file_path)
# ---------- end surface_keystoning ----------
merge = Merge(Data1=srf_6, Data2=srf_7, Data3=srf_8, Data4=srf_5, Data5=srf_4)
planesrf = PlaneSurface(Plane=PlaneXY(0, 0, 0), XSize=number_slider, YSize=number_slider)
merge_2 = Merge(Data1=srf_15, Data2=srf_16, Data3=srf_17, Data4=srf_14, Data5=srf_13)
surface_keystoning_2 = PythonScript(srf_1=srf_15, srf_2=srf_16, srf_3=srf_17, srf_4=srf_14, srf_set=srf_10)  # -> out, isocurve_visualisation, blend_crvs_vis, crv_vis, new_surfaces, visualize_uv_switched_crvs; inputs srf_1: Surface, srf_2: Surface, srf_3: Surface, srf_4: Surface, srf_set: list of Surface; same code as surface_keystoning
merge_3 = Merge()
series = Series(Start=0, Step=number_slider, Count=Slider(3, range=0..10))
series_2 = Series(Start=0, Step=number_slider, Count=Slider(4, range=0..10))
merge_4 = Merge()
panel = Panel(surface_keystoning.out)
pt = Point(surface_keystoning.uv_switched_pts)
crv = Curve(surface_keystoning.uv_switched_crvs)
X = UnitX(Factor=series)
srf_19 = Surface(srf_12)
Y = UnitY(Factor=series_2)  # -> graft(UnitVector)
srf_20 = Surface([<surface referenced from the Rhino model> x3])
srf_21 = Surface(surface_keystoning.keystone_srfs)
surface_keystoning_3 = PythonScript(
    srf_1=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,
    srf_2=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,
    srf_3=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,
    srf_4=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,
    srf_set=srf_19)  # -> out, isocurve_visualisation, blend_crvs_vis, crv_vis, new_surfaces, visualize_uv_switched_crvs; inputs srf_1: Surface, srf_2: Surface, srf_3: Surface, srf_4: Surface, srf_set: list of Surface; same code as surface_keystoning
srf_22 = Surface(surface_keystoning_2.new_surfaces)
srf_23 = Surface(srf_11)
srf_24 = Surface(srf_18)
surface_keystoning_4 = PythonScript(
    srf_1=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,
    srf_2=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,
    srf_3=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,
    srf_4=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,
    srf_set=srf_23)  # -> out, isocurve_visualisation, blend_crvs_vis, crv_vis, new_surfaces, visualize_uv_switched_crvs; inputs srf_1: Surface, srf_2: Surface, srf_3: Surface, srf_4: Surface, srf_set: list of Surface; same code as surface_keystoning
move = Move(Geometry=planesrf, Motion=X)  # -> Geometry, Transform
v_div = Slider(6, range=0..100)
surface_keystoning_5 = PythonScript(
    srf_1=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,
    srf_2=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,
    srf_3=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,
    srf_4=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,
    srf_set=srf_24)  # -> out, isocurve_visualisation, blend_crvs_vis, crv_vis, new_surfaces, visualize_uv_switched_crvs; inputs srf_1: Surface, srf_2: Surface, srf_3: Surface, srf_4: Surface, srf_set: list of Surface; same code as surface_keystoning
u_div = Slider(5, range=0..100)
srf_25 = Surface(srf_10)
v_div_2 = Slider(8, range=0..100)
u_div_2 = Slider(8, range=0..100)
surface_keystoning_6 = PythonScript(
    srf_1=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,
    srf_2=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,
    srf_3=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,
    srf_4=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,
    srf_set=srf_25)  # -> out, isocurve_visualisation, blend_crvs_vis, crv_vis, new_surfaces, visualize_uv_switched_crvs; inputs srf_1: Surface, srf_2: Surface, srf_3: Surface, srf_4: Surface, srf_set: list of Surface; same code as surface_keystoning
v_div_3 = Slider(8, range=0..100)
u_div_3 = Slider(8, range=0..100)
surface_keystoning_7 = PythonScript(
    srf_1=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,
    srf_2=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,
    srf_3=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,
    srf_4=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,
    srf_set=srf_20)  # -> out, isocurve_visualisation, blend_crvs_vis, crv_vis, new_surfaces, visualize_uv_switched_crvs; inputs srf_1: Surface, srf_2: Surface, srf_3: Surface, srf_4: Surface, srf_set: list of Surface; same code as surface_keystoning
v_div_4 = Slider(8, range=0..100)
u_div_4 = Slider(8, range=0..100)
move_2 = Move(Geometry=move.Geometry, Motion=Y)  # -> flatten(Geometry), Transform
srf_26 = Surface(surface_keystoning_3.new_surfaces)
srf_27 = Surface(surface_keystoning_4.new_surfaces)
srf_28 = Surface(move_2.Geometry)
number_slider_2 = Slider(20, range=0..100)
number_slider_3 = Slider(7, range=0..20)
srf_29 = Surface(surface_keystoning_5.new_surfaces)
v_div_5 = Slider(6, range=0..100)
u_div_5 = Slider(5, range=0..100)
number_slider_4 = Slider(20, range=0..100)
number_slider_5 = Slider(7, range=0..20)
srf_30 = Surface(surface_keystoning_6.new_surfaces)
number_slider_6 = Slider(20, range=0..100)
number_slider_7 = Slider(7, range=0..20)
number_slider_8 = Slider(20, range=0..100)
number_slider_9 = Slider(7, range=0..20)
srf_31 = Surface(surface_keystoning_7.new_surfaces)
srf_32 = Surface(srf_26)

# ---- group: in reality, must be done manually
python = GhPythonScript(surfaces=srf_28)  # -> out, organized_surfaces; inputs surfaces: list of Surface
# ---------- python: Python ----------
__author__ = "ytakzk"
__version__ = "2019.02.20"

import Rhino.Geometry as rg

organized_surfaces = []

for i, s in enumerate(surfaces):
    
    x = i % 5
    y = int(i / 5)
    
    domain = rg.Interval(0, 1)
    
    if (x + y) % 2 == 1:
        s = s.Reverse(1)
        s.SetDomain(1, domain)
        s = s.Reverse(0)
        s.SetDomain(0, domain)
        
    organized_surfaces.append(s)
# ---------- end python ----------

# ----
number_slider_10 = Slider(20, range=0..100)
number_slider_11 = Slider(7, range=0..20)
panel_2 = Panel(surface_keystoning_7.out)
srf_33 = Surface(srf_27)
srf_34 = Surface(srf_29)
srf_35 = Surface(srf_30)
surface_trimming = PythonScript(srf=surface_keystoning.keystone_srfs, value=number_slider_2, v_div=number_slider_3)  # -> out, isocurves, temp_surface, hole_visualisation; inputs srf: Surface, value: Int32, v_div: Int32
# ---------- surface_trimming: Python ----------
# snippet of code to make this python component look for it's code in the parent folder of the .gh file

import os

ghComp = ghenv.Component
ghDoc = ghComp.OnPingDocument()

file_name = "surface_offset.py"
gh_file_location = ghDoc.FilePath
parent = os.path.dirname(os.path.realpath(gh_file_location))

file_path = os.path.join(parent, file_name)
# print file_path

single_parent = os.path.dirname(os.path.realpath(parent))
double_parent = os.path.dirname(os.path.realpath(single_parent))
# print parent

# hacky-hacky run-fun
execfile(file_path)
# ---------- end surface_trimming ----------
srf_36 = Surface(srf_31)
surface_trimming_2 = PythonScript(srf=srf_32, value=number_slider_2, v_div=number_slider_3)  # -> out, isocurves, temp_surface, hole_visualisation; inputs srf: Surface, value: Int32, v_div: Int32; same code as surface_trimming
surface_trimming_3 = PythonScript(srf=srf_23, value=number_slider_4, v_div=number_slider_5)  # -> out, isocurves, temp_surface, hole_visualisation; inputs srf: Surface, value: Int32, v_div: Int32; same code as surface_trimming
surface_trimming_4 = PythonScript(srf=srf_33, value=number_slider_4, v_div=number_slider_5)  # -> out, isocurves, temp_surface, hole_visualisation; inputs srf: Surface, value: Int32, v_div: Int32; same code as surface_trimming
u_div_6 = Number(u_div_5)
v_div_6 = Number(v_div_5)
surface_trimming_5 = PythonScript(srf=srf_24, value=number_slider_6, v_div=number_slider_7)  # -> out, isocurves, temp_surface, hole_visualisation; inputs srf: Surface, value: Int32, v_div: Int32; same code as surface_trimming
surface_trimming_6 = PythonScript(srf=srf_34, value=number_slider_6, v_div=number_slider_7)  # -> out, isocurves, temp_surface, hole_visualisation; inputs srf: Surface, value: Int32, v_div: Int32; same code as surface_trimming
u_div_7 = Slider(12, range=0..100)
u_div_8 = Number(u_div)
v_div_7 = Number(v_div)
surface_trimming_7 = PythonScript(srf=srf_25, value=number_slider_8, v_div=number_slider_9)  # -> out, isocurves, temp_surface, hole_visualisation; inputs srf: Surface, value: Int32, v_div: Int32; same code as surface_trimming
surface_trimming_8 = PythonScript(srf=srf_35, value=number_slider_8, v_div=number_slider_9)  # -> out, isocurves, temp_surface, hole_visualisation; inputs srf: Surface, value: Int32, v_div: Int32; same code as surface_trimming
u_div_9 = Number(u_div_5)
v_div_8 = Number(v_div_5)
u_div_10 = Slider(2, range=0..100)
surface_trimming_9 = PythonScript(srf=srf_20, value=number_slider_10, v_div=number_slider_11)  # -> out, isocurves, temp_surface, hole_visualisation; inputs srf: Surface, value: Int32, v_div: Int32; same code as surface_trimming
surface_trimming_10 = PythonScript(srf=srf_36, value=number_slider_10, v_div=number_slider_11)  # -> out, isocurves, temp_surface, hole_visualisation; inputs srf: Surface, value: Int32, v_div: Int32; same code as surface_trimming
u_div_11 = Number(u_div)
v_div_9 = Number(v_div)
uvn = UVN(srf=python.organized_surfaces)
python_2 = GhPythonScript(surfaces=python.organized_surfaces)  # -> out, label, label_pos, tmp, beams; inputs surfaces: list of Surface
# ---------- python_2: Python ----------
# snippet of code to make this python component look for it's code in the parent folder of the .gh file

import os

ghComp = ghenv.Component
ghDoc = ghComp.OnPingDocument()

file_name = "SurfaceNetwork.py"
gh_file_location = ghDoc.FilePath
parent = os.path.dirname(os.path.realpath(gh_file_location))

single_parent = os.path.dirname(os.path.realpath(parent))
double_parent = os.path.dirname(os.path.realpath(single_parent))

file_path = os.path.join(parent, file_name)
print file_path

# hacky-hacky run-fun
execfile(file_path)
# ---------- end python_2 ----------

# ---- group: old script
python_3 = GhPythonScript(surfaces=srf_28)  # -> out, tmp, pt, a; inputs surfaces: list of Surface; disabled
# ---------- python_3: Python ----------
__author__ = "ytakzk"
__version__ = "2019.02.18"

import rhinoscriptsyntax as rs
import Rhino.Geometry as rg
import copy

class Division(object):
    
    def __init__(self):
        
        self.is_overwritten_with = None
        self.id = id(self)
        self.num = 4

a = []
class Network(object):
    
    @staticmethod
    def get_relation(s1, s2):
        
        domain = rg.Interval(0, 1)
        s1.SetDomain(0, domain)
        s1.SetDomain(1, domain)
        s2.SetDomain(0, domain)
        s2.SetDomain(1, domain)
        
        p1_1 = s1.IsoCurve(0, 0).PointAt(0.5)
        p1_2 = s1.IsoCurve(0, 1).PointAt(0.5)
        p1_3 = s1.IsoCurve(1, 0).PointAt(0.5)
        p1_4 = s1.IsoCurve(1, 1).PointAt(0.5)

        p2_1 = s2.IsoCurve(0, 0).PointAt(0.5)
        p2_2 = s2.IsoCurve(0, 1).PointAt(0.5)
        p2_3 = s2.IsoCurve(1, 0).PointAt(0.5)
        p2_4 = s2.IsoCurve(1, 1).PointAt(0.5)
        
        DIST = 50
       
        if p1_1.DistanceTo(p2_1) < DIST or \
           p1_1.DistanceTo(p2_2) < DIST or \
           p1_2.DistanceTo(p2_1) < DIST or \
           p1_2.DistanceTo(p2_2) < DIST:
            
            # u & u =
            return 'u', 'u'

        if p1_3.DistanceTo(p2_3) < DIST or \
           p1_3.DistanceTo(p2_4) < DIST or \
           p1_4.DistanceTo(p2_3) < DIST or \
           p1_4.DistanceTo(p2_4) < DIST:
            
            # v & v ||
            return 'v', 'v'

        if p1_1.DistanceTo(p2_3) < DIST or \
           p1_2.DistanceTo(p2_4) < DIST or \
           p1_1.DistanceTo(p2_3) < DIST or \
           p1_2.DistanceTo(p2_4) < DIST:
            
            # u & v -|
            return 'u', 'v'

        if p1_3.DistanceTo(p2_1) < DIST or \
           p1_4.DistanceTo(p2_2) < DIST or \
           p1_3.DistanceTo(p2_1) < DIST or \
           p1_4.DistanceTo(p2_2) < DIST:
            
            # v & u |-
            return 'v', 'u'
            
        return None
        
    def __init__(self, surfaces):
        
        self.surfaces = [Surface(s) for s in surfaces]
        
        for _ in range(5):
            
            for i, s1 in enumerate(self.surfaces):
            
                for j, s2 in enumerate(self.surfaces):
                
                    if s1 == s2:
                        continue
                
                    rel = Network.get_relation(s1.surface, s2.surface)
                    if rel:
                    
                        v1 = rel[0]
                        v2 = rel[1]
                    
                        if v1 == 'u' and v2 == 'u':
                            
                            s2.u_div = s1.u_div
                            s1.u_neighbors.append(s2)
                            
                        elif v1 == 'u' and v2 == 'v':
                            
                            s2.u_div = s1.v_div
                            s1.u_neighbors.append(s2)
                            
                        elif v1 == 'v' and v2 == 'u':
                            
                            s2.v_div = s1.u_div
                            s1.v_neighbors.append(s2)
                            
                        elif v1 == 'v' and v2 == 'v':
                            
                            s2.v_div = s1.v_div
                            s1.v_neighbors.append(s2)
    
    def orient_direction(self):
        
        for s in self.surfaces:
            
            # TODO: u-v case
            
            flip_u = False
            for u in s.u_neighbors:
                
                if u.flip_u == True:
                    flip_u = False
                    break
                elif u.flip_u == False:
                    flip_u = True
                    break
                    
            flip_v = False
            for v in s.v_neighbors:
                
                if v.flip_v == True:
                    flip_v = False
                    break
                elif v.flip_v == False:
                    flip_v = True
                    break
                    
            if len(s.u_neighbors) == 1:
                s.flip_u = False
            else:
                s.flip_u = flip_u
                
            if len(s.v_neighbors) == 1:
                s.flip_v = False
            else:
                s.flip_v = flip_v
            
        for s in self.surfaces:
            
            if s.flip_u:
                
                s.surface = s.surface.Reverse(0)
            
            if s.flip_v:
                s.surface = s.surface.Reverse(1)

            domain = rg.Interval(0, 1)
            s.surface.SetDomain(0, domain)
            s.surface.SetDomain(1, domain)

    
class Surface(object):
    
    def __init__(self, surface):
        
        self.surface = surface 
        self.u_div = Division()
        self.v_div = Division()
        self.u_neighbors = []
        self.v_neighbors = []
        self.flip_u = None
        self.flip_v = None
    
    def divide(self):
        
        surface = self.surface #self.__offset_sides_surface(50)
        
        global a
        a.append(surface)
        for u in range(self.u_div.num + 1):
            
            for v in range(self.v_div.num):
                
                if (u % 2 == 0 and v % 2 == 1) or (u % 2 == 1 and v % 2 == 0):
                    continue
                
                # TODO
                if u == 0:
                    uu = 0.1
                elif u == self.u_div.num:
                    uu = u - 0.1 
                else:
                    uu = u
                
                p1 = surface.PointAt(uu/self.u_div.num, v/self.v_div.num)
                p2 = surface.PointAt(uu/self.u_div.num, (v+1)/self.v_div.num)
                
                line = rg.Line(p1, p2)
                a.append(line)
                
    def __offset_sides_surface(self, offset_dis=20):
        """ method that returns a slightly shrunk version of the surface along the v direction
            :param offset_dis:       Offset Distance (default 20)
            :return temp_srf:   The trimmed surface
        """
        sampling_count = 25
    
        temp_surface = copy.deepcopy(self.surface)
    
        temp_surface.SetDomain(1, rg.Interval(0, sampling_count - 1))
        temp_isocurves = [temp_surface.IsoCurve(0, v_val) for v_val in range(sampling_count)]
    
        temp_isocurves_shortened = []
    
        for isocurve in temp_isocurves:
            # getting the length and the domain of every isocurve
            length = isocurve.GetLength()
            start_t, end_t = isocurve.Domain[0], isocurve.Domain[1]
            t_delta = end_t - start_t
            t_differential = t_delta / length
            # calculating how much the offset_dis result in t_val change
            t_shift = t_differential * offset_dis
            start_t_new = start_t + t_shift
            end_t_new = end_t - t_shift
            # splitting the curve at those two new start & end points with and taking the middle piece
            new_isocurve = isocurve.Split([start_t_new, end_t_new])[1]
            temp_isocurves_shortened.append(new_isocurve)
    
        # switching the uv direction back to where it should be! -> rebuilding the surface
        point_list = [[] for i in range(sampling_count)]
        for temp_curve in temp_isocurves_shortened:
            length = temp_curve.GetLength()
            start_t, end_t = temp_curve.Domain[0], temp_curve.Domain[1]
            t_delta = end_t - start_t
            t_differential = t_delta / (sampling_count - 1)
            # calculating how much the offset_dis result in t_val change
            point_set = [temp_curve.PointAt(t_val * t_differential + start_t) for t_val in range(0, sampling_count, 1)]
            for i, point in enumerate(point_set):
                point_list[i].append(rg.Point3d(point))
    
        uv_switched_curves = []
        for point_set in point_list:
            local_isocurve = rg.NurbsCurve.Create(False, 3, point_set)
            uv_switched_curves.append(local_isocurve)
    
        # lofting those isocurves
        loft_type = rg.LoftType.Tight
        s = rg.Brep.CreateFromLoftRebuild(uv_switched_curves, rg.Point3d.Unset, rg.Point3d.Unset, loft_type, False, 50)[0]
        # getting the loft as a nurbssurface out of the resulting brep
        print s.Faces.Item[0].ToNurbsSurface()
    
        domain = rg.Interval(0, 1)
        s.SetDomain(0, domain)
        s.SetDomain(1, domain)

        return s

import random
# debug
#random.shuffle(surfaces)

network = Network(surfaces)
network.orient_direction()

tmp = []
pt = []
unique_divisions = [] 
for s in network.surfaces:
    
    unique_divisions.extend([s.u_div, s.v_div])

    string = 'u%d\nv:%d' % (s.u_div.id, s.v_div.id)
    tmp.append(string)
    pt.append(s.surface.PointAt(0.5, 0.5))
    
    
unique_divisions = list(set(unique_divisions))
for d in unique_divisions:
    
    d.num = 5


for s in network.surfaces:
    
    s.divide()
# ---------- end python_3 ----------

# ----
u_div_12 = Number(u_div)
v_div_10 = Number(v_div)
panel_3 = Panel(surface_trimming.out)
int = Integer(0)
int_2 = Integer(1)
int_3 = Integer(1)
int_4 = Integer(0)
python_4 = PythonScript(surface=surface_trimming.temp_surface, u_div=u_div_7, v_div=v_div_6, start_position=int, add_extra_beam=Toggle(False))  # -> out, hole_visualisation, beam_visualisation; inputs surface: Surface, u_div: Int32, v_div: Int32
# ---------- python_4: Python ----------
# snippet of code to make this python component look for it's code in the parent folder of the .gh file

import os

ghComp = ghenv.Component
ghDoc = ghComp.OnPingDocument()

file_name = "simple_surface_divider.py"
gh_file_location = ghDoc.FilePath
parent = os.path.dirname(os.path.realpath(gh_file_location))

file_path = os.path.join(parent, file_name)
# print file_path

single_parent = os.path.dirname(os.path.realpath(parent))
double_parent = os.path.dirname(os.path.realpath(single_parent))
# print parent

# hacky-hacky run-fun
execfile(file_path)
# ---------- end python_4 ----------
python_5 = PythonScript(surface=surface_trimming_2.temp_surface, u_div=u_div_6, v_div=v_div_6, start_position=int, add_extra_beam=Toggle(False))  # -> out, beam_visualisation; inputs surface: Surface, u_div: Int32, v_div: Int32; same code as python_4
int_5 = Integer(0)
python_6 = PythonScript(surface=surface_trimming_3.temp_surface, u_div=u_div_10, v_div=v_div_7, start_position=int_3)  # -> out, beam_visualisation; inputs surface: Surface, u_div: Int32, v_div: Int32; same code as python_4
python_7 = PythonScript(surface=surface_trimming_4.temp_surface, u_div=u_div_8, v_div=v_div_7, start_position=int_3)  # -> out, beam_visualisation; inputs surface: Surface, u_div: Int32, v_div: Int32; same code as python_4
python_8 = PythonScript(
    surface=surface_trimming_5.temp_surface,
    u_div=[u_div_9, u_div_7],
    v_div=v_div_8,
    start_position=int_2,
    add_extra_beam=Toggle(False))  # -> out, beam_visualisation; inputs surface: Surface, u_div: Int32, v_div: Int32; same code as python_4
python_9 = PythonScript(
    surface=surface_trimming_6.temp_surface,
    u_div=u_div_9,
    v_div=v_div_8,
    start_position=int_2,
    add_extra_beam=Toggle(False))  # -> out, beam_visualisation; inputs surface: Surface, u_div: Int32, v_div: Int32; same code as python_4
python_10 = PythonScript(surface=surface_trimming_7.temp_surface, u_div=[u_div_11, u_div_10], v_div=v_div_9, start_position=int_4)  # -> out, beam_visualisation; inputs surface: Surface, u_div: Int32, v_div: Int32; same code as python_4
python_11 = PythonScript(surface=surface_trimming_8.temp_surface, u_div=u_div_11, v_div=v_div_9, start_position=int_4)  # -> out, beam_visualisation; inputs surface: Surface, u_div: Int32, v_div: Int32; same code as python_4

# ---- group: beams on the edges
geo = Geometry(python_2.tmp)

# ---- group: all beams
geo_2 = Geometry(python_2.beams)

# ----
tag = TextTag(Location=python_2.label_pos, Text=python_2.label)
python_12 = PythonScript(surface=surface_trimming_9.temp_surface, u_div=[u_div_12, u_div_10], v_div=v_div_10, start_position=int_5)  # -> out, beam_visualisation; inputs surface: Surface, u_div: Int32, v_div: Int32; same code as python_4
python_13 = PythonScript(surface=surface_trimming_10.temp_surface, u_div=u_div_12, v_div=v_div_10, start_position=int_5)  # -> out, beam_visualisation; inputs surface: Surface, u_div: Int32, v_div: Int32; same code as python_4
pt_2 = Point(python_4.hole_visualisation)
pt_3 = Point([<point referenced from the Rhino model> x4])
brep = Brep(python_4.beam_visualisation)
brep_2 = Brep(python_5.beam_visualisation)
brep_3 = Brep(python_6.beam_visualisation)
brep_4 = Brep(python_7.beam_visualisation)
brep_5 = Brep(python_8.beam_visualisation)
brep_6 = Brep(python_9.beam_visualisation)
python_14 = PythonScript(x=pt_3)  # -> out, a; inputs x: list of Point3d
# ---------- python_14: Python ----------
import os
print os.name
# ---------- end python_14 ----------
panel_4 = Panel(python_4.out)
merge_5 = Merge(Data1=brep, Data2=brep_2)
brep_7 = Brep(python_10.beam_visualisation)
brep_8 = Brep(python_11.beam_visualisation)
merge_6 = Merge(Data1=brep_3, Data2=brep_4)
merge_7 = Merge(Data1=brep_5, Data2=brep_6)
brep_9 = Brep(python_12.beam_visualisation)
brep_10 = Brep(python_13.beam_visualisation)
merge_8 = Merge(Data1=brep_7, Data2=brep_8)
panel_5 = Panel(python_14.out)
merge_9 = Merge(Data1=brep_9, Data2=brep_10)
brep_11 = Brep(merge_5)
brep_12 = Brep(merge_7)
brep_13 = Brep(merge_6)
brep_14 = Brep(merge_8)
brep_15 = Brep(merge_9)
preview_2 = CustomPreview(Geometry=brep_11, Shader=ColourSwatch(SwatchColor=RGB(255, 255, 255)))

# ==== cluster UVN
srf = ClusterInput()
number_slider = Slider(3, range=0..110)
extract_uv_vec = GhPythonScript(srf=srf)  # -> out, center_pt, u_vec, v_vec, normal; inputs srf: Surface
# ---------- extract_uv_vec: Python ----------
__author__ = "Wenqian"
__version__ = "2019.01.22"

import rhinoscriptsyntax as rs
import Rhino.Geometry as rg

srf.SetDomain(0,rg.Interval(0,1))
srf.SetDomain(1,rg.Interval(0,1))

center_pt = srf.PointAt(0.5,0.5)

u_vec = srf.FrameAt(0.5,0.5)[1].XAxis
v_vec = srf.FrameAt(0.5,0.5)[1].YAxis

normal =srf.NormalAt(0.5,0.5)
# ---------- end extract_uv_vec ----------
number_slider_2 = Slider(200, range=0..300)
vdisex = VectorDisplayEx(Point=extract_uv_vec.center_pt, Vector=<missing>, Colour=ColourSwatch(SwatchColor=RGB(255, 0, 0)), Width=number_slider)
vdisex_2 = VectorDisplayEx(Point=extract_uv_vec.center_pt, Vector=<missing>, Colour=ColourSwatch(SwatchColor=RGB(33, 220, 0)), Width=number_slider)
vdisex_3 = VectorDisplayEx(
    Point=extract_uv_vec.center_pt,
    Vector=<missing>,
    Colour=ColourSwatch(SwatchColor=RGB(255, 255, 255)),
    Width=number_slider)
