# Grasshopper definition 190109_UR_Dowels.gh (Grasshopper 1.0.7)

vector_xyz = VectorXYZ(XComponent=0, YComponent=0, ZComponent=1)  # -> Vector, Length
point = Point(<point referenced from the Rhino model>)
plane_normal = PlaneNormal(Origin=point, ZAxis=vector_xyz.Vector)
pt = Point(Point(0, 0, 0))
pt_2 = Point(Point(0, 0, 0))
bulletclass = GhPythonScript()
# ---------- bulletclass: Python ----------
import Rhino.Geometry as rg
import scriptcontext as sc
import math as m

class Bullet(object):
    """
    simple bullet of clay
    """
    def __init__(self, origin_plane, bullet_radius, bullet_height, origin_bullet_height):
        """
        Args:
        origin_plane(Plane)
        radius(float)
        height(float)
        """
        self.o_plane = origin_plane
        
        
        self.radius = bullet_radius
        self.height = bullet_height
        self.ob_height = origin_bullet_height
        
        self.o_plane.Translate(self.o_plane.ZAxis*self.ob_height)
        self.volume = m.pi*self.radius**2*self.height
        self.cyl = self.generate_geo()
        
    def generate_geo(self):
        
        cyl = rg.Cylinder(rg.Circle(self.o_plane, self.radius), -self.height)
        return cyl
        
#bullet = Bullet(rg.Plane.WorldXY, 1, 1)
#bullet_geo = bullet.cyl

sc.sticky["BulletClass"] = Bullet
# ---------- end bulletclass ----------
python = PythonScript(x_count=Slider(10, range=2..50), z_count=Slider(20, range=2..50), base_layer_count=Slider(2, range=1..50))  # -> out, useful_list, total_list, pipe_list, curve_list, plane_list; inputs x_count: Int32, z_count: Int32, base_layer_count: Int32
# ---------- python: Python ----------
import math
import Rhino.Geometry as rg

## python set variables
# controlling the pd function
x_delta = 10.0
z_delta = 12.0
pd_min = .1
pd_max = .65
pd_range = pd_max - pd_min

# grid spacing for functions
z_space = 1.0
x_space = 1.0

global x_delta, z_delta, pd_min, pd_max, pd_range

# x_count = 6
# z_count = 21

# pigeon parameters

pigeon_height = 15.0
pigeon_width = 18.0
pd_default = .5
default_spacing = 20.0
perp_vec = rg.Vector3d(0,0,1)

## grasshopper informed

x_count = x_count
z_count = z_count

base_layer_count = base_layer_count

## pre-calculations

tau = math.pi * 2
start_x_count = x_count + (z_count - 1 - z_count % 2)
total_list = []
useful_list = []
pipe_list = []
previous_list = []
new_list= []
plane_list = []
curve_list = []


def pdFunction(x_val_unitized, z_val_unitized):
    angle_x = x_val_unitized % x_delta * tau / x_delta
    angle_z = z_val_unitized % z_delta * tau / z_delta
    angle = angle_x + angle_z
    local_pd_unit = (math.sin(angle) + 1.0)/2 # from 0 to 1
    local_pd = local_pd_unit * pd_range
    local_pd += pd_min
    return local_pd

def piping(plane, height):
    radius = pigeon_width / 2.0
    circle = rg.Circle(plane, radius)
    pipe = rg.Cylinder(circle, -height)
    return pipe

for j in range(z_count):
    # previous_list cleaning
    previous_list = new_list
    for point in previous_list:
        print point.Z,
    print "/n"
    new_list = []

    # piramid scheme and filtering
    local_x_count_len = start_x_count - j
    start_useful = (local_x_count_len + (j + 1) % 2 - x_count) / 2
    end_useful = start_useful + x_count - (j + 1) % 2 - 1

    z_val_unitized = j * z_space

    if (j < base_layer_count):
        z_val = pigeon_height * pd_default * j
        z_val_top = pigeon_height * pd_default
        for i in range(local_x_count_len):
            x_val_unitized = (- float(local_x_count_len) / 2 + i)
            x_val = x_val_unitized * default_spacing
            x_val_unitized *= x_space
            base_point = rg.Point3d(x_val, 0, z_val)
            top_point = rg.Point3d(x_val, 0, z_val + z_val_top)
            new_list.append(top_point)
            total_list.append(base_point)
            if (i >= start_useful) and (i <= end_useful):
                useful_list.append(base_point)
                top_plane = rg.Plane(top_point, perp_vec)
                plane_list.append(top_plane)
                pipe_list.append(piping(top_plane, z_val_top))
    else:
        for i in range(local_x_count_len):
            # setting the x_value fot the function
            x_val_unitized = (- float(local_x_count_len) / 2 + i) * x_space
            # calculating the midpoints of the previous top_points
            x_val = (previous_list[i].X + previous_list[i+1].X) / 2
            y_val = (previous_list[i].Y + previous_list[i+1].Y) / 2
            z_val = (previous_list[i].Z + previous_list[i+1].Z) / 2
            pd = pdFunction(x_val_unitized, z_val_unitized)
            print "point" , i, j, ": " , pd, " - ",
            z_val_top_distance = pigeon_height * pd
            print z_val_top_distance
            base_point = rg.Point3d(x_val, y_val, z_val)
            top_point = rg.Point3d(x_val, y_val, z_val + z_val_top_distance)
            new_list.append(top_point)
            total_list.append(base_point)
            if (i >= start_useful) and (i <= end_useful):
                useful_list.append(base_point)
                top_plane = rg.Plane(top_point, perp_vec)
                plane_list.append(top_plane)
                pipe_list.append(piping(top_plane, z_val_top_distance))
    curve = rg.PolylineCurve(new_list)
    curve_list.append(curve)
# ---------- end python ----------
simplegradient = PythonScript(
    start_point=pt,
    x_spacing=Slider(20, range=0..40),
    x_count=Slider(8, range=2..30),
    z_count=Slider(26, range=2..40),
    rel_change_min=Slider(0.05, range=-1..0.65),
    rel_change_max=Slider(0.5, range=-1..0.65),
    baseline_count=Slider(2, range=2..30),
    gradient=Slider(0.1, range=-1..0.65))  # -> out, plane_list, pipe_list, pipes; inputs start_point: Point3d, x_count: Int32, z_count: Int32, z_delta: Int32, x_delta: Int32, baseline_count: Int32, invert: Boolean
# ---------- simplegradient: Python ----------
import math
import Rhino.Geometry as rg

pigeon_height = 15.0
pigeon_width = 18.0

# define in gh

x0 = start_point.X
y0 = start_point.Y
z0 = start_point.Z

base_layer_count = baseline_count
min_pres = rel_change_min
max_pres = rel_change_max

base_gradient = gradient

# defined in python

# x0 = 0
# y0 = 0
# z0 = 0
#
# x_count = 5
# z_count = 20
# base_layer_count = 2
#
# x_spacing = 20.0
#
# min_pres = -.1
# max_pres = .65
#
# base_gradient = .1

# local variables
pres_count = 0
prev_z_value = 0

plane_list = []
pipe_list = []
perp_vec = rg.Vector3d(0,0,1)

def piping(plane, height):
    radius = pigeon_width / 2.0
    circle = rg.Circle(plane, radius)
    pipe = rg.Cylinder(circle, -height)
    return pipe

gradient = -.8 * base_gradient

grading = x_count * x_spacing

for j in range(z_count):
    if (j < base_layer_count):
        pres_count = .5
    else: 
        if (pres_count <= min_pres):
            gradient = 1.2 * base_gradient
        elif (pres_count >= max_pres):
            gradient = -.8 * base_gradient
        pres_count += gradient
    local_z_value = pres_count * pigeon_height
    for i in range(x_count - j%2):
        pre_x = (float(j%2)/2.0 + i + .5) * x_spacing
        pre_x /= grading / 2
        pre_x -= 1
        if pre_x == 0:
            sign = 1
        else:
            sign = pre_x/abs(pre_x)
        x = (abs(pre_x))**1.2 * sign * grading * .45
#        x = math.sin(pre_x) * grading * .4
#        x = (float(j%2)/2.0 + i) * x_spacing
        z = prev_z_value + local_z_value
        local_point = rg.Point3d(x0 + x, y0 + 0, z0 + z)
        local_plane = rg.Plane(local_point, perp_vec)
        plane_list.append(local_plane)
        pipe_list.append(piping(local_plane, local_z_value))
    prev_z_value += local_z_value
# ---------- end simplegradient ----------
simplegradient_2 = PythonScript(
    start_point=pt_2,
    x_spacing=Slider(20, range=0..40),
    x_count=Slider(8, range=2..30),
    z_count=Slider(26, range=2..40),
    rel_change_min=Slider(0.2, range=-1..0.65),
    rel_change_max=Slider(0.5, range=-1..0.65),
    baseline_count=Slider(2, range=2..30),
    gradient=Slider(0.1, range=-1..0.65),
    exp=Slider(1.5, range=1..2),
    second_gradient=Slider(0.35, range=0.1..2))  # -> out, plane_list, pipe_list, pipes; inputs start_point: Point3d, x_count: Int32, z_count: Int32, z_delta: Int32, x_delta: Int32, baseline_count: Int32, invert: Boolean
# ---------- simplegradient_2: Python ----------
import math
import Rhino.Geometry as rg

pigeon_height = 15.0
pigeon_width = 18.0

# define in gh

x0 = start_point.X
y0 = start_point.Y
z0 = start_point.Z

base_layer_count = baseline_count
min_pres = rel_change_min
max_pres = rel_change_max

base_gradient = gradient

# defined in python

# x0 = 0
# y0 = 0
# z0 = 0
#
# x_count = 5
# z_count = 20
# base_layer_count = 2
#
# x_spacing = 20.0
#
# min_pres = -.1
# max_pres = .65
#
# base_gradient = .1

# local variables
pres_count = 0
prev_z_value = 0

plane_list = []
pipe_list = []
perp_vec = rg.Vector3d(0,0,1)

def piping(plane, height):
    radius = pigeon_width / 2.0
    circle = rg.Circle(plane, radius)
    pipe = rg.Cylinder(circle, -height)
    return pipe

gradient = -.8 * base_gradient

grading = x_count * x_spacing

for j in range(z_count):
    if (j < base_layer_count):
        pres_count = .5
    else: 
        if (pres_count <= min_pres):
            gradient = 1.2 * base_gradient
        elif (pres_count >= max_pres):
            gradient = -.8 * base_gradient
        pres_count += gradient
    local_z_value = pres_count * pigeon_height
    for i in range(x_count - j%2):
        pre_x = (float(j%2)/2.0 + i + .5) * x_spacing
        pre_x /= grading / 2
        pre_x -= 1
        if pre_x == 0:
            sign = 1
        else:
            sign = pre_x/abs(pre_x)
        x = (abs(pre_x))**exp * sign * grading * second_gradient
        y = (abs(pre_x))**.25 * grading * .1 * pres_count
#        x = math.sin(pre_x) * grading * .4
#        x = (float(j%2)/2.0 + i) * x_spacing
        z = prev_z_value + local_z_value
        local_point = rg.Point3d(x0 + x, y0 + y, z0 + z)
        local_plane = rg.Plane(local_point, perp_vec)
        plane_list.append(local_plane)
        pipe_list.append(piping(local_plane, local_z_value))
    prev_z_value += local_z_value
# ---------- end simplegradient_2 ----------
pt_3 = Point(python.useful_list)
pt_4 = Point(python.total_list)
brep = Brep(python.pipe_list)
pt_5 = ConstructPoint(
    XCoordinate=Slider(-380, range=-500..1000),
    YCoordinate=Slider(15, range=-500..1000),
    ZCoordinate=Slider(50, range=-50..50))
picking_vertical = GhPythonScript(
    base_point=pt_5,
    bullet_radius=Slider(9, range=0..20),
    buffer=Slider(1.5, range=0..5),
    x_no=Slider(22, range=0..22),
    y_no=Slider(17, range=0..25))  # -> out, picking_planes, visualize; inputs base_point: Point3d, bullet_radius: Int32, x_no: Int32, y_no: Int32
# ---------- picking_vertical: Python ----------
__author__ = "jennyd"
__version__ = "2018.11.01"

import Rhino.Geometry as rg
import math

picking_planes = []
#buffer = 1.0

#counter = 0 

hor_spacing = bullet_radius * 2.0 + buffer
ver_spacing = hor_spacing * math.sqrt(3) / 2.0

x0, y0, z0 = base_point.X, base_point.Y,base_point.Z
normal = rg.Vector3d(0,0,1)

for i in range(y_no):
    for j in range(x_no):
        if (i % 2 == 0):
            o_point = rg.Point3d(j * hor_spacing + x0, i * ver_spacing + y0, z0)
            plane = rg.Plane(o_point, normal)
            picking_planes.append(plane)
        else:
            o_point = rg.Point3d((j + .5) * hor_spacing + x0, i * ver_spacing + y0, z0)
            plane = rg.Plane(o_point, normal)
            picking_planes.append(plane)
#        counter +=1
#        if counter == (len(picking_planes) -1):
#            counter = 0

# visualisation of the picking planes
# circles
visualize = [rg.Circle(plane, bullet_radius) for plane in picking_planes]
o_plane = rg.Plane(base_point, normal)
bbr = buffer + bullet_radius
x1, y1, z1 = x0 - bbr, y0 - bbr, z0
x2, y2, z2 = x0 + hor_spacing * (x_no - .5)  + bbr, y0 + (y_no - 1) * ver_spacing + bbr, z0
pt1, pt2 = rg.Point3d(x1, y1, z1), rg.Point3d(x2, y2, z2)
rectangle = rg.Rectangle3d(o_plane, pt1, pt2)
visualize.append(rectangle)

# numeric parameters

print "Dimensions: ", round(x2 - x1), " x ", round(y2 - y1), "Total Bullets: ", x_no * y_no
# ---------- end picking_vertical ----------
panel = Panel(picking_vertical.out)
y_coordinate = Slider(200, range=0..1000)
z_coordinate = Slider(50, range=-500..1000)
x_coordinate = Slider(600, range=-500..1000)
crv = Curve(picking_vertical.visualize)
list_item = ListItem(List=picking_vertical.picking_planes, Index=0, Wrap=True)
list_item_2 = ListItem(List=picking_vertical.picking_planes, Index=-1, Wrap=True)
pt_6 = ConstructPoint(XCoordinate=x_coordinate, YCoordinate=y_coordinate, ZCoordinate=z_coordinate)
merge = Merge(Data1=list_item, Data2=list_item_2)
xy = XYPlane(Origin=Point(0, 0, 0))
xy_2 = XYPlane(Origin=Point(0, 0, 0))
python_2 = PythonScript(
    base_point=pt_6,
    x_count=Slider(5, range=2..50),
    z_count=Slider(2, range=2..200),
    base_layer_count=Slider(1, range=1..50),
    perp_bool=Toggle(True),
    xdelta=Slider(7, range=1..15),
    zdelta=Slider(15, range=1..40))  # -> out, useful_list, total_list, pipe_list, curve_list, a; inputs base_point: Point3d, x_count: Int32, z_count: Int32, base_layer_count: Int32, perp_bool: Boolean
# ---------- python_2: Python ----------
import math
import Rhino.Geometry as rg

## python set variables
# controlling the pd function
#x_delta = 10.0
#z_delta = 10.0

pd_min = .1
pd_max = .55
pd_range = pd_max - pd_min

# grid spacing for functions
z_space = .5

x_space = 1.0

global x_delta, z_delta, pd_min, pd_max, pd_range

# x_count = 6
# z_count = 21

# pigeon parameters

pigeon_height = 15.0
pigeon_width = 18.0
pd_default = .5
default_spacing = 20.0

## grasshopper informed

x0, y0, z0 = base_point.X, base_point.Y, base_point.Z

x_count = x_count
z_count = z_count

x_delta = xdelta
z_delta = zdelta

base_layer_count = base_layer_count

perp_bool = perp_bool

## pre-calculations

tau = math.pi * 2
start_x_count = x_count + (z_count - 1 - z_count % 2)
total_list = []
useful_list = []
pipe_list = []
previous_list = []
new_list= []
plane_list = []
curve_list = []

def perpVector(point0, point1):
    p0x, p0y, p0z = point0.X, point0.Y, point0.Z
    p1x, p1y, p1z = point1.X, point1.Y, point1.Z
    x_val, y_val, z_val = (p0x + p1x) / 2, (p0y + p1y) / 2, (p0z + p1z) / 2
    if (perp_bool):
        # translate to origin
        x1, y1, z1 = p0x - x_val, p0y - y_val, p0z - z_val
        # rotation around y-axis
        x2, y2, z2 = z1, y1, -x1
        perp_vec = rg.Vector3d(x2, y2, z2)
    else:
        perp_vec = rg.Vector3d(0,0,1)
    return x_val, y_val, z_val, perp_vec


def pdFunction(x_val_unitized, z_val_unitized):
    angle_x = x_val_unitized % x_delta * tau / x_delta
    angle_z = z_val_unitized % z_delta * tau / z_delta
    angle = angle_x + angle_z
    local_pd_unit = (math.sin(angle) + 1.0)/2
    local_pd = local_pd_unit * pd_range
    local_pd += pd_min
    return local_pd

def piping(plane, height):
    radius = pigeon_width / 2.0
    circle = rg.Circle(plane, radius)
    pipe = rg.Cylinder(circle, -height)
    return pipe

for j in range(z_count):
    # previous_list cleaning
    previous_list = new_list
    new_list = []

    # piramid scheme and filtering
    local_x_count_len = start_x_count - j
    start_useful = (local_x_count_len + (j + 1) % 2 - x_count) / 2
    end_useful = start_useful + x_count - (j + 1) % 2 - 1

    z_val_unitized = j * z_space

    if (j < base_layer_count):
        perp_vec = rg.Vector3d(0,0,1)
        z_val = pigeon_height * pd_default * j
        z_val_top = pigeon_height * pd_default
        for i in range(local_x_count_len):
            x_val_unitized = (- float(local_x_count_len) / 2 + i)
            x_val = x_val_unitized * default_spacing
            x_val_unitized *= x_space
            base_point = rg.Point3d(x_val + x0, y0, z_val + z0)
            top_point = rg.Point3d(x_val + x0, y0, z_val + z_val_top + z0)
            new_list.append(top_point)
            total_list.append(base_point)
            if (i >= start_useful) and (i <= end_useful):
                useful_list.append(base_point)
                top_plane = rg.Plane(top_point, perp_vec)
                plane_list.append(top_plane)
                pipe_list.append(piping(top_plane, z_val_top))
    else:
        for i in range(local_x_count_len):
            # setting the x_value fot the function
            x_val_unitized = (- float(local_x_count_len) / 2 + i) * x_space
            # calculating the midpoints of the previous top_points
            pt0 = previous_list[i]
            pt2 = previous_list[i+1]
            x_val, y_val, z_val, perp_vec = perpVector(pt0, pt2)
            pd = pdFunction(x_val_unitized, z_val_unitized)
            z_val_top_distance = pigeon_height * pd
            base_point = rg.Point3d(x_val, y_val, z_val)
            top_point = rg.Point3d(x_val, y_val, z_val + z_val_top_distance)
#            perp_vec = perp_vec / math.sqrt(perp_vec*perp_vec) * z_val_top_distance
#            top_point = base_point + perp_vec
            new_list.append(top_point)
            total_list.append(base_point)
            if (i >= start_useful) and (i <= end_useful):
                useful_list.append(base_point)
                top_plane = rg.Plane(top_point, perp_vec)
                plane_list.append(top_plane)
                pipe_list.append(piping(top_plane, z_val_top_distance))
    curve = rg.PolylineCurve(new_list)
    curve_list.append(curve)
    
a = plane_list
# ---------- end python_2 ----------
move = Move(Geometry=xy, Motion=pt_6)  # -> Geometry, Transform; disabled
Y = UnitY(Factor=Slider(141, range=0..200))
merge_2 = Merge(Data1=Slider(-10.5, range=-100..200), Data2=Slider(100, range=-100..200))  # -> graft(Result)

# ----
# 0a
# Settings
# Check your IP address and set UR IP address
server_address = ValueList({"192.168.10.12", "192.168.10.11", "192.168.10.10", "192.168.10.2", "127.0.0.1"}, selected="192.168.10.11")
ur_ip = ValueList({"192.168.10.13", "192.168.10.11", "192.168.10.10", "127.0.0.1"}, selected="192.168.10.10")
server_port = Integer(30003)
globals = PythonScript(server_address=server_address, server_port=server_port, ur_ip=ur_ip)  # inputs server_port: Int32
# ---------- globals: Python ----------
from scriptcontext import sticky as st

st["server_address"] = server_address
st["server_port"] = server_port

st["ur_ip"] = ur_ip
# ---------- end globals ----------

# ----
# Check if UR is available
ping = Button()
py = PythonScript(ip=ur_ip, ping=ping)  # -> out
# ---------- py: Python ----------
from scriptcontext import sticky as st
from ur_online_control.communication import is_available


guid = str(ghenv.Component.InstanceGuid)
txt_key = "txt_" + guid
if txt_key not in st:
    st[txt_key] = ""

if ping:
    
    available = is_available(ip)
    
    if available:
        st[txt_key] = "%s is up!" % ip
    else:
        st[txt_key] = "%s is down!" % ip

print st[txt_key]
# ---------- end py ----------
panel_2 = Panel(py)

size = Slider(3, range=0..200)
brep_2 = Brep(python_2.pipe_list)
pln = Plane(python_2.a)

pt_7 = ConstructPoint(XCoordinate=Slider(500, range=0..1000), YCoordinate=Slider(550, range=-500..1000), ZCoordinate=Slider(50, range=-50..50))
picking_horizontal = GhPythonScript(
    base_point=pt_7,
    bullet_radius=Slider(9, range=0..20),
    buffer=Slider(1.5, range=0..5),
    x_no=Slider(10, range=0..20),
    y_no=Slider(8, range=0..25))  # -> out, picking_planes, visualize; inputs base_point: Point3d, bullet_radius: Int32, x_no: Int32, y_no: Int32
# ---------- picking_horizontal: Python ----------
__author__ = "jennyd"
__version__ = "2018.11.01"

import Rhino.Geometry as rg
import math

picking_planes = []
#buffer = 1.0

#counter = 0 

ver_spacing = bullet_radius * 2.0 + buffer
hor_spacing = ver_spacing * math.sqrt(3) / 2.0

x0, y0, z0 = base_point.X, base_point.Y,base_point.Z
normal = rg.Vector3d(0,0,1)

for i in range(x_no):
    for j in range(y_no):
        if (i % 2 == 0):
            o_point = rg.Point3d(i * hor_spacing + x0, j * ver_spacing + y0, z0)
            plane = rg.Plane(o_point, normal)
            picking_planes.append(plane)
        else:
            o_point = rg.Point3d(i * hor_spacing + x0, (j + .5) * ver_spacing + y0, z0)
            plane = rg.Plane(o_point, normal)
            picking_planes.append(plane)
#        counter +=1
#        if counter == (len(picking_planes) -1):
#            counter = 0

# visualisation of the picking planes
# circles
visualize = [rg.Circle(plane, bullet_radius) for plane in picking_planes]
o_plane = rg.Plane(base_point, normal)
bbr = buffer + bullet_radius
x1, y1, z1 = x0 - bbr, y0 - bbr, z0
x2, y2, z2 = x0 + hor_spacing * (x_no - 1)  + bbr, y0 + (y_no - .5) * ver_spacing + bbr, z0
pt1, pt2 = rg.Point3d(x1, y1, z1), rg.Point3d(x2, y2, z2)
rectangle = rg.Rectangle3d(o_plane, pt1, pt2)
visualize.append(rectangle)

# numeric parameters

print "Dimensions: ", round(x2 - x1), " x ", round(y2 - y1), "Total Bullets: ", x_no * y_no
# ---------- end picking_horizontal ----------
panel_3 = Panel(picking_horizontal.out)
crv_2 = Curve(picking_horizontal.visualize)
picking_planes = Geometry(picking_horizontal.picking_planes)
ghpython_script = GhPythonScript(picking_planes=picking_planes, placing_planes=pln)  # -> out, new_picking_planes_list; inputs picking_planes: list, placing_planes: list
# ---------- ghpython_script: Python ----------
__author__ = "nikeo"
__version__ = "2018.11.06"

import rhinoscriptsyntax as rs

pick_planes_len = len(picking_planes)
new_picking_planes_list=[]
pick_count =0
for i in range(len(placing_planes)):
    pick = picking_planes[i % pick_planes_len]
    new_picking_planes_list.append(pick)
print new_picking_planes_list
# ---------- end ghpython_script ----------
split_list = SplitList(List=ghpython_script.new_picking_planes_list, Index=Slider(0, range=0..1000))  # -> ListA, ListB
picking_sequence_planes = Geometry(split_list.ListB)

list_item_3 = ListItem(List=picking_horizontal.picking_planes, Index=-1, Wrap=True)
list_item_4 = ListItem(List=picking_horizontal.picking_planes, Index=0, Wrap=True)
merge_3 = Merge(Data1=list_item_4, Data2=list_item_3)
merge_4 = Merge(Data1=picking_vertical.picking_planes, Data2=picking_horizontal.picking_planes)
X = UnitX(Factor=merge_2)
addition = Addition(A=Y, B=X)
angle = Slider(90, range=0..100)
pt_8 = Point(Point(0, 0, 0))
move_2 = Move(Geometry=xy_2, Motion=Y)  # -> Geometry, Transform
pln_2 = Plane(xy_2)
xy_3 = XYPlane(Origin=Point(0, 0, 0))
num = Number(9.892857143)
dom = Domain(DomainStart=expr("-x/2", size), DomainEnd=expr("x/2", size))

bang = Button()
panel_4 = Panel("Unload libraries")
unload = PythonScript(bang=bang)
# ---------- unload: Python ----------
from compas_ghpython import unload_modules

unload_modules("compas")
unload_modules("ur_online_control")
# ---------- end unload ----------

division = Division(A=num, B=2)
rectangle = Rectangle(Plane=pt_8, XSize=dom, YSize=dom, Radius=0)  # -> Rectangle, Length
area = Area(Geometry=rectangle.Rectangle)  # -> Area, Centroid
neg = Negative(Value=angle)
move_3 = Move(Geometry=xy_2, Motion=addition)  # -> Geometry, Transform
move_4 = Move(Geometry=xy_2, Motion=X)  # -> Geometry, Transform
addition_2 = Addition(A=division, B=1)
explode = Explode(Curve=rectangle.Rectangle, Recursive=True)  # -> Segments, flatten(Vertices)
ln = Line(StartPoint=explode.Vertices, EndPoint=area.Centroid)  # -> flatten(Line)
pl = PlaneNormal(Origin=explode.Vertices, ZAxis=ln)  # -> flatten(Plane)
num_2 = Number([5, 40, 105, 140])
expression = Expression(x=Slider(0, range=0..5), Expression="x * Pi / 2")
drill_bit_length = Slider(18.5, range=0..30)

# ---- group: Robot
# 1. load robot model
# 2. set tool
# 3. set basis
list = ValueList({"no_tool": 0, "measurement_tool": 1, "vaccuum_tool": 2, "clay_tool_simple": 3, "drill_angle": 4, "drill_vertical": 5}, selected="drill_vertical")
tools = Tools(tool_id=list, drill_bit_length=drill_bit_length)
base = PythonScript()  # -> base_frame
# ---------- base: Python ----------
from compas.geometry import Frame

"""
origin = [0, 0, 0]
xaxis = [1, 0, 0]
yaxis = [0, 1, 0]


origin = [-313.92, -147.58, 13.79]
xaxis = [0.00000, -1.00000, 0.00000]
yaxis = [1.00000, 0.00000, 0.00000]
"""

"""
origin = [155.98, -806.21, 343.76]
xaxis = [0, 0, 1]
yaxis = [1, 0, 0]
"""
"""
origin = [0, 0, 0]
xaxis = [0, -1, 0]
yaxis = [1, 0, 0]
"""


"""
origin = [0, 0, 0]
xaxis = [0, -1, 0]
yaxis = [1, 0, 0]
"""

"""
origin = [261.85, -66.21, -9.92]
xaxis = [1.00000, 0.00000, 0.00000]
yaxis = [0.00000, 1.00000, 0.00000]
"""


origin = [-180.00, -560.00, 0.00]
xaxis = [1.00000, 0.00000, 0.00000]
yaxis = [0.00000, 1.00000, 0.00000]


#origin = [149.37, 513.90, -6.89]
#xaxis = [0.00000, -1.00000, 0.00000]
#yaxis = [1.00000, 0.00000, 0.00000]




base_frame = Frame(list(origin), list(xaxis), list(yaxis))
# ---------- end base ----------
list_2 = ValueList({"UR5", "UR10"}, selected="UR5")
robot = PythonScript(model=list_2, tool=tools, base_frame=base)  # -> robot
# ---------- robot: Python ----------
from ur_online_control.ur.ur10 import UR10
from ur_online_control.ur.ur5 import UR5
from scriptcontext import sticky as st

if model == "UR5":
    robot = UR5()
elif model == "UR10":
    robot = UR10()

if tool:
    robot.set_tool(tool)
if base_frame:
    robot.set_base(base_frame)

st["robot"] = robot
# ---------- end robot ----------

# ----
merge_5 = Merge(Data1=move_3.Geometry, Data2=move_4.Geometry)
series = Series(Start=addition_2, Step=num, Count=14)  # -> graft(Series)
merge_6 = Merge(Data1=move_3.Geometry, Data2=move_2.Geometry, Data3=move_4.Geometry, Data4=pln_2)
subtraction = Subtraction(A=num_2, B=1)
geometry = Geometry(split_list.ListB)
rotax = RotateAxis(Geometry=pl, Angle=expression, Axis=ln)  # -> Geometry, Transform
xy_4 = XYPlane(Origin=Point(0, 0, 0))
pt_9 = ConstructPoint(XCoordinate=subtraction, YCoordinate=series, ZCoordinate=0)
move_5 = Move(Geometry=xy_3, Motion=pt_9)  # -> Geometry, Transform
ppx = PlanePlane(PlaneA=rotax.Geometry, PlaneB=xy_4)
rot3d = Rotate3D(Geometry=rotax.Geometry, Angle=degrees(neg), Center=explode.Vertices, Axis=ppx)  # -> Geometry, Transform
merge_7 = Merge(Data2=rot3d.Geometry)  # -> flatten(Result)
pln_3 = Plane(flatten(merge_7))
graft = GraftTree(Tree=pln_3, IncludeEmptyLists=True, IncludeNullItems=True)
item = ListItem(List=pln_3, Index=0, Wrap=True)
deplane = DeconstructPlane(Plane=graft)  # -> Origin, XAxis, YAxis, ZAxis
pdecon = Deconstruct(Point=deplane.ZAxis)  # -> XComponent, YComponent, ZComponent
multiplication = Multiplication(A=deplane.ZAxis, B=Slider(7, range=0..100))
multiplication_2 = Multiplication(A=deplane.ZAxis, B=Slider(20, range=0..100))
sqr = Square(Value=pdecon.XComponent)
sqr_2 = Square(Value=pdecon.YComponent)
sqr_3 = Square(Value=pdecon.ZComponent)
addition_3 = Addition(A=sqr, B=sqr_2, C=sqr_3)
move_6 = Move(Geometry=graft, Motion=multiplication_2)  # -> Geometry, Transform
move_7 = Move(Geometry=graft, Motion=multiplication)  # -> Geometry, Transform

py_2 = PythonScript()  # -> path
# ---------- py_2: Python ----------
import sys
import os

ghComp = ghenv.Component
ghDoc = ghComp.OnPingDocument()

# the full path of the gh file
path = ghDoc.FilePath
# the directory of the gh file
path = os.path.dirname(path)

path = os.path.abspath(os.path.join(path, ".."))

print path
# ---------- end py_2 ----------
# 1
# Executing
panel_5 = Panel("Start communication server")
start = Button()
panel_6 = Panel(py_2)
server = PythonScript(path=panel_6, start=start)
# ---------- server: Python ----------
import os
import threading
from scriptcontext import sticky as st

server_address = st["server_address"]
server_port = st["server_port"]
ur_ip = st["ur_ip"]

"""
Change main!!!!
"""
main = os.path.join(path, "communication", "main_dowel_drilling_v1.py")

if os.path.isfile(main):
        
    def myfunc():
        syscall = "python %s %s %s %s" % (main, server_address, server_port, ur_ip)
        os.system(syscall)
    
    if start:
        t = threading.Thread(target=myfunc)
        t.start()
# ---------- end server ----------

merge_8 = Merge(Data2=move_6.Geometry, Data3=move_7.Geometry, Data4=graft)  # -> flatten(Result)
pt_10 = ConstructPoint(
    XCoordinate=Slider(350, range=0..1000),
    YCoordinate=Slider(550, range=-500..1000),
    ZCoordinate=Slider(10, range=-400..300))
speed = Slider(300, range=0..300)
move_8 = Move(Geometry=merge_8, Motion=pt_10)  # -> Geometry, Transform

# ---- group: Define commands
python_3 = PythonScript(planes_WCS=move_8.Geometry, dfillet=Slider(0, range=0..100), speed=speed)  # -> flatten(commands); inputs planes_WCS: list, speed: Int32
# ---------- python_3: Python ----------
import Rhino.Geometry as rg
from compas.geometry import Frame
from compas.geometry import Transformation
from compas_ghpython import xdraw_frame
from scriptcontext import sticky as st

robot = st["robot"]
buffer = 1

# TODO this must be optimized! matrix multiplication!
commands = []
for i, plane_WCS in enumerate(planes_WCS):
    tcp_WCS = Frame(plane_WCS.Origin, plane_WCS.XAxis, plane_WCS.YAxis)
    if i == 0 or i == len(planes_WCS) - 1:
        radius = 0.
        
    else:
        # calculate blend radius
        prev, current, next = planes_WCS[i-1].Origin, planes_WCS[i].Origin, planes_WCS[i+1].Origin
        radius = min((prev - current).Length/2 * buffer, (next - current).Length/2 * buffer, dfillet)
    
    tcp_RCS = robot.get_frame_in_RCS(tcp_WCS)
    
    cmd = list(tcp_RCS.point) + tcp_RCS.axis_angle_vector + [speed, radius]
    #cmd = list(tcp_RCS.point) + tcp_RCS.axis_angle_vector + [time, radius]
    commands.append(cmd)
    
    
    
print (commands)
# ---------- end python_3 ----------

# ----
panel_7 = Panel("Get UR connected")
ur = PythonScript(send=start)
# ---------- ur: Python ----------
from scriptcontext import sticky as st
from ur_online_control.ur_driver import URDriver

server_address = st["server_address"]
server_port = st["server_port"]
ur_ip = st["ur_ip"]
robot = st["robot"]

tool_angle_axis = list(robot.tool.tcp_frame.point) + robot.tool.tcp_frame.axis_angle_vector
#robot.tool.tcp_frame.pose_axis_angle_vector
print tool_angle_axis

ur_driver = URDriver(server_address, server_port, tool_angle_axis, ur_ip, "UR")
print ur_driver

if send:
    ur_driver.send()
# ---------- end ur ----------

disconnect = Button()
panel_8 = Panel("Get Grasshopper connected")
client = PythonScript(connect=start, disconnect=disconnect)  # -> connected, client
# ---------- client: Python ----------
import time
from scriptcontext import sticky as st
from Rhino.RhinoApp import WriteLine
from ur_online_control.grasshopper import GHClient, gh_component_timer
import time

server_address = st["server_address"]
server_port = st["server_port"]

guid = str(ghenv.Component.InstanceGuid)

client_key = "client_" + guid
run_key = "run_" + guid

if connect:
    if client_key not in st:
        st[client_key] = GHClient(server_address, server_port)
        client = st[client_key]
        client.connect_to_server()
        client.start()
        
    else:
        if st[client_key].running:
            WriteLine("Client is already connected.")
            
        else:
            st[client_key] = GHClient(server_address, server_port)
            client = st[client_key]
            client.connect_to_server()
            client.start()
"""
else:
    if client_key in st:
        # we need a timer to ask if we have something on the rcv queue
        client = st[client_key]
        #if client.running:
        #    #client.run_inner_while()
        #    gh_component_timer(ghenv, True, 1000)
"""

if disconnect:
    if client_key in st:
        client = st[client_key]
        if client.running:
            client.close()

if client_key in st:
    connected =  st[client_key].running
    client = st[client_key]
    print st[client_key].rcv_queue.qsize()
    print st[client_key].snd_queue.qsize()
else:
    connected = False
# ---------- end client ----------
panel_9 = Panel(client.connected)

# ----
# This component updates on receive
bang_2 = Button()
receive = PythonScript(client=client.client, bang=bang_2)  # -> qsize, client
# ---------- receive: Python ----------
from ur_online_control.communication.msg_identifiers import *
from ur_online_control.utilities.lists import flatten_list
from Rhino.RhinoApp import WriteLine


if client:
    if not client.ghenv:
        client.ghenv = ghenv
    qsize = client.rcv_queue.qsize()
# ---------- end receive ----------
panel_10 = Panel(receive.qsize)

continue_fabrication = BooleanToggle(False)
panel_11 = Panel("Send a message")
drilling_commands = Data(python_3)
send = Button()
# 4
send_2 = PythonScript(
    client=client.client,
    send=send,
    continue_fabrication=continue_fabrication,
    tool=tools,
    drilling_commands=drilling_commands)  # -> out; inputs continue_fabrication: Int32, drilling_commands: list
# ---------- send_2: Python ----------
from ur_online_control.communication.msg_identifiers import *
from ur_online_control.utilities.lists import flatten_list

len_command_drilling = len(drilling_commands[0])
commands_flattened_drilling = flatten_list(drilling_commands)

"""
sand_tool = tool
sand_tool_axis = list(sand_tool.tcp_frame.point) + sand_tool.tcp_frame.axis_angle_vector
"""
"""
vaccuum_tool = tool
vaccuum_tool_axis = list(vaccuum_tool.tcp_frame.point) + vaccuum_tool.tcp_frame.axis_angle_vector
"""
# tool settigns
tool_axis = list(tool.tcp_frame.point) + tool.tcp_frame.axis_angle_vector

### Gravel placment ###
"""
#safe_in_pose_gravel, safe_out_pose_gravel = cmd_gravel_in_out 
pose_gravel = cmd_gravel
"""

#print waiting_times
#print len(io_values)


#===================================================================================
if send and client:
    ### string_fabrication ###
    client.send(MSG_INT, int(continue_fabrication))
    client.send(MSG_FLOAT_LIST, tool_axis) ### set string_tcp ###
    client.send(MSG_INT, len_command_drilling) ### send len of each cmd ###
    client.send(MSG_FLOAT_LIST, commands_flattened_drilling) ### send cmd list ###
#===================================================================================
# ---------- end send_2 ----------

bang_3 = Button()
receive_2 = PythonScript(client=client.client, bang=bang_3)  # -> qsize, client; same code as receive
panel_12 = Panel(receive_2.qsize)

send_3 = PythonScript(client=receive_2.client)  # -> out
# ---------- send_3: Python ----------
from ur_online_control.communication.msg_identifiers import *
from ur_online_control.utilities.lists import flatten_list

if client:
    qsize = client.rcv_queue.qsize()
    if qsize:
        msg = client.rcv_queue.get()
        print msg
# ---------- end send_3 ----------
panel_13 = Panel(send_3)
send_4 = PythonScript(client=receive.client)  # -> out; same code as send_3
panel_14 = Panel(send_2)
panel_15 = Panel(send_4)

# ----
# Direct UR control
get = Button()
get_2 = Button()
pose = PythonScript(get=get_2)  # -> pose_joints
# ---------- pose: Python ----------
from scriptcontext import sticky as st
from ur_online_control.ur_direct import get_current_pose_joints
from ur_online_control.ur.robot import BaseConfiguration

server_address = st["server_address"]
server_port = 30005
ur_ip = st["ur_ip"]
robot = st["robot"]
tool_angle_axis = list(robot.tool.tcp_frame.point) + robot.tool.tcp_frame.axis_angle_vector
print tool_angle_axis

guid = str(ghenv.Component.InstanceGuid)
pose_joints_key = "pose_joints" + guid


if get:
    st[pose_joints_key] = get_current_pose_joints(server_address, server_port, ur_ip, tool_angle_axis)
    
if pose_joints_key not in st:
    pose_joints = []
else:
    pose_joints = BaseConfiguration.from_joints(st[pose_joints_key])
# ---------- end pose ----------
pose_2 = PythonScript(get=get)  # -> pose_cartesian
# ---------- pose_2: Python ----------
from scriptcontext import sticky as st
from ur_online_control.ur_direct import get_current_pose_cartesian

server_address = st["server_address"]
server_port = 30005
ur_ip = st["ur_ip"]
robot = st["robot"]
tool_angle_axis = list(robot.tool.tcp_frame.point) + robot.tool.tcp_frame.axis_angle_vector
print tool_angle_axis

guid = str(ghenv.Component.InstanceGuid)
pose_cartesian_key = "pose_cartesian" + guid


if get:
    st[pose_cartesian_key] = get_current_pose_cartesian(server_address, server_port, ur_ip, tool_angle_axis)

if pose_cartesian_key not in st:
    pose_cartesian = []
else:
    pose_cartesian = st[pose_cartesian_key]
# ---------- end pose_2 ----------
stop = Button()
stop_2 = PythonScript(stop=stop)
# ---------- stop_2: Python ----------
from scriptcontext import sticky as st
from ur_online_control.ur_direct import stop as stop_robot

ur_ip = st["ur_ip"]

if stop:
    stop_robot(ur_ip)
# ---------- end stop_2 ----------
panel_16 = Panel(pose)
panel_17 = Panel(pose_2)

# ----
# Visualisation
pose_joints = Data(pose)
planes_wcs = Plane()
robot_2 = Data(robot)

# ---- group: Define plane in WCS, calculate joint positions
pt_11 = Point(Point(648.8632686, 624.689255, -55.48786018))
xy_5 = XYPlane(Origin=pt_11)
select_configuration = Slider(5, range=0..7)
plane_wcs = Plane(xy_5)
inverse = PythonScript(robot=robot_2, plane_WCS=plane_wcs, idx=select_configuration)  # -> configuration; inputs plane_WCS: Plane, idx: Int32
# ---------- inverse: Python ----------
import Rhino.Geometry as rg
from compas.geometry import Frame, Transformation
from compas_ghpython import xdraw_frame

tcp_WCS = Frame(plane_WCS.Origin, plane_WCS.XAxis, plane_WCS.YAxis)

# transform frame to robot coordinate system
tcp_RCS = robot.get_frame_in_RCS(tcp_WCS)

# get the frame of tool0
tool0_RCS = robot.get_tool0_frame_from_tcp_frame(tcp_RCS)

# calculate solutions to frame
solutions = robot.inverse_kinematics(tool0_RCS)

if not len(solutions):
    q = [0,0,0,0,0,0]
else:
    idx = min(len(solutions) - 1, idx)
    q = solutions[idx]
    
print q

configuration = q
# ---------- end inverse ----------

# ----
vertical_pose = Number([-152.427, -780.635, 855.229, -1.1958, -1.22046, -1.20201])
py_3 = PythonScript(pose_cartesian=pose_2)  # -> frame_WCS; inputs pose_cartesian: list
# ---------- py_3: Python ----------
import Rhino.Geometry as rg
from scriptcontext import sticky as st
from compas.geometry import Frame
from compas.geometry.xforms import Transformation

robot = st["robot"]



if pose_cartesian:
    frame_RCS = Frame.from_axis_angle_vector(pose_cartesian)
    frame_WCS = robot.get_frame_in_WCS(frame_RCS)
# ---------- end py_3 ----------
draw = Draw(frame=py_3)  # -> G, C
back = Button()
reset = Button()

# ---- group: Calculate joint positions for path
# Add init joint states
joint_states = Data([-0.1728179112, -1.415058186, 1.813991282, -1.971940356, -1.571654205, -3.308720436])
init_configuration = Slider(5, range=0..7)
py_4 = PythonScript(robot=robot_2, planes_WCS=planes_wcs, configuration_idx=init_configuration, init_configuration=joint_states)  # -> configurations; inputs planes_WCS: list, configuration_idx: Int32, init_configuration: list
# ---------- py_4: Python ----------
from compas_ghpython import unload_modules
unload_modules('ur_online_control')
import Rhino.Geometry as rg
from compas.geometry import Frame 
from compas.geometry.xforms import Transformation
from compas_ghpython import xdraw_frame
from ur_online_control.ur.kinematics import calculate_configurations_for_path, format_joint_positions


# TODO this must be optimized! matrix multiplication!
frames_tool0_RCS = []
for plane_WCS in planes_WCS:
    tcp_WCS = Frame(plane_WCS.Origin, plane_WCS.XAxis, plane_WCS.YAxis)
    tcp_RCS = robot.get_frame_in_RCS(tcp_WCS)
    frames_tool0_RCS.append(robot.get_tool0_frame_from_tcp_frame(tcp_RCS))
    

#configurations = calculate_configurations_for_path(frames_tool0_RCS, robot.params, init_configuration)
configurations = calculate_configurations_for_path(frames_tool0_RCS, robot, init_configuration)
#print configurations
configurations = configurations[min([configuration_idx, len(configurations) - 1])]

def format(numbers, k=4):
    #numbers = format_joint_positions(numbers)
    return "[" + ", ".join([("%." + str(k) + "f") % n for n in numbers]) + "]"
# ---------- end py_4 ----------
start_2 = Button()
stop_3 = Button()
step = Button()
counter = CountThroughList(L=py_4, start=start_2, stop=stop_3, step=step, step_back=back, reset=reset, interval=100)  # -> item; inputs L: list, start: Boolean, stop: Boolean, step_back: Boolean
# ---------- counter: Python ----------
from scriptcontext import sticky as st
from compas_ghpython import update_component


# store data in component
guid = str(ghenv.Component.InstanceGuid)
counter_key = "counter_" + guid
running_key = "running_" + guid

if counter_key not in st:
    st[counter_key] = 0

if running_key not in st:
    st[running_key] = False

if start:
    st[running_key] = True

if stop:
    st[running_key] = False

if step:
    if st[counter_key] < len(L) - 1:
        st[counter_key] += 1

if step_back:
    if st[counter_key] < len(L) - 1:
        st[counter_key] -= 1

if reset:
    st[counter_key] = 0

if len(L):
    item = L[st[counter_key]]

if st[running_key]:
    if st[counter_key] < len(L) - 1:
        st[counter_key] += 1
        update_component(ghenv, interval)
    else:
        st[counter_key] = 0
        st[running_key] = False
# ---------- end counter ----------

# ---- group: Calculate joint positions for path / Shows joint positions along path
flip = BooleanToggle(True)
l2t = PythonScript(L=py_4, flip=flip)  # -> T; inputs L: list, flip: Boolean
# ---------- l2t: Python ----------
from compas_ghpython import list_to_ghtree
L = [l.joint_values for l in L]

if flip:
    L = zip(*L)
T = list_to_ghtree(L)
# ---------- end l2t ----------
graph = QuickGraph(l2t, SortOrder=0)

# ---- group: Define joint positions
base_2 = Slider(-173.869, range=-360..360)
elbow = Slider(90.765, range=-360..360)
wrist2 = Slider(-82.725, range=-360..360)
wrist3 = Slider(91.571, range=-360..360)
shoulder = Slider(-72.967, range=-360..360)
wrist1 = Slider(-115.737, range=-360..360)
ur1_q1_q6 = Data([base_2, shoulder, elbow, wrist1, wrist2, wrist3])

# ----
preview = CustomPreview(Geometry=draw.G, Shader=draw.C)

origin_pt = Point(<point referenced from the Rhino model>)
xy_6 = XYPlane(Origin=origin_pt)
python_4 = GhPythonScript(
    o_plane=xy_6,
    x_size=Slider(200, range=0..1000),
    y_size=Slider(400, range=0..1000),
    x_no=Slider(5, range=0..30),
    y_no=Slider(10, range=0..10))  # -> out, way_pts, waiting_times, io_values; inputs o_plane: Plane, x_size: Int32, y_size: Int32, x_no: Int32, y_no: Int32
# ---------- python_4: Python ----------
__author__ = "jesusm"
__version__ = "2018.09.04"

import Rhino.Geometry as rg
import rhinoscriptsyntax as rs

import random as r

x_dist = x_size/x_no
y_dist = y_size/y_no

way_pts = []
waiting_times = []
io_values = []

for i in range(x_no + 1):
    for j in range(y_no + 1):
        temp_pt = o_plane.Origin + i * o_plane.XAxis * x_dist + j * o_plane.YAxis * y_dist
        temp_pt += rg.Vector3d.ZAxis * r.randint(0,60)
        way_pts.append(temp_pt)
        
        waiting_times.append(r.uniform(0.5,3.0))
        
        io = r.randint(0,1)
        io_values.append(io)
# ---------- end python_4 ----------
vec = VectorXYZ(XComponent=0, YComponent=Slider(-300, range=-1000..1001), ZComponent=0)  # -> Vector, Length
pt_12 = Point(python_4.way_pts)
xy_7 = XYPlane(Origin=pt_12)
move_9 = Move(Geometry=pt_12, Motion=vec.Vector)  # -> Geometry, Transform

py_5 = GhPythonScript(joint_values=ur1_q1_q6)  # -> configuration; inputs joint_values: list
# ---------- py_5: Python ----------
import math
from ur_online_control.ur.robot import BaseConfiguration

configuration = BaseConfiguration.from_joints([math.radians(d) for d in joint_values])
# ---------- end py_5 ----------

# ----
# Calculate basis
# Measure basis:
# 1. Clear the recorded poses
# 2. Move robot to origin and press "get pose"
# 3. Move robot to point in positive x-axis and press "get pose"
# 4. Move robot to an other point in your basis and press "get pose"
# (The farer away these positions are, the better)
# 
# 5. Alternatively change the order in the component calc base
# 6. Copy output into base component
list_3 = ValueList({"origin, pt on positive x-axis, pt in xy plane": 0, "origin, pt on positive y-axis, pt in xy plane": 1}, selected="origin, pt on positive x-axis, pt in xy plane")
clear = Button()
rec = PythonScript(msg=pose_2, rec=get, clear=clear)  # -> rec; inputs msg: list
# ---------- rec: Python ----------
from scriptcontext import sticky as st

guid = str(ghenv.Component.InstanceGuid)
recorded_key =  "recorded_" + guid
just_cleared_key = "just_cleared_" + guid

if recorded_key not in st:
    st[recorded_key] = []

if just_cleared_key not in st:
    st[just_cleared_key] = False

if clear:
    st[recorded_key] = []
    st[just_cleared_key] = True
else:
    if len(msg):
        if msg != [None] and not st[just_cleared_key] and rec:
            st[recorded_key].append(msg)
    st[just_cleared_key] = False
        


rec = st[recorded_key]

print rec
# ---------- end rec ----------
calc_base = PythonScript(poses=rec, input_type=list_3)  # -> out; inputs poses: list
# ---------- calc_base: Python ----------
import Rhino.Geometry as rg
import math


if len(poses) > 2:
    
    O = poses[0]
    P1 = poses[1]
    P2 = poses[2]
    
    if input_type == 0:
        # origin, pt on positive x-axis, pt in xy plane
        origin = rg.Point3d(O[0], O[1], O[2])
        pt_on_xaxis = rg.Point3d(P1[0], P1[1], P1[2])
        pt_in_xyplane = rg.Point3d(P2[0], P2[1], P2[2])
        
        xaxis = pt_on_xaxis - origin
        xaxis.Unitize()
        
        v = pt_in_xyplane - origin
        zaxis = rg.Vector3d.CrossProduct(v, xaxis)
        zaxis.Unitize()
        
        # zaxis must look up!
        if math.acos(rg.Vector3d.ZAxis * zaxis) > math.acos(rg.Vector3d.ZAxis * -zaxis):
            zaxis = -zaxis
        
        yaxis = rg.Vector3d.CrossProduct(zaxis, xaxis)
    
    elif input_type == 1:
        # origin, pt on positive y-axis, pt in xy plane
        origin = rg.Point3d(O[0], O[1], O[2])
        pt_on_yaxis = rg.Point3d(P1[0], P1[1], P1[2])
        pt_in_xyplane = rg.Point3d(P2[0], P2[1], P2[2])
        
        yaxis = pt_on_yaxis - origin
        yaxis.Unitize()
        
        v = pt_in_xyplane - origin
        zaxis = rg.Vector3d.CrossProduct(v, yaxis)
        zaxis.Unitize()
        
        # zaxis must look up!
        if math.acos(rg.Vector3d.ZAxis * zaxis) > math.acos(rg.Vector3d.ZAxis * -zaxis):
            zaxis = -zaxis
        
        xaxis = rg.Vector3d.CrossProduct(yaxis, zaxis)
        
        
    print "Copy the following into base component:"
    print " "
    print "origin = [%.2f, %.2f, %.2f]" % tuple(list(origin))
    print "xaxis = [%.5f, %.5f, %.5f]" % tuple(list(xaxis))
    print "yaxis = [%.5f, %.5f, %.5f]" % tuple(list(yaxis))
    

#print rg.Vector3d.CrossProduct(rg.Vector3d.YAxis, rg.Vector3d.ZAxis)
#print rg.Vector3d.CrossProduct(rg.Vector3d.ZAxis, rg.Vector3d.XAxis)
# ---------- end calc_base ----------
panel_18 = Panel(rec)
panel_19 = Panel(calc_base)

# ---- group: Visualise / robot model brep
py_6 = PythonScript(model=list_2)  # -> n
# ---------- py_6: Python ----------
if model == "UR5":
    n = 0
if model == "UR10":
    n = 1

print n
# ---------- end py_6 ----------
ur10_brep = UR10Brep([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])
ur5_brep = UR5Brep([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])
show_brep = BooleanToggle(False)
filter = StreamFilter(Gate=py_6, Stream0=ur5_brep, Stream1=ur10_brep)

# ---- group: Visualise
list_4 = ValueList({"0 forward, from angles": 0, "1 inverse, from one plane": 1, "2 inverse, from multiple planes": 2, "3 forward, from robot": 3}, selected="1 inverse, from one plane")
filter_2 = StreamFilter(Gate=list_4, Stream0=py_5, Stream1=inverse, Stream2=counter, Stream3=pose_joints)
configuration = Panel(filter_2)
mesh = Mesh(filter)
draw_2 = PythonScript(robot=robot_2, configuration=filter_2, mesh=mesh, brep=filter, show_brep=show_brep)  # -> meshes, tool0_plane, tcp_plane, robot_brep; inputs mesh: list, brep: list
# ---------- draw_2: Python ----------
from compas_ghpython import unload_modules
unload_modules("ur_online_control")

from compas_ghpython import xdraw_frame
from compas_ghpython import mesh_draw
from compas_ghpython.geometry.xforms import xform_from_transformation
from compas.geometry import Frame
from compas.geometry.xforms import Transformation
from ur_online_control.ur.robot import BaseConfiguration

import Rhino.Geometry as rg
import Rhino

def mesh_update_vertices(mesh, vertices):
    for i in range(len(vertices)):
        mesh.vertex[i].update({'x': vertices[i][0], 'y': vertices[i][1], 'z': vertices[i][2]})

if configuration:
    #print configuration
    #q = BaseConfiguration.from_joints(configuration)
    q = configuration
    print q
    print q.joint_values
    
    print robot.get_forward_transformations(q)
    R0, R1, R2, R3, R4, R5 = robot.get_forward_transformations(q)
    
    tool0_frame2 = robot.tool0_frame.transformed(R5)
    tcp_frame2 = Frame.from_transformation(Transformation.from_frame(tool0_frame2) * robot.transformation_tool0_tcp)
    
    print robot.transformation_tool0_tcp
    print robot.transformation_tcp_tool0
    print robot.transformation_tool0_tcp * robot.transformation_tcp_tool0
    print tcp_frame2
    tcp_frame2 = Frame.from_transformation(Transformation.from_frame(tool0_frame2) * robot.transformation_tcp_tool0)
    print tcp_frame2
    
    tool0_frame, tcp_frame = robot.get_transformed_tool_frames(R5)
    
    tool0_frame = tool0_frame2
    tcp_frame = tcp_frame2
    
    m0, m1, m2, m3, m4, m5 = mesh
    for i in range(6):
        exec("R%drg = xform_from_transformation(R%d)" % (i, i))
        exec("m%d.Transform(R%drg)" % (i, i))
    meshes = [m0, m1, m2, m3, m4, m5]
    print meshes
    mt = robot.tool.get_transformed_model(Transformation.from_frame(tool0_frame))
    
    if mt:
        meshes.extend(map(mesh_draw, mt))
    
    """
    m0, m1, m2, m3, m4, m5, tool0_frame, tcp_frame = robot.get_transformed_model(q)
    mt = robot.get_transformed_tool_model(tcp_frame)
    
    meshes = []
    meshes.append(mesh_draw(m0))
    meshes.append(mesh_draw(m1))
    meshes.append(mesh_draw(m2))
    meshes.append(mesh_draw(m3))
    meshes.append(mesh_draw(m4))
    meshes.append(mesh_draw(m5))
    if mt:
        meshes.append(mesh_draw(mt))
    
    """
    
    tool0_plane = xdraw_frame(tool0_frame)
    tcp_plane = xdraw_frame(tcp_frame)
    
    if show_brep:
        
        b0, b1, b2, b3, b4, b5 = brep
        
        b0.Transform(R0rg)
        b1.Transform(R1rg)
        b2.Transform(R2rg)
        b3.Transform(R3rg)
        b4.Transform(R4rg)
        b5.Transform(R5rg)
        
        robot_brep = [b0, b1, b2, b3, b4, b5]
# ---------- end draw_2 ----------
tool0_plane = Plane(draw_2.tool0_plane)
tcp_plane = Plane(draw_2.tcp_plane)
robot_brep = Brep(draw_2.robot_brep)
draw_3 = RepresentPlaneAsLines(plane=tcp_plane, size=100)  # -> G, C
# ---------- draw_3: Python ----------
import Rhino.Geometry as rg
from System.Drawing import Color

if plane:

    G = []
    G.append(rg.Line(plane.Origin, size * plane.XAxis))
    G.append(rg.Line(plane.Origin, size * plane.YAxis))
    G.append(rg.Line(plane.Origin, size * plane.ZAxis))
    
    C = []
    C.append(Color.FromArgb(255, 0, 0))
    C.append(Color.FromArgb(0, 255, 0))
    C.append(Color.FromArgb(0, 0, 255))
# ---------- end draw_3 ----------
preview_2 = CustomPreview(Geometry=draw_2.meshes, Shader=ColourSwatch(SwatchColor=RGBA(99, 94, 94, 96)))
preview_3 = CustomPreview(Geometry=draw_3.G, Shader=draw_3.C)

# ----
python_5 = GhPythonScript(planes=xy_7)  # -> out, out_planes; inputs planes: list of Plane
# ---------- python_5: Python ----------
import Rhino.Geometry as rg
out_planes = []
for plane in planes:
    in_plane = rg.Plane(plane)
    in_plane.Translate(in_plane.ZAxis * 100)
    out_planes.append(in_plane)
    out_planes.append(plane)
    out_planes.append(in_plane)
# ---------- end python_5 ----------
mesh_2 = Mesh(draw_2.meshes)
xy_8 = XYPlane(Origin=python_5.out_planes)
loop_count = PythonScript(planes=xy_8, cnt=Slider(1, range=1..10))  # -> many_planes; inputs planes: list, cnt: Int32
# ---------- loop_count: Python ----------
many_planes = []

for i in range(cnt):
    many_planes.extend(_planes)
# ---------- end loop_count ----------

panel_20 = Panel("move vertical")
movel = PythonScript()  # -> script
# ---------- movel: Python ----------
from scriptcontext import sticky as st

robot = st["robot"]
tool_angle_axis = list(robot.tool.tcp_frame.point) + robot.tool.tcp_frame.axis_angle_vector
x, y, z, ax, ay, az = tool_angle_axis

script = "def prog():\n"
script += "\ttextmsg(\">> program start\")\n"
script += "\tset_tcp(p%s)\n" % str([x/1000., y/1000., z/1000, ax, ay, az])
script += "\tcurrent_pose = get_forward_kin()\n"
script += "\tmovel(p[current_pose[0], current_pose[1], current_pose[2], 0, 0, 0], a=0.1, v=0.1)\n"
script += "\ttextmsg(\"<< program end\")\n"
script += "end\n"
script += "prog()\n\n"

print script
# ---------- end movel ----------
send_5 = Button()
send_6 = Send(script=movel, send=send_5)
panel_21 = Panel(send_6)

panel_22 = Panel("set digital out")
number = Slider(0, range=0..10)
value = BooleanToggle(False)
digital_out = PythonScript(number=number, value=value)  # -> script; inputs number: Int32, value: Boolean
# ---------- digital_out: Python ----------
script = "def prog():\n"
script += "\ttextmsg(\">> program start\")\n"
script += "\tset_digital_out(%i, %s)\n" % (int(number), str(value))
script += "\ttextmsg(\"<< program end\")\n"
script += "end\n"
script += "prog()\n\n"

print script
# ---------- end digital_out ----------
send_7 = Button()
send_8 = Send(script=digital_out, send=send_7)
panel_23 = Panel(send_8)

pt_13 = Point(<point referenced from the Rhino model>)
pt_14 = Point(<point referenced from the Rhino model>)
pt_15 = Point(<point referenced from the Rhino model>)
pt_16 = Point(<point referenced from the Rhino model>)
xy_9 = XYPlane(Origin=pt_16)
pl_3pt = Plane3Pt(PointA=pt_13, PointB=pt_15, PointC=pt_14)
pln_4 = Plane(Plane(origin=(-171.6965332, 167.2027749, 817.9104187), x=(-0.5149284328, -0.4652749615, 0.7199777214), y=(-0.1797311806, 0.879815641, 0.4400240228)))
pln_5 = Plane(Plane(origin=(-171.6965332, 167.2027749, 817.9104187), x=(-0.5149284328, -0.4652749615, 0.7199777214), y=(-0.1797311806, 0.879815641, 0.4400240228)))
speed_2 = Slider(26, range=0..300)

# ---- group: Define commands
python_6 = PythonScript(planes_WCS=loop_count, dfillet=Slider(20, range=0..100), speed=speed_2)  # -> commands; inputs planes_WCS: list, speed: Int32
# ---------- python_6: Python ----------
import Rhino.Geometry as rg
from compas.geometry import Frame
from compas.geometry import Transformation
from compas_ghpython import xdraw_frame
from scriptcontext import sticky as st

robot = st["robot"]
buffer = 0.7

# TODO this must be optimized! matrix multiplication!
commands = []
for i, plane_WCS in enumerate(planes_WCS):
    tcp_WCS = Frame(plane_WCS.Origin, plane_WCS.XAxis, plane_WCS.YAxis)
    if i == 0 or i == len(planes_WCS) - 1:
        radius = 0.
        
    else:
        # calculate blend radius
        prev, current, next = planes_WCS[i-1].Origin, planes_WCS[i].Origin, planes_WCS[i+1].Origin
        radius = min((prev - current).Length/2 * buffer, (next - current).Length/2 * buffer, dfillet)
    
    tcp_RCS = robot.get_frame_in_RCS(tcp_WCS)
    
    cmd = list(tcp_RCS.point) + tcp_RCS.axis_angle_vector + [speed, radius]
    #cmd = list(tcp_RCS.point) + tcp_RCS.axis_angle_vector + [time, radius]
    commands.append(cmd)
    
    
    
print (commands)
# ---------- end python_6 ----------

# ---- group: Send joint position directly to robot
panel_24 = Panel("move cartesian")
idx = Slider(0, range=0..100)
commands = Data(python_6)
item_2 = ListItem(List=commands, Index=idx, Wrap=True)
list_5 = ValueList({"send all positions": 0, "send only one position": 1}, selected="send only one position")
filter_3 = StreamFilter(Gate=list_5, Stream0=commands, Stream1=item_2)
movel_2 = PythonScript(commands=filter_3, velocity=Slider(100, range=0..100))  # -> script; inputs commands: list
# ---------- movel_2: Python ----------
from scriptcontext import sticky as st

script_lines = []
for cmd in commands:
    #q, a=1.4, v=1.05, t=0, r=0)
    x, y, z, ax, ay, az, speed, radius = cmd
    script_lines.append("movel(p%s, v=%f, r=%f)" % (str([x/1000., y/1000., z/1000, ax, ay, az]), speed/1000., radius/1000.))

robot = st["robot"]
tool_angle_axis = list(robot.tool.tcp_frame.point) + robot.tool.tcp_frame.axis_angle_vector
x, y, z, ax, ay, az = tool_angle_axis

script = "def prog():\n"
script += "\ttextmsg(\">> program start\")\n"
script += "\tset_tcp(p%s)\n" % str([x/1000., y/1000., z/1000, ax, ay, az])
script += "".join(["\t%s\n" % line for line in script_lines])
script += "\ttextmsg(\"<< program end\")\n"
script += "end\n"
script += "prog()\n\n"

print script
# ---------- end movel_2 ----------
send_9 = Button()
send_10 = Send(script=movel_2, send=send_9)
panel_25 = Panel(send_10)

# ----
entryexitpt = PythonScript(loop_plane=xy_9, planes=loop_count, safety_distance=Slider(100, range=0..100))  # -> commands, planes; inputs loop_plane: Plane, planes: list
# ---------- entryexitpt: Python ----------
import Rhino.Geometry as rg
from scriptcontext import sticky as st
from compas.geometry import Frame

robot = st["robot"]

in_plane = _planes[0]
out_plane = _planes[-1]

safe_in_plane = rg.Plane(in_plane)
safe_out_plane = rg.Plane(out_plane)

### safe_in_plane XX mm above start ####
safe_in_plane.Translate(rg.Vector3d(0,0,safety_distance))
safe_in_frame_WCS = Frame(safe_in_plane.Origin, safe_in_plane.XAxis, safe_in_plane.YAxis)
safe_in_frame_RCS = robot.get_frame_in_RCS(safe_in_frame_WCS)

### in_plane ###
in_frame_WCS = Frame(in_plane.Origin, in_plane.XAxis, in_plane.YAxis)
in_frame_RCS = robot.get_frame_in_RCS(in_frame_WCS)

### out_plane ###
out_frame_WCS = Frame(out_plane.Origin, out_plane.XAxis, out_plane.YAxis)
out_frame_RCS = robot.get_frame_in_RCS(out_frame_WCS)

### safe_out_plane XX mm above start ####
safe_out_plane.Translate(rg.Vector3d(0,0,safety_distance))
safe_out_frame_WCS = Frame(safe_out_plane.Origin, safe_out_plane.XAxis, safe_out_plane.YAxis)
safe_out_frame_RCS = robot.get_frame_in_RCS(safe_out_frame_WCS)

# loop_plane
loop_plane_frame_WCS = Frame(loop_plane.Origin, loop_plane.XAxis, loop_plane.YAxis)
loop_plane_frame_RCS = robot.get_frame_in_RCS(loop_plane_frame_WCS)

planes = safe_in_plane, in_plane, out_plane, safe_out_plane

acc = 100
vel = 30

commands = []
commands.append(list(safe_in_frame_RCS.point) + safe_in_frame_RCS.axis_angle_vector + [acc, vel])
commands.append(list(in_frame_RCS.point) + in_frame_RCS.axis_angle_vector + [acc, vel])

commands.append(list(out_frame_RCS.point) + out_frame_RCS.axis_angle_vector + [acc, vel])
commands.append(list(safe_out_frame_RCS.point) + safe_out_frame_RCS.axis_angle_vector + [acc, vel])

commands.append(list(loop_plane_frame_RCS.point) + loop_plane_frame_RCS.axis_angle_vector + [acc, vel])

print commands
# ---------- end entryexitpt ----------

# ----
# move incremental in WCS
number_slider = Slider(10, range=-10..10)
list_6 = ValueList({"xaxis", "yaxis", "zaxis"}, selected="yaxis")
movel_3 = PythonScript(step_size=number_slider, direction=list_6)  # -> script
# ---------- movel_3: Python ----------
from scriptcontext import sticky as st

robot = st["robot"]
tool_angle_axis = list(robot.tool.tcp_frame.point) + robot.tool.tcp_frame.axis_angle_vector
x, y, z, ax, ay, az = tool_angle_axis

script = "def prog():\n"
script += "\ttextmsg(\">> program start\")\n"
script += "\tset_tcp(p%s)\n" % str([x/1000., y/1000., z/1000, ax, ay, az])
script += "\tcurrent_pose = get_forward_kin()\n"


if direction == "xaxis":
    script += "\tmovel(p[current_pose[0] + %f, current_pose[1], current_pose[2], current_pose[3], current_pose[4], current_pose[5]], t=%f)\n" % (step_size/1000., step_size * 0.1)

elif direction == "yaxis":
    script += "\tmovel(p[current_pose[0], current_pose[1] + %f, current_pose[2], current_pose[3], current_pose[4], current_pose[5]], t=%f)\n" % (step_size/1000., step_size * 0.1)

else: # direction == "zaxis":
    script += "\tmovel(p[current_pose[0], current_pose[1], current_pose[2] + %f, current_pose[3], current_pose[4], current_pose[5]], t=%f)\n" % (step_size/1000., step_size * 0.1)

script += "\ttextmsg(\"<< program end\")\n"
script += "end\n"
script += "prog()\n\n"

print script
# ---------- end movel_3 ----------
send_11 = Button()
send_12 = Send(script=movel_3, send=send_11)
panel_26 = Panel(send_12)

# ----
# move incremental in TCS
get_current_pose = Button()
list_7 = ValueList({"xaxis", "yaxis", "zaxis"}, selected="zaxis")
movel_4 = PythonScript(get=get_current_pose, step_size=Slider(50, range=-10..50), direction=list_7)  # -> script; inputs get: list
# ---------- movel_4: Python ----------
from scriptcontext import sticky as st
from compas.geometry import Frame
from compas.geometry import Point, Vector
from ur_online_control.ur_direct import get_current_pose_cartesian

server_address = st["server_address"]
server_port = 30005
ur_ip = st["ur_ip"]
robot = st["robot"]
tool_angle_axis = list(robot.tool.tcp_frame.point) + robot.tool.tcp_frame.axis_angle_vector
print tool_angle_axis

guid = str(ghenv.Component.InstanceGuid)
pose_cartesian_key = "pose_cartesian" + guid

if get:
    st[pose_cartesian_key] = get_current_pose_cartesian(server_address, server_port, ur_ip, tool_angle_axis)

if pose_cartesian_key not in st:
    pose_cartesian = []
    script = ""
else:
    pose_cartesian = st[pose_cartesian_key]

    robot = st["robot"]
    tool_angle_axis = list(robot.tool.tcp_frame.point) + robot.tool.tcp_frame.axis_angle_vector
    x, y, z, ax, ay, az = tool_angle_axis
    
    script = "def prog():\n"
    script += "\ttextmsg(\">> program start\")\n"
    script += "\tset_tcp(p%s)\n" % str([x/1000., y/1000., z/1000, ax, ay, az])
    script += "\tcurrent_pose = get_forward_kin()\n"
    
#    frame = Frame.from_pose_axis_angle_vector(pose_cartesian)
    frame = Frame.from_axis_angle_vector([ax, ay, az])
    frame.point = [x, y, z]

    if direction == "xaxis":
        next_vector = Vector(*frame.xaxis) * step_size
    elif direction == "yaxis":
        next_vector = Vector(*frame.yaxis) * step_size
    else: # direction == "zaxis":
        next_vector = Vector(*frame.zaxis) * step_size
    
    x, y, z = next_vector
    script += "\tmovel(p[current_pose[0] + %f, current_pose[1] + %f, current_pose[2] + %f, current_pose[3], current_pose[4], current_pose[5]], t=%f)\n" % (x/1000., y/1000., z/1000., step_size * 0.1)
    
    script += "\ttextmsg(\"<< program end\")\n"
    script += "end\n"
    script += "prog()\n\n"
    
    print script
# ---------- end movel_4 ----------
send_13 = Button()
send_14 = Send(script=movel_4, send=send_13)
panel_27 = Panel(send_14)

# ---- group: Send joint position directly to robot
idx_2 = Slider(0, range=0..100)
panel_28 = Panel("move joints")
joint_positions = Data(py_5)
list_8 = ValueList({"send all positions": 0, "send only one position": 1}, selected="send only one position")
item_3 = ListItem(List=joint_positions, Index=idx_2, Wrap=True)
filter_4 = StreamFilter(Gate=list_8, Stream0=joint_positions, Stream1=item_3)
movej = PythonScript(joint_positions=filter_4, velocity=Slider(153, range=0..200))  # -> script; inputs joint_positions: list
# ---------- movej: Python ----------
script_lines = []

for position in joint_positions:
    script_lines.append("movej(%s, v=%f)" % (str(position), velocity/1000.))


script = "def prog():\n"
script += "\ttextmsg(\">> program start\")\n"
script += "".join(["\t%s\n" % line for line in script_lines])
script += "\ttextmsg(\"<< program end\")\n"
script += "end\n"
script += "prog()\n\n"


print script

#script = ""
# ---------- end movej ----------
send_15 = Button()

# ----
send_16 = Send(script=movej, send=send_15)

# ---- group: Send joint position directly to robot (continued)
panel_29 = Panel(send_16)

# ==== cluster Tools
drill_bit_length = ClusterInput()
brep = Brep([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])
pt = Point(Point(0, 0, 0))
tool_id = ClusterInput()
clay_modified = Geometry([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])
clay_modified_2 = Geometry([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])
clay_tool_simple = Geometry([<brep referenced from the Rhino model> x2])

# ---- group: measurement tool
measurement_tool_geo = Geometry([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])
mesh = Mesh(measurement_tool_geo)
mjoin = MeshJoin(Meshes=mesh)
tool = PythonScript(meshes=mjoin, brep=measurement_tool_geo)  # -> tool; inputs meshes: list, brep: list
# ---------- tool: Python ----------
from ur_online_control.ur.tools import MeasurementTool
from compas.datastructures import Mesh
from compas_rhino.helpers import mesh_from_guid


tool = MeasurementTool()
tool.model = [mesh_from_guid(Mesh, mesh) for mesh in meshes]
#tool.model_xyz = tool.model.xyz
tool.brep = brep
# ---------- end tool ----------

# ----
vacuum_gripper = Geometry(<brep referenced from the Rhino model>)

# ---- group: drill 90 degrees
clay_tool = Geometry([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])
yaxis_line = Curve(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)
xaxis_line = Curve(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)
mesh_2 = Mesh(clay_tool)
brep_2 = Brep(clay_tool)
tool_2 = Tool_2(meshes=mesh_2, breps=brep_2, xline=xaxis_line, yline=yaxis_line)

# ----
yaxis_line_2 = Curve(<curve referenced from the Rhino model>)
xaxis_line_2 = Curve(<curve referenced from the Rhino model>)
yaxis_line_3 = Curve(<curve referenced from the Rhino model>)

# ---- group: extruder
yaxis_line_4 = Curve(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)
test_geometry = Geometry(brep)
xaxis_line_3 = Curve(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)
brep_3 = Brep(test_geometry)
mesh_3 = Mesh(test_geometry)
tool_3 = Tool(meshes=mesh_3, breps=brep_3, xline=xaxis_line_3, yline=yaxis_line_4)

# ----
xaxis_line_4 = Curve(<curve referenced from the Rhino model>)
drill_bit_length_2 = Number(drill_bit_length)
X = UnitX(Factor=1)
Y = UnitY(Factor=-1)
tool_id_2 = Integer(tool_id)
mesh_4 = Mesh(clay_modified)
brep_4 = Brep(clay_modified)
ln = Line(StartPoint=pt, EndPoint=X)
ln_2 = Line(StartPoint=pt, EndPoint=Y)
mesh_5 = Mesh(vacuum_gripper)
brep_5 = Brep(vacuum_gripper)
addition = Addition(A=Slider(285, range=0..400), B=drill_bit_length_2)
mesh_6 = Mesh(clay_modified_2)
brep_6 = Brep(clay_modified_2)
Z = UnitZ(Factor=addition)
move = Move(Geometry=ln, Motion=Z)  # -> Geometry, Transform
tool_4 = Tool(meshes=mesh_5, breps=brep_5, xline=xaxis_line_2, yline=yaxis_line_2)
tool_5 = Tool(meshes=mesh_6, breps=brep_6, xline=xaxis_line_4, yline=yaxis_line_3)
move_2 = Move(Geometry=ln_2, Motion=Z)  # -> Geometry, Transform
crv = Curve(move.Geometry)
crv_2 = Curve(move_2.Geometry)
tool_6 = Tool(meshes=mesh_4, breps=brep_4, xline=crv, yline=crv_2)
filter = StreamFilter(Gate=tool_id_2, Stream1=tool, Stream2=tool_4, Stream3=tool_5, Stream4=tool_2, Stream5=tool_6)
py = PythonScript(tool=filter)  # -> tcp_frame, model
# ---------- py: Python ----------
from compas_ghpython import mesh_draw 

tcp_frame = tool.tcp_frame
model = map(mesh_draw, tool.model)
# ---------- end py ----------
tool_7 = Data(filter)
draw = PythonScript(frame=py.tcp_frame)  # -> G, C
# ---------- draw: Python ----------
import Rhino.Geometry as rg
from System.Drawing import Color

if not size:
    size = 100

if frame:
    plane = rg.Plane(rg.Point3d(*list(frame.point)), rg.Vector3d(*list(frame.xaxis)), rg.Vector3d(*list(frame.yaxis)))

    G = []
    G.append(rg.Line(plane.Origin, size * plane.XAxis))
    G.append(rg.Line(plane.Origin, size * plane.YAxis))
    G.append(rg.Line(plane.Origin, size * plane.ZAxis))
    
    C = []
    C.append(Color.FromArgb(255, 0, 0))
    C.append(Color.FromArgb(0, 255, 0))
    C.append(Color.FromArgb(0, 0, 255))
# ---------- end draw ----------
tool_8 = ClusterOutput(tool_7)
preview = CustomPreview(Geometry=draw.G, Shader=draw.C)
preview_2 = CustomPreview(Geometry=py.model, Shader=ColourSwatch(SwatchColor=RGB(141, 170, 178)))

# ==== cluster Send
script = ClusterInput()
send = ClusterInput()
send_2 = PythonScript(script=script, send=send)  # -> out
# ---------- send_2: Python ----------
import socket
from scriptcontext import sticky as st

ur_ip = st["ur_ip"]
ur_port = 30002

if send:
    s = socket.create_connection((ur_ip, ur_port), timeout=0.5) 
    s.send(script)
    s.close()
# ---------- end send_2 ----------
out = ClusterOutput(send_2)

# ==== cluster Draw
size = ClusterInput()
frame = ClusterInput()
draw = PythonScript(frame=frame, size=size)  # -> G, C
# ---------- draw: Python ----------
import Rhino.Geometry as rg
from System.Drawing import Color

if not size:
    size = 100

if frame:
    
    plane = rg.Plane(rg.Point3d(*frame.point), rg.Vector3d(*frame.xaxis), rg.Vector3d(*frame.yaxis))

    G = []
    G.append(rg.Line(plane.Origin, size * plane.XAxis))
    G.append(rg.Line(plane.Origin, size * plane.YAxis))
    G.append(rg.Line(plane.Origin, size * plane.ZAxis))
    
    C = []
    C.append(Color.FromArgb(255, 0, 0))
    C.append(Color.FromArgb(0, 255, 0))
    C.append(Color.FromArgb(0, 0, 255))
# ---------- end draw ----------
G = ClusterOutput(draw.G)
C = ClusterOutput(draw.C)

# ==== cluster Tool
breps = ClusterInput()
meshes = ClusterInput()
meshes_2 = Mesh(meshes)
xline = ClusterInput()
yline = ClusterInput()
mjoin = MeshJoin(Meshes=meshes_2)
tool = PythonScript(meshes=mjoin, breps=breps, xline=xline, yline=yline)  # -> tool; inputs meshes: list of Mesh, breps: list of Brep
# ---------- tool: Python ----------
import Rhino.Geometry as rg
from compas.geometry import Frame
from ur_online_control.ur.tool import Tool
from compas.datastructures import Mesh
from compas_rhino.helpers import mesh_from_guid

xaxis = rg.Line(xline.PointAtStart, xline.PointAtEnd)
yaxis = rg.Line(yline.PointAtStart, yline.PointAtEnd)

if xaxis.From.DistanceTo(yaxis.From) < 0.01:
    origin = xaxis.From
    xaxis = xaxis.Direction
    yaxis = yaxis.Direction
elif xaxis.To.DistanceTo(yaxis.To) < 0.01:
    origin = xaxis.To
    xaxis = -xaxis.Direction
    yaxis = -yaxis.Direction
elif xaxis.From.DistanceTo(yaxis.To) < 0.01:
    origin = xaxis.From
    xaxis = xaxis.Direction
    yaxis = -yaxis.Direction
elif xaxis.To.DistanceTo(yaxis.From) < 0.01:
    origin = xaxis.To
    xaxis = -xaxis.Direction
    yaxis = yaxis.Direction

xaxis.Unitize()
yaxis.Unitize()

print origin
print xaxis
print yaxis

tcp_frame = Frame(origin, xaxis, yaxis)

tool = Tool(tcp_frame)
tool.model = [mesh_from_guid(Mesh, mesh) for mesh in meshes]
#tool.model_xyz = tool.model.xyz
tool.breps = breps
# ---------- end tool ----------
tool_2 = ClusterOutput(tool)

# ==== cluster Tool_2
breps = ClusterInput()
meshes = ClusterInput()
meshes_2 = Mesh(meshes)
mjoin = MeshJoin(Meshes=meshes_2)
xline = ClusterInput()
yline = ClusterInput()
tool = PythonScript(meshes=mjoin, breps=breps, xline=xline, yline=yline)  # -> tool; inputs meshes: list of Mesh, breps: list of Brep; same code as tool
tool_2 = ClusterOutput(tool)
