# Grasshopper definition BeamClassImplementation.gh (Grasshopper 1.0.4)
# plug-ins: Python Interpreter

pt = ConstructPoint(XCoordinate=Slider(-0.142, range=-1..1), YCoordinate=Slider(0.248, range=-1..1), ZCoordinate=Slider(-0.248, range=-1..1))
pt_2 = ConstructPoint(XCoordinate=Slider(-0.142, range=-1..1), YCoordinate=Slider(0.248, range=-1..1), ZCoordinate=Slider(-0.248, range=-1..1))
number_slider = Slider(300, range=0..2000)
number_slider_2 = Slider(40, range=0..200)
number_slider_3 = Slider(10, range=0..200)
number_slider_4 = Slider(24, range=0..50)
number_slider_5 = Slider(600, range=0..1000)
pt_3 = Point(Point(-349.5694096, 492.4950717, 0))
line = Line()
pt_4 = Point(Point(0, 0, 0))
xy = XYPlane(Origin=Point(0, 0, 0))
pl = PlaneNormal(Origin=pt_3, ZAxis=pt)
pl_2 = PlaneNormal(Origin=pt_4, ZAxis=pt_2)
crv = Curve([<curve referenced from the Rhino model> x3])
brep = Brep(<brep referenced from the Rhino model>)
line_script_gen = PythonScript(origin_plane=pl, o_2=pl_2, size_x=number_slider, size_y=number_slider_2, size_z=number_slider_3)  # -> out, a, b, c, line_repr; inputs origin_plane: Plane, o_2: Plane, size_x: Int32, size_y: Int32, size_z: Int32
# ---------- line_script_gen: Python ----------
'''
Created on 07.01.2019
update by Wenqian157 14.01.2019

@author: jennyd, JonasWard, Wenqian157
'''

import Rhino.Geometry as rg
import math as m
# import rhinoscriptsyntax as rs

class SimpleDowel(object):
    # simple dowel class for Timner Assemblies

    def __init__(self, line, rod_d):
        self.r = rod_d / 2
        self.d = rod_d
        self.line = line

        self.safety_l = 1.0

    def placement_frame_gen(self):
        start_pt = self.line.PointAt(0.0)
        end_pt = self.line.PointAt(1.0)
        frame_normal = rg.Vector3d(end_pt - start_pt)

        self.base_pl = rg.Plane(start_pt, frame_normal)
        self.top_pl = rg.Plane(end_pt, frame_normal)

    def brep_representation(self):
        flat = rg.PipeCapMode.Flat
        brep = rg.Brep.CreatePipe(rg.LineCurve(self.line), self.rod_r, False, flat, False, .01, .01)
        return brep

class SimpleBeam(object):
    # simple beam class for Timber Assemblies

    def __init__(self, o_plane, s_x = 1500, s_y = 20, s_z = 40):
        self.o_plane = o_plane
        self.size_x = s_x
        self.size_y = s_y
        self.size_z = s_z

        # statement to indicate that no intersections have been calculated yet
        self.intersections_calculated = False
        # statement to indicate that there are no wrongly place holes
        self.bad_points = True

    def interval_gen(self, range, offset = 0):
        value = range * .5 - offset
        return rg.Interval(-value, value)

    def generate_box(self, plane = 0):
        if (plane == 0):
            plane = self.o_plane

        self.x_int = self.interval_gen(self.size_x)
        self.y_int = self.interval_gen(self.size_y)
        self.z_int = self.interval_gen(self.size_z)
        local_box = rg.Box(plane, self.x_int, self.y_int, self.z_int)
        return local_box

    def beam_line_intersection(self, dowels, coll_off_w = 0, coll_off_l = 0):
        # generating the top & bottom plane of a beam
        self.top_pl, self.bot_pl = rg.Plane(self.o_plane), rg.Plane(self.o_plane)
        move_up = rg.Vector3d(self.o_plane.Normal)
        move_down = rg.Vector3d(self.o_plane.Normal)
        move_up *= .5 * self.size_z
        move_down *= - .5 * self.size_z
        self.top_pl.Translate(move_up)
        self.bot_pl.Translate(move_down)

        # setting up global variables
        self.top_pts, self.bot_pts, self.dowel_ds = [], [], []
        self.local_int_lines = []

        for dowel in dowels:
            line = dowel.line
            r = dowel.r

            temp, top_pt_p = rg.Intersect.Intersection.LinePlane(line, self.top_pl)
            temp, bot_pt_p = rg.Intersect.Intersection.LinePlane(line, self.bot_pl)

            # implementing a scale_up to the geometry to allow for full overlap
            # with the bottom & top plane
            center_pt = rg.Point3d(top_pt_p - bot_pt_p) / 2

            normal = self.o_plane.normal
            vector = rg.Vector3d(top_pt_p - bot_pt_p)
            alfa = m.pi / 2 - rg.Vector3d(vector, normal)
            local_l = self.size_z + r / m.tan(alfa) + self.safety_l

            self.dowel_ds.append(r)
            self.top_pts.append(line.PointAt(top_pt_p))
            self.bot_pts.append(line.PointAt(bot_pt_p))
            self.local_int_lines.append(rg.Line(line.PointAt(top_pt_p),line.PointAt(bot_pt_p)))

        # indicating that the intersections have been calculated
        self.intersections_calculated = True

    def beam_line_intersection_collision(self, coll_off_w = 0, coll_off_l = 0):
        if (self.intersections_calculated):
            x_rec_int = self.interval_gen(self.size_x, coll_off_w)
            y_rec_int = self.interval_gen(self.size_y, coll_off_l)
            rec_up = rg.Rectangle3d(self.o_plane, x_rec_int, y_rec_int)
            rec_down = rg.Rectangle3d(self.o_plane, x_rec_int, y_rec_int)

            for top_pt in self.top_pts:
                value = rec_up.Contains(top_pt, self.top_pl)
                if (value == 2 or value == 0):
                    break
            else:
                self.bad_points = True
            for bot_pt in self.bot_pts:
                value = rec_down.Contains(bot_pt, self.bot_pl)
                if (value == 2 or value == 0):
                    break
            else:
                self.bad_points = True
        else:
            print "beam_line_intersection_collision requires some intersections"

    def beam_dowel_gen(self):
        pass

    def transform_to_other_plane(self, other_plane):
        self.transform_plane = other_plane
        trans = rg.Transform.PlaneToPlane(self.o_plane, other_plane)
        self.lines_transformed = []
        for line in self.local_int_lines:
            line_transformed = rg.LineCurve(line)
            line_transformed.Transform(trans)
            self.lines_transformed.append(line_transformed)

    def brep_subtraction(self, holes, plane = 0):
        if (plane == 0):
            plane = self.o_plane

        self.brep_repr = self.generate_box(plane)
        for hole in holes:
            self.brep_repr = rg.Brep.CreateBooleanDifference(self.brep_repr, hole, 0.1)[0]
        return box_geom

    def gen_3D_geom(self, plane = 0):
        if plane == 0:
            plane = self.o_plane

        if (plane == self.o_plane):
            if (self.intersections_calculated):
                local_box = self.generate_box(self.o_plane)
                dowel = SimpleDowel(self.lines, self.rod_ds)
                dowel_postives = self.brep_subtraction(local_box, dowels)
            else:
                return self.generate_box(self.o_plane)
        else:
            if (self.intersections_calculated):
            return self.generate_box(self.transform_plane)

test_dowels = SimpleDowel(lines, rod_d).brep_representation()

# test_beam = SimpleBeam(origin_plane, size_x, size_y, size_z)
# test_beam.beam_line_intersection(lines)
# test_beam.transform_for_robot(o_2)
#
# for_robot = []
# for_robot.append(o_2)
# for_robot.extend(test_beam.lines_transformed)
#
# for_3Dprint = []
# for_3Dprint.append(test_beam.generate_geom_for_print())
# for_3Dprint.extend(test_beam.lines_transformed)
#
# display_geom.append(test_beam.geom)
# ---------- end line_script_gen ----------
line_script_gen_2 = PythonScript(
    origin_plane=pl,
    o_2=pl_2,
    size_x=number_slider,
    size_y=number_slider_2,
    size_z=number_slider_3,
    lines=line,
    rod_d=number_slider_4)  # -> out, a, b, test_box, test_dowels; inputs origin_plane: Plane, o_2: Plane, size_x: Int32, size_y: Int32, size_z: Int32, lines: Line
# ---------- line_script_gen_2: Python ----------
# snippet of code to make this python component look for it's code in the parent folder of the .gh file

import os

ghComp = ghenv.Component
ghDoc = ghComp.OnPingDocument()

file_name = "BeamClass.py"
gh_file_location = ghDoc.FilePath
parent = os.path.dirname(os.path.realpath(gh_file_location))

file_path = os.path.join(parent, file_name)
print file_path

# hacky-hacky run-fun
execfile(file_path)
# ---------- end line_script_gen_2 ----------
pt_5 = Point(Point(0, 0, 0))
pt_6 = ConstructPoint(XCoordinate=0, YCoordinate=number_slider_5, ZCoordinate=number_slider_5)
pt_7 = ConstructPoint(XCoordinate=number_slider_5, YCoordinate=0, ZCoordinate=number_slider_5)
pt_8 = ConstructPoint(XCoordinate=number_slider_5, YCoordinate=number_slider_5, ZCoordinate=0)
trim = TrimWithBreps(Curve=crv, Brep=brep)  # -> flatten(Inside), Outside
addition = Addition(A=pt_5, B=pt_6)
addition_2 = Addition(A=pt_7, B=pt_8)
item = ListItem(Index=0, Wrap=True)
item_2 = ListItem(List=trim.Inside, Index=0, Wrap=True)  # -> Item, Item1, Item2
division = Division(A=addition, B=2)
number_slider_6 = Slider(-500, range=-500..500)
division_2 = Division(A=addition_2, B=2)
ln = Line(StartPoint=pt_5, EndPoint=pt_6)
ln_2 = Line(StartPoint=pt_7, EndPoint=pt_8)
number_slider_7 = Slider(20, range=1..20)
number_slider_8 = Slider(17, range=1..20)
flip = FlipCurve(Curve=item_2.Item1)  # -> Curve, Flag
subtraction = Subtraction(A=pt_8, B=pt_7)
xz = XZPlane(Origin=Point(0, 0, 0))
subtraction_2 = Subtraction(A=pt_6, B=pt_5)
yz = YZPlane(Origin=Point(0, 0, 0))
merge = Merge(Data1=item_2.Item, Data2=flip.Curve, Data3=item_2.Item2)
divide = DivideCurve(Curve=ln, Count=10, Kinks=False)  # -> Points, Tangents, Parameters
divide_2 = DivideCurve(Curve=ln_2, Count=10, Kinks=False)  # -> Points, Tangents, Parameters
pt_9 = ConstructPoint(XCoordinate=number_slider_6, YCoordinate=number_slider_6, ZCoordinate=Slider(50, range=0..400))
xy_2 = XYPlane(Origin=Point(0, 0, 0))
loft = Loft(Curves=merge, Options={Adjust=False, Closed=False, LoftEnds=0, LoftSimp=0, LoftType=0, Rebuild=10, Refit=0.01})
ln_3 = Line(StartPoint=divide.Points, EndPoint=divide_2.Points)
rotate = Rotate(Geometry=yz, Center=Point(0, 0, 0), From=Vector(0, -1, 0), To=subtraction_2)  # -> Geometry, Transform
rotate_2 = Rotate(Geometry=yz, Center=Point(0, 0, 0), From=Vector(0, 1, 0), To=subtraction)  # -> Geometry, Transform
python = PythonScript(surface=loft, divisions_u=number_slider_7, divisions_v=number_slider_8)  # -> out, line_list, frame_list; inputs surface: Surface, divisions_u: Int32, divisions_v: Int32
# ---------- python: Python ----------
# snippet of code to make this python component look for it's code in the parent folder of the .gh file

import os

ghComp = ghenv.Component
ghDoc = ghComp.OnPingDocument()

file_name = "SurfaceManipulation.py"
gh_file_location = ghDoc.FilePath
parent = os.path.dirname(os.path.realpath(gh_file_location))

file_path = os.path.join(parent, file_name)
print file_path

# hacky-hacky run-fun
execfile(file_path)
# ---------- end python ----------
python_2 = PythonScript(surface=loft, divisions_u=number_slider_7, divisions_v=number_slider_8)  # -> out, line_list, frame_list, flatten_list_line, flatten_list_frame; inputs surface: Surface, divisions_u: Int32, divisions_v: Int32
# ---------- python_2: Python ----------
# snippet of code to make this python component look for it's code in the parent folder of the .gh file

import os

ghComp = ghenv.Component
ghDoc = ghComp.OnPingDocument()

file_name = "SurfaceHingeSystem.py"
gh_file_location = ghDoc.FilePath
parent = os.path.dirname(os.path.realpath(gh_file_location))

file_path = os.path.join(parent, file_name)
print file_path

# hacky-hacky run-fun
execfile(file_path)
# ---------- end python_2 ----------
move = Move(Geometry=xy_2, Motion=pt_9)  # -> Geometry, Transform
move_2 = Move(Geometry=rotate.Geometry, Motion=division)  # -> Geometry, Transform
move_3 = Move(Geometry=rotate_2.Geometry, Motion=division_2)  # -> Geometry, Transform
geo = Geometry(python.line_list)
line_script_gen_3 = PythonScript(
    origin_plane=python_2.flatten_list_frame,
    o_2=pl_2,
    size_x=Slider(1200, range=0..2000),
    size_y=Slider(120, range=0..200),
    size_z=Slider(40, range=0..200),
    lines=ln_3,
    rod_d=number_slider_4,
    drill_plane=move.Geometry)  # -> out, a, b, test_box, test_box_1, test_box_0_lines, test_box_pts_top, test_box_pts_bot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; inputs origin_plane: list of Plane, o_2: Plane, size_x: Int32, size_y: Int32, size_z: Int32, lines: list of Line, drill_plane: Plane; same code as line_script_gen_2
panel = Panel(python_2.out)
line_script_gen_4 = PythonScript(
    origin_plane=[move_3.Geometry, move_2.Geometry],
    o_2=pl_2,
    size_x=number_slider,
    size_y=number_slider_2,
    size_z=number_slider_3,
    lines=ln_3,
    rod_d=number_slider_4,
    drill_plane=move.Geometry)  # -> out, a, b, test_box, test_box_1, test_box_0_lines, test_box_pts_top, test_box_pts_bot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; inputs origin_plane: list of Plane, o_2: Plane, size_x: Int32, size_y: Int32, size_z: Int32, lines: list of Line, drill_plane: Plane; same code as line_script_gen_2
brep_2 = Brep(line_script_gen_3.test_box)
ln_4 = Line(StartPoint=line_script_gen_4.test_box_pts_top, EndPoint=line_script_gen_4.test_box_pts_bot)
panel_2 = Panel(line_script_gen_3.out)
brep_3 = Brep(line_script_gen_4.test_box_1)
pt_10 = Point()
brep_4 = Brep(line_script_gen_4.boxes_top)
line_2 = Line(line_script_gen_4.test_box_0_lines)
panel_3 = Panel(line_script_gen_4.out)
