# Grasshopper definition template_eleni.gh (Grasshopper 1.0.7)
# plug-ins: LunchBox

vector_xyz = VectorXYZ(XComponent=0, YComponent=0, ZComponent=1)  # -> Vector, Length
point = Point(<point referenced from the Rhino model>)
plane_normal = PlaneNormal(Origin=point, ZAxis=vector_xyz.Vector)
z_axis = Slider(-90, range=-90..100)
y_axis = Slider(-5, range=-90..100)
move_z = Slider(90, range=-50..100)
x_axis = Slider(-10, range=-90..100)
move_y = Slider(-80, range=-200..1000)
move_x = Slider(500, range=0..1000)
Z = UnitZ(Factor=move_z)
X = UnitX(Factor=1)
pt = ConstructPoint(XCoordinate=0, YCoordinate=0, ZCoordinate=0)
Y = UnitY(Factor=1)
srf = Surface(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)
rot3d = Rotate3D(Geometry=srf, Angle=degrees(z_axis), Center=pt, Axis=X)  # -> Geometry, Transform
rot3d_2 = Rotate3D(Geometry=rot3d.Geometry, Angle=degrees(y_axis), Center=pt, Axis=Y)  # -> Geometry, Transform
rot3d_3 = Rotate3D(Geometry=rot3d_2.Geometry, Angle=degrees(x_axis), Center=Point(0, 0, 0), Axis=X)  # -> Geometry, Transform
move = Move(Geometry=rot3d_3.Geometry, Motion=Z)  # -> Geometry, Transform
X_2 = UnitX(Factor=move_x)

# ----
# 0a
# Settings
# Check your IP address and set UR IP address
server_address = ValueList({"192.168.10.12", "192.168.10.11", "192.168.10.10", "192.168.10.2", "127.0.0.1"}, selected="192.168.10.11")
ur_ip = ValueList({"192.168.10.13", "192.168.10.11", "192.168.10.10", "127.0.0.1"}, selected="192.168.10.10")
server_port = Integer(30003)
globals = PythonScript(server_address=server_address, server_port=server_port, ur_ip=ur_ip)  # inputs server_port: Int32
# ---------- globals: Python ----------
from scriptcontext import sticky as st

st["server_address"] = server_address
st["server_port"] = server_port

st["ur_ip"] = ur_ip
# ---------- end globals ----------

move_2 = Move(Geometry=move.Geometry, Motion=X_2)  # -> Geometry, Transform

# ----
# Check if UR is available
ping = Button()
py = PythonScript(ip=ur_ip, ping=ping)  # -> out
# ---------- py: Python ----------
from scriptcontext import sticky as st
from ur_online_control.communication import is_available


guid = str(ghenv.Component.InstanceGuid)
txt_key = "txt_" + guid
if txt_key not in st:
    st[txt_key] = ""

if ping:
    
    available = is_available(ip)
    
    if available:
        st[txt_key] = "%s is up!" % ip
    else:
        st[txt_key] = "%s is down!" % ip

print st[txt_key]
# ---------- end py ----------
panel = Panel(py)

Y_2 = UnitY(Factor=move_y)
move_3 = Move(Geometry=move_2.Geometry, Motion=Y_2)  # -> Geometry, Transform
revsrf = ReverseSurfaceDirection(Surface=move_3.Geometry, ReverseOption="3")
srf_2 = Surface(revsrf)
cluster = Cluster(surface=srf_2, srf=srf_2)  # -> number_slider_3, A, R, pln_4, line_6

bang = Button()
panel_2 = Panel("Unload libraries")
unload = PythonScript(bang=bang)
# ---------- unload: Python ----------
from compas_ghpython import unload_modules

unload_modules("compas")
unload_modules("ur_online_control")
# ---------- end unload ----------

python = GhPythonScript(
    beam_planes=cluster.pln_4,
    lengths=cluster.R,
    dowels=cluster.A,
    dowel_radius=cluster.number_slider_3,
    dowels_lines=cluster.line_6)  # -> out, safe_planes, top_planes, bottom_planes, beam_breps, original_beam_breps, placing_planes, beam_lengths; inputs beam_planes: list of Plane, lengths: list, dowels: list of Brep, dowels_lines: list of Line
# ---------- python: Python ----------
import Rhino.Geometry as rg
import rhinoscriptsyntax as rs
from geometry.beam import Beam
from geometry.dowel import Dowel
from geometry.hole import Hole

beams = []
pipes = []
# feed beam planes
for beam_plane, dx in zip(beam_planes,lengths):

    # create an instance of beam class
    beam = Beam(beam_plane, dx, dy=10, dz=4)
    cutters = []
    for d, brep in zip(dowels_lines,dowels): 
        if rs.IntersectBreps(beam.brep_representation() ,brep, 0.0000001) == None:
            print "False"
        else:
            print "True"
            dowel = Dowel(None, d, dowel_radius, None)
            pipes.append(dowel.get_dowel_pipe())
            cutters.append(dowel)
    for c in cutters:
        beam.add_dowel(c)
        print cutters

    beams.append(beam)

original_beam_breps = [b.brep_representation() for b in beams] # this is just to visualize for us

# get placing planes
placing_planes = [b.base_plane for b in beams]

# get beam lengths
beam_lengths = []
for b in beams:
    beam_line = b.get_baseline()
    beam_length = beam_line.Length
    beam_lengths.append(beam_length)

# get planes and brep(s)
safe_planes, top_planes, bottom_planes, beam_breps = Hole.get_tool_planes_as_tree(beams, target_plane=rg.Plane.WorldXY, safe_buffer=2, safe_plane_diff=100)
# ---------- end python ----------
drill_bit_length = Slider(18.5, range=0..30)

# ---- group: Robot
# 1. load robot model
# 2. set tool
# 3. set basis
list = ValueList({"measurement_tool": 0, "drill_tool": 1, "gripper_tool": 2}, selected="gripper_tool")
tools = Tools(tool_id=list, drill_bit_length=drill_bit_length)
base = PythonScript()  # -> base_frame
# ---------- base: Python ----------
from compas.geometry import Frame

#origin = [414.42, -207.44, 82.62]
#xaxis = [0.00000, 1.00000, 0.00000]
#yaxis = [-1.00000, 0.00000, 0.00000]

#origin = [414.40, -206.7, 82.62]
#xaxis = [0.00000, 1.00000, 0.00000]
#yaxis = [-1.00000, 0.00000, 0.00000]

origin = [415.10, -206.7, 82.62]
xaxis = [0.00000, 1.00000, 0.00000]
yaxis = [-1.00000, 0.00000, 0.00000]


base_frame = Frame(list(origin), list(xaxis), list(yaxis))
# ---------- end base ----------
list_2 = ValueList({"UR5", "UR10"}, selected="UR5")
robot = PythonScript(model=list_2, tool=tools, base_frame=base)  # -> robot
# ---------- robot: Python ----------
from ur_online_control.ur.ur10 import UR10
from ur_online_control.ur.ur5 import UR5
from scriptcontext import sticky as st

if model == "UR5":
    robot = UR5()
elif model == "UR10":
    robot = UR10()

if tool:
    robot.set_tool(tool)
if base_frame:
    robot.set_base(base_frame)

st["robot"] = robot
# ---------- end robot ----------

# ---- group: beams while drilling
brep = Brep(python.original_beam_breps)
preview = CustomPreview(Geometry=brep, Material=ColourSwatch(SwatchColor=RGB(191, 89, 255)))

# ----
pln = Plane(python.safe_planes)
pln_2 = Plane(python.top_planes)
pln_3 = Plane(python.bottom_planes)

# ---- group: placing plane
geo = Geometry(flatten(python.placing_planes))

# ---- group: beam length
num = Number(flatten(python.beam_lengths))

# ---- group: drill_safety_plane
geo_2 = Geometry(pln)

# ---- group: start_drill_plane
geo_3 = Geometry(pln_2)

# ---- group: end_drill_plane
geo_4 = Geometry(pln_3)

# ----
py_2 = PythonScript()  # -> path
# ---------- py_2: Python ----------
import sys
import os

ghComp = ghenv.Component
ghDoc = ghComp.OnPingDocument()

# the full path of the gh file
path = ghDoc.FilePath
# the directory of the gh file
path = os.path.dirname(path)

path = os.path.abspath(os.path.join(path, ".."))

print path
# ---------- end py_2 ----------
# 1
# Executing
panel_3 = Panel("Start communication server")
start = Button()
panel_4 = Panel(py_2)
server = PythonScript(path=panel_4, start=start)
# ---------- server: Python ----------
import os
import threading
from scriptcontext import sticky as st

server_address = st["server_address"]
server_port = st["server_port"]
ur_ip = st["ur_ip"]

"""
Change main!!!!
"""
main = os.path.join(path, "communication", "main_dowel_gripping_v1.py")

if os.path.isfile(main):
        
    def myfunc():
        syscall = "python %s %s %s %s" % (main, server_address, server_port, ur_ip)
        os.system(syscall)
    
    if start:
        t = threading.Thread(target=myfunc)
        t.start()
# ---------- end server ----------

panel_5 = Panel(num)
speed = Slider(300, range=0..300)

panel_6 = Panel("Get UR connected")
ur = PythonScript(send=start)
# ---------- ur: Python ----------
from scriptcontext import sticky as st
from ur_online_control.ur_driver import URDriver

server_address = st["server_address"]
server_port = st["server_port"]
ur_ip = st["ur_ip"]
robot = st["robot"]

tool_angle_axis = list(robot.tool.tcp_frame.point) + robot.tool.tcp_frame.axis_angle_vector
#robot.tool.tcp_frame.pose_axis_angle_vector
print tool_angle_axis

ur_driver = URDriver(server_address, server_port, tool_angle_axis, ur_ip, "UR")
print ur_driver

if send:
    ur_driver.send()
# ---------- end ur ----------

disconnect = Button()
panel_7 = Panel("Get Grasshopper connected")
client = PythonScript(connect=start, disconnect=disconnect)  # -> connected, client
# ---------- client: Python ----------
import time
from scriptcontext import sticky as st
from Rhino.RhinoApp import WriteLine
from ur_online_control.grasshopper import GHClient, gh_component_timer
import time

server_address = st["server_address"]
server_port = st["server_port"]

guid = str(ghenv.Component.InstanceGuid)

client_key = "client_" + guid
run_key = "run_" + guid

if connect:
    if client_key not in st:
        st[client_key] = GHClient(server_address, server_port)
        client = st[client_key]
        client.connect_to_server()
        client.start()
        
    else:
        if st[client_key].running:
            WriteLine("Client is already connected.")
            
        else:
            st[client_key] = GHClient(server_address, server_port)
            client = st[client_key]
            client.connect_to_server()
            client.start()
"""
else:
    if client_key in st:
        # we need a timer to ask if we have something on the rcv queue
        client = st[client_key]
        #if client.running:
        #    #client.run_inner_while()
        #    gh_component_timer(ghenv, True, 1000)
"""

if disconnect:
    if client_key in st:
        client = st[client_key]
        if client.running:
            client.close()

if client_key in st:
    connected =  st[client_key].running
    client = st[client_key]
    print st[client_key].rcv_queue.qsize()
    print st[client_key].snd_queue.qsize()
else:
    connected = False
# ---------- end client ----------
panel_8 = Panel(client.connected)

bang_2 = Button()

bang_3 = Button()
receive = PythonScript(client=client.client, bang=bang_3)  # -> qsize, client
# ---------- receive: Python ----------
from ur_online_control.communication.msg_identifiers import *
from ur_online_control.utilities.lists import flatten_list
from Rhino.RhinoApp import WriteLine


if client:
    if not client.ghenv:
        client.ghenv = ghenv
    qsize = client.rcv_queue.qsize()
# ---------- end receive ----------
panel_9 = Panel(receive.qsize)

receive_2 = PythonScript(client=client.client, bang=bang_2)  # -> qsize, client; same code as receive
panel_10 = Panel(receive_2.qsize)
send = PythonScript(client=receive.client)  # -> out
# ---------- send: Python ----------
from ur_online_control.communication.msg_identifiers import *
from ur_online_control.utilities.lists import flatten_list

if client:
    qsize = client.rcv_queue.qsize()
    if qsize:
        msg = client.rcv_queue.get()
        print msg
# ---------- end send ----------
panel_11 = Panel(send)
send_2 = PythonScript(client=receive_2.client)  # -> out; same code as send
panel_12 = Panel(send_2)

# ----
# Direct UR control
get = Button()
get_2 = Button()
pose = PythonScript(get=get_2)  # -> pose_joints
# ---------- pose: Python ----------
from scriptcontext import sticky as st
from ur_online_control.ur_direct import get_current_pose_joints
from ur_online_control.ur.robot import BaseConfiguration

server_address = st["server_address"]
server_port = 30005
ur_ip = st["ur_ip"]
robot = st["robot"]
tool_angle_axis = list(robot.tool.tcp_frame.point) + robot.tool.tcp_frame.axis_angle_vector
print tool_angle_axis

guid = str(ghenv.Component.InstanceGuid)
pose_joints_key = "pose_joints" + guid


if get:
    st[pose_joints_key] = get_current_pose_joints(server_address, server_port, ur_ip, tool_angle_axis)
    
if pose_joints_key not in st:
    pose_joints = []
else:
    pose_joints = BaseConfiguration.from_joints(st[pose_joints_key])
# ---------- end pose ----------
pose_2 = PythonScript(get=get)  # -> pose_cartesian
# ---------- pose_2: Python ----------
from scriptcontext import sticky as st
from ur_online_control.ur_direct import get_current_pose_cartesian

server_address = st["server_address"]
server_port = 30005
ur_ip = st["ur_ip"]
robot = st["robot"]
tool_angle_axis = list(robot.tool.tcp_frame.point) + robot.tool.tcp_frame.axis_angle_vector
print tool_angle_axis

guid = str(ghenv.Component.InstanceGuid)
pose_cartesian_key = "pose_cartesian" + guid


if get:
    st[pose_cartesian_key] = get_current_pose_cartesian(server_address, server_port, ur_ip, tool_angle_axis)

if pose_cartesian_key not in st:
    pose_cartesian = []
else:
    pose_cartesian = st[pose_cartesian_key]
# ---------- end pose_2 ----------
stop = Button()
stop_2 = PythonScript(stop=stop)
# ---------- stop_2: Python ----------
from scriptcontext import sticky as st
from ur_online_control.ur_direct import stop as stop_robot

ur_ip = st["ur_ip"]

if stop:
    stop_robot(ur_ip)
# ---------- end stop_2 ----------
panel_13 = Panel(pose)
panel_14 = Panel(pose_2)

vertical_pose = Number([-152.427, -780.635, 855.229, -1.1958, -1.22046, -1.20201])
py_3 = PythonScript(pose_cartesian=pose_2)  # -> frame_WCS; inputs pose_cartesian: list
# ---------- py_3: Python ----------
import Rhino.Geometry as rg
from scriptcontext import sticky as st
from compas.geometry import Frame
from compas.geometry.xforms import Transformation

robot = st["robot"]



if pose_cartesian:
    frame_RCS = Frame.from_axis_angle_vector(pose_cartesian)
    frame_WCS = robot.get_frame_in_WCS(frame_RCS)
# ---------- end py_3 ----------
draw = Draw(frame=py_3)  # -> G, C
back = Button()
reset = Button()

# ---- group: Define joint positions
base_2 = Slider(-173.869, range=-360..360)
elbow = Slider(90.765, range=-360..360)
wrist2 = Slider(-82.725, range=-360..360)
wrist3 = Slider(91.571, range=-360..360)
shoulder = Slider(-72.967, range=-360..360)
wrist1 = Slider(-115.737, range=-360..360)
ur1_q1_q6 = Data([base_2, shoulder, elbow, wrist1, wrist2, wrist3])

# ----
preview_2 = CustomPreview(Geometry=draw.G, Shader=draw.C)
py_4 = GhPythonScript(joint_values=ur1_q1_q6)  # -> configuration; inputs joint_values: list
# ---------- py_4: Python ----------
import math
from ur_online_control.ur.robot import BaseConfiguration

configuration = BaseConfiguration.from_joints([math.radians(d) for d in joint_values])
# ---------- end py_4 ----------

# ----
# Calculate basis
# Measure basis:
# 1. Clear the recorded poses
# 2. Move robot to origin and press "get pose"
# 3. Move robot to point in positive x-axis and press "get pose"
# 4. Move robot to an other point in your basis and press "get pose"
# (The farer away these positions are, the better)
# 
# 5. Alternatively change the order in the component calc base
# 6. Copy output into base component
list_3 = ValueList({"origin, pt on positive x-axis, pt in xy plane": 0, "origin, pt on positive y-axis, pt in xy plane": 1}, selected="origin, pt on positive x-axis, pt in xy plane")
clear = Button()
rec = PythonScript(msg=pose_2, rec=get, clear=clear)  # -> rec; inputs msg: list
# ---------- rec: Python ----------
from scriptcontext import sticky as st

guid = str(ghenv.Component.InstanceGuid)
recorded_key =  "recorded_" + guid
just_cleared_key = "just_cleared_" + guid

if recorded_key not in st:
    st[recorded_key] = []

if just_cleared_key not in st:
    st[just_cleared_key] = False

if clear:
    st[recorded_key] = []
    st[just_cleared_key] = True
else:
    if len(msg):
        if msg != [None] and not st[just_cleared_key] and rec:
            st[recorded_key].append(msg)
    st[just_cleared_key] = False
        


rec = st[recorded_key]

print rec
# ---------- end rec ----------
calc_base = PythonScript(poses=rec, input_type=list_3)  # -> out; inputs poses: list
# ---------- calc_base: Python ----------
import Rhino.Geometry as rg
import math


if len(poses) > 2:
    
    O = poses[0]
    P1 = poses[1]
    P2 = poses[2]
    
    if input_type == 0:
        # origin, pt on positive x-axis, pt in xy plane
        origin = rg.Point3d(O[0], O[1], O[2])
        pt_on_xaxis = rg.Point3d(P1[0], P1[1], P1[2])
        pt_in_xyplane = rg.Point3d(P2[0], P2[1], P2[2])
        
        xaxis = pt_on_xaxis - origin
        xaxis.Unitize()
        
        v = pt_in_xyplane - origin
        zaxis = rg.Vector3d.CrossProduct(v, xaxis)
        zaxis.Unitize()
        
        # zaxis must look up!
        if math.acos(rg.Vector3d.ZAxis * zaxis) > math.acos(rg.Vector3d.ZAxis * -zaxis):
            zaxis = -zaxis
        
        yaxis = rg.Vector3d.CrossProduct(zaxis, xaxis)
    
    elif input_type == 1:
        # origin, pt on positive y-axis, pt in xy plane
        origin = rg.Point3d(O[0], O[1], O[2])
        pt_on_yaxis = rg.Point3d(P1[0], P1[1], P1[2])
        pt_in_xyplane = rg.Point3d(P2[0], P2[1], P2[2])
        
        yaxis = pt_on_yaxis - origin
        yaxis.Unitize()
        
        v = pt_in_xyplane - origin
        zaxis = rg.Vector3d.CrossProduct(v, yaxis)
        zaxis.Unitize()
        
        # zaxis must look up!
        if math.acos(rg.Vector3d.ZAxis * zaxis) > math.acos(rg.Vector3d.ZAxis * -zaxis):
            zaxis = -zaxis
        
        xaxis = rg.Vector3d.CrossProduct(yaxis, zaxis)
        
        
    print "Copy the following into base component:"
    print " "
    print "origin = [%.2f, %.2f, %.2f]" % tuple(list(origin))
    print "xaxis = [%.5f, %.5f, %.5f]" % tuple(list(xaxis))
    print "yaxis = [%.5f, %.5f, %.5f]" % tuple(list(yaxis))
    

#print rg.Vector3d.CrossProduct(rg.Vector3d.YAxis, rg.Vector3d.ZAxis)
#print rg.Vector3d.CrossProduct(rg.Vector3d.ZAxis, rg.Vector3d.XAxis)
# ---------- end calc_base ----------
panel_15 = Panel(rec)
panel_16 = Panel(calc_base)

# ---- group: Visualise / robot model brep
py_5 = PythonScript(model=list_2)  # -> n
# ---------- py_5: Python ----------
if model == "UR5":
    n = 0
if model == "UR10":
    n = 1

print n
# ---------- end py_5 ----------
ur10_brep = UR10Brep([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])
ur5_brep = UR5Brep([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])
show_brep = BooleanToggle(False)
filter = StreamFilter(Gate=py_5, Stream0=ur5_brep, Stream1=ur10_brep)

# ---- group: Send joint position directly to robot
panel_17 = Panel("move cartesian")
idx = Slider(0, range=0..100)
commands = Data([-0.7378762823, -1.645309655, 1.740348054, -0.3678008479, -0.3738495375, -0.1107411527])
item = ListItem(List=commands, Index=idx, Wrap=True)
list_4 = ValueList({"send all positions": 0, "send only one position": 1}, selected="send only one position")
filter_2 = StreamFilter(Gate=list_4, Stream0=commands, Stream1=item)
movel = PythonScript(commands=filter_2, velocity=Slider(100, range=0..100))  # -> script; inputs commands: list
# ---------- movel: Python ----------
from scriptcontext import sticky as st

script_lines = []
for cmd in commands:
    #q, a=1.4, v=1.05, t=0, r=0)
    x, y, z, ax, ay, az, speed, radius = cmd
    script_lines.append("movel(p%s, v=%f, r=%f)" % (str([x/1000., y/1000., z/1000, ax, ay, az]), speed/1000., radius/1000.))

robot = st["robot"]
tool_angle_axis = list(robot.tool.tcp_frame.point) + robot.tool.tcp_frame.axis_angle_vector
x, y, z, ax, ay, az = tool_angle_axis

script = "def prog():\n"
script += "\ttextmsg(\">> program start\")\n"
script += "\tset_tcp(p%s)\n" % str([x/1000., y/1000., z/1000, ax, ay, az])
script += "".join(["\t%s\n" % line for line in script_lines])
script += "\ttextmsg(\"<< program end\")\n"
script += "end\n"
script += "prog()\n\n"

print script
# ---------- end movel ----------
send_3 = Button()
send_4 = Send(script=movel, send=send_3)
panel_18 = Panel(send_4)

# ----
panel_19 = Panel("move vertical")
movel_2 = PythonScript()  # -> script
# ---------- movel_2: Python ----------
from scriptcontext import sticky as st

robot = st["robot"]
tool_angle_axis = list(robot.tool.tcp_frame.point) + robot.tool.tcp_frame.axis_angle_vector
x, y, z, ax, ay, az = tool_angle_axis

script = "def prog():\n"
script += "\ttextmsg(\">> program start\")\n"
script += "\tset_tcp(p%s)\n" % str([x/1000., y/1000., z/1000, ax, ay, az])
script += "\tcurrent_pose = get_forward_kin()\n"
script += "\tmovel(p[current_pose[0], current_pose[1], current_pose[2], 0, 0, 0], a=0.1, v=0.1)\n"
script += "\ttextmsg(\"<< program end\")\n"
script += "end\n"
script += "prog()\n\n"

print script
# ---------- end movel_2 ----------
send_5 = Button()
send_6 = Send(script=movel_2, send=send_5)
panel_20 = Panel(send_6)

panel_21 = Panel("set digital out")
number = Slider(0, range=0..10)
value = BooleanToggle(False)
digital_out = PythonScript(number=number, value=value)  # -> script; inputs number: Int32, value: Boolean
# ---------- digital_out: Python ----------
script = "def prog():\n"
script += "\ttextmsg(\">> program start\")\n"
script += "\tset_digital_out(%i, %s)\n" % (int(number), str(value))
script += "\ttextmsg(\"<< program end\")\n"
script += "end\n"
script += "prog()\n\n"

print script
# ---------- end digital_out ----------
send_7 = Button()
send_8 = Send(script=digital_out, send=send_7)
panel_22 = Panel(send_8)

# ----
# move incremental in WCS
number_slider = Slider(10, range=-10..10)
list_5 = ValueList({"xaxis", "yaxis", "zaxis"}, selected="yaxis")
movel_3 = PythonScript(step_size=number_slider, direction=list_5)  # -> script
# ---------- movel_3: Python ----------
from scriptcontext import sticky as st

robot = st["robot"]
tool_angle_axis = list(robot.tool.tcp_frame.point) + robot.tool.tcp_frame.axis_angle_vector
x, y, z, ax, ay, az = tool_angle_axis

script = "def prog():\n"
script += "\ttextmsg(\">> program start\")\n"
script += "\tset_tcp(p%s)\n" % str([x/1000., y/1000., z/1000, ax, ay, az])
script += "\tcurrent_pose = get_forward_kin()\n"


if direction == "xaxis":
    script += "\tmovel(p[current_pose[0] + %f, current_pose[1], current_pose[2], current_pose[3], current_pose[4], current_pose[5]], t=%f)\n" % (step_size/1000., step_size * 0.1)

elif direction == "yaxis":
    script += "\tmovel(p[current_pose[0], current_pose[1] + %f, current_pose[2], current_pose[3], current_pose[4], current_pose[5]], t=%f)\n" % (step_size/1000., step_size * 0.1)

else: # direction == "zaxis":
    script += "\tmovel(p[current_pose[0], current_pose[1], current_pose[2] + %f, current_pose[3], current_pose[4], current_pose[5]], t=%f)\n" % (step_size/1000., step_size * 0.1)

script += "\ttextmsg(\"<< program end\")\n"
script += "end\n"
script += "prog()\n\n"

print script
# ---------- end movel_3 ----------
send_9 = Button()
send_10 = Send(script=movel_3, send=send_9)
panel_23 = Panel(send_10)

# ----
# move incremental in TCS
get_current_pose = Button()
list_6 = ValueList({"xaxis", "yaxis", "zaxis"}, selected="zaxis")
movel_4 = PythonScript(get=get_current_pose, step_size=Slider(50, range=-10..50), direction=list_6)  # -> script; inputs get: list
# ---------- movel_4: Python ----------
from scriptcontext import sticky as st
from compas.geometry import Frame
from compas.geometry import Point, Vector
from ur_online_control.ur_direct import get_current_pose_cartesian

server_address = st["server_address"]
server_port = 30005
ur_ip = st["ur_ip"]
robot = st["robot"]
tool_angle_axis = list(robot.tool.tcp_frame.point) + robot.tool.tcp_frame.axis_angle_vector
print tool_angle_axis

guid = str(ghenv.Component.InstanceGuid)
pose_cartesian_key = "pose_cartesian" + guid

if get:
    st[pose_cartesian_key] = get_current_pose_cartesian(server_address, server_port, ur_ip, tool_angle_axis)

if pose_cartesian_key not in st:
    pose_cartesian = []
    script = ""
else:
    pose_cartesian = st[pose_cartesian_key]

    robot = st["robot"]
    tool_angle_axis = list(robot.tool.tcp_frame.point) + robot.tool.tcp_frame.axis_angle_vector
    x, y, z, ax, ay, az = tool_angle_axis
    
    script = "def prog():\n"
    script += "\ttextmsg(\">> program start\")\n"
    script += "\tset_tcp(p%s)\n" % str([x/1000., y/1000., z/1000, ax, ay, az])
    script += "\tcurrent_pose = get_forward_kin()\n"
    
#    frame = Frame.from_pose_axis_angle_vector(pose_cartesian)
    frame = Frame.from_axis_angle_vector([ax, ay, az])
    frame.point = [x, y, z]

    if direction == "xaxis":
        next_vector = Vector(*frame.xaxis) * step_size
    elif direction == "yaxis":
        next_vector = Vector(*frame.yaxis) * step_size
    else: # direction == "zaxis":
        next_vector = Vector(*frame.zaxis) * step_size
    
    x, y, z = next_vector
    script += "\tmovel(p[current_pose[0] + %f, current_pose[1] + %f, current_pose[2] + %f, current_pose[3], current_pose[4], current_pose[5]], t=%f)\n" % (x/1000., y/1000., z/1000., step_size * 0.1)
    
    script += "\ttextmsg(\"<< program end\")\n"
    script += "end\n"
    script += "prog()\n\n"
    
    print script
# ---------- end movel_4 ----------
send_11 = Button()
send_12 = Send(script=movel_4, send=send_11)
panel_24 = Panel(send_12)

# ---- group: picking plane
number_slider_2 = Slider(60.7, range=0..100)

# ----
neg = Negative(Value=number_slider_2)

# ---- group: picking plane (continued)
pt_2 = ConstructPoint(XCoordinate=Slider(251, range=0..1000), YCoordinate=Slider(0, range=0..50), ZCoordinate=neg)

# ----
xy = XYPlane(Origin=pt_2)

# ---- group: picking_plane
geo_5 = Geometry(flatten(xy))

# ----
arrange_plane_lists = GhPythonScript(
    picking_plane=geo_5,
    drill_safety_plane=geo_2,
    start_drill_plane=geo_3,
    end_drill_plane=geo_4,
    placing_plane=geo,
    beam_lengths=num)  # -> out, plane_list, number_of_holes_list; inputs picking_plane: Plane, drill_safety_plane: tree of Plane, start_drill_plane: tree of Plane, end_drill_plane: tree of Plane, placing_plane: Plane, beam_lengths: list
# ---------- arrange_plane_lists: Python ----------
__author__ = "JesusBarney"
__version__ = "2019.01.16"

import rhinoscriptsyntax as rs
import Rhino.Geometry as rg

plane_list = []

number_of_holes_list = []

for i in range(len(drill_safety_plane.Branches)):

    plane = rg.Plane(picking_plane)
    plane.Translate(rg.Vector3d(beam_lengths[i] * 0.5, 0, 0))
    plane_list.append(plane)
    
    number_of_holes = 0
    
    for j, (d, s, e) in enumerate(zip(drill_safety_plane.Branches[i], start_drill_plane.Branches[i], end_drill_plane.Branches[i])):
        plane_list.append(d)
        plane_list.append(s)
        plane_list.append(e)
        number_of_holes = j
        
    plane_list.append(placing_plane)
    
    number_of_holes_list.append(number_of_holes + 1)
# ---------- end arrange_plane_lists ----------

# ---- group: Define commands
python_2 = PythonScript(planes_WCS=arrange_plane_lists.plane_list, dfillet=Slider(0, range=0..100), speed=speed)  # -> flatten(commands); inputs planes_WCS: list, speed: Int32
# ---------- python_2: Python ----------
import Rhino.Geometry as rg
from compas.geometry import Frame
from compas.geometry import Transformation
from compas_ghpython import xdraw_frame
from scriptcontext import sticky as st

robot = st["robot"]
buffer = 1

# TODO this must be optimized! matrix multiplication!
commands = []
for i, plane_WCS in enumerate(planes_WCS):
    tcp_WCS = Frame(plane_WCS.Origin, plane_WCS.XAxis, plane_WCS.YAxis)
    if i == 0 or i == len(planes_WCS) - 1:
        radius = 0.
        
    else:
        # calculate blend radius
        prev, current, next = planes_WCS[i-1].Origin, planes_WCS[i].Origin, planes_WCS[i+1].Origin
        radius = min((prev - current).Length/2 * buffer, (next - current).Length/2 * buffer, dfillet)
    
    tcp_RCS = robot.get_frame_in_RCS(tcp_WCS)
    
    cmd = list(tcp_RCS.point) + tcp_RCS.axis_angle_vector + [speed, radius]
    #cmd = list(tcp_RCS.point) + tcp_RCS.axis_angle_vector + [time, radius]
    commands.append(cmd)
    
    
    
print (commands)
# ---------- end python_2 ----------

# ----
continue_fabrication = BooleanToggle(False)
panel_25 = Panel("Send a message")
send_13 = Button()
drilling_commands = Data(python_2)
# 4
send_14 = PythonScript(
    client=client.client,
    send=send_13,
    continue_fabrication=continue_fabrication,
    tool=tools,
    drilling_commands=drilling_commands,
    number_of_holes_list=arrange_plane_lists.number_of_holes_list)  # -> out; inputs continue_fabrication: Int32, drilling_commands: list, number_of_holes_list: list
# ---------- send_14: Python ----------
from ur_online_control.communication.msg_identifiers import *
from ur_online_control.utilities.lists import flatten_list

len_command_drilling = len(drilling_commands[0])
commands_flattened_drilling = flatten_list(drilling_commands)

"""
sand_tool = tool
sand_tool_axis = list(sand_tool.tcp_frame.point) + sand_tool.tcp_frame.axis_angle_vector
"""
"""
vaccuum_tool = tool
vaccuum_tool_axis = list(vaccuum_tool.tcp_frame.point) + vaccuum_tool.tcp_frame.axis_angle_vector
"""
# tool settigns
tool_axis = list(tool.tcp_frame.point) + tool.tcp_frame.axis_angle_vector

### Gravel placment ###
"""
#safe_in_pose_gravel, safe_out_pose_gravel = cmd_gravel_in_out 
pose_gravel = cmd_gravel
"""

#print waiting_times
#print len(io_values)

#===================================================================================
if send and client:
    ### string_fabrication ###
    client.send(MSG_INT, int(continue_fabrication))
    client.send(MSG_FLOAT_LIST, tool_axis) ### set string_tcp ###
    client.send(MSG_INT, len_command_drilling) ### send len of each cmd ###
    client.send(MSG_FLOAT_LIST, commands_flattened_drilling) ### send cmd list ###
    client.send(MSG_FLOAT_LIST, number_of_holes_list) ### send cmd list ###

#===================================================================================
# ---------- end send_14 ----------

panel_26 = Panel(send_14)

# ----
# Visualisation
robot_2 = Data(robot)
planes_wcs = Plane(arrange_plane_lists.plane_list)
pose_joints = Data(pose)

# ---- group: Define plane in WCS, calculate joint positions
pt_3 = Point(Point(648.8632686, 624.689255, -55.48786018))
xy_2 = XYPlane(Origin=pt_3)
select_configuration = Slider(5, range=0..7)
plane_wcs = Plane(xy_2)
inverse = PythonScript(robot=robot_2, plane_WCS=plane_wcs, idx=select_configuration)  # -> configuration; inputs plane_WCS: Plane, idx: Int32
# ---------- inverse: Python ----------
import Rhino.Geometry as rg
from compas.geometry import Frame, Transformation
from compas_ghpython import xdraw_frame

tcp_WCS = Frame(plane_WCS.Origin, plane_WCS.XAxis, plane_WCS.YAxis)

# transform frame to robot coordinate system
tcp_RCS = robot.get_frame_in_RCS(tcp_WCS)

# get the frame of tool0
tool0_RCS = robot.get_tool0_frame_from_tcp_frame(tcp_RCS)

# calculate solutions to frame
solutions = robot.inverse_kinematics(tool0_RCS)

if not len(solutions):
    q = [0,0,0,0,0,0]
else:
    idx = min(len(solutions) - 1, idx)
    q = solutions[idx]
    
print q

configuration = q
# ---------- end inverse ----------

# ---- group: Calculate joint positions for path
# Add init joint states
joint_states = Data([-0.1728179112, -1.415058186, 1.813991282, -1.971940356, -1.571654205, -3.308720436])
init_configuration = Slider(2, range=0..7)
py_6 = PythonScript(robot=robot_2, planes_WCS=planes_wcs, configuration_idx=init_configuration, init_configuration=joint_states)  # -> configurations; inputs planes_WCS: list, configuration_idx: Int32, init_configuration: list
# ---------- py_6: Python ----------
from compas_ghpython import unload_modules
unload_modules('ur_online_control')
import Rhino.Geometry as rg
from compas.geometry import Frame 
from compas.geometry.xforms import Transformation
from compas_ghpython import xdraw_frame
from ur_online_control.ur.kinematics import calculate_configurations_for_path, format_joint_positions


# TODO this must be optimized! matrix multiplication!
frames_tool0_RCS = []
for plane_WCS in planes_WCS:
    tcp_WCS = Frame(plane_WCS.Origin, plane_WCS.XAxis, plane_WCS.YAxis)
    tcp_RCS = robot.get_frame_in_RCS(tcp_WCS)
    frames_tool0_RCS.append(robot.get_tool0_frame_from_tcp_frame(tcp_RCS))
    

#configurations = calculate_configurations_for_path(frames_tool0_RCS, robot.params, init_configuration)
configurations = calculate_configurations_for_path(frames_tool0_RCS, robot, init_configuration)
#print configurations
configurations = configurations[min([configuration_idx, len(configurations) - 1])]

def format(numbers, k=4):
    #numbers = format_joint_positions(numbers)
    return "[" + ", ".join([("%." + str(k) + "f") % n for n in numbers]) + "]"
# ---------- end py_6 ----------
start_2 = Button()
stop_3 = Button()
step = Button()
counter = CountThroughList(L=py_6, start=start_2, stop=stop_3, step=step, step_back=back, reset=reset, interval=100)  # -> item; inputs L: list, start: Boolean, stop: Boolean, step_back: Boolean
# ---------- counter: Python ----------
from scriptcontext import sticky as st
from compas_ghpython import update_component


# store data in component
guid = str(ghenv.Component.InstanceGuid)
counter_key = "counter_" + guid
running_key = "running_" + guid

if counter_key not in st:
    st[counter_key] = 0

if running_key not in st:
    st[running_key] = False

if start:
    st[running_key] = True

if stop:
    st[running_key] = False

if step:
    if st[counter_key] < len(L) - 1:
        st[counter_key] += 1

if step_back:
    if st[counter_key] < len(L) - 1:
        st[counter_key] -= 1

if reset:
    st[counter_key] = 0

if len(L):
    item = L[st[counter_key]]

if st[running_key]:
    if st[counter_key] < len(L) - 1:
        st[counter_key] += 1
        update_component(ghenv, interval)
    else:
        st[counter_key] = 0
        st[running_key] = False
# ---------- end counter ----------

# ---- group: Calculate joint positions for path / Shows joint positions along path
flip = BooleanToggle(True)
l2t = PythonScript(L=py_6, flip=flip)  # -> T; inputs L: list, flip: Boolean
# ---------- l2t: Python ----------
from compas_ghpython import list_to_ghtree
L = [l.joint_values for l in L]

if flip:
    L = zip(*L)
T = list_to_ghtree(L)
# ---------- end l2t ----------
graph = QuickGraph(l2t, SortOrder=0)

# ---- group: Visualise
list_7 = ValueList({"0 forward, from angles": 0, "1 inverse, from one plane": 1, "2 inverse, from multiple planes": 2, "3 forward, from robot": 3}, selected="2 inverse, from multiple planes")
filter_3 = StreamFilter(Gate=list_7, Stream0=py_4, Stream1=inverse, Stream2=counter, Stream3=pose_joints)
configuration = Panel(filter_3)
mesh = Mesh(filter)
draw_2 = PythonScript(robot=robot_2, configuration=filter_3, mesh=mesh, brep=filter, show_brep=show_brep)  # -> meshes, tool0_plane, tcp_plane, robot_brep; inputs mesh: list, brep: list
# ---------- draw_2: Python ----------
from compas_ghpython import unload_modules
unload_modules("ur_online_control")

from compas_ghpython import xdraw_frame
from compas_ghpython import mesh_draw
from compas_ghpython.geometry.xforms import xform_from_transformation
from compas.geometry import Frame
from compas.geometry.xforms import Transformation
from ur_online_control.ur.robot import BaseConfiguration

import Rhino.Geometry as rg
import Rhino

def mesh_update_vertices(mesh, vertices):
    for i in range(len(vertices)):
        mesh.vertex[i].update({'x': vertices[i][0], 'y': vertices[i][1], 'z': vertices[i][2]})

if configuration:
    #print configuration
    #q = BaseConfiguration.from_joints(configuration)
    q = configuration
    print q
    print q.joint_values
    
    print robot.get_forward_transformations(q)
    R0, R1, R2, R3, R4, R5 = robot.get_forward_transformations(q)
    
    tool0_frame2 = robot.tool0_frame.transformed(R5)
    tcp_frame2 = Frame.from_transformation(Transformation.from_frame(tool0_frame2) * robot.transformation_tool0_tcp)
    
    print robot.transformation_tool0_tcp
    print robot.transformation_tcp_tool0
    print robot.transformation_tool0_tcp * robot.transformation_tcp_tool0
    print tcp_frame2
    tcp_frame2 = Frame.from_transformation(Transformation.from_frame(tool0_frame2) * robot.transformation_tcp_tool0)
    print tcp_frame2
    
    tool0_frame, tcp_frame = robot.get_transformed_tool_frames(R5)
    
    tool0_frame = tool0_frame2
    tcp_frame = tcp_frame2
    
    m0, m1, m2, m3, m4, m5 = mesh
    for i in range(6):
        exec("R%drg = xform_from_transformation(R%d)" % (i, i))
        exec("m%d.Transform(R%drg)" % (i, i))
    meshes = [m0, m1, m2, m3, m4, m5]
    print meshes
    mt = robot.tool.get_transformed_model(Transformation.from_frame(tool0_frame))
    
    if mt:
        meshes.extend(map(mesh_draw, mt))
    
    """
    m0, m1, m2, m3, m4, m5, tool0_frame, tcp_frame = robot.get_transformed_model(q)
    mt = robot.get_transformed_tool_model(tcp_frame)
    
    meshes = []
    meshes.append(mesh_draw(m0))
    meshes.append(mesh_draw(m1))
    meshes.append(mesh_draw(m2))
    meshes.append(mesh_draw(m3))
    meshes.append(mesh_draw(m4))
    meshes.append(mesh_draw(m5))
    if mt:
        meshes.append(mesh_draw(mt))
    
    """
    
    tool0_plane = xdraw_frame(tool0_frame)
    tcp_plane = xdraw_frame(tcp_frame)
    
    if show_brep:
        
        b0, b1, b2, b3, b4, b5 = brep
        
        b0.Transform(R0rg)
        b1.Transform(R1rg)
        b2.Transform(R2rg)
        b3.Transform(R3rg)
        b4.Transform(R4rg)
        b5.Transform(R5rg)
        
        robot_brep = [b0, b1, b2, b3, b4, b5]
# ---------- end draw_2 ----------
tcp_plane = Plane(draw_2.tcp_plane)
tool0_plane = Plane(draw_2.tool0_plane)
robot_brep = Brep(draw_2.robot_brep)
draw_3 = RepresentPlaneAsLines(plane=tcp_plane, size=100)  # -> G, C
# ---------- draw_3: Python ----------
import Rhino.Geometry as rg
from System.Drawing import Color

if plane:

    G = []
    G.append(rg.Line(plane.Origin, size * plane.XAxis))
    G.append(rg.Line(plane.Origin, size * plane.YAxis))
    G.append(rg.Line(plane.Origin, size * plane.ZAxis))
    
    C = []
    C.append(Color.FromArgb(255, 0, 0))
    C.append(Color.FromArgb(0, 255, 0))
    C.append(Color.FromArgb(0, 0, 255))
# ---------- end draw_3 ----------
preview_3 = CustomPreview(Geometry=draw_2.meshes, Shader=ColourSwatch(SwatchColor=RGBA(99, 94, 94, 96)))
preview_4 = CustomPreview(Geometry=draw_3.G, Shader=draw_3.C)

# ----
mesh_2 = Mesh(draw_2.meshes)

# ---- group: placing plane
number_slider_3 = Slider(300, range=0..1000)

# ----
vec = VectorXYZ(XComponent=number_slider_3, YComponent=0, ZComponent=Slider(60, range=0..100))  # -> Vector, Length

# ---- group: placing plane (continued)
move_4 = Move(Geometry=xy, Motion=vec.Vector)  # -> Geometry, Transform
pln_4 = Plane(move_4.Geometry)

# ---- group: Send joint position directly to robot
idx_2 = Slider(0, range=0..100)
panel_27 = Panel("move joints")
joint_positions = Data(py_4)
list_8 = ValueList({"send all positions": 0, "send only one position": 1}, selected="send only one position")
item_2 = ListItem(List=joint_positions, Index=idx_2, Wrap=True)
filter_4 = StreamFilter(Gate=list_8, Stream0=joint_positions, Stream1=item_2)
movej = PythonScript(joint_positions=filter_4, velocity=Slider(153, range=0..200))  # -> script; inputs joint_positions: list
# ---------- movej: Python ----------
script_lines = []

for position in joint_positions:
    script_lines.append("movej(%s, v=%f)" % (str(position), velocity/1000.))


script = "def prog():\n"
script += "\ttextmsg(\">> program start\")\n"
script += "".join(["\t%s\n" % line for line in script_lines])
script += "\ttextmsg(\"<< program end\")\n"
script += "end\n"
script += "prog()\n\n"


print script

#script = ""
# ---------- end movej ----------
send_15 = Button()

# ----
send_16 = Send(script=movej, send=send_15)

# ---- group: Send joint position directly to robot (continued)
panel_28 = Panel(send_16)

# ==== cluster Tools

# ---- group: drill_tool
drill_bit_length = ClusterInput()
pt = Point(Point(0, 0, 0))
clay_modified = Geometry([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])
drill_bit_length_2 = Number(drill_bit_length)
X = UnitX(Factor=1)
Y = UnitY(Factor=-1)
brep = Brep(clay_modified)
mesh = Mesh(clay_modified)
ln = Line(StartPoint=pt, EndPoint=X)
ln_2 = Line(StartPoint=pt, EndPoint=Y)
addition = Addition(A=Slider(285, range=0..400), B=drill_bit_length_2)
Z = UnitZ(Factor=addition)
move = Move(Geometry=ln, Motion=Z)  # -> Geometry, Transform
move_2 = Move(Geometry=ln_2, Motion=Z)  # -> Geometry, Transform
crv = Curve(move.Geometry)
crv_2 = Curve(move_2.Geometry)
tool = Tool(meshes=mesh, breps=brep, xline=crv, yline=crv_2)

# ----
tool_id = ClusterInput()

# ---- group: measurement tool
measurement_tool_geo = Geometry([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])
mesh_2 = Mesh(measurement_tool_geo)
mjoin = MeshJoin(Meshes=mesh_2)
tool_2 = PythonScript(meshes=mjoin, brep=measurement_tool_geo)  # -> tool; inputs meshes: list, brep: list
# ---------- tool_2: Python ----------
from ur_online_control.ur.tools import MeasurementTool
from compas.datastructures import Mesh
from compas_rhino.helpers import mesh_from_guid


tool = MeasurementTool()
tool.model = [mesh_from_guid(Mesh, mesh) for mesh in meshes]
#tool.model_xyz = tool.model.xyz
tool.brep = brep
# ---------- end tool_2 ----------

# ----
tool_id_2 = Integer(tool_id)
neg = Negative(Value=Slider(45.8, range=0..100))
panel = Panel(tool_id_2)

# ---- group: drill_tool / gripper_tool
pt_2 = Point(Point(0, 0, 0))
clay_modified_2 = Geometry([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])
X_2 = UnitX(Factor=1)
Y_2 = UnitY(Factor=-1)
mesh_3 = Mesh(clay_modified_2)
brep_2 = Brep(clay_modified_2)
ln_3 = Line(StartPoint=pt_2, EndPoint=X_2)
ln_4 = Line(StartPoint=pt_2, EndPoint=Y_2)
addition_2 = Addition(A=Slider(102, range=0..1000))
Z_2 = UnitZ(Factor=addition_2)
move_3 = Move(Geometry=ln_3, Motion=Z_2)  # -> Geometry, Transform
move_4 = Move(Geometry=ln_4, Motion=Z_2)  # -> Geometry, Transform
crv_3 = Curve(move_3.Geometry)
crv_4 = Curve(move_4.Geometry)

# ----
rot3d = Rotate3D(Geometry=crv_4, Angle=degrees(neg), Center=pt_2, Axis=Vector(0, 0, 1))  # -> Geometry, Transform
rot3d_2 = Rotate3D(Geometry=crv_3, Angle=degrees(neg), Center=pt_2, Axis=Vector(0, 0, 1))  # -> Geometry, Transform

# ---- group: drill_tool / gripper_tool (continued)
tool_3 = Tool(meshes=mesh_3, breps=brep_2, xline=rot3d_2.Geometry, yline=rot3d.Geometry)

# ----
filter = StreamFilter(Gate=tool_id_2, Stream0=tool_2, Stream1=tool, Stream2=tool_3)
py = PythonScript(tool=filter)  # -> tcp_frame, model
# ---------- py: Python ----------
from compas_ghpython import mesh_draw 

tcp_frame = tool.tcp_frame
model = map(mesh_draw, tool.model)
# ---------- end py ----------
tool_4 = Data(filter)
draw = PythonScript(frame=py.tcp_frame)  # -> G, C
# ---------- draw: Python ----------
import Rhino.Geometry as rg
from System.Drawing import Color

if not size:
    size = 100

if frame:
    plane = rg.Plane(rg.Point3d(*list(frame.point)), rg.Vector3d(*list(frame.xaxis)), rg.Vector3d(*list(frame.yaxis)))

    G = []
    G.append(rg.Line(plane.Origin, size * plane.XAxis))
    G.append(rg.Line(plane.Origin, size * plane.YAxis))
    G.append(rg.Line(plane.Origin, size * plane.ZAxis))
    
    C = []
    C.append(Color.FromArgb(255, 0, 0))
    C.append(Color.FromArgb(0, 255, 0))
    C.append(Color.FromArgb(0, 0, 255))
# ---------- end draw ----------
tool_5 = ClusterOutput(tool_4)
preview = CustomPreview(Geometry=draw.G, Shader=draw.C)
preview_2 = CustomPreview(Geometry=py.model, Shader=ColourSwatch(SwatchColor=RGB(141, 170, 178)))

# ==== cluster Send
script = ClusterInput()
send = ClusterInput()
send_2 = PythonScript(script=script, send=send)  # -> out
# ---------- send_2: Python ----------
import socket
from scriptcontext import sticky as st

ur_ip = st["ur_ip"]
ur_port = 30002

if send:
    s = socket.create_connection((ur_ip, ur_port), timeout=0.5) 
    s.send(script)
    s.close()
# ---------- end send_2 ----------
out = ClusterOutput(send_2)

# ==== cluster Draw
size = ClusterInput()
frame = ClusterInput()
draw = PythonScript(frame=frame, size=size)  # -> G, C
# ---------- draw: Python ----------
import Rhino.Geometry as rg
from System.Drawing import Color

if not size:
    size = 100

if frame:
    
    plane = rg.Plane(rg.Point3d(*frame.point), rg.Vector3d(*frame.xaxis), rg.Vector3d(*frame.yaxis))

    G = []
    G.append(rg.Line(plane.Origin, size * plane.XAxis))
    G.append(rg.Line(plane.Origin, size * plane.YAxis))
    G.append(rg.Line(plane.Origin, size * plane.ZAxis))
    
    C = []
    C.append(Color.FromArgb(255, 0, 0))
    C.append(Color.FromArgb(0, 255, 0))
    C.append(Color.FromArgb(0, 0, 255))
# ---------- end draw ----------
G = ClusterOutput(draw.G)
C = ClusterOutput(draw.C)

# ==== cluster Cluster
surface = ClusterInput()
surface_2 = Surface(surface)
multiplication = Multiplication(A=Slider(6, range=0..30), B=Slider(2, range=0..10))
uv_curve_extraction = GhPythonScript(srf=surface_2, u_div=Slider(4, range=0..200), v_div=multiplication, dist=Slider(29, range=0..1000))  # -> out, srf_u_curve_front, srf_u_curve_back, srf_v_crvs_front, srf_v_crvs_back, srf_front, srf_back; inputs srf: Surface, u_div: Int32, v_div: Int32, dist: Int32
# ---------- uv_curve_extraction: Python ----------
__author__ = "ukeer"
__version__ = "2019.01.27"

import rhinoscriptsyntax as rs
import Rhino.Geometry as rg

class GetBeam(object):
    """ 
    gets uv curevs of a surface
    offsets u curves, divides them and gets the odd beams in every row 
    """
    def __init__(self, srf, u_div, v_div):
        
        self.srf = srf
        self.u_div = u_div
        self.v_div = v_div
        
        srf.SetDomain(0, rg.Interval(0,1))
        srf.SetDomain(1, rg.Interval(0,1))
        
        self.u_crvs = []
        self.v_crvs = []
        self.get_beam()
        
    def get_beam(self):
        
        #get u_curve 
        u_curve = []
        for u in range(self.u_div + 1):
            uCrv = self.srf.IsoCurve(1, u/self.u_div)
            u_curve.append(uCrv)
        self.u_crvs.extend(u_curve)
        
        #get v_curve
        v_curve = []
        for v in range (self.v_div + 1):
            vCrv = self.srf.IsoCurve(0, v/self.v_div)
            v_curve.append(vCrv)
        self.v_crvs.extend(v_curve)
        
        
#offset surface on both sides 
srf_front = srf.Offset(-dist, 0.001)
srf_back = srf.Offset( dist, 0.001)



##get U curves for offseted surfaces       
temp_srf_front =  GetBeam(srf_front, u_div, v_div)
srf_u_curve_front = temp_srf_front.u_crvs
srf_v_crvs_front  = temp_srf_front.v_crvs
#
temp_srf_back =  GetBeam(srf_back, u_div, v_div)
srf_u_curve_back = temp_srf_back.u_crvs
srf_v_crvs_back  = temp_srf_back.v_crvs
#
#
# ---------- end uv_curve_extraction ----------
curve = Curve(uv_curve_extraction.srf_u_curve_front)
curve_2 = Curve(uv_curve_extraction.srf_u_curve_back)
curve_3 = Curve(uv_curve_extraction.srf_v_crvs_front)
curve_4 = Curve(uv_curve_extraction.srf_v_crvs_back)
surface_3 = Surface(uv_curve_extraction.srf_front)
surface_4 = Surface(uv_curve_extraction.srf_back)
u_curve_division = GhPythonScript(
    srf_front=surface_3,
    srf_back=surface_4,
    crv_front=curve,
    crv_back=curve_2,
    crv_shift_front=curve_3,
    srf_v_crvs_back=curve_4,
    pts_div=multiplication,
    shift=Slider(-0.056, range=-1..0.5),
    shift_d=Slider(0.045, range=0..0.5),
    shift_dd=Slider(-0.1, range=-0.5..0.5))  # -> out, below, up, back_crv_pts, back_crv_pts_shifted, diagonals; inputs srf_front: Surface, srf_back: Surface, crv_front: list of Curve, crv_back: list of Curve, crv_shift_front: list of Curve, srf_v_crvs_back: list of Curve, pts_div: Int32
# ---------- u_curve_division: Python ----------
import rhinoscriptsyntax as rs
import Rhino.Geometry as rg

#points on front curve list
front_crv_pts = []

for i,crvs in enumerate(crv_front):
    pts = crvs.DivideByCount(pts_div, True)
    crv_div = [crvs.PointAt(p) for p in pts]
    front_crv_pts.extend(crv_div)
    
front_crv_pts_shifted = []

for i,p in enumerate(front_crv_pts):
    u = srf_front.ClosestPoint(p)[1]
    v = srf_front.ClosestPoint(p)[2]
    front_crv_pts_shifted.append(srf_front.PointAt(u+ shift , v ))
    
back_crv_pts = []
for i,crvs in enumerate(crv_back):
    pts = crvs.DivideByCount(pts_div, True)
    crv_div = [crvs.PointAt(p) for p in pts]
    back_crv_pts.extend(crv_div) 
   
back_crv_pts_shifted = [] 
for i,p in enumerate(back_crv_pts):
    u = srf_back.ClosestPoint(p)[1]
    v = srf_back.ClosestPoint(p)[2]
    back_crv_pts_shifted.append(srf_back.PointAt(u+ shift , v ))

below = []    
up = []

for i,p in enumerate(front_crv_pts):
    if i%2 == 0 and (i % (pts_div+1) != pts_div):
        temp_line = rg.Line(p, back_crv_pts[i + 1])
        below.append(temp_line)
    

for i,p in enumerate(back_crv_pts_shifted):
    if i%2 == 1 and (i % (pts_div+1) != pts_div):
        temp_line = rg.Line(p, front_crv_pts_shifted[i + 1])
        up.append(temp_line)


diagonals = []

flag  = True
for i in range(1,len(back_crv_pts)-pts_div,2):
    print i

    if flag == True:
        num = 0
    else:
        num = pts_div
        
    if i % (pts_div + 1) == num:
        flag  = not (flag )
    else:
            
        p1 = back_crv_pts[i]
        u = srf_back.ClosestPoint(p1)[1]
        v = srf_back.ClosestPoint(p1)[2]
        p1 = srf_back.PointAt(u + shift_d , v )
        
        p2 = back_crv_pts[i+ pts_div]
        u = srf_back.ClosestPoint(p2)[1]
        v = srf_back.ClosestPoint(p2)[2]
        p2 = srf_back.PointAt(u + shift_dd , v )
        
        
        temp_line = rg.Line(p1, p2)
        
        diagonals.append(temp_line)
# ---------- end u_curve_division ----------
line = Line([u_curve_division.below, u_curve_division.up, u_curve_division.diagonals])
number_slider = Slider(21, range=0..1000)
geo = Geometry(flatten(line))
python = GhPythonScript(x=geo)  # -> out, part1, part2, part3; inputs x: list of Line
# ---------- python: Python ----------
part1 = [ x[30], x[31], x[0], x[1], x[60], x[61], x[36], x[37],  x[6], x[7], x[66], x[67], \
x[42], x[43], x[12], x[13], x[71], x[72], x[48], x[49],  x[18], x[19], x[77], x[78], x[54], x[55], x[24], x[25] ]


part2 = [ x[32], x[33], x[2], x[3], x[62], x[63], x[38], x[39],  x[8], x[9], x[68], x[69], \
x[44], x[45], x[14], x[15], x[73], x[74], x[50], x[51],  x[20], x[21], x[79], x[80], x[56], x[57], x[26], x[27] ]

part3 = [ x[28], x[29], x[58], x[59], x[81], x[22], x[23],  x[52], x[53], x[75], x[76], \
x[16], x[17], x[46], x[47], x[70], x[10], x[11],  x[40], x[41], x[64], x[65], x[4], x[5], x[34], x[35] ]
# ---------- end python ----------
python_2 = GhPythonScript(srf=surface_2, crvs=line)  # -> out, planes; inputs srf: Surface, crvs: list of Curve
# ---------- python_2: Python ----------
import Rhino.Geometry as rg

planes = []
for c in crvs:
    
    pt = c.PointAt(0.5)
    u = srf.ClosestPoint(pt)[1]
    v = srf.ClosestPoint(pt)[2]
    normal = srf.NormalAt(u,v)
    
    yDirection = normal
    xDirection = c.PointAt(0) - c.PointAt(1)
    planes.append( rg.Plane(pt, xDirection, yDirection) )
# ---------- end python_2 ----------
len = Length(Curve=python.part2)
len_2 = Length(Curve=python.part1)
geo_2 = Geometry(python.part2)
geo_3 = Geometry(python.part1)
geo_4 = Geometry(python.part3)
len_3 = Length(Curve=python.part3)
lng = ListLength(List=geo)
python_3 = GhPythonScript(srf=surface_2, crvs=geo_2)  # -> out, planes; inputs srf: Surface, crvs: list of Curve; same code as python_2
python_4 = GhPythonScript(srf=surface_2, crvs=geo_4)  # -> out, planes; inputs srf: Surface, crvs: list of Curve; same code as python_2
python_5 = GhPythonScript(srf=surface_2, crvs=geo_3)  # -> out, planes; inputs srf: Surface, crvs: list of Curve; same code as python_2
addition = Addition(A=len, B=number_slider)
addition_2 = Addition(A=len_3, B=number_slider)
panel = Panel(lng)
addition_3 = Addition(A=len_2, B=number_slider)
R = ClusterOutput(addition_2)
pln = Plane(python_4.planes)
pln_2 = Plane(python_3.planes)
number_slider_2 = Slider(1.3, range=0..100)
pln_3 = Plane(python_5.planes)
len_4 = Length(Curve=geo)
pln_4 = ClusterOutput(pln)
addition_4 = Addition(A=len_4, B=Slider(250, range=0..1000))
number_slider_3 = ClusterOutput(number_slider_2)
srf = ClusterInput()
generate_connections = GhPythonScript(
    extension=Slider(11, range=0..150),
    offset_0=Slider(6, range=0..100),
    offset_1=Slider(8, range=0..120),
    srf=srf,
    radius=number_slider_2,
    pts_div=multiplication,
    below=u_curve_division.below,
    up=u_curve_division.up,
    diagonals=u_curve_division.diagonals,
    srf_back=surface_4,
    srf_front=uv_curve_extraction.srf_front,
    pts_div_2=multiplication,
    extra=geo)  # -> out, dowels_hinge, dowels_diagonals, dowels_front, dowels_extra, dowel_lines_hinge, dowel_lines_diagonals, dowel_lines_front, dowel_lines_extra; inputs extension: Int32, crvs: list of Curve, srf: Surface, pts_div: Int32, below: list of Curve, up: list of Curve, diagonals: list of Curve, srf_back: Surface, srf_front: Surface, pts_div_2: Int32, extra: list of Line
# ---------- generate_connections: Python ----------
import rhinoscriptsyntax as rs
import Rhino.Geometry as rg
import ghpythonlib.components as ghc
import math


class ConnectionPoints(object):
    # create connection points at the end
    
    def __init__(self, plane, line, extension, side, offset_0, offset_1):
        
        self.line = line
        self.o_plane = plane
        self.extension = extension
        self.offset_0 = offset_0
        self.offset_1 = offset_1
        self.points = []
        self.points_generation(side)
        
    def points_generation(self, side):
        if side == 1:
            flag = 1
        else:
            flag = -1
        p_far = rg.Point3d.Add(self.line.PointAt(side),self.o_plane.XAxis * (self.extension-self.offset_0)*flag)
        p_far = rg.Point3d.Add(p_far,self.o_plane.YAxis * (self.extension-self.offset_1)*flag)
        p_near = rg.Point3d.Add(self.line.PointAt(side),self.o_plane.XAxis * -(self.extension-self.offset_0)*flag)
        p_near = rg.Point3d.Add(p_near, self.o_plane.YAxis * (self.extension-self.offset_1)*flag)

        self.points = [p_far,p_near]
        
    def Connect(self, others):

        return rg.Line( self.points[0] , others.points[1] )

def planes(c, srf):

    pt = c.PointAt(0.5)
    u = srf.ClosestPoint(pt)[1]
    v = srf.ClosestPoint(pt)[2]
    normal = srf.NormalAt(u,v)
    
    yDirection = normal
    xDirection = c.PointAt(0) - c.PointAt(1)
    plane = rg.Plane(pt, xDirection, yDirection)
    return plane


dowel_lines_hinge = []
dowel_lines_diagonals = []
dowel_lines_front = []


#hinge connections

points_from = []
points_to = []

flag = True

for i in range(len(below)-(int(pts_div/2) + 1)):

    if i % (pts_div/2) == 0 and i!= 0:
        flag = not(flag)

    if flag == True:
        points_from.append(up[i].PointAt(0.5))
        points_to.append(below[i+int(pts_div/2)].PointAt(0.5))
         
    else:
        points_from.append(up[i].PointAt(0.5))
        points_to.append(below[i-int(pts_div/2)].PointAt(0.5))
        

for p1,p2 in zip(points_from, points_to):
    dowel_lines_hinge.append(rg.Line(p1,p2))

#diagonal connections

lines_from = []
lines_to = []


for i in range(1,len(diagonals)-(int(pts_div/2)-1), 1):

    if i % (pts_div-1) != 0 :
        lines_from.append(diagonals[i])
        lines_to.append(diagonals[i+(int(pts_div/2)-1)])



for f,t in zip(lines_from, lines_to):

    Beam1 = ConnectionPoints(planes(f,srf_back),f, extension, 1,  offset_0, 1.65 *offset_1)
    Beam2 = ConnectionPoints(planes(t, srf_back),t, extension, 0,  2 * offset_0, 1.05* offset_1)
    dowel_lines_diagonals.append(Beam1.Connect(Beam2))
    
    Beam3 = ConnectionPoints(planes(f,srf_back),f, extension, 1,  2 * offset_0,  1.05* offset_1)
    Beam4 = ConnectionPoints(planes(t, srf_back),t, extension, 0,  1 * offset_0, 1.65 * offset_1)
    dowel_lines_diagonals.append(Beam3.Connect(Beam4))
    
#extra connections
lines_from = []
lines_to = []

for i in range(24,29,1):
    lines_from.append(extra[i])
    lines_to.append(extra[i+53])

dowel_lines_extra = []

for f,t in zip(lines_from, lines_to):

    Beam1 = ConnectionPoints(planes(f,srf_back),f, extension, 1,   offset_0, 1.2 *offset_1)
    Beam2 = ConnectionPoints(planes(t, srf_back),t, extension, 1,  2 * offset_0, 1.1* offset_1)
    dowel_lines_extra.append(Beam1.Connect(Beam2))
    
lines_from = []
lines_to = []

for i in range(30,36,1):
    
    lines_from.append(extra[i])
    lines_to.append(extra[i+30])
    
lines_from.append(extra[47])
lines_to.append(extra[76])


for f,t in zip(lines_from, lines_to):

    Beam1 = ConnectionPoints(planes(f,srf_back),f, extension, 0,  1.5 * offset_0, 1.5 *offset_1)
    Beam2 = ConnectionPoints(planes(t, srf_back),t, extension, 0,  2 * offset_0, 1.35* offset_1)
    dowel_lines_extra.append(Beam1.Connect(Beam2))
    
    
lines_from = []
lines_to = []

for i in range(1,6,1):
    lines_from.append(extra[i])
    lines_to.append(extra[i+29])

lines_from.append(extra[59])
lines_to.append(extra[29])

lines_from.append(extra[48])
lines_to.append(extra[71])

lines_from.append(extra[36])
lines_to.append(extra[60])



for f,t in zip(lines_from, lines_to):

    Beam1 = ConnectionPoints(planes(f,srf_back),f, extension, 0,  offset_0, 1.15 *offset_1)
    Beam2 = ConnectionPoints(planes(t, srf_back),t, extension, 1,  2 * offset_0, 1.4* offset_1)
    dowel_lines_extra.append(Beam1.Connect(Beam2))
    

#front connections

lines_from = []
lines_to = []


flag = True

for i in range( int(pts_div/2) , len(up)-1 ,1):
    
    if (i % (pts_div/2) )== 0 and i != (pts_div/2):
        flag  = not (flag )

    if flag == True:
        num = 0
    else:
        num = 1

    if i % pts_div != (pts_div/2 -1):
        lines_from.append(up[i])
        lines_to.append(below[i+num])
        
    



for f,b in zip(lines_from, lines_to):

    Beam1 = ConnectionPoints(planes(f,srf_front), f, extension, 1,   2.2* offset_0, 1.6 * offset_1)

    Beam2 = ConnectionPoints(planes(b, srf_front), b,  extension, 0, 1.5 * offset_0, 1* offset_1)
    dowel_lines_front.append(Beam1.Connect(Beam2))
    
    
    Beam3 = ConnectionPoints(planes(f,srf_back),f, extension, 1,  2 * offset_0,  1.1* offset_1)
    Beam4 = ConnectionPoints(planes(b, srf_back),b, extension, 0,  1.7 * offset_0, 1.5 * offset_1)
    dowel_lines_front.append(Beam3.Connect(Beam4))
    



dowels_hinge = []
dowels_diagonals = []
dowels_front = []
dowels_extra = []

#turn lines into beams
for k in dowel_lines_hinge:
    
    k.Extend(8,8)
    d = ghc.Pipe(k,radius, 1)
    dowels_hinge.append( d )


for l in dowel_lines_diagonals:
    l.Extend(8, 8)
    d = ghc.Pipe(l,radius, 1)
    dowels_diagonals.append( d )


for m in dowel_lines_front:
    m.Extend(17, 17)
    d = ghc.Pipe(m,radius, 1)
    dowels_front.append( d )
    
    
for e in dowel_lines_extra:
    e.Extend(17, 17)
    d = ghc.Pipe(e,radius, 1)
    dowels_extra.append( d )
# ---------- end generate_connections ----------
geo_5 = Geometry(generate_connections.dowels_hinge)
geo_6 = Geometry(generate_connections.dowels_diagonals)
geo_7 = Geometry(generate_connections.dowels_front)
geo_8 = Geometry(generate_connections.dowels_extra)
line_2 = Line([generate_connections.dowel_lines_hinge, generate_connections.dowel_lines_diagonals, generate_connections.dowel_lines_front, generate_connections.dowel_lines_extra])
line_3 = Line(flatten(line_2))
line_4 = Line(flatten(line_2))
line_5 = Line(flatten(line_2))
line_6 = ClusterOutput(line_5)
geo_9 = Geometry(flatten([geo_5, geo_6, geo_7, geo_8]))
dam = DataDam(DataA=geo_9, BufferDelay=10000000, BufferMode=0)
A = ClusterOutput(dam)
python_6 = GhPythonScript(beam_planes=pln_3, lengths=addition_3, dowels=dam, dowel_radius=number_slider_2, dowels_lines=line_4)  # -> out, safe_planes, top_planes, bottom_planes, beam_breps, original_beam_breps, pipes; inputs beam_planes: list of Plane, lengths: list, dowels: list of Brep, dowels_lines: list of Line
# ---------- python_6: Python ----------
import Rhino.Geometry as rg
import rhinoscriptsyntax as rs
from geometry.beam import Beam
from geometry.dowel import Dowel
from geometry.hole import Hole

beams = []
pipes = []
# feed beam planes
for beam_plane, dx in zip(beam_planes,lengths):

    # create an instance of beam class
    beam = Beam(beam_plane, dx, dy=10, dz=4)
    cutters = []
    for d, brep in zip(dowels_lines,dowels):
        
        if rs.IntersectBreps(beam.brep_representation() ,brep, 0.0000001) == None:
            pass
            #print "False"
        else:
            #print "True"
            dowel = Dowel(None, d, dowel_radius, None)
            pipes.append(dowel.get_dowel_pipe())
            cutters.append(dowel)
            
    for c in cutters:
        beam.add_dowel(c)
    beams.append(beam)
    
    print type(beam)
original_beam_breps = [b.brep_representation() for b in beams] # this is just to visualize for us

# get planes and brep(s)
safe_planes, top_planes, bottom_planes, beam_breps = Hole.get_tool_planes_as_tree(beams, target_plane=rg.Plane.WorldXY, safe_buffer=2, safe_plane_diff=100)
# ---------- end python_6 ----------
python_7 = GhPythonScript(beam_planes=pln_2, lengths=addition, dowels=dam, dowel_radius=number_slider_2, dowels_lines=line_3)  # -> out, safe_planes, top_planes, bottom_planes, beam_breps, original_beam_breps, pipes; inputs beam_planes: list of Plane, lengths: list, dowels: list of Brep, dowels_lines: list of Line
# ---------- python_7: Python ----------
import Rhino.Geometry as rg
import rhinoscriptsyntax as rs
from geometry.beam import Beam
from geometry.dowel import Dowel
from geometry.hole import Hole

beams = []
pipes = []
# feed beam planes
for beam_plane, dx in zip(beam_planes,lengths):

    # create an instance of beam class
    beam = Beam(beam_plane, dx, dy=10, dz=4)
    cutters = []
    for d, brep in zip(dowels_lines,dowels): 
        if rs.IntersectBreps(beam.brep_representation() ,brep, 0.0000001) == None:
            print "False"
        else:
            print "True"
            dowel = Dowel(None, d, dowel_radius, None)
            pipes.append(dowel.get_dowel_pipe())
            cutters.append(dowel)
    for c in cutters:
        beam.add_dowel(c)

    beams.append(beam)

original_beam_breps = [b.brep_representation() for b in beams] # this is just to visualize for us

# get planes and brep(s)
safe_planes, top_planes, bottom_planes, beam_breps = Hole.get_tool_planes_as_tree(beams, target_plane=rg.Plane.WorldXY, safe_buffer=2, safe_plane_diff=100)
# ---------- end python_7 ----------
pln_5 = Plane(python_7.safe_planes)
pln_6 = Plane(python_7.bottom_planes)
brep = Brep(python_7.beam_breps)
brep_2 = Brep(python_7.pipes)
pln_7 = Plane(python_7.top_planes)
pln_8 = Plane(python_6.safe_planes)
pln_9 = Plane(python_6.top_planes)
pln_10 = Plane(python_6.bottom_planes)
brep_3 = Brep(python_6.beam_breps)
brep_4 = Brep(python_6.pipes)
brep_5 = Brep(python_7.original_beam_breps)
brep_6 = Brep(python_6.original_beam_breps)
panel_2 = Panel(addition_2)
bnd = Bounds(Numbers=panel_2)
panel_3 = Panel(bnd)

# ==== cluster Tool
breps = ClusterInput()
meshes = ClusterInput()
meshes_2 = Mesh(meshes)
xline = ClusterInput()
yline = ClusterInput()
mjoin = MeshJoin(Meshes=meshes_2)
tool = PythonScript(meshes=mjoin, breps=breps, xline=xline, yline=yline)  # -> tool; inputs meshes: list of Mesh, breps: list of Brep
# ---------- tool: Python ----------
import Rhino.Geometry as rg
from compas.geometry import Frame
from ur_online_control.ur.tool import Tool
from compas.datastructures import Mesh
from compas_rhino.helpers import mesh_from_guid

xaxis = rg.Line(xline.PointAtStart, xline.PointAtEnd)
yaxis = rg.Line(yline.PointAtStart, yline.PointAtEnd)

if xaxis.From.DistanceTo(yaxis.From) < 0.01:
    origin = xaxis.From
    xaxis = xaxis.Direction
    yaxis = yaxis.Direction
elif xaxis.To.DistanceTo(yaxis.To) < 0.01:
    origin = xaxis.To
    xaxis = -xaxis.Direction
    yaxis = -yaxis.Direction
elif xaxis.From.DistanceTo(yaxis.To) < 0.01:
    origin = xaxis.From
    xaxis = xaxis.Direction
    yaxis = -yaxis.Direction
elif xaxis.To.DistanceTo(yaxis.From) < 0.01:
    origin = xaxis.To
    xaxis = -xaxis.Direction
    yaxis = yaxis.Direction

xaxis.Unitize()
yaxis.Unitize()

print origin
print xaxis
print yaxis

tcp_frame = Frame(origin, xaxis, yaxis)

tool = Tool(tcp_frame)
tool.model = [mesh_from_guid(Mesh, mesh) for mesh in meshes]
#tool.model_xyz = tool.model.xyz
tool.breps = breps
# ---------- end tool ----------
tool_2 = ClusterOutput(tool)
