# Grasshopper definition angle_calculation_example.gh (Grasshopper 1.0.4)

python = GhPythonScript()  # -> out, beam_brep, dowel_lines, angles
# ---------- python: Python ----------
# import libraries
import Rhino.Geometry as rg
from geometry.beam import Beam
from geometry.dowel import Dowel
from geometry.hole import Hole
import math

# dimensions
beam_dx = 145
beam_dy = 10
beam_dz = 4
dowel_radius = 1.0

# create beams from planes
beam_plane_1 = rg.Plane(rg.Plane.WorldXY)
beam_plane_1.Translate(rg.Vector3d(0, 32, 0))
beam_plane_2 = rg.Plane(rg.Plane.WorldXY)
beam_plane_2.Translate(rg.Vector3d(0, 28, 16))
beam_planes = [beam_plane_1, beam_plane_2]

# create dowels from planes
dowels = []

for i in range(11):
    dowel_plane = rg.Plane(rg.Plane.WorldXY)
    dowel_plane.Translate(rg.Vector3d(-50 + 10 * i, 30, 8))
    dowel_plane.Rotate(i * 0.07, dowel_plane.XAxis, dowel_plane.Origin)
    
    # create an instance of dowel class as the connected dowel connected
    dowel = Dowel(base_plane=dowel_plane, dowel_radius=dowel_radius)
    dowels.append(dowel)
    
beams = []

for beam_plane in beam_planes:

    # create an instance of beam class
    beam = Beam(base_plane=beam_plane, dx=beam_dx, dy=beam_dy, dz=beam_dz)

    for dowel in dowels:

        # add the dowel to the beam as its connection
        beam.add_dowel(dowel)

    beams.append(beam)

# calculation by beam
angles = beam.get_angle_between_beam_and_dowel()

# OR

# calculation by dowel
#angles = [d.get_angle_between_beam_and_dowel() for d in dowels]

dowel_lines = [d.get_calculated_line() for d in dowels]

beam_brep = [beam.brep_representation() for beam in beams]
# ---------- end python ----------
python_2 = GhPythonScript(toggle=Button())  # -> out
# ---------- python_2: Python ----------
__author__ = "ytakzk"
__version__ = "2019.01.21"

import geometry.beam as beam
import geometry.dowel as dowel
import geometry.hole as hole

if toggle:
    
    reload(beam)
    reload(dowel)
    reload(hole)
# ---------- end python_2 ----------

# ---- group: get angles in degrees
deg = Degrees(Radians=python.angles)
panel = Panel(deg)

# ---- group: acceptable range of degrees
dom = ConstructDomain(DomainStart="0", DomainEnd="pi * 0.2")

# ---- group: color range
dom_2 = ConstructDomain(DomainStart="0.5", DomainEnd="0")

# ----
remap = RemapNumbers(Value=python.angles, Source=dom, Target=dom_2)  # -> Mapped, Clipped

# ---- group: must not be less than 0
max = Maximum(A=remap.Mapped, B="0")

# ----
hsl = ColourHSL(Alpha=1, Hue=max, Saturation=1, Luminance=0.5)
preview = CustomPreview(Geometry=python.dowel_lines, Material=hsl)
