# Grasshopper definition simple_example.gh (Grasshopper 1.0.4)

python = GhPythonScript()  # -> out, safe_planes, top_planes, bottom_planes, beam_breps, original_beam_breps
# ---------- python: Python ----------
# import libraries
import Rhino.Geometry as rg
from geometry.beam import Beam
from geometry.dowel import Dowel
from geometry.hole import Hole

# dimensions
beam_dx = 145
beam_dy = 10
beam_dz = 4
dowel_radius = 1.0

# create beams as planes
beam_plane_1 = rg.Plane(rg.Plane.WorldXY)
beam_plane_1.Translate(rg.Vector3d(100, 100, 0))

beam_plane_2 = rg.Plane(rg.Plane.WorldXY)
beam_plane_2.Translate(rg.Vector3d(100, 100, 50))

beam_planes = [beam_plane_1, beam_plane_2]

# create dowels as planes
dowel_plane_1 = rg.Plane(rg.Plane.WorldXY)
dowel_plane_1.Translate(rg.Vector3d(140, 100, 0))
dowel_plane_2 = rg.Plane(rg.Plane.WorldXY)
dowel_plane_2.Translate(rg.Vector3d(60, 100, 0))
dowel_plane_3 = rg.Plane(rg.Plane.WorldXY)
dowel_plane_3.Translate(rg.Vector3d(140, 100, 50))
dowel_plane_4 = rg.Plane(rg.Plane.WorldXY)
dowel_plane_4.Translate(rg.Vector3d(60, 100, 50))

# create an instance of dowel class as the connected dowel connected
dowel_1 = Dowel(base_plane=dowel_plane_1, dowel_radius=dowel_radius)
dowel_2 = Dowel(base_plane=dowel_plane_2, dowel_radius=dowel_radius)
dowel_3 = Dowel(base_plane=dowel_plane_3, dowel_radius=dowel_radius)
dowel_4 = Dowel(base_plane=dowel_plane_4, dowel_radius=dowel_radius)

dowels = [dowel_1, dowel_2, dowel_3, dowel_4]

beams = []

# feed beam planes
for beam_plane in beam_planes:

    # create an instance of beam class
    beam = Beam(base_plane=beam_plane, dx=beam_dx, dy=beam_dy, dz=beam_dz)

    for dowel in dowels:

        # add a dowel to the beam as its connection
        beam.add_dowel(dowel)

    beams.append(beam)

original_beam_breps = [b.brep_representation() for b in beams]

for b in beams:
    b.remove_duplicates_in_dowel_list()

# get planes and brep(s)
safe_planes, top_planes, bottom_planes, beam_breps = Hole.get_tool_planes_as_tree(beams, target_plane=rg.Plane.WorldXY, safe_buffer=2, safe_plane_diff=100)
# ---------- end python ----------
python_2 = GhPythonScript(toggle=Button())  # -> out, a
# ---------- python_2: Python ----------
__author__ = "ytakzk"
__version__ = "2019.01.21"

import geometry.beam as beam
import geometry.dowel as dowel
import geometry.hole as hole

if toggle:
    
    reload(beam)
    reload(dowel)
    reload(hole)
# ---------- end python_2 ----------
pln = Plane(python.safe_planes)
pln_2 = Plane(python.top_planes)
pln_3 = Plane(python.bottom_planes)
brep = Brep(python.beam_breps)
brep_2 = Brep(python.original_beam_breps)
