# Grasshopper definition growth_logic.gh (Grasshopper 1.0.4)

# ---- group: Gallery space
rectangle = Rectangle(Plane=PlaneXY(0, 0, 0), XSize=Slider(28400, range=0..28400), YSize=Slider(9700, range=0..10000), Radius=0)  # -> Rectangle, Length
boxrec = BoxRectangle(Rectangle=rectangle.Rectangle, Height=Slider(4500, range=0..5000))

# ---- group: Subtracting volume _1
pt = ConstructPoint(XCoordinate=Slider(5994, range=0..8000), YCoordinate=Slider(3000, range=0..3000), ZCoordinate=Slider(0, range=0..10000))
rectangle_2 = Rectangle(Plane=pt, XSize=Slider(1500, range=0..6000), YSize=Slider(3473, range=0..6000), Radius=0)  # -> Rectangle, Length
boxrec_2 = BoxRectangle(Rectangle=rectangle_2.Rectangle, Height=Slider(6000, range=0..6000))

# ----
python = GhPythonScript(toggle=Button())  # -> out, a
# ---------- python: Python ----------
__author__ = "ytakzk"
__version__ = "2019.01.21"

import geometry.beam as beam
import geometry.dowel as dowel
import geometry.hole as hole

if toggle:
    
    reload(beam)
    reload(dowel)
    reload(hole)
# ---------- end python ----------

# ---- group: Subtracting volume_2
pt_2 = ConstructPoint(
    XCoordinate=Slider(2287, range=0..6000),
    YCoordinate=Slider(7250, range=0..9000),
    ZCoordinate=Slider(1000, range=0..1000))
sph = Sphere(Base=pt_2, Radius=Slider(1668, range=0..2500))

# ---- group: recursive
number_slider = Slider(11, range=0..20)

# ----
sdiff = SolidDifference(BrepsA=boxrec, BrepsB=boxrec_2)

# ---- group: remapping scale
addition = Addition(A=number_slider, B="1")
series = Series(Start=0, Step=1, Count=addition)
bnd = Bounds(Numbers=series)
remap = RemapNumbers(Value=series, Source=bnd, Target=Domain(0, 1))  # -> Mapped, Clipped

# ---- group: Booleaned Volume
sdiff_2 = SolidDifference(BrepsA=sdiff, BrepsB=sph)

# ----
pt_3 = ConstructPoint(XCoordinate=Slider(1000, range=0..1000), YCoordinate=Slider(3800, range=0..3800), ZCoordinate=Slider(470, range=0..470))
xz = XZPlane(Origin=pt_3)

# ---- group: seed_plane_to_grow
pln = Plane(xz)

# ---- group: toggle to have flush beams in a module & a probability to decide which side will be flush to its middle beam
flush_ratio_of_1_to_2 = Slider(0.41, range=0..1)
always_flush = BooleanToggle(True)

# ---- group: probabilities to stop growth
growth_probability_2 = Slider(0.66, range=0..1)
growth_probability_1 = Slider(0.86, range=0..1)
graph = GraphMapper(
    remap.Mapped,
    x0=0,
    x1=1,
    y0=0,
    y1=1,
    container_name="Bezier",
    cpx=[0, 0.4095366597, 0.2466068119, 1],
    cpy=[1, 1, 0.4134748578, 0.1976451278])

# ---- group: dimensions
number_slider_2 = Slider(120, range=100..1500)
panel = Panel("1")
panel_2 = Panel("12")
panel_3 = Panel("4")
panel_4 = Panel("1")

# ---- group: angles
number_slider_3 = Slider(12, range=-25..25)
number_slider_4 = Slider(-10, range=-25..25)
wing_angle_2 = Slider(12, range=0..20)
rot_angle_1 = Slider(12, range=0..20)
rot_angle_2 = Slider(-14, range=-20..0)
wing_angle_1 = Slider(10, range=0..20)

# ---- group: when the beam is extended by the given ratio, extend it to make it touch the ground, if it could bump into the ground
number_slider_5 = Slider(0, range=0..1)

# ---- group: random seed
random_seed = Slider(174, range=0..1000)

# ---- group: parameters to tweak angles according to the depth
graph_2 = GraphMapper(
    remap.Mapped,
    x0=0,
    x1=1,
    y0=0,
    y1=1,
    container_name="Sinc",
    Equation_X0=0,
    Equation_X1=0.7928636074,
    Equation_Y0=0.9676427841,
    Equation_Y1=0.1434913278)
list = ValueList({"twist 1": 0, "twist 2": 1, "wing 1": 2, "wing 2": 3, "rot 1": 4, "rot 2": 5}, selected=["twist 1", "twist 2", "wing 1", "wing 2", "rot 1", "rot 2"])

# ---- group: for debug purpose
show_dowels = BooleanToggle(True)

# ---- group: bounding box as brep
brep = Brep(sdiff_2)

# ----
# 0a
# Settings
# Check your IP address and set UR IP address
server_address = ValueList({"192.168.10.12", "192.168.10.11", "192.168.10.10", "192.168.10.2", "127.0.0.1"}, selected="192.168.10.11")
ur_ip = ValueList({"192.168.10.13", "192.168.10.11", "192.168.10.10", "127.0.0.1"}, selected="192.168.10.10")
server_port = Integer(30003)
globals = PythonScript(server_address=server_address, server_port=server_port, ur_ip=ur_ip)  # inputs server_port: Int32
# ---------- globals: Python ----------
from scriptcontext import sticky as st

st["server_address"] = server_address
st["server_port"] = server_port

st["ur_ip"] = ur_ip
# ---------- end globals ----------

# ----
# Check if UR is available
ping = Button()
py = PythonScript(ip=ur_ip, ping=ping)  # -> out
# ---------- py: Python ----------
from scriptcontext import sticky as st
from ur_online_control.communication import is_available


guid = str(ghenv.Component.InstanceGuid)
txt_key = "txt_" + guid
if txt_key not in st:
    st[txt_key] = ""

if ping:
    
    available = is_available(ip)
    
    if available:
        st[txt_key] = "%s is up!" % ip
    else:
        st[txt_key] = "%s is down!" % ip

print st[txt_key]
# ---------- end py ----------
panel_5 = Panel(py)

preview = CustomPreview(Geometry=brep, Material=ColourSwatch(SwatchColor=RGBA(168, 222, 255, 17)))

bang = Button()
panel_6 = Panel("Unload libraries")
unload = PythonScript(bang=bang)
# ---------- unload: Python ----------
from compas_ghpython import unload_modules

unload_modules("compas")
unload_modules("ur_online_control")
# ---------- end unload ----------

python_2 = GhPythonScript(
    shift_ratio=Slider(0.75, range=0..0.75),
    bounding_brep=brep,
    initial_plane=pln,
    beam_dx=number_slider_2,
    beam_dy=panel_2,
    beam_dz=panel_3,
    beam_gap=panel_4,
    dowel_radius=panel,
    recursive=number_slider,
    twist_angle_1=number_slider_3,
    twist_angle_2=number_slider_4,
    wing_angle_1=wing_angle_1,
    wing_angle_2=wing_angle_2,
    rot_angle_1=rot_angle_1,
    rot_angle_2=rot_angle_2,
    show_dowels=show_dowels,
    scaling_factors=graph_2,
    applied_angles=list,
    growth_probability_1=growth_probability_1,
    growth_probability_2=growth_probability_2,
    growth_probability_factors=graph,
    always_flush=always_flush,
    flush_ratio_of_1_to_2=flush_ratio_of_1_to_2,
    random_seed=random_seed,
    extension_ratio=number_slider_5)  # -> out, beams, dowels, beam_family, planes; inputs bounding_brep: Brep, initial_plane: Plane, recursive: Int32, show_dowels: Boolean, scaling_factors: list, applied_angles: list of Int32, growth_probability_factors: list, always_flush: Boolean, random_seed: Int32
# ---------- python_2: Python ----------
__author__ = "ytakzk"
__version__ = "2019.01.25"

import ghpythonlib.components as gh 
import Rhino.Geometry as rg
import math
import random
from geometry.beam import Beam
from geometry.dowel import Dowel

random.seed(random_seed)


"""
Beam class for the modular unit
"""
class ModularBeam(Beam):

    def __init__(self, base_plane, dx, dy, dz, shift_ratio):
        
        super(ModularBeam, self).__init__(base_plane, dx, dy, dz)

        self.shift_ratio = shift_ratio
        self.module_list = []
        self.alive = True
        self.extended = False
    
    def belongs_to(self, module):
        
        self.module_list.append(module)
    
    def get_middle_beam_in_module(self):
        
        for module in self.module_list:
            if module.middle_beam != self:
                return module.middle_beam

    def rotate_or_terminate(self, twist_angle, wing_angle, rot_angle):

        # simulate
        plane = rg.Plane(self.base_plane)
        
        self.simulate_rotation(plane, twist_angle, wing_angle, rot_angle)
 
        # get a distance to the bounding box
        line = rg.Line(plane.Origin - (plane.XAxis * self.dx * 0.5), \
                        plane.Origin + (plane.XAxis * self.dx * 1.5)).ToNurbsCurve()
           
        _, vals = rg.Intersect.Intersection.CurveBrep(line, bounding_brep, 1.0, 0.1)
        
        too_close = True if len(vals) > 0 else False 

        if not too_close:
    
            self.rotate(twist_angle, wing_angle, rot_angle)

        else:
            
            self.alive = False

    
    def extend_to_ground_if_needed(self):

        if extension_ratio == 0:
            return

        plane = self.base_plane
        line  = rg.Line(plane.Origin + (plane.XAxis * self.dx * 0.5), \
                        plane.Origin + (plane.XAxis * self.dx * (0.5 + extension_ratio)))
        
        succeeded, v = rg.Intersect.Intersection.LinePlane(line, rg.Plane.WorldXY)

        if line and v >= 0 and v <= 1:

            p = line.PointAt(v)
            dist = p.DistanceTo(plane.Origin)
            vec = plane.XAxis * (dist * 0.5 - self.dx * 0.5)
            plane.Translate(vec)
            self.dx += dist
            self.extended = True

    def rotate(self, twist_angle, wing_angle, rot_angle):
        
        # twist
        radian, center, axis, _ = self.__get_rotation_values(self.base_plane, twist_angle, 'twist')
        self.base_plane.Rotate(radian, axis, center)
        
        # wing
        radian, center, axis, _ = self.__get_rotation_values(self.base_plane, wing_angle, 'wing')
        self.base_plane.Rotate(radian, axis, center)

        # rot
        radian, center, axis, orientation_sign = self.__get_rotation_values(self.base_plane, rot_angle, 'rot')
        self.base_plane.Rotate(radian, axis, center)

        # move
        middle_beam = self.get_middle_beam_in_module()
        move_vec = orientation_sign * middle_beam.base_plane.ZAxis * self.dy * 0.5 * math.sin(radian)
        self.base_plane.Translate(move_vec)

    def simulate_rotation(self, plane, twist_angle, wing_angle, rot_angle):
        
        # twist
        radian, center, axis, _ = self.__get_rotation_values(plane, twist_angle, 'twist')
        plane.Rotate(radian, axis, center)
        
        # wing
        radian, center, axis, _ = self.__get_rotation_values(plane, wing_angle, 'wing')
        plane.Rotate(radian, axis, center)

        # rot
        radian, center, axis, orientation_sign = self.__get_rotation_values(plane, rot_angle, 'rot')
        plane.Rotate(radian, axis, center)

        # move
        middle_beam = self.get_middle_beam_in_module()
        move_vec = orientation_sign * middle_beam.base_plane.ZAxis * self.dy * 0.5 * math.sin(radian)
        plane.Translate(move_vec)

            
    def __rotate(self, plane, angle, rotation_center, axis):
        
        if not bounding_brep:
            
            plane.Rotate(angle, axis, rotation_center)

        else:
            
            # check to see if the new beam is inside of the bounding brep or not
            candidate_angles = [angle, angle * 0.75, angle * 0.50, angle * 0.25, 0]
            
            for angle in candidate_angles:
                
                plane.Rotate(angle, axis, rotation_center)

                evaluation_point = rg.Point3d.Add(plane.Origin, plane.XAxis * self.dx * 0.5)
            
                if not bounding_brep.IsPointInside(evaluation_point, 1.0, True):
                    self.alive = False
            
                    # if outside, make it flush and try again
                    plane.Rotate(-angle, axis, rotation_center)
                
                else:
                    
                    self.alive = True
                    break
    def __get_rotation_values(self, plane, angle, rotation):
        
        if rotation == 'twist':

            shift_vec = plane.XAxis * ((self.dx * self.shift_ratio) - 9) 
            
            # this is the center of the overlapping area between beams
            rotation_center = rg.Point3d(plane.Origin - shift_vec)
            
            radian = math.radians(angle)

            return radian, rotation_center, plane.ZAxis, 1.0

        elif rotation == 'wing':

            # whether the normal of this beam goes toward the same direction of its middle beam or not
            middle_beam = self.get_middle_beam_in_module()
            vec = rg.Vector3d(plane.Origin) - rg.Vector3d(middle_beam.base_plane.Origin)
            vec_angle = rg.Vector3d.VectorAngle(vec, middle_beam.base_plane.ZAxis)

            # in case that it goes in the opposite direction
            if vec_angle < math.pi * 0.5:
                angle *= -1

            # the end point along its length direction
            shift_vec = plane.XAxis * ((self.dx * self.shift_ratio) - 9)
            rotation_center = rg.Point3d(plane.Origin - shift_vec)
            
            radian = math.radians(angle)
            
            return radian, rotation_center, plane.YAxis, 1.0

        elif rotation == 'rot':

            # whether the normal of this beam goes toward the same direction of its middle beam or not
            middle_beam = self.get_middle_beam_in_module()
            vec = rg.Vector3d(plane.Origin) - rg.Vector3d(middle_beam.base_plane.Origin)
            vec_angle = rg.Vector3d.VectorAngle(vec, middle_beam.base_plane.ZAxis)
        
            # rotation center
            shift_vec = plane.XAxis * ((self.dx * self.shift_ratio) - 9)
            rotation_center = rg.Point3d(plane.Origin - shift_vec)
        
            radian = math.radians(angle)

            # to avoid the collision with its middle beam, move the beam

            # in case that it goes in the opposite direction
            orientation_sign = 1.0 if vec_angle < math.pi * 0.5 else -1.0

            # in case that the angle is negative 
            orientation_sign *= 1.0 if angle > 0 else -1.0

            return radian, rotation_center, self.base_plane.XAxis, orientation_sign


"""
Module class to contain three beams
"""
class Module:
    
    def __init__(self, middle_beam, side_beam_1, side_beam_2, depth=0):
        
        self.middle_beam = middle_beam
        self.side_beam_1 = side_beam_1
        self.side_beam_2 = side_beam_2
        
        self.middle_beam.belongs_to(self)
        self.side_beam_1.belongs_to(self)
        self.side_beam_2.belongs_to(self)
        
        self.depth = 0
        
        self.children = []
    
    def get_beams(self):
        
        return [self.middle_beam, self.side_beam_1, self.side_beam_2]
    
    def add_child(self, child):
        
        self.children.append(child)
    
    def add_dowels(self):
        
        b = self.middle_beam
        b1 = self.side_beam_1
        b2 = self.side_beam_2
        
        
        b_line = b.get_baseline().ToNurbsCurve()
        b1_line = b1.get_baseline().ToNurbsCurve()
        b2_line = b2.get_baseline().ToNurbsCurve()
        
        
        #splitting the curve to get the overlapping length (Middle Beam)
        b_line = gh.Shatter(b_line, shift_ratio)[1]
        print b_line.GetLength()
        b_rc = gh.EvaluateLength(b_line,9, False)[0]
        b_len_p = gh.EvaluateLength(b_line,9, False)[2]
        b_line = gh.Shatter(b_line,b_len_p)[1]
        print b_line.GetLength()
        
        b_top_line = rg.NurbsCurve(b_line)
        b_bottom_line = rg.NurbsCurve(b_line)
        
        #Translating the curve in both direction (Middle Beam)
        mb_offset_value = b.base_plane.YAxis * 3
        b_top_line.Translate(mb_offset_value)
        b_bottom_line.Translate(-mb_offset_value)
        print b_top_line, b_bottom_line
        
        #splitting the curve to get the overlapping length (Side Beam 1)
        b1_line = gh.Shatter(b1_line, shift_ratio)[0]
        print b1_line.GetLength()
        b1_rc = gh.EvaluateLength(b1_line,9, False)[0]
        b1_len_p = gh.EvaluateLength(b1_line,9, False)[2]
        b1_line = gh.Shatter(b1_line,b1_len_p)[1]
        print b1_line.GetLength()
        
        b1_top_line = rg.NurbsCurve(b1_line)
        b1_bottom_line = rg.NurbsCurve(b1_line)
        
        #Translating the curve in both direction (Side Beam 1)
        sb_offset_value = b1.base_plane.YAxis * 2
        b1_top_line.Translate(sb_offset_value)
        b1_bottom_line.Translate(-sb_offset_value)
        print b1_top_line, b1_bottom_line
        
        #splitting the curve to get the overlapping length (Side Beam 2)
        b2_line = gh.Shatter(b2_line, shift_ratio)[0]
        print b2_line.GetLength()
        b2_rc = gh.EvaluateLength(b2_line,9, False)[0]
        b2_len_p = gh.EvaluateLength(b2_line,9, False)[2]
        b2_line = gh.Shatter(b2_line,b2_len_p)[1]
        print b2_line.GetLength()
        
        b2_top_line = rg.NurbsCurve(b2_line)
        b2_bottom_line = rg.NurbsCurve(b2_line)
        
        #Translating the curve in both direction (Side Beam 2)
        sb_offset_value = b2.base_plane.YAxis * 2
        b2_top_line.Translate(sb_offset_value)
        b2_bottom_line.Translate(-sb_offset_value)
        print b2_top_line, b2_bottom_line
        
        
# third dowel to be added
#        pts = [
#            
#            [b1_top_line.PointAtLength(50.0),b2_top_line.PointAtLength(100.0)],
#            [b1_bottom_line.PointAtLength(100.0),b2_bottom_line.PointAtLength(50.0)],
#        ]
#        
#        for p1, p2 in pts:
#            
#            line =rg.Line(p1,p2)
#            line.Extend(80,80)
#            dowel = Dowel(line=line, dowel_radius=dowel_radius)
        pts = [
            [b_rc, b1_rc ,b2_rc],
            [b1_top_line.PointAtLength(5.0), b_top_line.PointAtLength(8.0),b2_top_line.PointAtLength(10.0)],
            [b1_bottom_line.PointAtLength(10.0), b_bottom_line.PointAtLength(8.0),b2_bottom_line.PointAtLength(5.0)],
        ]
        
        for p1, p2, p3 in pts:
            
            line = gh.FitLine([p1,p2,p3])
            line.Extend(8,8)
            dowel = Dowel(line=line, dowel_radius=dowel_radius)
            
            for b in self.get_beams():
                b.add_dowel(dowel)
    
    @staticmethod
    def create_with_plane(base_plane, dx, dy, dz, shift_ratio):
        
        middle_beam = ModularBeam(base_plane, dx, dy, dz, shift_ratio)

        side_plane_1 = rg.Plane(base_plane)
        side_plane_1.Translate(base_plane.XAxis * dx * shift_ratio)
        side_plane_1.Translate(base_plane.ZAxis * (dz + beam_gap))
        side_beam_1  = ModularBeam(side_plane_1, dx, dy, dz, shift_ratio)

        side_plane_2 = rg.Plane(base_plane)
        side_plane_2.Translate(base_plane.XAxis * dx * shift_ratio)
        side_plane_2.Translate(-base_plane.ZAxis * (dz + beam_gap))
        side_beam_2  = ModularBeam(side_plane_2, dx, dy, dz, shift_ratio)
        
        return Module(middle_beam, side_beam_1, side_beam_2, 0)

    @staticmethod
    def create_with_beam(beam, depth):
        
        base_plane = beam.base_plane
        dx, dy, dz = beam_dx, beam.dy, beam.dz

        side_plane_1 = rg.Plane(base_plane)
        side_plane_1.Translate(base_plane.XAxis * dx * beam.shift_ratio)
        side_plane_1.Translate(base_plane.ZAxis * (dz + beam_gap))
        side_beam_1  = ModularBeam(side_plane_1, dx, dy, dz, beam.shift_ratio)

        side_plane_2 = rg.Plane(base_plane)
        side_plane_2.Translate(base_plane.XAxis * dx * beam.shift_ratio)
        side_plane_2.Translate(-base_plane.ZAxis * (dz + beam_gap))
        side_beam_2  = ModularBeam(side_plane_2, dx, dy, dz, beam.shift_ratio)
        
        return Module(beam, side_beam_1, side_beam_2, depth)

    def get_modules_in_family(self):
        
        modules = []
        
        def add(parent):
            
            modules.append(parent)
            
            for child in parent.children:
                
                if child.middle_beam.alive:
                    add(child)

        add(self)

        return list(set(modules))

    def get_beams_in_family(self):
        
        beams = []
        
        def add(parent):
            
            beams.extend(parent.get_beams())

            for child in parent.children:

                if child.middle_beam.alive:
                    add(child)

        add(self)
        
        
        filtered_beams = []
        
        for i, beam_1 in enumerate(beams):
            
            if i >= len(beams) - 1:
                continue
            
            duplicated = False
            for beam_2 in beams[i+1:]:
                
                if beam_1 == beam_2:
                    duplicated = True
                    break
                    
            if not duplicated:
                filtered_beams.append(beam_1)

        return filtered_beams


# recursive function to grow the structure
def grow(parent, recursive=0, limit=3):
    
    angles = [twist_angle_1, twist_angle_2, wing_angle_1, wing_angle_2, rot_angle_1, rot_angle_2]
    scaled_angles = []
    for i, angle in enumerate(angles):
        factor = scaling_factors[recursive] if i in applied_angles else 1.0
        scaled_angles.append(angle * factor)

    # if it bumps into the bounding box, then make it terminate. if not keep grow
    parent.side_beam_1.rotate_or_terminate(scaled_angles[0], scaled_angles[2], scaled_angles[4])
    parent.side_beam_2.rotate_or_terminate(scaled_angles[1], scaled_angles[3], scaled_angles[5])

    # extend a beam to touch the ground
    parent.side_beam_1.extend_to_ground_if_needed()
    parent.side_beam_2.extend_to_ground_if_needed()
        
    if recursive == limit:

        return

    for i, beam in enumerate([parent.side_beam_1, parent.side_beam_2]):
        
        if not beam.alive:
            continue
        
        beams_by_depth[recursive].append(beam)
        
        growth_probability_factor = growth_probability_factors[recursive] 
        
        probability = growth_probability_1 if i == 0 else growth_probability_2
        
        if random.random() < probability * growth_probability_factor:

            child = Module.create_with_beam(beam, recursive + 1)
        
            if child:
                parent.add_child(child)
                grow(child, recursive + 1, limit)

beams_by_depth = {}
for i in range(recursive):
    beams_by_depth[i] = []

module = Module.create_with_plane(initial_plane, dx=beam_dx, dy=beam_dy, dz=beam_dz, shift_ratio=shift_ratio)

grow(module, 0, recursive)

# reduction process (applied to the beams in the same depth level only)
for depth in beams_by_depth:
    
    beams = beams_by_depth[depth]
    
    for i, beam_1 in enumerate(beams):
        
        if len(beams) < i - 1:
            continue
        
        for beam_2 in beams[i+1:]:
            
            # if the beams are in the same module, skip
            if beam_1.get_middle_beam_in_module() == beam_2.get_middle_beam_in_module():
                continue
            
            line_1 = beam_1.get_baseline()
            line_2 = beam_2.get_baseline()
            
            dist = line_1.MinimumDistanceTo(line_2)
            
            if dist < beam_1.dy * 2:
                beam_1.alive = False

# visualization purpose
module_family = module.get_modules_in_family()
beam_family   = module.get_beams_in_family()

[module.add_dowels() for module in module_family]

beams  = []
dowels = []
planes = []

for b in beam_family:
    
    beam_brep = b.brep_representation(make_holes=False)
    beams.append(beam_brep)
    dowels.extend(b.dowel_list)
    planes.append(b.base_plane)
if show_dowels:
    dowels = list(set(dowels))
    dowels = [d.brep_representation() for d in dowels]
# ---------- end python_2 ----------
drill_bit_length = Slider(18.5, range=0..30)

# ---- group: Robot
# 1. load robot model
# 2. set tool
# 3. set basis
list_2 = ValueList({"measurement_tool": 0, "drill_tool": 1, "gripper_tool": 2}, selected="gripper_tool")
tools = Tools(tool_id=list_2, drill_bit_length=drill_bit_length)
base = PythonScript()  # -> base_frame
# ---------- base: Python ----------
from compas.geometry import Frame

#origin = [414.42, -207.44, 82.62]
#xaxis = [0.00000, 1.00000, 0.00000]
#yaxis = [-1.00000, 0.00000, 0.00000]

#origin = [414.40, -206.7, 82.62]
#xaxis = [0.00000, 1.00000, 0.00000]
#yaxis = [-1.00000, 0.00000, 0.00000]

origin = [415.10, -206.7, 82.62]
xaxis = [0.00000, 1.00000, 0.00000]
yaxis = [-1.00000, 0.00000, 0.00000]


base_frame = Frame(list(origin), list(xaxis), list(yaxis))
# ---------- end base ----------
list_3 = ValueList({"UR5", "UR10"}, selected="UR5")
robot = PythonScript(model=list_3, tool=tools, base_frame=base)  # -> robot
# ---------- robot: Python ----------
from ur_online_control.ur.ur10 import UR10
from ur_online_control.ur.ur5 import UR5
from scriptcontext import sticky as st

if model == "UR5":
    robot = UR5()
elif model == "UR10":
    robot = UR10()

if tool:
    robot.set_tool(tool)
if base_frame:
    robot.set_base(base_frame)

st["robot"] = robot
# ---------- end robot ----------

# ----
brep_2 = Brep(python_2.dowels)
points = PointList(Points=python_2.planes, Size=Slider(40, range=0..50))
brep_3 = Brep(python_2.beams)
python_3 = GhPythonScript(beam_family=python_2.beam_family)  # -> out, safe_planes, top_planes, bottom_planes, beam_breps, original_beam_breps, original_beam_planes; inputs beam_family: list
# ---------- python_3: Python ----------
# import libraries
import Rhino.Geometry as rg
from geometry.beam import Beam
from geometry.dowel import Dowel
from geometry.hole import Hole

original_beam_breps = [b.brep_representation() for b in beam_family]

original_beam_planes = [b.base_plane for b in beam_family]

safe_planes, top_planes, bottom_planes, beam_breps = Hole.get_tool_planes_as_tree(beam_family, target_plane=rg.Plane.WorldXY, safe_buffer=4, safe_plane_diff=150)
# ---------- end python_3 ----------

# ---- group: original beams
brep_4 = Brep(python_3.original_beam_planes)
preview_2 = CustomPreview(Geometry=brep_4, Material=ColourSwatch(SwatchColor=RGB(82, 122, 255)))

# ---- group: beams while drilling
brep_5 = Brep(python_3.beam_breps)
preview_3 = CustomPreview(Geometry=brep_5, Material=ColourSwatch(SwatchColor=RGB(191, 89, 255)))

# ---- group: drill_safety_plane
geo = Geometry(python_3.safe_planes)

# ---- group: start_drill_plane
geo_2 = Geometry(python_3.top_planes)

# ---- group: end_drill_plane
geo_3 = Geometry(python_3.bottom_planes)

# ---- group: beam length
num = Number("120")

# ----
py_2 = PythonScript()  # -> path
# ---------- py_2: Python ----------
import sys
import os

ghComp = ghenv.Component
ghDoc = ghComp.OnPingDocument()

# the full path of the gh file
path = ghDoc.FilePath
# the directory of the gh file
path = os.path.dirname(path)

path = os.path.abspath(os.path.join(path, ".."))

print path
# ---------- end py_2 ----------
# 1
# Executing
panel_7 = Panel("Start communication server")
start = Button()
panel_8 = Panel(py_2)
server = PythonScript(path=panel_8, start=start)
# ---------- server: Python ----------
import os
import threading
from scriptcontext import sticky as st

server_address = st["server_address"]
server_port = st["server_port"]
ur_ip = st["ur_ip"]

"""
Change main!!!!
"""
main = os.path.join(path, "communication", "main_dowel_gripping_v1.py")

if os.path.isfile(main):
        
    def myfunc():
        syscall = "python %s %s %s %s" % (main, server_address, server_port, ur_ip)
        os.system(syscall)
    
    if start:
        t = threading.Thread(target=myfunc)
        t.start()
# ---------- end server ----------

speed = Slider(300, range=0..300)

panel_9 = Panel("Get UR connected")
ur = PythonScript(send=start)
# ---------- ur: Python ----------
from scriptcontext import sticky as st
from ur_online_control.ur_driver import URDriver

server_address = st["server_address"]
server_port = st["server_port"]
ur_ip = st["ur_ip"]
robot = st["robot"]

tool_angle_axis = list(robot.tool.tcp_frame.point) + robot.tool.tcp_frame.axis_angle_vector
#robot.tool.tcp_frame.pose_axis_angle_vector
print tool_angle_axis

ur_driver = URDriver(server_address, server_port, tool_angle_axis, ur_ip, "UR")
print ur_driver

if send:
    ur_driver.send()
# ---------- end ur ----------

disconnect = Button()
panel_10 = Panel("Get Grasshopper connected")
client = PythonScript(connect=start, disconnect=disconnect)  # -> connected, client
# ---------- client: Python ----------
import time
from scriptcontext import sticky as st
from Rhino.RhinoApp import WriteLine
from ur_online_control.grasshopper import GHClient, gh_component_timer
import time

server_address = st["server_address"]
server_port = st["server_port"]

guid = str(ghenv.Component.InstanceGuid)

client_key = "client_" + guid
run_key = "run_" + guid

if connect:
    if client_key not in st:
        st[client_key] = GHClient(server_address, server_port)
        client = st[client_key]
        client.connect_to_server()
        client.start()
        
    else:
        if st[client_key].running:
            WriteLine("Client is already connected.")
            
        else:
            st[client_key] = GHClient(server_address, server_port)
            client = st[client_key]
            client.connect_to_server()
            client.start()
"""
else:
    if client_key in st:
        # we need a timer to ask if we have something on the rcv queue
        client = st[client_key]
        #if client.running:
        #    #client.run_inner_while()
        #    gh_component_timer(ghenv, True, 1000)
"""

if disconnect:
    if client_key in st:
        client = st[client_key]
        if client.running:
            client.close()

if client_key in st:
    connected =  st[client_key].running
    client = st[client_key]
    print st[client_key].rcv_queue.qsize()
    print st[client_key].snd_queue.qsize()
else:
    connected = False
# ---------- end client ----------
panel_11 = Panel(client.connected)

bang_2 = Button()

bang_3 = Button()
receive = PythonScript(client=client.client, bang=bang_3)  # -> qsize, client
# ---------- receive: Python ----------
from ur_online_control.communication.msg_identifiers import *
from ur_online_control.utilities.lists import flatten_list
from Rhino.RhinoApp import WriteLine


if client:
    if not client.ghenv:
        client.ghenv = ghenv
    qsize = client.rcv_queue.qsize()
# ---------- end receive ----------
panel_12 = Panel(receive.qsize)

receive_2 = PythonScript(client=client.client, bang=bang_2)  # -> qsize, client; same code as receive
panel_13 = Panel(receive_2.qsize)
send = PythonScript(client=receive.client)  # -> out
# ---------- send: Python ----------
from ur_online_control.communication.msg_identifiers import *
from ur_online_control.utilities.lists import flatten_list

if client:
    qsize = client.rcv_queue.qsize()
    if qsize:
        msg = client.rcv_queue.get()
        print msg
# ---------- end send ----------
panel_14 = Panel(send)
send_2 = PythonScript(client=receive_2.client)  # -> out; same code as send
panel_15 = Panel(send_2)

# ----
# Direct UR control
get = Button()
get_2 = Button()
pose = PythonScript(get=get_2)  # -> pose_joints
# ---------- pose: Python ----------
from scriptcontext import sticky as st
from ur_online_control.ur_direct import get_current_pose_joints
from ur_online_control.ur.robot import BaseConfiguration

server_address = st["server_address"]
server_port = 30005
ur_ip = st["ur_ip"]
robot = st["robot"]
tool_angle_axis = list(robot.tool.tcp_frame.point) + robot.tool.tcp_frame.axis_angle_vector
print tool_angle_axis

guid = str(ghenv.Component.InstanceGuid)
pose_joints_key = "pose_joints" + guid


if get:
    st[pose_joints_key] = get_current_pose_joints(server_address, server_port, ur_ip, tool_angle_axis)
    
if pose_joints_key not in st:
    pose_joints = []
else:
    pose_joints = BaseConfiguration.from_joints(st[pose_joints_key])
# ---------- end pose ----------
pose_2 = PythonScript(get=get)  # -> pose_cartesian
# ---------- pose_2: Python ----------
from scriptcontext import sticky as st
from ur_online_control.ur_direct import get_current_pose_cartesian

server_address = st["server_address"]
server_port = 30005
ur_ip = st["ur_ip"]
robot = st["robot"]
tool_angle_axis = list(robot.tool.tcp_frame.point) + robot.tool.tcp_frame.axis_angle_vector
print tool_angle_axis

guid = str(ghenv.Component.InstanceGuid)
pose_cartesian_key = "pose_cartesian" + guid


if get:
    st[pose_cartesian_key] = get_current_pose_cartesian(server_address, server_port, ur_ip, tool_angle_axis)

if pose_cartesian_key not in st:
    pose_cartesian = []
else:
    pose_cartesian = st[pose_cartesian_key]
# ---------- end pose_2 ----------
stop = Button()
stop_2 = PythonScript(stop=stop)
# ---------- stop_2: Python ----------
from scriptcontext import sticky as st
from ur_online_control.ur_direct import stop as stop_robot

ur_ip = st["ur_ip"]

if stop:
    stop_robot(ur_ip)
# ---------- end stop_2 ----------
panel_16 = Panel(pose)
panel_17 = Panel(pose_2)

vertical_pose = Number([-152.427, -780.635, 855.229, -1.1958, -1.22046, -1.20201])
py_3 = PythonScript(pose_cartesian=pose_2)  # -> frame_WCS; inputs pose_cartesian: list
# ---------- py_3: Python ----------
import Rhino.Geometry as rg
from scriptcontext import sticky as st
from compas.geometry import Frame
from compas.geometry.xforms import Transformation

robot = st["robot"]



if pose_cartesian:
    frame_RCS = Frame.from_axis_angle_vector(pose_cartesian)
    frame_WCS = robot.get_frame_in_WCS(frame_RCS)
# ---------- end py_3 ----------
draw = Draw(frame=py_3)  # -> G, C
back = Button()
reset = Button()

# ---- group: Define joint positions
base_2 = Slider(-173.869, range=-360..360)
elbow = Slider(90.765, range=-360..360)
wrist2 = Slider(-82.725, range=-360..360)
wrist3 = Slider(91.571, range=-360..360)
shoulder = Slider(-72.967, range=-360..360)
wrist1 = Slider(-115.737, range=-360..360)
ur1_q1_q6 = Data([base_2, shoulder, elbow, wrist1, wrist2, wrist3])

# ----
preview_4 = CustomPreview(Geometry=draw.G, Shader=draw.C)
py_4 = GhPythonScript(joint_values=ur1_q1_q6)  # -> configuration; inputs joint_values: list
# ---------- py_4: Python ----------
import math
from ur_online_control.ur.robot import BaseConfiguration

configuration = BaseConfiguration.from_joints([math.radians(d) for d in joint_values])
# ---------- end py_4 ----------

# ----
# Calculate basis
# Measure basis:
# 1. Clear the recorded poses
# 2. Move robot to origin and press "get pose"
# 3. Move robot to point in positive x-axis and press "get pose"
# 4. Move robot to an other point in your basis and press "get pose"
# (The farer away these positions are, the better)
# 
# 5. Alternatively change the order in the component calc base
# 6. Copy output into base component
list_4 = ValueList({"origin, pt on positive x-axis, pt in xy plane": 0, "origin, pt on positive y-axis, pt in xy plane": 1}, selected="origin, pt on positive x-axis, pt in xy plane")
clear = Button()
rec = PythonScript(msg=pose_2, rec=get, clear=clear)  # -> rec; inputs msg: list
# ---------- rec: Python ----------
from scriptcontext import sticky as st

guid = str(ghenv.Component.InstanceGuid)
recorded_key =  "recorded_" + guid
just_cleared_key = "just_cleared_" + guid

if recorded_key not in st:
    st[recorded_key] = []

if just_cleared_key not in st:
    st[just_cleared_key] = False

if clear:
    st[recorded_key] = []
    st[just_cleared_key] = True
else:
    if len(msg):
        if msg != [None] and not st[just_cleared_key] and rec:
            st[recorded_key].append(msg)
    st[just_cleared_key] = False
        


rec = st[recorded_key]

print rec
# ---------- end rec ----------
calc_base = PythonScript(poses=rec, input_type=list_4)  # -> out; inputs poses: list
# ---------- calc_base: Python ----------
import Rhino.Geometry as rg
import math


if len(poses) > 2:
    
    O = poses[0]
    P1 = poses[1]
    P2 = poses[2]
    
    if input_type == 0:
        # origin, pt on positive x-axis, pt in xy plane
        origin = rg.Point3d(O[0], O[1], O[2])
        pt_on_xaxis = rg.Point3d(P1[0], P1[1], P1[2])
        pt_in_xyplane = rg.Point3d(P2[0], P2[1], P2[2])
        
        xaxis = pt_on_xaxis - origin
        xaxis.Unitize()
        
        v = pt_in_xyplane - origin
        zaxis = rg.Vector3d.CrossProduct(v, xaxis)
        zaxis.Unitize()
        
        # zaxis must look up!
        if math.acos(rg.Vector3d.ZAxis * zaxis) > math.acos(rg.Vector3d.ZAxis * -zaxis):
            zaxis = -zaxis
        
        yaxis = rg.Vector3d.CrossProduct(zaxis, xaxis)
    
    elif input_type == 1:
        # origin, pt on positive y-axis, pt in xy plane
        origin = rg.Point3d(O[0], O[1], O[2])
        pt_on_yaxis = rg.Point3d(P1[0], P1[1], P1[2])
        pt_in_xyplane = rg.Point3d(P2[0], P2[1], P2[2])
        
        yaxis = pt_on_yaxis - origin
        yaxis.Unitize()
        
        v = pt_in_xyplane - origin
        zaxis = rg.Vector3d.CrossProduct(v, yaxis)
        zaxis.Unitize()
        
        # zaxis must look up!
        if math.acos(rg.Vector3d.ZAxis * zaxis) > math.acos(rg.Vector3d.ZAxis * -zaxis):
            zaxis = -zaxis
        
        xaxis = rg.Vector3d.CrossProduct(yaxis, zaxis)
        
        
    print "Copy the following into base component:"
    print " "
    print "origin = [%.2f, %.2f, %.2f]" % tuple(list(origin))
    print "xaxis = [%.5f, %.5f, %.5f]" % tuple(list(xaxis))
    print "yaxis = [%.5f, %.5f, %.5f]" % tuple(list(yaxis))
    

#print rg.Vector3d.CrossProduct(rg.Vector3d.YAxis, rg.Vector3d.ZAxis)
#print rg.Vector3d.CrossProduct(rg.Vector3d.ZAxis, rg.Vector3d.XAxis)
# ---------- end calc_base ----------
panel_18 = Panel(rec)
panel_19 = Panel(calc_base)

# ---- group: Visualise / robot model brep
py_5 = PythonScript(model=list_3)  # -> n
# ---------- py_5: Python ----------
if model == "UR5":
    n = 0
if model == "UR10":
    n = 1

print n
# ---------- end py_5 ----------
ur10_brep = UR10Brep([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])
ur5_brep = UR5Brep([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])
show_brep = BooleanToggle(False)
filter = StreamFilter(Gate=py_5, Stream0=ur5_brep, Stream1=ur10_brep)

# ---- group: Send joint position directly to robot
panel_20 = Panel("move cartesian")
idx = Slider(0, range=0..100)
commands = Data([-0.7378762823, -1.645309655, 1.740348054, -0.3678008479, -0.3738495375, -0.1107411527])
item = ListItem(List=commands, Index=idx, Wrap=True)
list_5 = ValueList({"send all positions": 0, "send only one position": 1}, selected="send only one position")
filter_2 = StreamFilter(Gate=list_5, Stream0=commands, Stream1=item)
movel = PythonScript(commands=filter_2, velocity=Slider(100, range=0..100))  # -> script; inputs commands: list
# ---------- movel: Python ----------
from scriptcontext import sticky as st

script_lines = []
for cmd in commands:
    #q, a=1.4, v=1.05, t=0, r=0)
    x, y, z, ax, ay, az, speed, radius = cmd
    script_lines.append("movel(p%s, v=%f, r=%f)" % (str([x/1000., y/1000., z/1000, ax, ay, az]), speed/1000., radius/1000.))

robot = st["robot"]
tool_angle_axis = list(robot.tool.tcp_frame.point) + robot.tool.tcp_frame.axis_angle_vector
x, y, z, ax, ay, az = tool_angle_axis

script = "def prog():\n"
script += "\ttextmsg(\">> program start\")\n"
script += "\tset_tcp(p%s)\n" % str([x/1000., y/1000., z/1000, ax, ay, az])
script += "".join(["\t%s\n" % line for line in script_lines])
script += "\ttextmsg(\"<< program end\")\n"
script += "end\n"
script += "prog()\n\n"

print script
# ---------- end movel ----------
send_3 = Button()
send_4 = Send(script=movel, send=send_3)
panel_21 = Panel(send_4)

# ----
panel_22 = Panel("move vertical")
movel_2 = PythonScript()  # -> script
# ---------- movel_2: Python ----------
from scriptcontext import sticky as st

robot = st["robot"]
tool_angle_axis = list(robot.tool.tcp_frame.point) + robot.tool.tcp_frame.axis_angle_vector
x, y, z, ax, ay, az = tool_angle_axis

script = "def prog():\n"
script += "\ttextmsg(\">> program start\")\n"
script += "\tset_tcp(p%s)\n" % str([x/1000., y/1000., z/1000, ax, ay, az])
script += "\tcurrent_pose = get_forward_kin()\n"
script += "\tmovel(p[current_pose[0], current_pose[1], current_pose[2], 0, 0, 0], a=0.1, v=0.1)\n"
script += "\ttextmsg(\"<< program end\")\n"
script += "end\n"
script += "prog()\n\n"

print script
# ---------- end movel_2 ----------
send_5 = Button()
send_6 = Send(script=movel_2, send=send_5)
panel_23 = Panel(send_6)

panel_24 = Panel("set digital out")
number = Slider(0, range=0..10)
value = BooleanToggle(False)
digital_out = PythonScript(number=number, value=value)  # -> script; inputs number: Int32, value: Boolean
# ---------- digital_out: Python ----------
script = "def prog():\n"
script += "\ttextmsg(\">> program start\")\n"
script += "\tset_digital_out(%i, %s)\n" % (int(number), str(value))
script += "\ttextmsg(\"<< program end\")\n"
script += "end\n"
script += "prog()\n\n"

print script
# ---------- end digital_out ----------
send_7 = Button()
send_8 = Send(script=digital_out, send=send_7)
panel_25 = Panel(send_8)

# ----
# move incremental in WCS
number_slider_6 = Slider(10, range=-10..10)
list_6 = ValueList({"xaxis", "yaxis", "zaxis"}, selected="yaxis")
movel_3 = PythonScript(step_size=number_slider_6, direction=list_6)  # -> script
# ---------- movel_3: Python ----------
from scriptcontext import sticky as st

robot = st["robot"]
tool_angle_axis = list(robot.tool.tcp_frame.point) + robot.tool.tcp_frame.axis_angle_vector
x, y, z, ax, ay, az = tool_angle_axis

script = "def prog():\n"
script += "\ttextmsg(\">> program start\")\n"
script += "\tset_tcp(p%s)\n" % str([x/1000., y/1000., z/1000, ax, ay, az])
script += "\tcurrent_pose = get_forward_kin()\n"


if direction == "xaxis":
    script += "\tmovel(p[current_pose[0] + %f, current_pose[1], current_pose[2], current_pose[3], current_pose[4], current_pose[5]], t=%f)\n" % (step_size/1000., step_size * 0.1)

elif direction == "yaxis":
    script += "\tmovel(p[current_pose[0], current_pose[1] + %f, current_pose[2], current_pose[3], current_pose[4], current_pose[5]], t=%f)\n" % (step_size/1000., step_size * 0.1)

else: # direction == "zaxis":
    script += "\tmovel(p[current_pose[0], current_pose[1], current_pose[2] + %f, current_pose[3], current_pose[4], current_pose[5]], t=%f)\n" % (step_size/1000., step_size * 0.1)

script += "\ttextmsg(\"<< program end\")\n"
script += "end\n"
script += "prog()\n\n"

print script
# ---------- end movel_3 ----------
send_9 = Button()
send_10 = Send(script=movel_3, send=send_9)
panel_26 = Panel(send_10)

# ----
# move incremental in TCS
get_current_pose = Button()
list_7 = ValueList({"xaxis", "yaxis", "zaxis"}, selected="zaxis")
movel_4 = PythonScript(get=get_current_pose, step_size=Slider(50, range=-10..50), direction=list_7)  # -> script; inputs get: list
# ---------- movel_4: Python ----------
from scriptcontext import sticky as st
from compas.geometry import Frame
from compas.geometry import Point, Vector
from ur_online_control.ur_direct import get_current_pose_cartesian

server_address = st["server_address"]
server_port = 30005
ur_ip = st["ur_ip"]
robot = st["robot"]
tool_angle_axis = list(robot.tool.tcp_frame.point) + robot.tool.tcp_frame.axis_angle_vector
print tool_angle_axis

guid = str(ghenv.Component.InstanceGuid)
pose_cartesian_key = "pose_cartesian" + guid

if get:
    st[pose_cartesian_key] = get_current_pose_cartesian(server_address, server_port, ur_ip, tool_angle_axis)

if pose_cartesian_key not in st:
    pose_cartesian = []
    script = ""
else:
    pose_cartesian = st[pose_cartesian_key]

    robot = st["robot"]
    tool_angle_axis = list(robot.tool.tcp_frame.point) + robot.tool.tcp_frame.axis_angle_vector
    x, y, z, ax, ay, az = tool_angle_axis
    
    script = "def prog():\n"
    script += "\ttextmsg(\">> program start\")\n"
    script += "\tset_tcp(p%s)\n" % str([x/1000., y/1000., z/1000, ax, ay, az])
    script += "\tcurrent_pose = get_forward_kin()\n"
    
#    frame = Frame.from_pose_axis_angle_vector(pose_cartesian)
    frame = Frame.from_axis_angle_vector([ax, ay, az])
    frame.point = [x, y, z]

    if direction == "xaxis":
        next_vector = Vector(*frame.xaxis) * step_size
    elif direction == "yaxis":
        next_vector = Vector(*frame.yaxis) * step_size
    else: # direction == "zaxis":
        next_vector = Vector(*frame.zaxis) * step_size
    
    x, y, z = next_vector
    script += "\tmovel(p[current_pose[0] + %f, current_pose[1] + %f, current_pose[2] + %f, current_pose[3], current_pose[4], current_pose[5]], t=%f)\n" % (x/1000., y/1000., z/1000., step_size * 0.1)
    
    script += "\ttextmsg(\"<< program end\")\n"
    script += "end\n"
    script += "prog()\n\n"
    
    print script
# ---------- end movel_4 ----------
send_11 = Button()
send_12 = Send(script=movel_4, send=send_11)
panel_27 = Panel(send_12)

# ---- group: picking plane
number_slider_7 = Slider(60.7, range=0..100)

# ----
neg = Negative(Value=number_slider_7)

# ---- group: picking plane (continued)
pt_4 = ConstructPoint(XCoordinate=Slider(251, range=0..1000), YCoordinate=Slider(0, range=0..50), ZCoordinate=neg)

# ----
xy = XYPlane(Origin=pt_4)

# ---- group: picking_plane
geo_4 = Geometry(flatten(xy))

# ---- group: placing plane
number_slider_8 = Slider(300, range=0..1000)

# ----
vec = VectorXYZ(XComponent=number_slider_8, YComponent=0, ZComponent=Slider(60, range=0..100))  # -> Vector, Length

# ---- group: placing plane (continued)
move = Move(Geometry=xy, Motion=vec.Vector)  # -> Geometry, Transform
pln_2 = Plane(move.Geometry)

geo_5 = Geometry(pln_2)

# ----
arrange_plane_lists = GhPythonScript(
    picking_plane=geo_4,
    drill_safety_plane=geo,
    start_drill_plane=geo_2,
    end_drill_plane=geo_3,
    placing_plane=geo_5,
    beam_length=num)  # -> out, plane_list, number_of_holes_list; inputs picking_plane: Plane, drill_safety_plane: tree of Plane, start_drill_plane: tree of Plane, end_drill_plane: tree of Plane, placing_plane: Plane
# ---------- arrange_plane_lists: Python ----------
__author__ = "JesusBarney"
__version__ = "2019.01.16"

import rhinoscriptsyntax as rs
import Rhino.Geometry as rg

plane_list = []

number_of_holes_list = []

for i in range(len(drill_safety_plane.Branches)):

    plane = rg.Plane(picking_plane)
    plane.Translate(rg.Vector3d(beam_length * 0.5, 0, 0))
    plane_list.append(plane)
    
    number_of_holes = 0
    
    for j, (d, s, e) in enumerate(zip(drill_safety_plane.Branches[i], start_drill_plane.Branches[i], end_drill_plane.Branches[i])):
        plane_list.append(d)
        plane_list.append(s)
        plane_list.append(e)
        number_of_holes = j
        
    plane_list.append(placing_plane)
    
    number_of_holes_list.append(number_of_holes + 1)
# ---------- end arrange_plane_lists ----------

# ---- group: Define commands
python_4 = PythonScript(planes_WCS=arrange_plane_lists.plane_list, dfillet=Slider(0, range=0..100), speed=speed)  # -> flatten(commands); inputs planes_WCS: list, speed: Int32
# ---------- python_4: Python ----------
import Rhino.Geometry as rg
from compas.geometry import Frame
from compas.geometry import Transformation
from compas_ghpython import xdraw_frame
from scriptcontext import sticky as st

robot = st["robot"]
buffer = 1

# TODO this must be optimized! matrix multiplication!
commands = []
for i, plane_WCS in enumerate(planes_WCS):
    tcp_WCS = Frame(plane_WCS.Origin, plane_WCS.XAxis, plane_WCS.YAxis)
    if i == 0 or i == len(planes_WCS) - 1:
        radius = 0.
        
    else:
        # calculate blend radius
        prev, current, next = planes_WCS[i-1].Origin, planes_WCS[i].Origin, planes_WCS[i+1].Origin
        radius = min((prev - current).Length/2 * buffer, (next - current).Length/2 * buffer, dfillet)
    
    tcp_RCS = robot.get_frame_in_RCS(tcp_WCS)
    
    cmd = list(tcp_RCS.point) + tcp_RCS.axis_angle_vector + [speed, radius]
    #cmd = list(tcp_RCS.point) + tcp_RCS.axis_angle_vector + [time, radius]
    commands.append(cmd)
    
    
    
print (commands)
# ---------- end python_4 ----------

# ----
continue_fabrication = BooleanToggle(False)
panel_28 = Panel("Send a message")
send_13 = Button()
drilling_commands = Data(python_4)
# 4
send_14 = PythonScript(
    client=client.client,
    send=send_13,
    continue_fabrication=continue_fabrication,
    tool=tools,
    drilling_commands=drilling_commands,
    number_of_holes_list=arrange_plane_lists.number_of_holes_list)  # -> out; inputs continue_fabrication: Int32, drilling_commands: list, number_of_holes_list: list
# ---------- send_14: Python ----------
from ur_online_control.communication.msg_identifiers import *
from ur_online_control.utilities.lists import flatten_list

len_command_drilling = len(drilling_commands[0])
commands_flattened_drilling = flatten_list(drilling_commands)

"""
sand_tool = tool
sand_tool_axis = list(sand_tool.tcp_frame.point) + sand_tool.tcp_frame.axis_angle_vector
"""
"""
vaccuum_tool = tool
vaccuum_tool_axis = list(vaccuum_tool.tcp_frame.point) + vaccuum_tool.tcp_frame.axis_angle_vector
"""
# tool settigns
tool_axis = list(tool.tcp_frame.point) + tool.tcp_frame.axis_angle_vector

### Gravel placment ###
"""
#safe_in_pose_gravel, safe_out_pose_gravel = cmd_gravel_in_out 
pose_gravel = cmd_gravel
"""

#print waiting_times
#print len(io_values)

#===================================================================================
if send and client:
    ### string_fabrication ###
    client.send(MSG_INT, int(continue_fabrication))
    client.send(MSG_FLOAT_LIST, tool_axis) ### set string_tcp ###
    client.send(MSG_INT, len_command_drilling) ### send len of each cmd ###
    client.send(MSG_FLOAT_LIST, commands_flattened_drilling) ### send cmd list ###
    client.send(MSG_FLOAT_LIST, number_of_holes_list) ### send cmd list ###

#===================================================================================
# ---------- end send_14 ----------

panel_29 = Panel(send_14)

# ----
# Visualisation
robot_2 = Data(robot)
planes_wcs = Plane(arrange_plane_lists.plane_list)
pose_joints = Data(pose)

# ---- group: Define plane in WCS, calculate joint positions
pt_5 = Point(Point(648.8632686, 624.689255, -55.48786018))
xy_2 = XYPlane(Origin=pt_5)
select_configuration = Slider(5, range=0..7)
plane_wcs = Plane(xy_2)
inverse = PythonScript(robot=robot_2, plane_WCS=plane_wcs, idx=select_configuration)  # -> configuration; inputs plane_WCS: Plane, idx: Int32
# ---------- inverse: Python ----------
import Rhino.Geometry as rg
from compas.geometry import Frame, Transformation
from compas_ghpython import xdraw_frame

tcp_WCS = Frame(plane_WCS.Origin, plane_WCS.XAxis, plane_WCS.YAxis)

# transform frame to robot coordinate system
tcp_RCS = robot.get_frame_in_RCS(tcp_WCS)

# get the frame of tool0
tool0_RCS = robot.get_tool0_frame_from_tcp_frame(tcp_RCS)

# calculate solutions to frame
solutions = robot.inverse_kinematics(tool0_RCS)

if not len(solutions):
    q = [0,0,0,0,0,0]
else:
    idx = min(len(solutions) - 1, idx)
    q = solutions[idx]
    
print q

configuration = q
# ---------- end inverse ----------

# ---- group: Calculate joint positions for path
# Add init joint states
joint_states = Data([-0.1728179112, -1.415058186, 1.813991282, -1.971940356, -1.571654205, -3.308720436])
init_configuration = Slider(2, range=0..7)
py_6 = PythonScript(robot=robot_2, planes_WCS=planes_wcs, configuration_idx=init_configuration, init_configuration=joint_states)  # -> configurations; inputs planes_WCS: list, configuration_idx: Int32, init_configuration: list
# ---------- py_6: Python ----------
from compas_ghpython import unload_modules
unload_modules('ur_online_control')
import Rhino.Geometry as rg
from compas.geometry import Frame 
from compas.geometry.xforms import Transformation
from compas_ghpython import xdraw_frame
from ur_online_control.ur.kinematics import calculate_configurations_for_path, format_joint_positions


# TODO this must be optimized! matrix multiplication!
frames_tool0_RCS = []
for plane_WCS in planes_WCS:
    tcp_WCS = Frame(plane_WCS.Origin, plane_WCS.XAxis, plane_WCS.YAxis)
    tcp_RCS = robot.get_frame_in_RCS(tcp_WCS)
    frames_tool0_RCS.append(robot.get_tool0_frame_from_tcp_frame(tcp_RCS))
    

#configurations = calculate_configurations_for_path(frames_tool0_RCS, robot.params, init_configuration)
configurations = calculate_configurations_for_path(frames_tool0_RCS, robot, init_configuration)
#print configurations
configurations = configurations[min([configuration_idx, len(configurations) - 1])]

def format(numbers, k=4):
    #numbers = format_joint_positions(numbers)
    return "[" + ", ".join([("%." + str(k) + "f") % n for n in numbers]) + "]"
# ---------- end py_6 ----------
start_2 = Button()
stop_3 = Button()
step = Button()
counter = CountThroughList(L=py_6, start=start_2, stop=stop_3, step=step, step_back=back, reset=reset, interval=100)  # -> item; inputs L: list, start: Boolean, stop: Boolean, step_back: Boolean
# ---------- counter: Python ----------
from scriptcontext import sticky as st
from compas_ghpython import update_component


# store data in component
guid = str(ghenv.Component.InstanceGuid)
counter_key = "counter_" + guid
running_key = "running_" + guid

if counter_key not in st:
    st[counter_key] = 0

if running_key not in st:
    st[running_key] = False

if start:
    st[running_key] = True

if stop:
    st[running_key] = False

if step:
    if st[counter_key] < len(L) - 1:
        st[counter_key] += 1

if step_back:
    if st[counter_key] < len(L) - 1:
        st[counter_key] -= 1

if reset:
    st[counter_key] = 0

if len(L):
    item = L[st[counter_key]]

if st[running_key]:
    if st[counter_key] < len(L) - 1:
        st[counter_key] += 1
        update_component(ghenv, interval)
    else:
        st[counter_key] = 0
        st[running_key] = False
# ---------- end counter ----------

# ---- group: Calculate joint positions for path / Shows joint positions along path
flip = BooleanToggle(True)
l2t = PythonScript(L=py_6, flip=flip)  # -> T; inputs L: list, flip: Boolean
# ---------- l2t: Python ----------
from compas_ghpython import list_to_ghtree
L = [l.joint_values for l in L]

if flip:
    L = zip(*L)
T = list_to_ghtree(L)
# ---------- end l2t ----------
graph_3 = QuickGraph(l2t)

# ---- group: Visualise
list_8 = ValueList({"0 forward, from angles": 0, "1 inverse, from one plane": 1, "2 inverse, from multiple planes": 2, "3 forward, from robot": 3}, selected="2 inverse, from multiple planes")
filter_3 = StreamFilter(Gate=list_8, Stream0=py_4, Stream1=inverse, Stream2=counter, Stream3=pose_joints)
configuration = Panel(filter_3)
mesh = Mesh(filter)
draw_2 = PythonScript(robot=robot_2, configuration=filter_3, mesh=mesh, brep=filter, show_brep=show_brep)  # -> meshes, tool0_plane, tcp_plane, robot_brep; inputs mesh: list, brep: list
# ---------- draw_2: Python ----------
from compas_ghpython import unload_modules
unload_modules("ur_online_control")

from compas_ghpython import xdraw_frame
from compas_ghpython import mesh_draw
from compas_ghpython.geometry.xforms import xform_from_transformation
from compas.geometry import Frame
from compas.geometry.xforms import Transformation
from ur_online_control.ur.robot import BaseConfiguration

import Rhino.Geometry as rg
import Rhino

def mesh_update_vertices(mesh, vertices):
    for i in range(len(vertices)):
        mesh.vertex[i].update({'x': vertices[i][0], 'y': vertices[i][1], 'z': vertices[i][2]})

if configuration:
    #print configuration
    #q = BaseConfiguration.from_joints(configuration)
    q = configuration
    print q
    print q.joint_values
    
    print robot.get_forward_transformations(q)
    R0, R1, R2, R3, R4, R5 = robot.get_forward_transformations(q)
    
    tool0_frame2 = robot.tool0_frame.transformed(R5)
    tcp_frame2 = Frame.from_transformation(Transformation.from_frame(tool0_frame2) * robot.transformation_tool0_tcp)
    
    print robot.transformation_tool0_tcp
    print robot.transformation_tcp_tool0
    print robot.transformation_tool0_tcp * robot.transformation_tcp_tool0
    print tcp_frame2
    tcp_frame2 = Frame.from_transformation(Transformation.from_frame(tool0_frame2) * robot.transformation_tcp_tool0)
    print tcp_frame2
    
    tool0_frame, tcp_frame = robot.get_transformed_tool_frames(R5)
    
    tool0_frame = tool0_frame2
    tcp_frame = tcp_frame2
    
    m0, m1, m2, m3, m4, m5 = mesh
    for i in range(6):
        exec("R%drg = xform_from_transformation(R%d)" % (i, i))
        exec("m%d.Transform(R%drg)" % (i, i))
    meshes = [m0, m1, m2, m3, m4, m5]
    print meshes
    mt = robot.tool.get_transformed_model(Transformation.from_frame(tool0_frame))
    
    if mt:
        meshes.extend(map(mesh_draw, mt))
    
    """
    m0, m1, m2, m3, m4, m5, tool0_frame, tcp_frame = robot.get_transformed_model(q)
    mt = robot.get_transformed_tool_model(tcp_frame)
    
    meshes = []
    meshes.append(mesh_draw(m0))
    meshes.append(mesh_draw(m1))
    meshes.append(mesh_draw(m2))
    meshes.append(mesh_draw(m3))
    meshes.append(mesh_draw(m4))
    meshes.append(mesh_draw(m5))
    if mt:
        meshes.append(mesh_draw(mt))
    
    """
    
    tool0_plane = xdraw_frame(tool0_frame)
    tcp_plane = xdraw_frame(tcp_frame)
    
    if show_brep:
        
        b0, b1, b2, b3, b4, b5 = brep
        
        b0.Transform(R0rg)
        b1.Transform(R1rg)
        b2.Transform(R2rg)
        b3.Transform(R3rg)
        b4.Transform(R4rg)
        b5.Transform(R5rg)
        
        robot_brep = [b0, b1, b2, b3, b4, b5]
# ---------- end draw_2 ----------
tcp_plane = Plane(draw_2.tcp_plane)
tool0_plane = Plane(draw_2.tool0_plane)
robot_brep = Brep(draw_2.robot_brep)
draw_3 = RepresentPlaneAsLines(plane=tcp_plane, size=100)  # -> G, C
# ---------- draw_3: Python ----------
import Rhino.Geometry as rg
from System.Drawing import Color

if plane:

    G = []
    G.append(rg.Line(plane.Origin, size * plane.XAxis))
    G.append(rg.Line(plane.Origin, size * plane.YAxis))
    G.append(rg.Line(plane.Origin, size * plane.ZAxis))
    
    C = []
    C.append(Color.FromArgb(255, 0, 0))
    C.append(Color.FromArgb(0, 255, 0))
    C.append(Color.FromArgb(0, 0, 255))
# ---------- end draw_3 ----------
preview_5 = CustomPreview(Geometry=draw_2.meshes, Shader=ColourSwatch(SwatchColor=RGBA(99, 94, 94, 96)))
preview_6 = CustomPreview(Geometry=draw_3.G, Shader=draw_3.C)

# ----
mesh_2 = Mesh(draw_2.meshes)

# ---- group: Send joint position directly to robot
idx_2 = Slider(0, range=0..100)
panel_30 = Panel("move joints")
joint_positions = Data(py_4)
list_9 = ValueList({"send all positions": 0, "send only one position": 1}, selected="send only one position")
item_2 = ListItem(List=joint_positions, Index=idx_2, Wrap=True)
filter_4 = StreamFilter(Gate=list_9, Stream0=joint_positions, Stream1=item_2)
movej = PythonScript(joint_positions=filter_4, velocity=Slider(153, range=0..200))  # -> script; inputs joint_positions: list
# ---------- movej: Python ----------
script_lines = []

for position in joint_positions:
    script_lines.append("movej(%s, v=%f)" % (str(position), velocity/1000.))


script = "def prog():\n"
script += "\ttextmsg(\">> program start\")\n"
script += "".join(["\t%s\n" % line for line in script_lines])
script += "\ttextmsg(\"<< program end\")\n"
script += "end\n"
script += "prog()\n\n"


print script

#script = ""
# ---------- end movej ----------
send_15 = Button()

# ----
send_16 = Send(script=movej, send=send_15)

# ---- group: Send joint position directly to robot (continued)
panel_31 = Panel(send_16)

# ==== cluster Tools

# ---- group: drill_tool
drill_bit_length = ClusterInput()
pt = Point(Point(0, 0, 0))
clay_modified = Geometry([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])
drill_bit_length_2 = Number(drill_bit_length)
X = UnitX(Factor=1)
Y = UnitY(Factor=-1)
brep = Brep(clay_modified)
mesh = Mesh(clay_modified)
ln = Line(StartPoint=pt, EndPoint=X)
ln_2 = Line(StartPoint=pt, EndPoint=Y)
addition = Addition(A=Slider(285, range=0..400), B=drill_bit_length_2)
Z = UnitZ(Factor=addition)
move = Move(Geometry=ln, Motion=Z)  # -> Geometry, Transform
move_2 = Move(Geometry=ln_2, Motion=Z)  # -> Geometry, Transform
crv = Curve(move.Geometry)
crv_2 = Curve(move_2.Geometry)
tool = Tool(meshes=mesh, breps=brep, xline=crv, yline=crv_2)

# ----
tool_id = ClusterInput()

# ---- group: measurement tool
measurement_tool_geo = Geometry([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])
mesh_2 = Mesh(measurement_tool_geo)
mjoin = MeshJoin(Meshes=mesh_2)
tool_2 = PythonScript(meshes=mjoin, brep=measurement_tool_geo)  # -> tool; inputs meshes: list, brep: list
# ---------- tool_2: Python ----------
from ur_online_control.ur.tools import MeasurementTool
from compas.datastructures import Mesh
from compas_rhino.helpers import mesh_from_guid


tool = MeasurementTool()
tool.model = [mesh_from_guid(Mesh, mesh) for mesh in meshes]
#tool.model_xyz = tool.model.xyz
tool.brep = brep
# ---------- end tool_2 ----------

# ----
tool_id_2 = Integer(tool_id)
neg = Negative(Value=Slider(45.8, range=0..100))
panel = Panel(tool_id_2)

# ---- group: drill_tool / gripper_tool
pt_2 = Point(Point(0, 0, 0))
clay_modified_2 = Geometry([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])
X_2 = UnitX(Factor=1)
Y_2 = UnitY(Factor=-1)
mesh_3 = Mesh(clay_modified_2)
brep_2 = Brep(clay_modified_2)
ln_3 = Line(StartPoint=pt_2, EndPoint=X_2)
ln_4 = Line(StartPoint=pt_2, EndPoint=Y_2)
addition_2 = Addition(A=Slider(102, range=0..1000))
Z_2 = UnitZ(Factor=addition_2)
move_3 = Move(Geometry=ln_3, Motion=Z_2)  # -> Geometry, Transform
move_4 = Move(Geometry=ln_4, Motion=Z_2)  # -> Geometry, Transform
crv_3 = Curve(move_3.Geometry)
crv_4 = Curve(move_4.Geometry)

# ----
rot3d = Rotate3D(Geometry=crv_4, Angle=degrees(neg), Center=pt_2, Axis=Vector(0, 0, 1))  # -> Geometry, Transform
rot3d_2 = Rotate3D(Geometry=crv_3, Angle=degrees(neg), Center=pt_2, Axis=Vector(0, 0, 1))  # -> Geometry, Transform

# ---- group: drill_tool / gripper_tool (continued)
tool_3 = Tool(meshes=mesh_3, breps=brep_2, xline=rot3d_2.Geometry, yline=rot3d.Geometry)

# ----
filter = StreamFilter(Gate=tool_id_2, Stream0=tool_2, Stream1=tool, Stream2=tool_3)
py = PythonScript(tool=filter)  # -> tcp_frame, model
# ---------- py: Python ----------
from compas_ghpython import mesh_draw 

tcp_frame = tool.tcp_frame
model = map(mesh_draw, tool.model)
# ---------- end py ----------
tool_4 = Data(filter)
draw = PythonScript(frame=py.tcp_frame)  # -> G, C
# ---------- draw: Python ----------
import Rhino.Geometry as rg
from System.Drawing import Color

if not size:
    size = 100

if frame:
    plane = rg.Plane(rg.Point3d(*list(frame.point)), rg.Vector3d(*list(frame.xaxis)), rg.Vector3d(*list(frame.yaxis)))

    G = []
    G.append(rg.Line(plane.Origin, size * plane.XAxis))
    G.append(rg.Line(plane.Origin, size * plane.YAxis))
    G.append(rg.Line(plane.Origin, size * plane.ZAxis))
    
    C = []
    C.append(Color.FromArgb(255, 0, 0))
    C.append(Color.FromArgb(0, 255, 0))
    C.append(Color.FromArgb(0, 0, 255))
# ---------- end draw ----------
tool_5 = ClusterOutput(tool_4)
preview = CustomPreview(Geometry=draw.G, Shader=draw.C)
preview_2 = CustomPreview(Geometry=py.model, Shader=ColourSwatch(SwatchColor=RGB(141, 170, 178)))

# ==== cluster Send
script = ClusterInput()
send = ClusterInput()
send_2 = PythonScript(script=script, send=send)  # -> out
# ---------- send_2: Python ----------
import socket
from scriptcontext import sticky as st

ur_ip = st["ur_ip"]
ur_port = 30002

if send:
    s = socket.create_connection((ur_ip, ur_port), timeout=0.5) 
    s.send(script)
    s.close()
# ---------- end send_2 ----------
out = ClusterOutput(send_2)

# ==== cluster Draw
size = ClusterInput()
frame = ClusterInput()
draw = PythonScript(frame=frame, size=size)  # -> G, C
# ---------- draw: Python ----------
import Rhino.Geometry as rg
from System.Drawing import Color

if not size:
    size = 100

if frame:
    
    plane = rg.Plane(rg.Point3d(*frame.point), rg.Vector3d(*frame.xaxis), rg.Vector3d(*frame.yaxis))

    G = []
    G.append(rg.Line(plane.Origin, size * plane.XAxis))
    G.append(rg.Line(plane.Origin, size * plane.YAxis))
    G.append(rg.Line(plane.Origin, size * plane.ZAxis))
    
    C = []
    C.append(Color.FromArgb(255, 0, 0))
    C.append(Color.FromArgb(0, 255, 0))
    C.append(Color.FromArgb(0, 0, 255))
# ---------- end draw ----------
G = ClusterOutput(draw.G)
C = ClusterOutput(draw.C)

# ==== cluster Tool
breps = ClusterInput()
meshes = ClusterInput()
meshes_2 = Mesh(meshes)
xline = ClusterInput()
yline = ClusterInput()
mjoin = MeshJoin(Meshes=meshes_2)
tool = PythonScript(meshes=mjoin, breps=breps, xline=xline, yline=yline)  # -> tool; inputs meshes: list of Mesh, breps: list of Brep
# ---------- tool: Python ----------
import Rhino.Geometry as rg
from compas.geometry import Frame
from ur_online_control.ur.tool import Tool
from compas.datastructures import Mesh
from compas_rhino.helpers import mesh_from_guid

xaxis = rg.Line(xline.PointAtStart, xline.PointAtEnd)
yaxis = rg.Line(yline.PointAtStart, yline.PointAtEnd)

if xaxis.From.DistanceTo(yaxis.From) < 0.01:
    origin = xaxis.From
    xaxis = xaxis.Direction
    yaxis = yaxis.Direction
elif xaxis.To.DistanceTo(yaxis.To) < 0.01:
    origin = xaxis.To
    xaxis = -xaxis.Direction
    yaxis = -yaxis.Direction
elif xaxis.From.DistanceTo(yaxis.To) < 0.01:
    origin = xaxis.From
    xaxis = xaxis.Direction
    yaxis = -yaxis.Direction
elif xaxis.To.DistanceTo(yaxis.From) < 0.01:
    origin = xaxis.To
    xaxis = -xaxis.Direction
    yaxis = yaxis.Direction

xaxis.Unitize()
yaxis.Unitize()

print origin
print xaxis
print yaxis

tcp_frame = Frame(origin, xaxis, yaxis)

tool = Tool(tcp_frame)
tool.model = [mesh_from_guid(Mesh, mesh) for mesh in meshes]
#tool.model_xyz = tool.model.xyz
tool.breps = breps
# ---------- end tool ----------
tool_2 = ClusterOutput(tool)
