# Grasshopper definition simple_example.gh (Grasshopper 1.0.4)

python = GhPythonScript()  # -> out, safe_planes, top_planes, bottom_planes, beam_breps
# ---------- python: Python ----------
# import libraries
import Rhino.Geometry as rg
from geometry.beam import Beam
from geometry.dowel import Dowel
from geometry.hole import Hole

# dimensions
beam_dx = 145
beam_dy = 10
beam_dz = 4
dowel_radius = 1.0

# create beams as planes
beam_plane_1 = rg.Plane(rg.Plane.WorldXY)
beam_plane_1.Translate(rg.Vector3d(400, 30, 0))

beam_plane_2 = rg.Plane(rg.Plane.WorldXY)
beam_plane_2.Translate(rg.Vector3d(400, 30, 0))

beam_planes = [beam_plane_1, beam_plane_2]

# create dowels as planes
dowel_plane_1 = rg.Plane(rg.Plane.WorldXY)
dowel_plane_1.Translate(rg.Vector3d(440, 30, 0))
dowel_plane_2 = rg.Plane(rg.Plane.WorldXY)
dowel_plane_2.Translate(rg.Vector3d(-440, 30, 0))

dowel_planes = [dowel_plane_1, dowel_plane_2]

beams = []

# feed beam planes
for beam_plane in beam_planes:

    # create an instance of beam class
    beam = Beam(base_plane=beam_plane, dx=beam_dx, dy=beam_dy, dz=beam_dz)

    for dowel_plane in dowel_planes:

        # create an instance of dowel class as the connected dowel connected
        dowel = Dowel(base_plane=dowel_plane, dowel_radius=dowel_radius)

        # add the dowel to the beam as its connection
        beam.add_dowel(dowel)

    beams.append(beam)

# get planes and brep(s)
safe_planes, top_planes, bottom_planes, beam_breps = Hole.get_tool_planes_as_tree(beams, safe_buffer=0, safe_plane_diff=100)
# ---------- end python ----------
python_2 = GhPythonScript(toggle=Button())  # -> out, a
# ---------- python_2: Python ----------
__author__ = "ytakzk"
__version__ = "2019.01.21"

import geometry.beam as beam
import geometry.dowel as dowel
import geometry.hole as hole

if toggle:
    
    reload(beam)
    reload(dowel)
    reload(hole)
# ---------- end python_2 ----------
pln = Plane(python.safe_planes)
pln_2 = Plane(python.top_planes)
pln_3 = Plane(python.bottom_planes)
brep = Brep(python.beam_breps)
