# Grasshopper definition t2_framework.gh (Grasshopper 1.0.4)

number_slider = Slider(3, range=0..10)
number_slider_2 = Slider(20, range=0..100)
python = GhPythonScript()  # -> out
# ---------- python: Python ----------
__author__ = "ytakzk"
__version__ = "2019.01.15"

import Rhino.Geometry as rg
import scriptcontext as sc

class Beam:
    
    def __init__(self, base_plane, dx, dy, dz):
        
        self.base_plane = base_plane
        self.dx = dx
        self.dy = dy
        self.dz = dz
        self.dowel_list = []
        
    def materialize(self):
        
        # create a beam
        box = rg.Box(self.base_plane,
            rg.Interval(-self.dx*0.5, self.dx*0.5),
            rg.Interval(-self.dy*0.5, self.dy*0.5),
            rg.Interval(-self.dz*0.5, self.dz*0.5)
            )
        
        # create a dowels
        for dowel in self.dowel_list:
            
            d = dowel.get_pipe_with_length()
            
            rg.Circle(d)
        
        return box

class Dowel:
    
    inner_radius = 24
    outer_radius = 26
    
    def __init__(self, base_plane):
        
        self.base_plane = base_plane
        self.beam_list = []
        
    def materialize(self):
        
        pass
        
    def get_pipe_with_length(self, length=9999):
        
        copied_plane = rg.Plane(self.base_plane)
        
        copied_plane.Translate(copied_plane.Normal * -length)
    
        circle = rg.Circle(copied_plane, self.inner_radius)
        return rg.Cylinder(circle, length)

sc.sticky['Dowel'] = Dowel
sc.sticky['Beam'] = Beam
# ---------- end python ----------
neg = Negative(Value=number_slider_2)
pt = ConstructPoint(XCoordinate=Slider(64, range=0..100), YCoordinate=Slider(0, range=0..100), ZCoordinate=Slider(3, range=0..100))
pt_2 = ConstructPoint(XCoordinate=Slider(65, range=0..100), YCoordinate=Slider(40, range=0..100), ZCoordinate=Slider(-74, range=-100..101))
neg_2 = Negative(Value="60")
pt_3 = ConstructPoint(XCoordinate=Slider(0.1, range=0..1), YCoordinate=Slider(0.9, range=0..1), ZCoordinate=Slider(0.3, range=0..1))
pt_4 = ConstructPoint(XCoordinate=Slider(0.3, range=0..1), YCoordinate=Slider(0.7, range=0..1), ZCoordinate=Slider(0.1, range=0..1))
pt_5 = ConstructPoint(XCoordinate=Slider(97, range=0..100), YCoordinate=Slider(100, range=0..100), ZCoordinate=Slider(40, range=0..100))
pt_6 = ConstructPoint(XCoordinate=Slider(80, range=0..100), YCoordinate=Slider(35, range=0..500), ZCoordinate=Slider(133, range=0..200))
pt_7 = ConstructPoint(XCoordinate=Slider(0.2, range=0..1), YCoordinate=Slider(0.7, range=0..1), ZCoordinate=Slider(0.2, range=0..1))
pt_8 = ConstructPoint(XCoordinate=Slider(0.1, range=-1..1), YCoordinate=Slider(0.8, range=0..1), ZCoordinate=Slider(0.1, range=0..1))
series = Series(Start="60", Step=number_slider_2, Count=number_slider)
series_2 = Series(Start=neg_2, Step=neg, Count=number_slider)
number_slider_3 = Slider(100, range=0..100)
number_slider_4 = Slider(100, range=0..100)
pl = PlaneNormal(Origin=pt, ZAxis=pt_3)
pl_2 = PlaneNormal(Origin=pt_2, ZAxis=pt_4)
pl_3 = PlaneNormal(Origin=pt_5, ZAxis=pt_7)
pl_4 = PlaneNormal(Origin=pt_6, ZAxis=pt_8)
pl_5 = PlaneNormal(Origin=Point(0, 0, 0), ZAxis=Vector(0, 0, 1))
merge = Merge(Data1=series, Data2=series_2)
X = UnitX(Factor=merge)
pl_6 = PlaneNormal(Origin=Point(0, 0, 0), ZAxis=Vector(0, 0, 1))
size_z = Slider(4, range=0..200)
line = LineSDL(Start=pt_2, Direction=pt_4, Length=number_slider_3)
line_2 = LineSDL(Start=pt_6, Direction=pt_8, Length=number_slider_4)
move = Move(Geometry=pl_6, Motion=X)  # -> Geometry, Transform
ext = ExtendCurve(Curve=line, Type=0, Start=number_slider_3, End=number_slider_3)
ext_2 = ExtendCurve(Curve=line_2, Type=0, Start=number_slider_4, End=number_slider_4)
python_2 = GhPythonScript(dx=Slider(145, range=0..1000), dy=Slider(10, range=0..10), dz=size_z, beam_planes=pl_5, dowel_planes=move.Geometry)  # -> out, safe_planes, top_planes, bottom_planes, beam_breps; inputs beam_planes: list of Plane, dowel_planes: list of Plane
# ---------- python_2: Python ----------
"""
Basic classes for MAS-DFAB 2018-19 T2 GKR Project
"""

__author__ = "masdfab students"
__status__ = "development"
__version__ = "0.0.1"
__date__    = "15 January 2019"

import Rhino.Geometry as rg
import Grasshopper.Kernel.Data.GH_Path as ghpath
import Grasshopper.DataTree as datatree
import System
import math

tmp = []

class Hole:

    """
    Stores the planes for the drilling process.
    """

    def __init__(self, gripping_plane, top_plane, bottom_plane, middle_plane, beam_brep):

        """
        initialization
        :param gripping_plane: gripping_plane plane to grab the beam
        :param top_plane:  top_plane plane to be drilled
        :param bottom_plane:  bottom_plane plane to be drilled
        :param middle_plane:  middle_plane plane to be drilled
        :param beam_brep: beam brep to be drilled (for debug purpose only)
        """

        self.gripping_plane = gripping_plane
        self.top_plane = top_plane
        self.bottom_plane = bottom_plane
        self.middle_plane = middle_plane
        self.beam_brep = beam_brep

    @staticmethod
    def create_holes(beam, safe_buffer=2.0):

        """
        instanciates the holes in the beam
        :param beam:  beam plane to be drilled
        :param safe_buffer:  buffer length to drill for each side of the beam
        :return [Hole]
        """

        holes = []

        # can be optimized (for now it holds the very middle part of the beam)
        gripping_plane = beam.base_plane

        beam_normal = beam.base_plane.XAxis

        for dowel in beam.dowel_list:

            line = dowel.get_line()

            dowel_plane  = dowel.get_plane()
            dowel_normal = dowel_plane.Normal
            angle = rg.Vector3d.VectorAngle(beam_normal, dowel_normal)

            top_frame    = rg.Plane(beam.base_plane)
            middle_frame = rg.Plane(beam.base_plane)
            bottom_frame = rg.Plane(beam.base_plane)

            diff = beam.dy * 0.5 + abs(dowel.inner_radius / math.tan(angle)) + safe_buffer

            top_frame.Translate(beam.base_plane.ZAxis * diff)
            bottom_frame.Translate(-beam.base_plane.ZAxis * diff)

            hole_plane_list = []

            for f in [top_frame, middle_frame, bottom_frame]:

                succeeded, v = rg.Intersect.Intersection.LinePlane(line, f)

                p = line.PointAt(v)
                plane = rg.Plane(dowel_plane)
                plane.Origin = p
                hole_plane_list.append(plane)

                # to direct normals of holes to that of gripping plane
                angle = rg.Vector3d.VectorAngle(gripping_plane.Normal, plane.Normal)
                if math.pi * 0.5 < angle and angle < math.pi * 1.5:
                    plane.Flip()

            hole = Hole(gripping_plane=rg.Plane(gripping_plane),
                top_plane=hole_plane_list[0],
                middle_plane=hole_plane_list[1],
                bottom_plane=hole_plane_list[2],
                beam_brep=beam.brep_representation())

            holes.append(hole)

        return holes

    @staticmethod
    def get_tool_planes_as_tree(beams, target_plane=rg.Plane.WorldXY, safe_buffer=2.0, safe_plane_diff=100):
        
        safe_plane_tree   = datatree[System.Object]()
        top_plane_tree    = datatree[System.Object]()
        bottom_plane_tree = datatree[System.Object]()
        beam_brep_tree    = datatree[System.Object]()
        
        for i, beam in enumerate(beams):
            
            holes = Hole.create_holes(beam, safe_buffer=safe_buffer)
            
            path = ghpath(i)
            
            for hole in holes:
                
                hole.orient_to_drilling_station(target_plane)
                safe_plane, top_plane, bottom_plane = hole.get_tool_planes(safe_plane_diff=safe_plane_diff)
                
                safe_plane_tree.Add(safe_plane, path)
                top_plane_tree.Add(top_plane, path)
                bottom_plane_tree.Add(bottom_plane, path)
                beam_brep_tree.Add(hole.beam_brep, path)
         
        return safe_plane_tree, top_plane_tree, bottom_plane_tree, beam_brep_tree
                
    def orient_to_drilling_station(self, target_frame):

        """
        orient a bottom plane to a given frame
        """

        transform = rg.Transform.PlaneToPlane(self.bottom_plane, target_frame)
        self.gripping_plane.Transform(transform)
        self.top_plane.Transform(transform)
        self.bottom_plane.Transform(transform)
        self.middle_plane.Transform(transform)

        if self.beam_brep:
            self.beam_brep.Transform(transform)

    def get_tool_planes(self, safe_plane_diff=100):

        """
        get planes to be sent to the robotic arm 
        :param diff:  offset for the safe plane
        :return (safe plane, top plane, bottom plane)
        """

        top_diff = self.top_plane.Origin.Z - self.middle_plane.Origin.Z
        bottom_diff = self.bottom_plane.Origin.Z - self.middle_plane.Origin.Z
        
        top_gripping_plane = rg.Plane(self.gripping_plane)
        top_gripping_plane.Translate(rg.Vector3d(0, 0, top_diff))

        bottom_gripping_plane = rg.Plane(self.gripping_plane)
        bottom_gripping_plane.Translate(rg.Vector3d(0, 0, bottom_diff))

        safe_gripping_plane = rg.Plane(top_gripping_plane)
        safe_gripping_plane.Translate(rg.Vector3d(0, 0, safe_plane_diff))
        
        return safe_gripping_plane, top_gripping_plane, bottom_gripping_plane

        
class Beam:

    """
    Beam class containing its size and connecting dowels
    """

    def __init__(self, base_plane, dx, dy, dz):

        """
        initialization
        :param base_plane: base plane which the beam is along with
        :param dx:  the length along the local x-axis (= the length of this beam)
        :param dy:  the length along the local y-axis
        :param dz:  the length along the local z-axis
        """

        self.base_plane = base_plane
        self.dx = dx
        self.dy = dy
        self.dz = dz
        self.dowel_list = []

    def add_dowel(self, dowel):

        """
        add a dowel to this beam
        :param dowel:  the new dowel to be added
        """

        self.dowel_list.append(dowel)
        dowel.beam_list.append(self)

    def remove_duplicates_in_dowel_list(self):

        """
        resolve dowel duplication
        """

        self.dowel_list = list(set(self.dowel_list))

    def brep_representation(self):

        """
        make a brep of this beam with holes
        :return brep object of this beam
        """

        # create a beam
        box = rg.Box(self.base_plane,
            rg.Interval(-self.dx*0.5, self.dx*0.5),
            rg.Interval(-self.dy*0.5, self.dy*0.5),
            rg.Interval(-self.dz*0.5, self.dz*0.5)
            )

        box = box.ToBrep()

        # create a dowels
        for dowel in self.dowel_list:

            pipe = dowel.get_outer_pipe()

            pipe = pipe.ToBrep(True, True)

            tmp_box = rg.Brep.CreateBooleanDifference(box, pipe, 0.1)

            if len(tmp_box) > 0:
                box = tmp_box[0]

        return box

    def get_baseline(self):

        """
        get a line along with z-axis
        :return line object of this beam
        """

        diff = self.base_plane.XAxis * self.dx * 0.5
        p1 = rg.Point3d.Subtract(self.base_plane.Origin, diff)
        p2 = rg.Point3d.Subtract(self.base_plane.Origin, -diff)

        return rg.Line(p1, p2)

    def transform_instance_to_frame(self, target_frame=None):

        """
        in-place transform
        :param target_frame:  target frame to transform according to this base_plane
        """

        Beam.__move_to_frame(self, self.base_plane, target_frame)

    def transform_instance_from_frame_to_frame(self, source_frame, target_frame=None):

        """
        in-place transform
        :param source_frame:  source_frame frame to transform
        :param target_frame:  target frame  to be transformed
        """

        Beam.__move_to_frame(self, source_frame, target_frame)

    def __move_to_frame(beam, source_frame, target_frame=None):

        """
        private method to transform
        """

        if not target_frame:
            target_frame = beam.base_plane

        transform = rg.Transform.PlaneToPlane(source_frame, target_frame)

        beam.base_plane.Transform(transform)

        for dowel in beam.dowel_list:

            if dowel.base_plane:
                dowel.base_plane.Transform(transform)

            if dowel.line:
                dowel.line.Transform(transform)

        return beam


    @staticmethod
    def get_strucutured_data(beams):

        """
        get a data tree of lines with the actual length of each dowel
        :param beams:  beams to be structured
        :return DataTree
        """

        tree = datatree[System.Object]()

        for i, beam in enumerate(beams):
            
            path = ghpath(i)
            
            for dowel in beam.dowel_list:
                
                tree.Add(dowel.get_calculated_line(), path)

        return tree

class Dowel:

    """
    Dowel class with connected beams
    """

    """radius of dowel itself"""
    inner_radius = 1.0

    """radius to be drilled"""
    outer_radius = 1.2

    def __init__(self, base_plane=None, line=None):

        """
        initialization
        :param base_plane: base plane which the dowel is along with
        :param line: line object that corresponds to the dowel itself

        base_plane and line are exclusive!
        """

        if base_plane and line:
            # TODO throw error
            return

        self.base_plane = base_plane
        self.line = line
        self.beam_list  = []

    def remove_duplicates_in_beam_list(self):

        """
        resolve beam duplication
        """

        return list(set(self.beam_list))
    
    def get_plane(self):

        """
        get the plane on this dowel
        :return rg.Vector3d
        """

        if self.base_plane:
        
            return self.base_plane
        
        else:
            
            p1 = self.line.PointAt(0)
            pc = self.line.PointAt(0.5)
            p2 = self.line.PointAt(1)
            return rg.Plane(pc, rg.Vector3d.Subtract(rg.Vector3d(p1),
                rg.Vector3d(p2)))
        
        
    def get_calculated_line(self):

        """
        get the line with the actual length
        :return rg.Line
        """

        if self.line:
            return self.line

        # get an infinite line
        diff = self.base_plane.Normal * 9999
        p1 = rg.Point3d.Subtract(self.base_plane.Origin, diff)
        p2 = rg.Point3d.Subtract(self.base_plane.Origin, -diff)

        dowel_line = rg.Line(p1, p2)
        
        smallest_val  = 9999
        biggest_val   = -9999
        smallest_beam = None
        biggest_beam  = None
        
        dowel_plane  = self.get_plane()
        dowel_normal = dowel_plane.Normal 

        # get both ends of this dowel
        for beam in self.beam_list:

            beam_line = beam.get_baseline()

            _, dowel_v, beam_v = rg.Intersect.Intersection.LineLine(dowel_line, beam_line)
            
            if dowel_v < smallest_val:
                smallest_val = dowel_v
                smallest_beam = beam
                
            elif biggest_val < dowel_v:
                biggest_val = dowel_v
                biggest_beam = beam

        actual_dowel_line = rg.Line(dowel_line.PointAt(smallest_val), dowel_line.PointAt(biggest_val))

        # entend the dowel        
        angle = rg.Vector3d.VectorAngle(dowel_normal, smallest_beam.base_plane.XAxis)
        exntension_1 = smallest_beam.dz * 0.5 / math.sin(angle)

        angle = rg.Vector3d.VectorAngle(dowel_normal, biggest_beam.base_plane.XAxis)
        exntension_2 = biggest_beam.dz * 0.5 / math.sin(angle)
        
        actual_dowel_line.Extend(exntension_1, exntension_2)
        
        return actual_dowel_line
        
    def brep_representation(self):

        """
        make a brep of this dowel (for now with pseudo end points)
        :return cylinder object of this dowel
        """

        return self.get_inner_pipe()

    def get_line(self):

        """
        get a line object of this dowel
        :return line object
        """

        if self.line:
            return self.line

        # get an infinite line
        diff = self.base_plane.Normal * 9999
        p1 = rg.Point3d.Subtract(self.base_plane.Origin, diff)
        p2 = rg.Point3d.Subtract(self.base_plane.Origin, -diff)

        return rg.Line(p1, p2)

    def get_outer_pipe(self):

        """
        get a cylinder drilled
        :return cylinder object
        """

        return self.__get_pipe(self.outer_radius)

    def get_inner_pipe(self):

        """
        get a cylinder of dowel
        :return cylinder object
        """

        return self.__get_pipe(self.inner_radius)

    def __get_pipe(self, radius):

        """
        private method to create a cylinder
        """

        line = self.get_line()

        _, plane = line.ToNurbsCurve().PerpendicularFrameAt(0)
        circle = rg.Circle(plane, radius)
        return rg.Cylinder(circle, line.Length)

beams = []

for beam_plane in beam_planes:
    
    beam = Beam(base_plane=beam_plane, dx=dx, dy=dy, dz=dz)
    
    for dowel_plane in dowel_planes:
        
        dowel = Dowel(base_plane=dowel_plane)
        beam.add_dowel(dowel)
    
    beams.append(beam)

# create holes
frame = rg.Plane(rg.Plane.WorldXY.Origin, rg.Plane.WorldXY.ZAxis)
frame.Translate(rg.Vector3d(-200, -200, 0))

safe_planes, top_planes, bottom_planes, beam_breps = Hole.get_tool_planes_as_tree(beams, target_plane=frame, safe_buffer=2.0, safe_plane_diff=100)
# ---------- end python_2 ----------
python_3 = GhPythonScript(beam_base_plane_1=pl, dowel_base_plane_1=pl_2, beam_base_plane_2=pl_3, dowel_base_plane_2=pl_4)  # -> out, beams, moved_beams, safe_plane_tree, top_plane_tree, bottom_plane_tree, beam_brep_tree, tmp, tree; inputs beam_base_plane_1: Plane, dowel_base_plane_1: Plane, beam_base_plane_2: Plane, dowel_base_plane_2: Plane
# ---------- python_3: Python ----------
"""
Basic classes for MAS-DFAB 2018-19 T2 GKR Project
"""

__author__ = "masdfab students"
__status__ = "development"
__version__ = "0.0.1"
__date__    = "15 January 2019"

import Rhino.Geometry as rg
import Grasshopper.Kernel.Data.GH_Path as ghpath
import Grasshopper.DataTree as datatree
import System
import math

tmp = []

class Hole:

    """
    Stores the planes for the drilling process.
    """

    def __init__(self, gripping_plane, top_plane, bottom_plane, middle_plane, beam_brep):

        """
        initialization
        :param gripping_plane: gripping_plane plane to grab the beam
        :param top_plane:  top_plane plane to be drilled
        :param bottom_plane:  bottom_plane plane to be drilled
        :param middle_plane:  middle_plane plane to be drilled
        :param beam_brep: beam brep to be drilled (for debug purpose only)
        """

        self.gripping_plane = gripping_plane
        self.top_plane = top_plane
        self.bottom_plane = bottom_plane
        self.middle_plane = middle_plane
        self.beam_brep = beam_brep

    @staticmethod
    def create_holes(beam, safe_buffer=2.0):

        """
        instanciates the holes in the beam
        :param beam:  beam plane to be drilled
        :param safe_buffer:  buffer length to drill for each side of the beam
        :return [Hole]
        """

        holes = []

        # can be optimized (for now it holds the very middle part of the beam)
        gripping_plane = beam.base_plane

        beam_normal = beam.base_plane.XAxis

        for dowel in beam.dowel_list:

            line = dowel.get_line()

            dowel_plane  = dowel.get_plane()
            dowel_normal = dowel_plane.Normal
            angle = rg.Vector3d.VectorAngle(beam_normal, dowel_normal)

            top_frame    = rg.Plane(beam.base_plane)
            middle_frame = rg.Plane(beam.base_plane)
            bottom_frame = rg.Plane(beam.base_plane)

            diff = beam.dy * 0.5 + abs(dowel.inner_radius / math.tan(angle)) + safe_buffer

            top_frame.Translate(beam.base_plane.ZAxis * diff)
            bottom_frame.Translate(-beam.base_plane.ZAxis * diff)

            hole_plane_list = []

            for f in [top_frame, middle_frame, bottom_frame]:

                succeeded, v = rg.Intersect.Intersection.LinePlane(line, f)

                p = line.PointAt(v)
                plane = rg.Plane(dowel_plane)
                plane.Origin = p
                hole_plane_list.append(plane)

                # to direct normals of holes to that of gripping plane
                angle = rg.Vector3d.VectorAngle(gripping_plane.Normal, plane.Normal)
                if math.pi * 0.5 < angle and angle < math.pi * 1.5:
                    plane.Flip()

            hole = Hole(gripping_plane=rg.Plane(gripping_plane),
                top_plane=hole_plane_list[0],
                middle_plane=hole_plane_list[1],
                bottom_plane=hole_plane_list[2],
                beam_brep=beam.brep_representation())

            holes.append(hole)

        return holes

    @staticmethod
    def get_tool_planes_as_tree(beams, target_plane=rg.Plane.WorldXY, safe_buffer=2.0, safe_plane_diff=100):
        
        safe_plane_tree   = datatree[System.Object]()
        top_plane_tree    = datatree[System.Object]()
        bottom_plane_tree = datatree[System.Object]()
        beam_brep_tree    = datatree[System.Object]()
        
        for i, beam in enumerate(beams):
            
            holes = Hole.create_holes(beam, safe_buffer=safe_buffer)
            
            path = ghpath(i)
            
            for hole in holes:
                
                hole.orient_to_drilling_station(target_plane)
                safe_plane, top_plane, bottom_plane = hole.get_tool_planes(safe_plane_diff=safe_plane_diff)
                
                safe_plane_tree.Add(safe_plane, path)
                top_plane_tree.Add(top_plane, path)
                bottom_plane_tree.Add(bottom_plane, path)
                beam_brep_tree.Add(hole.beam_brep, path)
         
        return safe_plane_tree, top_plane_tree, bottom_plane_tree, beam_brep_tree
                
    def orient_to_drilling_station(self, target_frame):

        """
        orient a bottom plane to a given frame
        """

        transform = rg.Transform.PlaneToPlane(self.bottom_plane, target_frame)
        self.gripping_plane.Transform(transform)
        self.top_plane.Transform(transform)
        self.bottom_plane.Transform(transform)
        self.middle_plane.Transform(transform)

        if self.beam_brep:
            self.beam_brep.Transform(transform)

    def get_tool_planes(self, safe_plane_diff=100):

        """
        get planes to be sent to the robotic arm 
        :param diff:  offset for the safe plane
        :return (safe plane, top plane, bottom plane)
        """

        top_diff = self.top_plane.Origin.Z - self.middle_plane.Origin.Z
        bottom_diff = self.bottom_plane.Origin.Z - self.middle_plane.Origin.Z
        
        top_gripping_plane = rg.Plane(self.gripping_plane)
        top_gripping_plane.Translate(rg.Vector3d(0, 0, top_diff))

        bottom_gripping_plane = rg.Plane(self.gripping_plane)
        bottom_gripping_plane.Translate(rg.Vector3d(0, 0, bottom_diff))

        safe_gripping_plane = rg.Plane(top_gripping_plane)
        safe_gripping_plane.Translate(rg.Vector3d(0, 0, safe_plane_diff))
        
        return safe_gripping_plane, top_gripping_plane, bottom_gripping_plane

        
class Beam:

    """
    Beam class containing its size and connecting dowels
    """

    def __init__(self, base_plane, dx, dy, dz):

        """
        initialization
        :param base_plane: base plane which the beam is along with
        :param dx:  the length along the local x-axis (= the length of this beam)
        :param dy:  the length along the local y-axis
        :param dz:  the length along the local z-axis
        """

        self.base_plane = base_plane
        self.dx = dx
        self.dy = dy
        self.dz = dz
        self.dowel_list = []

    def add_dowel(self, dowel):

        """
        add a dowel to this beam
        :param dowel:  the new dowel to be added
        """

        self.dowel_list.append(dowel)
        dowel.beam_list.append(self)

    def remove_duplicates_in_dowel_list(self):

        """
        resolve dowel duplication
        """

        self.dowel_list = list(set(self.dowel_list))

    def brep_representation(self):

        """
        make a brep of this beam with holes
        :return brep object of this beam
        """

        # create a beam
        box = rg.Box(self.base_plane,
            rg.Interval(-self.dx*0.5, self.dx*0.5),
            rg.Interval(-self.dy*0.5, self.dy*0.5),
            rg.Interval(-self.dz*0.5, self.dz*0.5)
            )

        box = box.ToBrep()

        # create a dowels
        for dowel in self.dowel_list:

            pipe = dowel.get_outer_pipe()

            pipe = pipe.ToBrep(True, True)

            tmp_box = rg.Brep.CreateBooleanDifference(box, pipe, 0.1)

            if len(tmp_box) > 0:
                box = tmp_box[0]

        return box

    def get_baseline(self):

        """
        get a line along with z-axis
        :return line object of this beam
        """

        diff = self.base_plane.XAxis * self.dx * 0.5
        p1 = rg.Point3d.Subtract(self.base_plane.Origin, diff)
        p2 = rg.Point3d.Subtract(self.base_plane.Origin, -diff)

        return rg.Line(p1, p2)

    def transform_instance_to_frame(self, target_frame=None):

        """
        in-place transform
        :param target_frame:  target frame to transform according to this base_plane
        """

        Beam.__move_to_frame(self, self.base_plane, target_frame)

    def transform_instance_from_frame_to_frame(self, source_frame, target_frame=None):

        """
        in-place transform
        :param source_frame:  source_frame frame to transform
        :param target_frame:  target frame  to be transformed
        """

        Beam.__move_to_frame(self, source_frame, target_frame)

    def __move_to_frame(beam, source_frame, target_frame=None):

        """
        private method to transform
        """

        if not target_frame:
            target_frame = beam.base_plane

        transform = rg.Transform.PlaneToPlane(source_frame, target_frame)

        beam.base_plane.Transform(transform)

        for dowel in beam.dowel_list:

            if dowel.base_plane:
                dowel.base_plane.Transform(transform)

            if dowel.line:
                dowel.line.Transform(transform)

        return beam


    @staticmethod
    def get_strucutured_data(beams):

        """
        get a data tree of lines with the actual length of each dowel
        :param beams:  beams to be structured
        :return DataTree
        """

        tree = datatree[System.Object]()

        for i, beam in enumerate(beams):
            
            path = ghpath(i)
            
            for dowel in beam.dowel_list:
                
                tree.Add(dowel.get_calculated_line(), path)

        return tree

class Dowel:

    """
    Dowel class with connected beams
    """

    """radius of dowel itself"""
    inner_radius = 10

    """radius to be drilled"""
    outer_radius = 12

    def __init__(self, base_plane=None, line=None):

        """
        initialization
        :param base_plane: base plane which the dowel is along with
        :param line: line object that corresponds to the dowel itself

        base_plane and line are exclusive!
        """

        if base_plane and line:
            # TODO throw error
            return

        self.base_plane = base_plane
        self.line = line
        self.beam_list  = []

    def remove_duplicates_in_beam_list(self):

        """
        resolve beam duplication
        """

        return list(set(self.beam_list))
    
    def get_plane(self):

        """
        get the plane on this dowel
        :return rg.Vector3d
        """

        if self.base_plane:
        
            return self.base_plane
        
        else:
            
            p1 = self.line.PointAt(0)
            pc = self.line.PointAt(0.5)
            p2 = self.line.PointAt(1)
            return rg.Plane(pc, rg.Vector3d.Subtract(rg.Vector3d(p1),
                rg.Vector3d(p2)))
        
        
    def get_calculated_line(self):

        """
        get the line with the actual length
        :return rg.Line
        """

        if self.line:
            return self.line

        # get an infinite line
        diff = self.base_plane.Normal * 9999
        p1 = rg.Point3d.Subtract(self.base_plane.Origin, diff)
        p2 = rg.Point3d.Subtract(self.base_plane.Origin, -diff)

        dowel_line = rg.Line(p1, p2)
        
        smallest_val  = 9999
        biggest_val   = -9999
        smallest_beam = None
        biggest_beam  = None
        
        dowel_plane  = self.get_plane()
        dowel_normal = dowel_plane.Normal 

        # get both ends of this dowel
        for beam in self.beam_list:

            beam_line = beam.get_baseline()

            _, dowel_v, beam_v = rg.Intersect.Intersection.LineLine(dowel_line, beam_line)
            
            if dowel_v < smallest_val:
                smallest_val = dowel_v
                smallest_beam = beam
                
            elif biggest_val < dowel_v:
                biggest_val = dowel_v
                biggest_beam = beam

        actual_dowel_line = rg.Line(dowel_line.PointAt(smallest_val), dowel_line.PointAt(biggest_val))

        # entend the dowel        
        angle = rg.Vector3d.VectorAngle(dowel_normal, smallest_beam.base_plane.XAxis)
        exntension_1 = smallest_beam.dz * 0.5 / math.sin(angle)

        angle = rg.Vector3d.VectorAngle(dowel_normal, biggest_beam.base_plane.XAxis)
        exntension_2 = biggest_beam.dz * 0.5 / math.sin(angle)
        
        actual_dowel_line.Extend(exntension_1, exntension_2)
        
        return actual_dowel_line
        
    def brep_representation(self):

        """
        make a brep of this dowel (for now with pseudo end points)
        :return cylinder object of this dowel
        """

        return self.get_inner_pipe()

    def get_line(self):

        """
        get a line object of this dowel
        :return line object
        """

        if self.line:
            return self.line

        # get an infinite line
        diff = self.base_plane.Normal * 9999
        p1 = rg.Point3d.Subtract(self.base_plane.Origin, diff)
        p2 = rg.Point3d.Subtract(self.base_plane.Origin, -diff)

        return rg.Line(p1, p2)

    def get_outer_pipe(self):

        """
        get a cylinder drilled
        :return cylinder object
        """

        return self.__get_pipe(self.outer_radius)

    def get_inner_pipe(self):

        """
        get a cylinder of dowel
        :return cylinder object
        """

        return self.__get_pipe(self.inner_radius)

    def __get_pipe(self, radius):

        """
        private method to create a cylinder
        """

        line = self.get_line()

        _, plane = line.ToNurbsCurve().PerpendicularFrameAt(0)
        circle = rg.Circle(plane, radius)
        return rg.Cylinder(circle, line.Length)

# instanciate objects
beam_1  = Beam(base_plane=beam_base_plane_1, dx=300, dy=50, dz=25)
beam_2  = Beam(base_plane=beam_base_plane_2, dx=300, dy=50, dz=25)
dowel_1 = Dowel(base_plane=dowel_base_plane_1)
dowel_2 = Dowel(base_plane=dowel_base_plane_2)

beam_1.add_dowel(dowel_1)
beam_1.add_dowel(dowel_2)
beam_2.add_dowel(dowel_1)
beam_2.add_dowel(dowel_2)

dowel_2.get_calculated_line()

# visualize the beams positioned in space
beams = [b.brep_representation() for b in [beam_1, beam_2]]

# create holes
frame = rg.Plane(rg.Plane.WorldXY.Origin, rg.Plane.WorldXY.ZAxis)
frame.Translate(rg.Vector3d(-200, -200, 0))

safe_plane_tree, top_plane_tree, bottom_plane_tree, beam_brep_tree = Hole.get_tool_planes_as_tree([beam_1, beam_2], target_plane=frame, safe_buffer=2.0, safe_plane_diff=100)
# ---------- end python_3 ----------
python_4 = GhPythonScript(beam_base_plane_1=pl, dowel_line_1=ext, beam_base_plane_2=pl_3, dowel_line_2=ext_2)  # -> out, beams, moved_beams, top_planes, bottom_planes, gripping_planes, safe_planes, tmp, tree; inputs beam_base_plane_1: Plane, dowel_line_1: Line, beam_base_plane_2: Plane, dowel_line_2: Line
# ---------- python_4: Python ----------
"""
Basic classes for MAS-DFAB 2018-19 T2 GKR Project
"""

__author__ = "masdfab students"
__status__ = "development"
__version__ = "0.0.1"
__date__    = "15 January 2019"

import Rhino.Geometry as rg
import Grasshopper.Kernel.Data.GH_Path as ghpath
import Grasshopper.DataTree as datatree
import System
import math

tmp = []

class Hole:

    """
    Stores the planes for the drilling process.
    """

    def __init__(self, gripping_plane, top_plane, bottom_plane, beam):

        """
        initialization
        :param gripping_plane: gripping_plane plane to grab the beam
        :param top_plane:  top_plane plane to start drilling
        :param bottom_plane:  bottom_plane plane to end drilling
        :param beam: beam to be drilled (for debug purpose only)
        """

        self.gripping_plane = gripping_plane
        self.top_plane = top_plane
        self.bottom_plane = bottom_plane
        self.beam = beam

    @staticmethod
    def create_holes(beam, safe_buffer=2.0):

        """
        instanciates the holes in the beam
        :param beam:  beam plane to be drilled
        :param safe_buffer:  buffer length to drill for each side of the beam
        :return [Hole]
        """

        holes = []

        # can be optimized (for now it holds the very middle part of the beam)
        gripping_plane = beam.base_plane

        beam_normal = beam.base_plane.XAxis

        for dowel in beam.dowel_list:

            line = dowel.get_line()

            dowel_plane = dowel.get_plane()
            dowel_normal = dowel_plane.Normal
            angle = rg.Vector3d.VectorAngle(beam_normal, dowel_normal)

            top_frame = rg.Plane(beam.base_plane)
            bottom_frame = rg.Plane(beam.base_plane)

            diff = beam.dy * 0.5 + abs(dowel.inner_radius / math.tan(angle)) + safe_buffer

            top_frame.Translate(beam.base_plane.ZAxis * diff)
            bottom_frame.Translate(-beam.base_plane.ZAxis * diff)

            hole_plane_list = []

            for f in [top_frame, bottom_frame]:

                succeeded, v = rg.Intersect.Intersection.LinePlane(line, f)

                p = line.PointAt(v)
                plane = rg.Plane(dowel_plane)
                plane.Origin = p
                hole_plane_list.append(plane)

                # to direct normals of holes to that of gripping plane
                angle = rg.Vector3d.VectorAngle(gripping_plane.Normal, plane.Normal)
                if math.pi * 0.5 < angle and angle < math.pi * 1.5:
                    plane.Flip()
            
            hole = Hole(gripping_plane=rg.Plane(gripping_plane),
                top_plane=hole_plane_list[0],
                bottom_plane=hole_plane_list[1],
                beam=beam.copy())

            holes.append(hole)

        return holes

    def orient_to_drilling_station(self, target_frame):

        """
        orient a bottom plane to a given frame
        """

        copied = rg.Plane(self.bottom_plane)
        transform = rg.Transform.PlaneToPlane(copied, target_frame)
        self.gripping_plane.Transform(transform)
        self.top_plane.Transform(transform)
        self.bottom_plane.Transform(transform)

        if self.beam:
            self.beam.transform_instance_from_frame_to_frame(copied, target_frame)

    def get_safe_plane(self, diff=100):

        """
        get a safe plane to drill
        :param diff:  offset for the safe plane
        :return rg.Plane
        """

        safe_plane = rg.Plane(self.bottom_plane)
        safe_plane.Translate(safe_plane.ZAxis * -diff)
        return safe_plane
        
class Beam:

    """
    Beam class containing its size and connecting dowels
    """

    def __init__(self, base_plane, dx, dy, dz):

        """
        initialization
        :param base_plane: base plane which the beam is along with
        :param dx:  the length along the local x-axis (= the length of this beam)
        :param dy:  the length along the local y-axis
        :param dz:  the length along the local z-axis
        """

        self.base_plane = base_plane
        self.dx = dx
        self.dy = dy
        self.dz = dz
        self.dowel_list = []

    def copy(self):

        """
        create a copy of this instance
        :return copied beam
        """

        beam = Beam(base_plane=rg.Plane(self.base_plane),
                dx=self.dx,
                dy=self.dy,
                dz=self.dz)

        for d in self.dowel_list:
            
            dowel = Dowel(
                base_plane=rg.Plane(d.base_plane) if d.base_plane else None,
                line=rg.Line(d.line.PointAt(0), d.line.PointAt(1)) if d.line else None)
            beam.add_dowel(dowel)

        return beam

    def add_dowel(self, dowel):

        """
        add a dowel to this beam
        :param dowel:  the new dowel to be added
        """

        self.dowel_list.append(dowel)
        dowel.beam_list.append(self)

    def remove_duplicates_in_dowel_list(self):

        """
        resolve dowel duplication
        """

        self.dowel_list = list(set(self.dowel_list))

    def brep_representation(self):

        """
        make a brep of this beam with holes
        :return brep object of this beam
        """

        # create a beam
        box = rg.Box(self.base_plane,
            rg.Interval(-self.dx*0.5, self.dx*0.5),
            rg.Interval(-self.dy*0.5, self.dy*0.5),
            rg.Interval(-self.dz*0.5, self.dz*0.5)
            )

        box = box.ToBrep()

        # create a dowels
        for dowel in self.dowel_list:

            pipe = dowel.get_outer_pipe()

            pipe = pipe.ToBrep(True, True)

            tmp_box = rg.Brep.CreateBooleanDifference(box, pipe, 0.1)

            if len(tmp_box) > 0:
                box = tmp_box[0]

        return box

    def get_baseline(self):

        """
        get a line along with z-axis
        :return line object of this beam
        """

        diff = self.base_plane.XAxis * self.dx * 0.5
        p1 = rg.Point3d.Subtract(self.base_plane.Origin, diff)
        p2 = rg.Point3d.Subtract(self.base_plane.Origin, -diff)

        return rg.Line(p1, p2)

    def transform_instance_to_frame(self, target_frame=None):

        """
        in-place transform
        :param target_frame:  target frame to transform according to this base_plane
        """

        Beam.__move_to_frame(self, self.base_plane, target_frame)

    def transform_duplicate_to_frame(self, target_frame=None):

        """
        get the new beam transformed
        :param target_frame:  target frame to transform according to this base_plane
        :return Beam class
        """

        copied = self.copy()
        return Beam.__move_to_frame(copied, self.base_plane, target_frame)

    def transform_instance_from_frame_to_frame(self, source_frame, target_frame=None):

        Beam.__move_to_frame(self, source_frame, target_frame)

    def transform_duplicate_from_frame_to_frame(self, source_frame, target_frame=None):

        copied = self.copy()
        return Beam.__move_to_frame(copied, source_frame, target_frame)

    def __move_to_frame(beam, source_frame, target_frame=None):

        """
        private method to transform
        """

        if not target_frame:
            target_frame = beam.base_plane

        transform = rg.Transform.PlaneToPlane(source_frame, target_frame)

        beam.base_plane.Transform(transform)

        for dowel in beam.dowel_list:

            if dowel.base_plane:
                dowel.base_plane.Transform(transform)

            if dowel.line:
                dowel.line.Transform(transform)

        return beam


    @staticmethod
    def get_strucutured_data(beams):

        """
        get a data tree with the length of each dowel
        :param beams:  beams to be structured
        :return DataTree
        """

        tree = datatree[System.Object]()

        for i, beam in enumerate(beams):
            
            path = ghpath(i)
            
            for dowel in beam.dowel_list:
                
                tree.Add(dowel.get_length(), path)

        return tree

class Dowel:

    """
    Dowel class with connected beams
    """

    """radius of dowel itself"""
    inner_radius = 10

    """radius to be drilled"""
    outer_radius = 12

    def __init__(self, base_plane=None, line=None):

        """
        initialization
        :param base_plane: base plane which the dowel is along with
        :param line: line object that corresponds to the dowel itself

        base_plane and line are exclusive!
        """

        if base_plane and line:
            # TODO throw error
            return

        self.base_plane = base_plane
        self.line = line
        self.beam_list  = []

    def remove_duplicates_in_beam_list(self):

        """
        resolve beam duplication
        """

        return list(set(self.beam_list))
    
    def get_plane(self):

        """
        get the plane on this dowel
        :return rg.Vector3d
        """

        if self.base_plane:
        
            return self.base_plane
        
        else:
            
            p1 = self.line.PointAt(0)
            pc = self.line.PointAt(0.5)
            p2 = self.line.PointAt(1)
            return rg.Plane(pc, rg.Vector3d.Subtract(rg.Vector3d(p1),
                rg.Vector3d(p2)))
        
        
    def get_length(self):

        """
        get the length of this dowel
        :return float
        """

        if self.line:
            return self.line.Length

        # get an infinite line
        diff = self.base_plane.Normal * 9999
        p1 = rg.Point3d.Subtract(self.base_plane.Origin, diff)
        p2 = rg.Point3d.Subtract(self.base_plane.Origin, -diff)

        dowel_line = rg.Line(p1, p2)
        
        smallest_val = 9999
        biggest_val  = -9999
        smallest_beam = None
        biggest_beam = None

        # the dowel is connected to multiple beams
        for beam in self.beam_list:

            beam_line = beam.get_baseline()

            _, dowel_v, beam_v = rg.Intersect.Intersection.LineLine(dowel_line, beam_line)
            
            if dowel_v < smallest_val:
                smallest_val = dowel_v
                smallest_beam = beam
                
            elif biggest_val < dowel_v:
                biggest_val = dowel_v
                biggest_beam = beam

        actual_dowel_line = rg.Line(dowel_line.PointAt(smallest_val), dowel_line.PointAt(biggest_val))
        
        angle = rg.Vector3d.VectorAngle(self.base_plane.Normal, smallest_beam.base_plane.XAxis)
        exntension_1 = smallest_beam.dz * 0.5 / math.sin(angle)

        angle = rg.Vector3d.VectorAngle(self.base_plane.Normal, biggest_beam.base_plane.XAxis)
        exntension_2 = biggest_beam.dz * 0.5 / math.sin(angle)
        
        actual_dowel_line.Extend(exntension_1, exntension_2)
        
        return actual_dowel_line.Length
        
    def brep_representation(self):

        """
        make a brep of this dowel (for now with pseudo end points)
        :return cylinder object of this dowel
        """

        return self.get_inner_pipe()

    def get_line(self):

        """
        get a line object of this dowel
        :return line object
        """

        if self.line:
            return self.line

        # get an infinite line
        diff = self.base_plane.Normal * 9999
        p1 = rg.Point3d.Subtract(self.base_plane.Origin, diff)
        p2 = rg.Point3d.Subtract(self.base_plane.Origin, -diff)

        return rg.Line(p1, p2)

    def get_outer_pipe(self):

        """
        get a cylinder drilled
        :return cylinder object
        """

        return self.__get_pipe(self.outer_radius)

    def get_inner_pipe(self):

        """
        get a cylinder of dowel
        :return cylinder object
        """

        return self.__get_pipe(self.inner_radius)

    def __get_pipe(self, radius):

        """
        private method to create a cylinder
        """

        line = self.get_line()

        _, plane = line.ToNurbsCurve().PerpendicularFrameAt(0)
        circle = rg.Circle(plane, radius)
        return rg.Cylinder(circle, line.Length)


# instanciate objects
beam_1  = Beam(base_plane=beam_base_plane_1, dx=300, dy=50, dz=25)
beam_2  = Beam(base_plane=beam_base_plane_2, dx=300, dy=50, dz=25)
dowel_1 = Dowel(line=dowel_line_1)
dowel_2 = Dowel(line=dowel_line_2)

beam_1.add_dowel(dowel_1)
beam_1.add_dowel(dowel_2)
beam_2.add_dowel(dowel_1)
beam_2.add_dowel(dowel_2)

dowel_2.get_length()

# visualize the beams positioned in space
beams = [b.brep_representation() for b in [beam_1, beam_2]]

# create holes
frame = rg.Plane(rg.Plane.WorldXY.Origin, rg.Plane.WorldXY.ZAxis)
frame.Translate(rg.Vector3d(-200, -200, 0))

gripping_planes = []
top_planes = []
bottom_planes = []
safe_planes = []

holes = Hole.create_holes(beam_1)
for hole in holes:

    hole.orient_to_drilling_station(frame)

    top_planes.append(hole.top_plane)
    bottom_planes.append(hole.bottom_plane)
    gripping_planes.append(hole.gripping_plane)
    safe_planes.append(hole.get_safe_plane())
    
tmp.append(holes[1].beam.brep_representation())
tmp.append(holes[0].beam.brep_representation())

#holes = Hole.create_holes(beam_2)
#for hole in holes:
#
#    hole.orient_to_drilling_station(frame)
#
#    top_planes.append(hole.top_plane)
#    bottom_planes.append(hole.bottom_plane)
#    gripping_planes.append(hole.gripping_plane)
#    safe_planes.append(hole.get_safe_plane())
#    
#tmp.append(holes[1].beam.brep_representation())
#tmp.append(holes[0].beam.brep_representation())

tree = Beam.get_strucutured_data([holes[0].beam, holes[1].beam])
# ---------- end python_4 ----------
brep = Brep(python_2.beam_breps)
panel = Panel(python_2.bottom_planes)
geo = Geometry(python_3.tree)
panel_2 = Panel(python_3.beams)
line_3 = Line()
panel_3 = Panel(python_3.tree)
