# Grasshopper definition template_ur2_antonio_keystonetest.gh (Grasshopper 1.0.7)

vector_xyz = VectorXYZ(XComponent=0, YComponent=0, ZComponent=1)  # -> Vector, Length
point = Point(<point referenced from the Rhino model>)
plane_normal = PlaneNormal(Origin=point, ZAxis=vector_xyz.Vector)
number_slider = Slider(90, range=0..100)
scale_factor = Slider(0.1, range=0..0.1)

# ---- group: merged data from all surface groups
merged_dowel_crvs = Geometry(flatten([Line((-2094.648205, -5342.117223, 1078.079562), (-1976.895876, -5178.992457, 1142.488358)), Line((-2533.873688, -5257.33468, 1341.811187), (-2524.175104, -4991.667502, 1342.670677)), Line((-2033.135991, -5279.89618, 1045.548472), (-1979.375222, -5079.464388, 1081.036158)), Line((-1818.956237, -5335.401091, 622.1434538), (-1668.829372, -5200.366311, 607.2777956)), Line((-3114.072545, -5154.458628, 1074.802385), (-3019.631614, -5310.158272, 1097.313891)), Line((-2759.596581, -5020.926243, 1395.753507), (-2516.74441, -5127.498905, 1288.108053))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]))
merged_beam_crvs = Geometry(Tree({0;0}: [Line((-2551.558572, -6396.886148, 1319.929137), (-2050.796507, -6277.368402, 1081.64964)), Line((-2507.5785, -6116.608154, 1244.269606), (-2071.12128, -6048.973612, 1030.666467)), Line((-2488.234059, -5825.16294, 1214.287908), (-2078.844932, -5815.148121, 1009.704151)), Line((-2497.885407, -5532.072003, 1229.026647), (-2075.073113, -5580.518075, 1020.066486)), Line((-2534.370565, -5246.957459, 1288.97118), (-2059.24929, -5349.777858, 1061.102181)), Line((-2059.024423, -6202.869058, 1061.660371), (-1825.56713, -6148.646376, 586.6920493))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], {0;1}: [Line((-2551.558475, -5153.487177, 1319.929282), (-3001.50825, -5289.204373, 1055.690847)), Line((-2507.578293, -5433.765134, 1244.269687), (-2931.859263, -5506.844144, 1019.821496)), Line((-2488.234017, -5725.21035, 1214.287919), (-2902.550672, -5735.808591, 1005.639921)), Line((-2497.885583, -6018.301285, 1229.026591), (-2917.08896, -5966.506437, 1012.610657)), Line((-2534.370734, -6303.415847, 1288.971053), (-2973.712325, -6188.958843, 1040.991347)), Line((-2974.472076, -5359.263476, 1041.386543), (-3201.803365, -5417.01877, 586.6920618))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], {0;2}: [Line((-3908.566, -4735.745675, 1306.276681), (-3868.103361, -5004.944823, 981.6488368)), Line((-3613.241915, -4761.316432, 1310.141943), (-3680.476874, -5013.022806, 987.1058119)), Line((-3323.286875, -4823.142756, 1319.621304), (-3496.057101, -5046.217194, 1001.645264)), Line((-3038.762661, -4906.32473, 1332.37415), (-3317.006197, -5098.962528, 1023.996122)), Line((-2757.530273, -4999.978892, 1346.185989), (-3144.163217, -5167.496069, 1051.898748)), Line((-3806.053186, -5004.445855, 982.4352196), (-3814.638939, -5149.023328, 586.6920976))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], {0;3}: [Line((-2492.351435, -5022.530802, 1373.243717), (-1991.566008, -5152.583901, 1102.646478)), Line((-2262.838715, -4885.481431, 1430.084356), (-1841.895801, -5009.69967, 1101.274555)), Line((-2042.475878, -4735.69495, 1490.849596), (-1694.45697, -4864.585548, 1105.77792)), Line((-1831.823407, -4574.166057, 1555.850542), (-1550.55007, -4716.364035, 1117.425384)), Line((-1630.355578, -4402.89011, 1624.93106), (-1410.662093, -4565.187602, 1137.1952)), Line((-1942.037808, -5105.582266, 1101.621928), (-1706.166786, -5174.248433, 586.6920254))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], {0;4}: [Line((-1563.698187, -4342.873705, 1649.245922), (-1711.301462, -4146.959565, 1895.900157)), Line((-1762.351913, -4516.90671, 1578.902379), (-1889.43687, -4309.185258, 1805.717637)), Line((-1969.768044, -4682.008272, 1512.472466), (-2079.835608, -4459.206764, 1719.651982)), Line((-2186.838671, -4835.959986, 1450.279248), (-2285.21404, -4591.516946, 1639.32186)), Line((-2413.367479, -4977.367582, 1392.166773), (-2507.135382, -4699.061585, 1566.603604)), Line((-1768.917209, -4201.566394, 1865.772965), (-1931.702905, -3944.324471, 2025.530269))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], {0;5}: [Line((-2662.261705, -5032.869835, 1350.823053), (-2760.87884, -4723.086186, 1522.109839)), Line((-2942.89448, -4937.418032, 1337.046896), (-3051.328036, -4628.787606, 1526.410455)), Line((-3226.028963, -4849.660183, 1323.7098), (-3343.032458, -4539.629886, 1541.296536)), Line((-3513.970611, -4779.093064, 1312.847224), (-3638.821683, -4467.992558, 1565.818553)), Line((-3807.751985, -4739.315591, 1306.834078), (-3939.505206, -4427.547804, 1599.049083)), Line((-2856.799292, -4692.142825, 1522.29514), (-2976.865037, -4366.281793, 1663.047253))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]))
merged_beam_plns = Geometry(Tree({0;0}: [Plane(origin=(-2301.177539, -6337.127275, 1200.789388), x=(0.882718106, 0.2106798533, -0.4200270762), y=(-0.3322623808, -0.3522312702, -0.8749484799)), Plane(origin=(-2289.34989, -6082.790883, 1137.468036), x=(0.8896262169, 0.1378587849, -0.4353850591), y=(-0.4171572343, -0.1426921918, -0.8975626888)), Plane(origin=(-2283.539496, -5820.155531, 1111.99603), x=(0.8943099221, 0.02187735637, -0.4469129049), y=(-0.4468953382, -0.005957670501, -0.8945664105)), Plane(origin=(-2286.47926, -5556.295039, 1124.546567), x=(0.8917994928, -0.1021828913, -0.4407406509), y=(-0.4347308564, 0.07627939925, -0.8973240974)), Plane(origin=(-2296.809927, -5298.367658, 1175.03668), x=(0.8849728734, -0.19151587, -0.4244345471), y=(-0.3639266733, 0.2841507834, -0.8870263292)), Plane(origin=(-1942.295777, -6175.757717, 824.1762102), x=(0.4388191775, 0.1019199377, -0.892776599), y=(-0.8121107839, -0.3802606534, -0.4425809645))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], {0;1}: [Plane(origin=(-2776.533362, -5221.345775, 1187.810064), x=(-0.8345350475, -0.251718664, -0.490090776), y=(0.3624672795, 0.419077983, -0.8324608792)), Plane(origin=(-2719.718778, -5470.304639, 1132.045591), x=(-0.8738651093, -0.150516287, -0.4622819681), y=(0.4213589952, 0.239851644, -0.8746015013)), Plane(origin=(-2695.392345, -5730.509471, 1109.96392), x=(-0.8929059907, -0.02284057923, -0.4496634293), y=(0.4490062827, 0.02880444573, -0.8930641981)), Plane(origin=(-2707.487271, -5992.403861, 1120.818624), x=(-0.8832676811, 0.1091325055, -0.4559915566), y=(0.4366769755, -0.1626756951, -0.8847880183)), Plane(origin=(-2754.04153, -6246.187345, 1164.9812), x=(-0.8492719671, 0.2212518151, -0.4793586969), y=(0.3831458227, -0.3663791412, -0.8479183943)), Plane(origin=(-3088.137721, -5388.141123, 814.0393026), x=(-0.4443300635, -0.1128855313, -0.8887224828), y=(0.7295497326, 0.5301477138, -0.4320886359))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], {0;2}: [Plane(origin=(-3888.334681, -4870.345249, 1143.962759), x=(0.09550711373, -0.6354116795, -0.7662443401), y=(-0.04416381243, 0.7663003366, -0.6409628319)), Plane(origin=(-3646.859395, -4887.169619, 1148.623877), x=(-0.162010079, -0.6065143747, -0.7783913204), y=(0.19151962, 0.7544867056, -0.627749987)), Plane(origin=(-3409.671988, -4934.679975, 1160.633284), x=(-0.4064107348, -0.5247423013, -0.7479811708), y=(0.2660662513, 0.7151917895, -0.6463044593)), Plane(origin=(-3177.884429, -5002.643629, 1178.185136), x=(-0.6077188709, -0.420745174, -0.6735363928), y=(0.293965075, 0.6686937981, -0.6829591049)), Plane(origin=(-2950.846745, -5083.737481, 1199.042368), x=(-0.7522667904, -0.3259360358, -0.572590933), y=(0.3422328752, 0.5493214371, -0.762313989)), Plane(origin=(-3810.346062, -5076.734591, 784.5636586), x=(-0.0203737216, -0.3430778062, -0.939086008), y=(-0.1574898652, 0.9286556879, -0.3358504959))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], {0;3}: [Plane(origin=(-2241.958721, -5087.557351, 1237.945097), x=(0.8576768952, -0.2227371898, -0.4634420005), y=(-0.2934026349, 0.5281711195, -0.796837601)), Plane(origin=(-2052.367258, -4947.59055, 1265.679455), x=(0.7675882751, -0.2265116258, -0.5995837917), y=(-0.3719477315, 0.6044208497, -0.7045071479)), Plane(origin=(-1868.466424, -4800.140249, 1298.313758), x=(0.6507469228, -0.2410074804, -0.7200304416), y=(-0.4347842958, 0.6591536424, -0.6135789206)), Plane(origin=(-1691.186738, -4645.265046, 1336.637963), x=(0.5209198055, -0.2633514575, -0.8119658651), y=(-0.5010182667, 0.6758043352, -0.5406192718)), Plane(origin=(-1520.508835, -4484.038856, 1381.06313), x=(0.3930047016, -0.2903303082, -0.872499637), y=(-0.5510009758, 0.6852810945, -0.4762223706)), Plane(origin=(-1824.102297, -5139.91535, 844.1569768), x=(0.4134253476, -0.1203553261, -0.9025486566), y=(-0.7467482876, 0.5223575604, -0.4117154041))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], {0;4}: [Plane(origin=(-1637.499825, -4244.916635, 1772.573039), x=(-0.4243166251, 0.5631963572, 0.7090594227), y=(-0.2931403609, 0.6554445949, -0.6960324072)), Plane(origin=(-1825.894391, -4413.045984, 1692.310008), x=(-0.3818863574, 0.624196524, 0.6815728204), y=(-0.2413522119, 0.644521181, -0.7254940089)), Plane(origin=(-2024.801826, -4570.607518, 1616.062224), x=(-0.3401967222, 0.6886346934, 0.6403502551), y=(-0.1776901659, 0.6216231524, -0.7628963635)), Plane(origin=(-2236.026356, -4713.738466, 1544.800554), x=(-0.3033515191, 0.7537676156, 0.5829341622), y=(-0.1030875024, 0.5822099648, -0.8064766108)), Plane(origin=(-2460.251431, -4838.214584, 1479.385189), x=(-0.2745146782, 0.8147679328, 0.510680827), y=(0.02584399012, 0.5371431821, -0.8430950659)), Plane(origin=(-1850.310057, -4072.945432, 1945.651617), x=(-0.4734964349, 0.7482422396, 0.4646877198), y=(-0.003240392554, 0.5260937877, -0.8504203822))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], {0;5}: [Plane(origin=(-2711.570273, -4877.978011, 1436.466446), x=(-0.2683716178, 0.8430293516, 0.4661310837), y=(0.1909372982, 0.5208332246, -0.8320310693)), Plane(origin=(-2997.111258, -4783.102819, 1431.728676), x=(-0.2868761848, 0.8165250864, 0.500987862), y=(0.1970127985, 0.5620776791, -0.8032774365)), Plane(origin=(-3284.530711, -4694.645035, 1432.503168), x=(-0.2951467894, 0.7820659243, 0.5488727201), y=(0.20707734, 0.6131691901, -0.7623270424)), Plane(origin=(-3576.396147, -4623.542811, 1439.332888), x=(-0.2972932698, 0.7407872878, 0.60237107), y=(0.1368322173, 0.6574402344, -0.7409785979)), Plane(origin=(-3873.628595, -4583.431697, 1452.94158), x=(-0.2946477061, 0.6972251802, 0.6534981082), y=(-0.1115241249, 0.6540950132, -0.7481457634)), Plane(origin=(-2916.832165, -4529.212309, 1592.671196), x=(-0.3204176736, 0.8696205026, 0.375623077), y=(0.1325585059, 0.4337902728, -0.8912094264))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]))

# ----
X = UnitX(Factor=Slider(768, range=0..1000))
Y = UnitY(Factor=Slider(553, range=0..1000))
Z = UnitZ(Factor=Slider(-135, range=-200..1000))
scale = Scale(Geometry=merged_beam_plns, Center=Point(0, 0, 0), Factor=scale_factor)  # -> Geometry, Transform
scale_2 = Scale(Geometry=merged_beam_crvs, Center=Point(0, 0, 0), Factor=scale_factor)  # -> Geometry, Transform
scale_3 = Scale(Geometry=merged_dowel_crvs, Center=Point(0, 0, 0), Factor=scale_factor)  # -> Geometry, Transform
move = Move(Geometry=scale.Geometry, Motion=X)  # -> Geometry, Transform
move_2 = Move(Geometry=scale_2.Geometry, Motion=X)  # -> Geometry, Transform
move_3 = Move(Geometry=scale_3.Geometry, Motion=X)  # -> Geometry, Transform

# ----
# 0a
# Settings
# Check your IP address and set UR IP address
server_address = ValueList({"192.168.10.12", "192.168.10.11", "192.168.10.10", "192.168.10.2", "127.0.0.1"}, selected="192.168.10.11")
ur_ip = ValueList({"192.168.10.13", "192.168.10.11", "192.168.10.10", "127.0.0.1"}, selected="192.168.10.10")
server_port = Integer(30003)
globals = PythonScript(server_address=server_address, server_port=server_port, ur_ip=ur_ip)  # inputs server_port: Int32
# ---------- globals: Python ----------
from scriptcontext import sticky as st

st["server_address"] = server_address
st["server_port"] = server_port

st["ur_ip"] = ur_ip
# ---------- end globals ----------

# ----
# Check if UR is available
ping = Button()
py = PythonScript(ip=ur_ip, ping=ping)  # -> out
# ---------- py: Python ----------
from scriptcontext import sticky as st
from ur_online_control.communication import is_available


guid = str(ghenv.Component.InstanceGuid)
txt_key = "txt_" + guid
if txt_key not in st:
    st[txt_key] = ""

if ping:
    
    available = is_available(ip)
    
    if available:
        st[txt_key] = "%s is up!" % ip
    else:
        st[txt_key] = "%s is down!" % ip

print st[txt_key]
# ---------- end py ----------
panel = Panel(py)

move_4 = Move(Geometry=move.Geometry, Motion=Y)  # -> Geometry, Transform
move_5 = Move(Geometry=move_2.Geometry, Motion=Y)  # -> Geometry, Transform
move_6 = Move(Geometry=move_3.Geometry, Motion=Y)  # -> Geometry, Transform

# ---- group: picking plane
pt = ConstructPoint(XCoordinate=Slider(262.5, range=0..1000), YCoordinate=Slider(0, range=0..50), ZCoordinate=Slider(-92, range=-200..100))

# ---- group: drilling_plane
move_z = Slider(22.5, range=0..100)
move_y = Slider(0, range=-100..100)
pt_2 = ConstructPoint(XCoordinate=0, YCoordinate=move_y, ZCoordinate=move_z)
xy = XYPlane(Origin=pt_2)

# ----
list_index_2 = Slider(2, range=0..10)
list_index_2_2 = Slider(4, range=0..10)
move_7 = Move(Geometry=move_4.Geometry, Motion=Z)  # -> Geometry, Transform
move_8 = Move(Geometry=move_5.Geometry, Motion=Z)  # -> Geometry, Transform
move_9 = Move(Geometry=move_6.Geometry, Motion=Z)  # -> Geometry, Transform
rot3d = Rotate3D(Geometry=move_7.Geometry, Angle=degrees(number_slider), Center=Point(0, 0, 0), Axis=X)  # -> simplify(Geometry), Transform
rot3d_2 = Rotate3D(Geometry=move_8.Geometry, Angle=degrees(number_slider), Center=Point(0, 0, 0), Axis=X)  # -> Geometry, Transform
rot3d_3 = Rotate3D(Geometry=move_9.Geometry, Angle=degrees(number_slider), Center=Point(0, 0, 0), Axis=X)  # -> Geometry, Transform

bang = Button()
panel_2 = Panel("Unload libraries")
unload = PythonScript(bang=bang)
# ---------- unload: Python ----------
from compas_ghpython import unload_modules

unload_modules("compas")
unload_modules("ur_online_control")
# ---------- end unload ----------

python = GhPythonScript(plane_list=rot3d.Geometry, list_index_1=Slider(1, range=0..10), list_index_2=list_index_2, list_index_3=list_index_2_2)  # -> out, plane_list; inputs plane_list: tree of Plane
# ---------- python: Python ----------
__author__ = "JesusBarney"
__version__ = "2019.02.25"

import rhinoscriptsyntax as rs
import Rhino.Geometry as rg
import clr
clr.AddReference("Grasshopper")
import Grasshopper.Kernel.Data.GH_Path as ghpath
import Grasshopper.DataTree as datatree
import System
import math as ma

for i,l in enumerate(plane_list.Branches):
    if i == list_index_1 or i == list_index_2 or i == list_index_3:
        for p in l:
            p.Rotate(ma.pi, p.YAxis, p.Origin)
# ---------- end python ----------
geo = Geometry(python.plane_list)
geo_2 = Geometry(rot3d_2.Geometry)
geo_3 = Geometry(rot3d_3.Geometry)

# ---- group: Robot
# 1. load robot model
# 2. set tool
# 3. set basis
list = ValueList({"measurement_tool": 0, "drill_tool": 1, "gripper_tool": 2}, selected="gripper_tool")
tools = Tools(tool_id=list)
base = PythonScript()  # -> base_frame
# ---------- base: Python ----------
from compas.geometry import Frame

#origin = [414.42, -207.44, 82.62]
#xaxis = [0.00000, 1.00000, 0.00000]
#yaxis = [-1.00000, 0.00000, 0.00000]

#origin = [414.40, -206.7, 82.62]
#xaxis = [0.00000, 1.00000, 0.00000]
#yaxis = [-1.00000, 0.00000, 0.00000]

origin = [415.16, -220.18, 108.94]
xaxis = [0.00000, 1.00000, 0.00000]
yaxis = [-1.00000, 0.00000, 0.00000]


base_frame = Frame(list(origin), list(xaxis), list(yaxis))
# ---------- end base ----------
list_2 = ValueList({"UR5", "UR10"}, selected="UR5")
robot = PythonScript(model=list_2, tool=tools, base_frame=base)  # -> robot
# ---------- robot: Python ----------
from ur_online_control.ur.ur10 import UR10
from ur_online_control.ur.ur5 import UR5
from scriptcontext import sticky as st

if model == "UR5":
    robot = UR5()
elif model == "UR10":
    robot = UR10()

if tool:
    robot.set_tool(tool)
if base_frame:
    robot.set_base(base_frame)

st["robot"] = robot
# ---------- end robot ----------

# ----
lng = ListLength(List=flatten(geo_2))
lng_2 = ListLength(List=flatten(geo_3))
deplane = DeconstructPlane(Plane=python.plane_list)  # -> Origin, XAxis, YAxis, ZAxis
xy_2 = XYPlane(Origin=pt)

# ---- group: placing_plane
vec = VectorXYZ(XComponent=Slider(300, range=0..1000), YComponent=0, ZComponent=Slider(60, range=0..100))  # -> Vector, Length
move_10 = Move(Geometry=xy_2, Motion=vec.Vector)  # -> Geometry, Transform
pln = Plane(move_10.Geometry)

# ----
python_2 = GhPythonScript(dowel_crv=geo_3, radius=Slider(1.2, range=0..10))  # -> out, dowel, dowel_brep; inputs dowel_crv: Line
# ---------- python_2: Python ----------
__author__ = "ytakzk"
__version__ = "2019.02.22"

from geometry.dowel import Dowel
import Rhino.Geometry as rg

dowel = Dowel(line=dowel_crv, dowel_radius=radius)
dowel_brep = dowel.brep_representation().ToBrep(True, True)
# ---------- end python_2 ----------
vdis = VectorDisplay(Anchor=deplane.Origin, Vector=deplane.ZAxis)
panel_3 = Panel(lng)
panel_4 = Panel(lng_2)
points = PointList(Points=flatten(geo), Size=Slider(1, range=0..100))
panel_5 = Panel(geo)
geo_4 = Geometry(python_2.dowel_brep)
data = Data([19, 0, 14, 5, 18, 1, 13, 6, 17, 2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])
get_geo = PythonScript(
    beam_plane=geo,
    beam_crv=geo_2,
    dowels=python_2.dowel,
    dowel_breps=python_2.dowel_brep,
    end_extension=Slider(6, range=0..150))  # -> out, beam, beam_geo; inputs beam_plane: Plane, beam_crv: Line, dowels: list, dowel_breps: list of Brep
# ---------- get_geo: Python ----------
import Rhino.Geometry as rg
import rhinoscriptsyntax as rs

from geometry.beam import Beam
from geometry.dowel import Dowel

print beam_crv.Length

dx = beam_crv.Length + 2 * end_extension
dy = 15
dz = 5

beam = Beam(beam_plane, dx, dy, dz)

beam_geo = rg.Box(beam_plane, rg.Interval(-dx * 0.5, dx * 0.5),
            rg.Interval(-dy * 0.5, dy * 0.5),
            rg.Interval(-dz * 0.5, dz * 0.5))

for d in dowels:

    intersected, _ = rg.Intersect.Intersection.LineBox(d.line, beam_geo, 1.0)

    if intersected:
        beam.add_dowel(d)

beam_geo = beam.brep_representation()
# ---------- end get_geo ----------
python_3 = GhPythonScript(beam_family=flatten(get_geo.beam), drilling_plane=xy)  # -> out, safe_planes, top_planes, bottom_planes, placing_plane, beam_lengths, beam_breps, original_beam_breps; inputs beam_family: list
# ---------- python_3: Python ----------
# import libraries
import Rhino.Geometry as rg
from geometry.beam import Beam
from geometry.dowel import Dowel
from geometry.hole import Hole

# get placing planes
placing_plane = []
for b in beam_family:
    temp_plane = b.base_plane
    placing_plane.append(temp_plane)

# get beam lengths
beam_lengths = []
for b in beam_family:
    temp_line = b.get_baseline().Length
    beam_lengths.append(temp_line)

# get drill planes and brep(s)
safe_planes, top_planes, bottom_planes, beam_breps = Hole.get_tool_planes_as_tree(beam_family, target_plane=drilling_plane, safe_buffer=2, safe_plane_diff=100)
# ---------- end python_3 ----------
pln_2 = Plane(python_3.safe_planes)
pln_3 = Plane(python_3.top_planes)
pln_4 = Plane(python_3.bottom_planes)
pln_5 = Plane(python_3.placing_plane)

# ---- group: original beams
brep = Brep(python_3.original_beam_breps)
preview = CustomPreview(Geometry=brep, Material=ColourSwatch(SwatchColor=RGB(82, 122, 255)))

# ---- group: beams while drilling
brep_2 = Brep(python_3.beam_breps)
preview_2 = CustomPreview(Geometry=brep_2, Material=ColourSwatch(SwatchColor=RGB(191, 89, 255)))

# ----
panel_6 = Panel(data)
lng_3 = ListLength(List=flatten(pln_5))

# ---- group: picking_plane
geo_5 = Geometry(flatten(xy_2))

# ---- group: drill_safety_plane
geo_6 = Geometry(pln_2)

# ---- group: start_drill_plane
geo_7 = Geometry(pln_3)

# ---- group: placing plane
geo_8 = Geometry(pln_5)

# ---- group: end_drill_plane
geo_9 = Geometry(pln_4)

# ----
panel_7 = Panel(lng_3)

# ---- group: beam length
num = Number(python_3.beam_lengths)

# ----
preview_3 = CustomPreview(
    Geometry=get_geo.beam_geo,
    Material={diffuse=RGB(0, 0, 205), emission=RGB(66, 48, 66), shine=0.5, specular=RGB(255, 255, 255), transparency=0.7})

py_2 = PythonScript()  # -> path
# ---------- py_2: Python ----------
import sys
import os

ghComp = ghenv.Component
ghDoc = ghComp.OnPingDocument()

# the full path of the gh file
path = ghDoc.FilePath
# the directory of the gh file
path = os.path.dirname(path)

path = os.path.abspath(os.path.join(path, ".."))

print path
# ---------- end py_2 ----------
# 1
# Executing
panel_8 = Panel("Start communication server")
start = Button()
panel_9 = Panel(py_2)
server = PythonScript(path=panel_9, start=start)
# ---------- server: Python ----------
import os
import threading
from scriptcontext import sticky as st

server_address = st["server_address"]
server_port = st["server_port"]
ur_ip = st["ur_ip"]

"""
Change main!!!!
"""
main = os.path.join(path, "communication", "main_dowel_gripping_v1.py")

if os.path.isfile(main):
        
    def myfunc():
        syscall = "python %s %s %s %s" % (main, server_address, server_port, ur_ip)
        os.system(syscall)
    
    if start:
        t = threading.Thread(target=myfunc)
        t.start()
# ---------- end server ----------

python_4 = GhPythonScript(beams=flatten(get_geo.beam), sequence_list=panel_6)  # -> out, sequenced_beams, sequenced_beam_planes; inputs beams: list, sequence_list: list of Int32
# ---------- python_4: Python ----------
__author__ = "ytakzk"
__version__ = "2019.02.22"

sequenced_beams = []
sequenced_beam_planes = []

for index in sequence_list:
    
    beam = beams[index]
    sequenced_beams.append(beam)
    sequenced_beam_planes.append(beam.base_plane)
# ---------- end python_4 ----------
arrange_plane_lists = GhPythonScript(
    picking_plane=geo_5,
    drill_safety_plane=geo_6,
    start_drill_plane=geo_7,
    end_drill_plane=geo_9,
    placing_plane=geo_8,
    beam_length=num,
    start_index="0",
    end_index=panel_7)  # -> out, plane_list, number_of_holes_list; inputs picking_plane: Plane, drill_safety_plane: tree of Plane, start_drill_plane: tree of Plane, end_drill_plane: tree of Plane, placing_plane: Plane, beam_length: list, start_index: Int32, end_index: Int32
# ---------- arrange_plane_lists: Python ----------
__author__ = "JesusBarney"
__version__ = "2019.01.16"

import rhinoscriptsyntax as rs
import Rhino.Geometry as rg

plane_list = []

number_of_holes_list = []

for i in range(start_index, end_index):
    
    length = beam_length[i]
    plane = rg.Plane(picking_plane)
    plane.Translate(rg.Vector3d(length * 0.5, 0, 0))
    plane_list.append(plane)
    
    number_of_holes = 0
    
    for j, (d, s, e) in enumerate(zip(drill_safety_plane.Branches[i], start_drill_plane.Branches[i], end_drill_plane.Branches[i])):
        plane_list.append(d)
        plane_list.append(s)
        plane_list.append(e)
        number_of_holes = j
        
    plane_list.append(placing_plane)
    
    number_of_holes_list.append(number_of_holes + 1)
# ---------- end arrange_plane_lists ----------
speed = Slider(300, range=0..300)

# ---- group: Define commands
python_5 = PythonScript(planes_WCS=arrange_plane_lists.plane_list, dfillet=Slider(0, range=0..100), speed=speed)  # -> flatten(commands); inputs planes_WCS: list, speed: Int32
# ---------- python_5: Python ----------
import Rhino.Geometry as rg
from compas.geometry import Frame
from compas.geometry import Transformation
from compas_ghpython import xdraw_frame
from scriptcontext import sticky as st

robot = st["robot"]
buffer = 1

# TODO this must be optimized! matrix multiplication!
commands = []
for i, plane_WCS in enumerate(planes_WCS):
    tcp_WCS = Frame(plane_WCS.Origin, plane_WCS.XAxis, plane_WCS.YAxis)
    if i == 0 or i == len(planes_WCS) - 1:
        radius = 0.
        
    else:
        # calculate blend radius
        prev, current, next = planes_WCS[i-1].Origin, planes_WCS[i].Origin, planes_WCS[i+1].Origin
        radius = min((prev - current).Length/2 * buffer, (next - current).Length/2 * buffer, dfillet)
    
    tcp_RCS = robot.get_frame_in_RCS(tcp_WCS)
    
    cmd = list(tcp_RCS.point) + tcp_RCS.axis_angle_vector + [speed, radius]
    #cmd = list(tcp_RCS.point) + tcp_RCS.axis_angle_vector + [time, radius]
    commands.append(cmd)
    
    
    
print (commands)
# ---------- end python_5 ----------

# ----
points_2 = PointList(Points=flatten(python_4.sequenced_beam_planes), Size=Slider(10, range=0..100))

panel_10 = Panel("Get UR connected")
ur = PythonScript(send=start)
# ---------- ur: Python ----------
from scriptcontext import sticky as st
from ur_online_control.ur_driver import URDriver

server_address = st["server_address"]
server_port = st["server_port"]
ur_ip = st["ur_ip"]
robot = st["robot"]

tool_angle_axis = list(robot.tool.tcp_frame.point) + robot.tool.tcp_frame.axis_angle_vector
#robot.tool.tcp_frame.pose_axis_angle_vector
print tool_angle_axis

ur_driver = URDriver(server_address, server_port, tool_angle_axis, ur_ip, "UR")
print ur_driver

if send:
    ur_driver.send()
# ---------- end ur ----------

disconnect = Button()
panel_11 = Panel("Get Grasshopper connected")
client = PythonScript(connect=start, disconnect=disconnect)  # -> connected, client
# ---------- client: Python ----------
import time
from scriptcontext import sticky as st
from Rhino.RhinoApp import WriteLine
from ur_online_control.grasshopper import GHClient, gh_component_timer
import time

server_address = st["server_address"]
server_port = st["server_port"]

guid = str(ghenv.Component.InstanceGuid)

client_key = "client_" + guid
run_key = "run_" + guid

if connect:
    if client_key not in st:
        st[client_key] = GHClient(server_address, server_port)
        client = st[client_key]
        client.connect_to_server()
        client.start()
        
    else:
        if st[client_key].running:
            WriteLine("Client is already connected.")
            
        else:
            st[client_key] = GHClient(server_address, server_port)
            client = st[client_key]
            client.connect_to_server()
            client.start()
"""
else:
    if client_key in st:
        # we need a timer to ask if we have something on the rcv queue
        client = st[client_key]
        #if client.running:
        #    #client.run_inner_while()
        #    gh_component_timer(ghenv, True, 1000)
"""

if disconnect:
    if client_key in st:
        client = st[client_key]
        if client.running:
            client.close()

if client_key in st:
    connected =  st[client_key].running
    client = st[client_key]
    print st[client_key].rcv_queue.qsize()
    print st[client_key].snd_queue.qsize()
else:
    connected = False
# ---------- end client ----------
panel_12 = Panel(client.connected)

bang_2 = Button()

continue_fabrication = BooleanToggle(False)
panel_13 = Panel("Send a message")
send = Button()
drilling_commands = Data(python_5)
# 4
send_2 = PythonScript(
    client=client.client,
    send=send,
    continue_fabrication=continue_fabrication,
    tool=tools,
    drilling_commands=drilling_commands,
    number_of_holes_list=arrange_plane_lists.number_of_holes_list)  # -> out; inputs continue_fabrication: Int32, drilling_commands: list, number_of_holes_list: list
# ---------- send_2: Python ----------
from ur_online_control.communication.msg_identifiers import *
from ur_online_control.utilities.lists import flatten_list

len_command_drilling = len(drilling_commands[0])
commands_flattened_drilling = flatten_list(drilling_commands)

"""
sand_tool = tool
sand_tool_axis = list(sand_tool.tcp_frame.point) + sand_tool.tcp_frame.axis_angle_vector
"""
"""
vaccuum_tool = tool
vaccuum_tool_axis = list(vaccuum_tool.tcp_frame.point) + vaccuum_tool.tcp_frame.axis_angle_vector
"""
# tool settigns
tool_axis = list(tool.tcp_frame.point) + tool.tcp_frame.axis_angle_vector

### Gravel placment ###
"""
#safe_in_pose_gravel, safe_out_pose_gravel = cmd_gravel_in_out 
pose_gravel = cmd_gravel
"""

#print waiting_times
#print len(io_values)

#===================================================================================
if send and client:
    ### string_fabrication ###
    client.send(MSG_INT, int(continue_fabrication))
    client.send(MSG_FLOAT_LIST, tool_axis) ### set string_tcp ###
    client.send(MSG_INT, len_command_drilling) ### send len of each cmd ###
    client.send(MSG_FLOAT_LIST, commands_flattened_drilling) ### send cmd list ###
    client.send(MSG_FLOAT_LIST, number_of_holes_list) ### send cmd list ###

#===================================================================================
# ---------- end send_2 ----------

bang_3 = Button()
receive = PythonScript(client=client.client, bang=bang_3)  # -> qsize, client
# ---------- receive: Python ----------
from ur_online_control.communication.msg_identifiers import *
from ur_online_control.utilities.lists import flatten_list
from Rhino.RhinoApp import WriteLine


if client:
    if not client.ghenv:
        client.ghenv = ghenv
    qsize = client.rcv_queue.qsize()
# ---------- end receive ----------
panel_14 = Panel(receive.qsize)

receive_2 = PythonScript(client=client.client, bang=bang_2)  # -> qsize, client; same code as receive
panel_15 = Panel(receive_2.qsize)
send_3 = PythonScript(client=receive.client)  # -> out
# ---------- send_3: Python ----------
from ur_online_control.communication.msg_identifiers import *
from ur_online_control.utilities.lists import flatten_list

if client:
    qsize = client.rcv_queue.qsize()
    if qsize:
        msg = client.rcv_queue.get()
        print msg
# ---------- end send_3 ----------
panel_16 = Panel(send_3)
send_4 = PythonScript(client=receive_2.client)  # -> out; same code as send_3
panel_17 = Panel(send_2)
panel_18 = Panel(send_4)

# ----
# Direct UR control
get = Button()
get_2 = Button()
pose = PythonScript(get=get_2)  # -> pose_joints
# ---------- pose: Python ----------
from scriptcontext import sticky as st
from ur_online_control.ur_direct import get_current_pose_joints
from ur_online_control.ur.robot import BaseConfiguration

server_address = st["server_address"]
server_port = 30005
ur_ip = st["ur_ip"]
robot = st["robot"]
tool_angle_axis = list(robot.tool.tcp_frame.point) + robot.tool.tcp_frame.axis_angle_vector
print tool_angle_axis

guid = str(ghenv.Component.InstanceGuid)
pose_joints_key = "pose_joints" + guid


if get:
    st[pose_joints_key] = get_current_pose_joints(server_address, server_port, ur_ip, tool_angle_axis)
    
if pose_joints_key not in st:
    pose_joints = []
else:
    pose_joints = BaseConfiguration.from_joints(st[pose_joints_key])
# ---------- end pose ----------
pose_2 = PythonScript(get=get)  # -> pose_cartesian
# ---------- pose_2: Python ----------
from scriptcontext import sticky as st
from ur_online_control.ur_direct import get_current_pose_cartesian

server_address = st["server_address"]
server_port = 30005
ur_ip = st["ur_ip"]
robot = st["robot"]
tool_angle_axis = list(robot.tool.tcp_frame.point) + robot.tool.tcp_frame.axis_angle_vector
print tool_angle_axis

guid = str(ghenv.Component.InstanceGuid)
pose_cartesian_key = "pose_cartesian" + guid


if get:
    st[pose_cartesian_key] = get_current_pose_cartesian(server_address, server_port, ur_ip, tool_angle_axis)

if pose_cartesian_key not in st:
    pose_cartesian = []
else:
    pose_cartesian = st[pose_cartesian_key]
# ---------- end pose_2 ----------
stop = Button()
stop_2 = PythonScript(stop=stop)
# ---------- stop_2: Python ----------
from scriptcontext import sticky as st
from ur_online_control.ur_direct import stop as stop_robot

ur_ip = st["ur_ip"]

if stop:
    stop_robot(ur_ip)
# ---------- end stop_2 ----------
panel_19 = Panel(pose)
panel_20 = Panel(pose_2)

# ----
# Visualisation
robot_2 = Data(robot)
planes_wcs = Plane()
pose_joints = Data(pose)

# ---- group: Define plane in WCS, calculate joint positions
pt_3 = Point(Point(648.8632686, 624.689255, -55.48786018))
xy_3 = XYPlane(Origin=pt_3)
select_configuration = Slider(5, range=0..7)
plane_wcs = Plane(xy_3)
inverse = PythonScript(robot=robot_2, plane_WCS=plane_wcs, idx=select_configuration)  # -> configuration; inputs plane_WCS: Plane, idx: Int32
# ---------- inverse: Python ----------
import Rhino.Geometry as rg
from compas.geometry import Frame, Transformation
from compas_ghpython import xdraw_frame

tcp_WCS = Frame(plane_WCS.Origin, plane_WCS.XAxis, plane_WCS.YAxis)

# transform frame to robot coordinate system
tcp_RCS = robot.get_frame_in_RCS(tcp_WCS)

# get the frame of tool0
tool0_RCS = robot.get_tool0_frame_from_tcp_frame(tcp_RCS)

# calculate solutions to frame
solutions = robot.inverse_kinematics(tool0_RCS)

if not len(solutions):
    q = [0,0,0,0,0,0]
else:
    idx = min(len(solutions) - 1, idx)
    q = solutions[idx]
    
print q

configuration = q
# ---------- end inverse ----------

# ----
vertical_pose = Number([-152.427, -780.635, 855.229, -1.1958, -1.22046, -1.20201])
py_3 = PythonScript(pose_cartesian=pose_2)  # -> frame_WCS; inputs pose_cartesian: list
# ---------- py_3: Python ----------
import Rhino.Geometry as rg
from scriptcontext import sticky as st
from compas.geometry import Frame
from compas.geometry.xforms import Transformation

robot = st["robot"]



if pose_cartesian:
    frame_RCS = Frame.from_axis_angle_vector(pose_cartesian)
    frame_WCS = robot.get_frame_in_WCS(frame_RCS)
# ---------- end py_3 ----------
draw = Draw(frame=py_3)  # -> G, C
back = Button()
reset = Button()

# ---- group: Calculate joint positions for path
# Add init joint states
joint_states = Data([-0.1728179112, -1.415058186, 1.813991282, -1.971940356, -1.571654205, -3.308720436])
init_configuration = Slider(2, range=0..7)
py_4 = PythonScript(robot=robot_2, planes_WCS=planes_wcs, configuration_idx=init_configuration, init_configuration=joint_states)  # -> configurations; inputs planes_WCS: list, configuration_idx: Int32, init_configuration: list
# ---------- py_4: Python ----------
from compas_ghpython import unload_modules
unload_modules('ur_online_control')
import Rhino.Geometry as rg
from compas.geometry import Frame 
from compas.geometry.xforms import Transformation
from compas_ghpython import xdraw_frame
from ur_online_control.ur.kinematics import calculate_configurations_for_path, format_joint_positions


# TODO this must be optimized! matrix multiplication!
frames_tool0_RCS = []
for plane_WCS in planes_WCS:
    tcp_WCS = Frame(plane_WCS.Origin, plane_WCS.XAxis, plane_WCS.YAxis)
    tcp_RCS = robot.get_frame_in_RCS(tcp_WCS)
    frames_tool0_RCS.append(robot.get_tool0_frame_from_tcp_frame(tcp_RCS))
    

#configurations = calculate_configurations_for_path(frames_tool0_RCS, robot.params, init_configuration)
configurations = calculate_configurations_for_path(frames_tool0_RCS, robot, init_configuration)
#print configurations
configurations = configurations[min([configuration_idx, len(configurations) - 1])]

def format(numbers, k=4):
    #numbers = format_joint_positions(numbers)
    return "[" + ", ".join([("%." + str(k) + "f") % n for n in numbers]) + "]"
# ---------- end py_4 ----------
start_2 = Button()
stop_3 = Button()
step = Button()
counter = CountThroughList(L=py_4, start=start_2, stop=stop_3, step=step, step_back=back, reset=reset, interval=100)  # -> item; inputs L: list, start: Boolean, stop: Boolean, step_back: Boolean
# ---------- counter: Python ----------
from scriptcontext import sticky as st
from compas_ghpython import update_component


# store data in component
guid = str(ghenv.Component.InstanceGuid)
counter_key = "counter_" + guid
running_key = "running_" + guid

if counter_key not in st:
    st[counter_key] = 0

if running_key not in st:
    st[running_key] = False

if start:
    st[running_key] = True

if stop:
    st[running_key] = False

if step:
    if st[counter_key] < len(L) - 1:
        st[counter_key] += 1

if step_back:
    if st[counter_key] < len(L) - 1:
        st[counter_key] -= 1

if reset:
    st[counter_key] = 0

if len(L):
    item = L[st[counter_key]]

if st[running_key]:
    if st[counter_key] < len(L) - 1:
        st[counter_key] += 1
        update_component(ghenv, interval)
    else:
        st[counter_key] = 0
        st[running_key] = False
# ---------- end counter ----------

# ---- group: Calculate joint positions for path / Shows joint positions along path
flip = BooleanToggle(True)
l2t = PythonScript(L=py_4, flip=flip)  # -> T; inputs L: list, flip: Boolean
# ---------- l2t: Python ----------
from compas_ghpython import list_to_ghtree
L = [l.joint_values for l in L]

if flip:
    L = zip(*L)
T = list_to_ghtree(L)
# ---------- end l2t ----------
graph = QuickGraph(l2t, SortOrder=0)

# ---- group: Define joint positions
base_2 = Slider(-173.869, range=-360..360)
elbow = Slider(90.765, range=-360..360)
wrist2 = Slider(-82.725, range=-360..360)
wrist3 = Slider(91.571, range=-360..360)
shoulder = Slider(-72.967, range=-360..360)
wrist1 = Slider(-115.737, range=-360..360)
ur1_q1_q6 = Data([base_2, shoulder, elbow, wrist1, wrist2, wrist3])

# ----
preview_4 = CustomPreview(Geometry=draw.G, Shader=draw.C)
py_5 = GhPythonScript(joint_values=ur1_q1_q6)  # -> configuration; inputs joint_values: list
# ---------- py_5: Python ----------
import math
from ur_online_control.ur.robot import BaseConfiguration

configuration = BaseConfiguration.from_joints([math.radians(d) for d in joint_values])
# ---------- end py_5 ----------

# ----
# Calculate basis
# Measure basis:
# 1. Clear the recorded poses
# 2. Move robot to origin and press "get pose"
# 3. Move robot to point in positive x-axis and press "get pose"
# 4. Move robot to an other point in your basis and press "get pose"
# (The farer away these positions are, the better)
# 
# 5. Alternatively change the order in the component calc base
# 6. Copy output into base component
list_3 = ValueList({"origin, pt on positive x-axis, pt in xy plane": 0, "origin, pt on positive y-axis, pt in xy plane": 1}, selected="origin, pt on positive x-axis, pt in xy plane")
clear = Button()
rec = PythonScript(msg=pose_2, rec=get, clear=clear)  # -> rec; inputs msg: list
# ---------- rec: Python ----------
from scriptcontext import sticky as st

guid = str(ghenv.Component.InstanceGuid)
recorded_key =  "recorded_" + guid
just_cleared_key = "just_cleared_" + guid

if recorded_key not in st:
    st[recorded_key] = []

if just_cleared_key not in st:
    st[just_cleared_key] = False

if clear:
    st[recorded_key] = []
    st[just_cleared_key] = True
else:
    if len(msg):
        if msg != [None] and not st[just_cleared_key] and rec:
            st[recorded_key].append(msg)
    st[just_cleared_key] = False
        


rec = st[recorded_key]

print rec
# ---------- end rec ----------
calc_base = PythonScript(poses=rec, input_type=list_3)  # -> out; inputs poses: list
# ---------- calc_base: Python ----------
import Rhino.Geometry as rg
import math


if len(poses) > 2:
    
    O = poses[0]
    P1 = poses[1]
    P2 = poses[2]
    
    if input_type == 0:
        # origin, pt on positive x-axis, pt in xy plane
        origin = rg.Point3d(O[0], O[1], O[2])
        pt_on_xaxis = rg.Point3d(P1[0], P1[1], P1[2])
        pt_in_xyplane = rg.Point3d(P2[0], P2[1], P2[2])
        
        xaxis = pt_on_xaxis - origin
        xaxis.Unitize()
        
        v = pt_in_xyplane - origin
        zaxis = rg.Vector3d.CrossProduct(v, xaxis)
        zaxis.Unitize()
        
        # zaxis must look up!
        if math.acos(rg.Vector3d.ZAxis * zaxis) > math.acos(rg.Vector3d.ZAxis * -zaxis):
            zaxis = -zaxis
        
        yaxis = rg.Vector3d.CrossProduct(zaxis, xaxis)
    
    elif input_type == 1:
        # origin, pt on positive y-axis, pt in xy plane
        origin = rg.Point3d(O[0], O[1], O[2])
        pt_on_yaxis = rg.Point3d(P1[0], P1[1], P1[2])
        pt_in_xyplane = rg.Point3d(P2[0], P2[1], P2[2])
        
        yaxis = pt_on_yaxis - origin
        yaxis.Unitize()
        
        v = pt_in_xyplane - origin
        zaxis = rg.Vector3d.CrossProduct(v, yaxis)
        zaxis.Unitize()
        
        # zaxis must look up!
        if math.acos(rg.Vector3d.ZAxis * zaxis) > math.acos(rg.Vector3d.ZAxis * -zaxis):
            zaxis = -zaxis
        
        xaxis = rg.Vector3d.CrossProduct(yaxis, zaxis)
        
        
    print "Copy the following into base component:"
    print " "
    print "origin = [%.2f, %.2f, %.2f]" % tuple(list(origin))
    print "xaxis = [%.5f, %.5f, %.5f]" % tuple(list(xaxis))
    print "yaxis = [%.5f, %.5f, %.5f]" % tuple(list(yaxis))
    

#print rg.Vector3d.CrossProduct(rg.Vector3d.YAxis, rg.Vector3d.ZAxis)
#print rg.Vector3d.CrossProduct(rg.Vector3d.ZAxis, rg.Vector3d.XAxis)
# ---------- end calc_base ----------
panel_21 = Panel(rec)
panel_22 = Panel(calc_base)

# ---- group: Visualise / robot model brep
py_6 = PythonScript(model=list_2)  # -> n
# ---------- py_6: Python ----------
if model == "UR5":
    n = 0
if model == "UR10":
    n = 1

print n
# ---------- end py_6 ----------
ur10_brep = UR10Brep([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])
ur5_brep = UR5Brep([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])
show_brep = BooleanToggle(False)
filter = StreamFilter(Gate=py_6, Stream0=ur5_brep, Stream1=ur10_brep)

# ---- group: Visualise
list_4 = ValueList({"0 forward, from angles": 0, "1 inverse, from one plane": 1, "2 inverse, from multiple planes": 2, "3 forward, from robot": 3}, selected="2 inverse, from multiple planes")
filter_2 = StreamFilter(Gate=list_4, Stream0=py_5, Stream1=inverse, Stream2=counter, Stream3=pose_joints)
configuration = Panel(filter_2)
mesh = Mesh(filter)
draw_2 = PythonScript(robot=robot_2, configuration=filter_2, mesh=mesh, brep=filter, show_brep=show_brep)  # -> meshes, tool0_plane, tcp_plane, robot_brep; inputs mesh: list, brep: list
# ---------- draw_2: Python ----------
from compas_ghpython import unload_modules
unload_modules("ur_online_control")

from compas_ghpython import xdraw_frame
from compas_ghpython import mesh_draw
from compas_ghpython.geometry.xforms import xform_from_transformation
from compas.geometry import Frame
from compas.geometry.xforms import Transformation
from ur_online_control.ur.robot import BaseConfiguration

import Rhino.Geometry as rg
import Rhino

def mesh_update_vertices(mesh, vertices):
    for i in range(len(vertices)):
        mesh.vertex[i].update({'x': vertices[i][0], 'y': vertices[i][1], 'z': vertices[i][2]})

if configuration:
    #print configuration
    #q = BaseConfiguration.from_joints(configuration)
    q = configuration
    print q
    print q.joint_values
    
    print robot.get_forward_transformations(q)
    R0, R1, R2, R3, R4, R5 = robot.get_forward_transformations(q)
    
    tool0_frame2 = robot.tool0_frame.transformed(R5)
    tcp_frame2 = Frame.from_transformation(Transformation.from_frame(tool0_frame2) * robot.transformation_tool0_tcp)
    
    print robot.transformation_tool0_tcp
    print robot.transformation_tcp_tool0
    print robot.transformation_tool0_tcp * robot.transformation_tcp_tool0
    print tcp_frame2
    tcp_frame2 = Frame.from_transformation(Transformation.from_frame(tool0_frame2) * robot.transformation_tcp_tool0)
    print tcp_frame2
    
    tool0_frame, tcp_frame = robot.get_transformed_tool_frames(R5)
    
    tool0_frame = tool0_frame2
    tcp_frame = tcp_frame2
    
    m0, m1, m2, m3, m4, m5 = mesh
    for i in range(6):
        exec("R%drg = xform_from_transformation(R%d)" % (i, i))
        exec("m%d.Transform(R%drg)" % (i, i))
    meshes = [m0, m1, m2, m3, m4, m5]
    print meshes
    mt = robot.tool.get_transformed_model(Transformation.from_frame(tool0_frame))
    
    if mt:
        meshes.extend(map(mesh_draw, mt))
    
    """
    m0, m1, m2, m3, m4, m5, tool0_frame, tcp_frame = robot.get_transformed_model(q)
    mt = robot.get_transformed_tool_model(tcp_frame)
    
    meshes = []
    meshes.append(mesh_draw(m0))
    meshes.append(mesh_draw(m1))
    meshes.append(mesh_draw(m2))
    meshes.append(mesh_draw(m3))
    meshes.append(mesh_draw(m4))
    meshes.append(mesh_draw(m5))
    if mt:
        meshes.append(mesh_draw(mt))
    
    """
    
    tool0_plane = xdraw_frame(tool0_frame)
    tcp_plane = xdraw_frame(tcp_frame)
    
    if show_brep:
        
        b0, b1, b2, b3, b4, b5 = brep
        
        b0.Transform(R0rg)
        b1.Transform(R1rg)
        b2.Transform(R2rg)
        b3.Transform(R3rg)
        b4.Transform(R4rg)
        b5.Transform(R5rg)
        
        robot_brep = [b0, b1, b2, b3, b4, b5]
# ---------- end draw_2 ----------
tcp_plane = Plane(draw_2.tcp_plane)
tool0_plane = Plane(draw_2.tool0_plane)
robot_brep = Brep(draw_2.robot_brep)
draw_3 = RepresentPlaneAsLines(plane=tcp_plane, size=100)  # -> G, C
# ---------- draw_3: Python ----------
import Rhino.Geometry as rg
from System.Drawing import Color

if plane:

    G = []
    G.append(rg.Line(plane.Origin, size * plane.XAxis))
    G.append(rg.Line(plane.Origin, size * plane.YAxis))
    G.append(rg.Line(plane.Origin, size * plane.ZAxis))
    
    C = []
    C.append(Color.FromArgb(255, 0, 0))
    C.append(Color.FromArgb(0, 255, 0))
    C.append(Color.FromArgb(0, 0, 255))
# ---------- end draw_3 ----------
preview_5 = CustomPreview(Geometry=draw_2.meshes, Shader=ColourSwatch(SwatchColor=RGBA(99, 94, 94, 96)))
preview_6 = CustomPreview(Geometry=draw_3.G, Shader=draw_3.C)

# ----
mesh_2 = Mesh(draw_2.meshes)

# ---- group: Send joint position directly to robot
panel_23 = Panel("move cartesian")
idx = Slider(0, range=0..100)
commands = Data([-0.7378762823, -1.645309655, 1.740348054, -0.3678008479, -0.3738495375, -0.1107411527])
item = ListItem(List=commands, Index=idx, Wrap=True)
list_5 = ValueList({"send all positions": 0, "send only one position": 1}, selected="send only one position")
filter_3 = StreamFilter(Gate=list_5, Stream0=commands, Stream1=item)
movel = PythonScript(commands=filter_3, velocity=Slider(100, range=0..100))  # -> script; inputs commands: list
# ---------- movel: Python ----------
from scriptcontext import sticky as st

script_lines = []
for cmd in commands:
    #q, a=1.4, v=1.05, t=0, r=0)
    x, y, z, ax, ay, az, speed, radius = cmd
    script_lines.append("movel(p%s, v=%f, r=%f)" % (str([x/1000., y/1000., z/1000, ax, ay, az]), speed/1000., radius/1000.))

robot = st["robot"]
tool_angle_axis = list(robot.tool.tcp_frame.point) + robot.tool.tcp_frame.axis_angle_vector
x, y, z, ax, ay, az = tool_angle_axis

script = "def prog():\n"
script += "\ttextmsg(\">> program start\")\n"
script += "\tset_tcp(p%s)\n" % str([x/1000., y/1000., z/1000, ax, ay, az])
script += "".join(["\t%s\n" % line for line in script_lines])
script += "\ttextmsg(\"<< program end\")\n"
script += "end\n"
script += "prog()\n\n"

print script
# ---------- end movel ----------
send_5 = Button()
send_6 = Send(script=movel, send=send_5)
panel_24 = Panel(send_6)

# ----
panel_25 = Panel("move vertical")
movel_2 = PythonScript()  # -> script
# ---------- movel_2: Python ----------
from scriptcontext import sticky as st

robot = st["robot"]
tool_angle_axis = list(robot.tool.tcp_frame.point) + robot.tool.tcp_frame.axis_angle_vector
x, y, z, ax, ay, az = tool_angle_axis

script = "def prog():\n"
script += "\ttextmsg(\">> program start\")\n"
script += "\tset_tcp(p%s)\n" % str([x/1000., y/1000., z/1000, ax, ay, az])
script += "\tcurrent_pose = get_forward_kin()\n"
script += "\tmovel(p[current_pose[0], current_pose[1], current_pose[2], 0, 0, 0], a=0.1, v=0.1)\n"
script += "\ttextmsg(\"<< program end\")\n"
script += "end\n"
script += "prog()\n\n"

print script
# ---------- end movel_2 ----------
send_7 = Button()
send_8 = Send(script=movel_2, send=send_7)
panel_26 = Panel(send_8)

panel_27 = Panel("set digital out")
number = Slider(0, range=0..10)
value = BooleanToggle(False)
digital_out = PythonScript(number=number, value=value)  # -> script; inputs number: Int32, value: Boolean
# ---------- digital_out: Python ----------
script = "def prog():\n"
script += "\ttextmsg(\">> program start\")\n"
script += "\tset_digital_out(%i, %s)\n" % (int(number), str(value))
script += "\ttextmsg(\"<< program end\")\n"
script += "end\n"
script += "prog()\n\n"

print script
# ---------- end digital_out ----------
send_9 = Button()
send_10 = Send(script=digital_out, send=send_9)
panel_28 = Panel(send_10)

# ----
# move incremental in WCS
number_slider_2 = Slider(10, range=-10..10)
list_6 = ValueList({"xaxis", "yaxis", "zaxis"}, selected="yaxis")
movel_3 = PythonScript(step_size=number_slider_2, direction=list_6)  # -> script
# ---------- movel_3: Python ----------
from scriptcontext import sticky as st

robot = st["robot"]
tool_angle_axis = list(robot.tool.tcp_frame.point) + robot.tool.tcp_frame.axis_angle_vector
x, y, z, ax, ay, az = tool_angle_axis

script = "def prog():\n"
script += "\ttextmsg(\">> program start\")\n"
script += "\tset_tcp(p%s)\n" % str([x/1000., y/1000., z/1000, ax, ay, az])
script += "\tcurrent_pose = get_forward_kin()\n"


if direction == "xaxis":
    script += "\tmovel(p[current_pose[0] + %f, current_pose[1], current_pose[2], current_pose[3], current_pose[4], current_pose[5]], t=%f)\n" % (step_size/1000., step_size * 0.1)

elif direction == "yaxis":
    script += "\tmovel(p[current_pose[0], current_pose[1] + %f, current_pose[2], current_pose[3], current_pose[4], current_pose[5]], t=%f)\n" % (step_size/1000., step_size * 0.1)

else: # direction == "zaxis":
    script += "\tmovel(p[current_pose[0], current_pose[1], current_pose[2] + %f, current_pose[3], current_pose[4], current_pose[5]], t=%f)\n" % (step_size/1000., step_size * 0.1)

script += "\ttextmsg(\"<< program end\")\n"
script += "end\n"
script += "prog()\n\n"

print script
# ---------- end movel_3 ----------
send_11 = Button()
send_12 = Send(script=movel_3, send=send_11)
panel_29 = Panel(send_12)

# ----
# move incremental in TCS
get_current_pose = Button()
list_7 = ValueList({"xaxis", "yaxis", "zaxis"}, selected="zaxis")
movel_4 = PythonScript(get=get_current_pose, step_size=Slider(50, range=-10..50), direction=list_7)  # -> script; inputs get: list
# ---------- movel_4: Python ----------
from scriptcontext import sticky as st
from compas.geometry import Frame
from compas.geometry import Point, Vector
from ur_online_control.ur_direct import get_current_pose_cartesian

server_address = st["server_address"]
server_port = 30005
ur_ip = st["ur_ip"]
robot = st["robot"]
tool_angle_axis = list(robot.tool.tcp_frame.point) + robot.tool.tcp_frame.axis_angle_vector
print tool_angle_axis

guid = str(ghenv.Component.InstanceGuid)
pose_cartesian_key = "pose_cartesian" + guid

if get:
    st[pose_cartesian_key] = get_current_pose_cartesian(server_address, server_port, ur_ip, tool_angle_axis)

if pose_cartesian_key not in st:
    pose_cartesian = []
    script = ""
else:
    pose_cartesian = st[pose_cartesian_key]

    robot = st["robot"]
    tool_angle_axis = list(robot.tool.tcp_frame.point) + robot.tool.tcp_frame.axis_angle_vector
    x, y, z, ax, ay, az = tool_angle_axis
    
    script = "def prog():\n"
    script += "\ttextmsg(\">> program start\")\n"
    script += "\tset_tcp(p%s)\n" % str([x/1000., y/1000., z/1000, ax, ay, az])
    script += "\tcurrent_pose = get_forward_kin()\n"
    
#    frame = Frame.from_pose_axis_angle_vector(pose_cartesian)
    frame = Frame.from_axis_angle_vector([ax, ay, az])
    frame.point = [x, y, z]

    if direction == "xaxis":
        next_vector = Vector(*frame.xaxis) * step_size
    elif direction == "yaxis":
        next_vector = Vector(*frame.yaxis) * step_size
    else: # direction == "zaxis":
        next_vector = Vector(*frame.zaxis) * step_size
    
    x, y, z = next_vector
    script += "\tmovel(p[current_pose[0] + %f, current_pose[1] + %f, current_pose[2] + %f, current_pose[3], current_pose[4], current_pose[5]], t=%f)\n" % (x/1000., y/1000., z/1000., step_size * 0.1)
    
    script += "\ttextmsg(\"<< program end\")\n"
    script += "end\n"
    script += "prog()\n\n"
    
    print script
# ---------- end movel_4 ----------
send_13 = Button()
send_14 = Send(script=movel_4, send=send_13)
panel_30 = Panel(send_14)

# ---- group: Send joint position directly to robot
idx_2 = Slider(0, range=0..100)
panel_31 = Panel("move joints")
joint_positions = Data(py_5)
list_8 = ValueList({"send all positions": 0, "send only one position": 1}, selected="send only one position")
item_2 = ListItem(List=joint_positions, Index=idx_2, Wrap=True)
filter_4 = StreamFilter(Gate=list_8, Stream0=joint_positions, Stream1=item_2)
movej = PythonScript(joint_positions=filter_4, velocity=Slider(153, range=0..200))  # -> script; inputs joint_positions: list
# ---------- movej: Python ----------
script_lines = []

for position in joint_positions:
    script_lines.append("movej(%s, v=%f)" % (str(position), velocity/1000.))


script = "def prog():\n"
script += "\ttextmsg(\">> program start\")\n"
script += "".join(["\t%s\n" % line for line in script_lines])
script += "\ttextmsg(\"<< program end\")\n"
script += "end\n"
script += "prog()\n\n"


print script

#script = ""
# ---------- end movej ----------
send_15 = Button()

# ----
send_16 = Send(script=movej, send=send_15)

# ---- group: Send joint position directly to robot (continued)
panel_32 = Panel(send_16)

# ==== cluster Tools

# ---- group: drill_tool
pt = Point(Point(0, 0, 0))
clay_modified = Geometry([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])
drill_bit_length = Number()
X = UnitX(Factor=1)
Y = UnitY(Factor=-1)
brep = Brep(clay_modified)
mesh = Mesh(clay_modified)
ln = Line(StartPoint=pt, EndPoint=X)
ln_2 = Line(StartPoint=pt, EndPoint=Y)
addition = Addition(A=Slider(285, range=0..400), B=drill_bit_length)
Z = UnitZ(Factor=addition)
move = Move(Geometry=ln, Motion=Z)  # -> Geometry, Transform
move_2 = Move(Geometry=ln_2, Motion=Z)  # -> Geometry, Transform
crv = Curve(move.Geometry)
crv_2 = Curve(move_2.Geometry)
tool = Tool(meshes=mesh, breps=brep, xline=crv, yline=crv_2)

# ----
tool_rotation = Slider(45.3, range=0..100)
tool_id = ClusterInput()

# ---- group: measurement tool
measurement_tool_geo = Geometry([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])
mesh_2 = Mesh(measurement_tool_geo)
mjoin = MeshJoin(Meshes=mesh_2)
tool_2 = PythonScript(meshes=mjoin, brep=measurement_tool_geo)  # -> tool; inputs meshes: list, brep: list
# ---------- tool_2: Python ----------
from ur_online_control.ur.tools import MeasurementTool
from compas.datastructures import Mesh
from compas_rhino.helpers import mesh_from_guid


tool = MeasurementTool()
tool.model = [mesh_from_guid(Mesh, mesh) for mesh in meshes]
#tool.model_xyz = tool.model.xyz
tool.brep = brep
# ---------- end tool_2 ----------

# ----
tool_id_2 = Integer(tool_id)
neg = Negative(Value=tool_rotation)
panel = Panel(tool_id_2)

# ---- group: drill_tool / gripper_tool
pt_2 = Point(Point(0, 0, 0))
clay_modified_2 = Geometry([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])
X_2 = UnitX(Factor=1)
Y_2 = UnitY(Factor=-1)
mesh_3 = Mesh(clay_modified_2)
brep_2 = Brep(clay_modified_2)
ln_3 = Line(StartPoint=pt_2, EndPoint=X_2)
ln_4 = Line(StartPoint=pt_2, EndPoint=Y_2)
addition_2 = Addition(A=Slider(78, range=0..100))
Z_2 = UnitZ(Factor=addition_2)
move_3 = Move(Geometry=ln_3, Motion=Z_2)  # -> Geometry, Transform
move_4 = Move(Geometry=ln_4, Motion=Z_2)  # -> Geometry, Transform
crv_3 = Curve(move_3.Geometry)
crv_4 = Curve(move_4.Geometry)

# ----
rot3d = Rotate3D(Geometry=crv_4, Angle=degrees(neg), Center=pt_2, Axis=Vector(0, 0, 1))  # -> Geometry, Transform
rot3d_2 = Rotate3D(Geometry=crv_3, Angle=degrees(neg), Center=pt_2, Axis=Vector(0, 0, 1))  # -> Geometry, Transform

# ---- group: drill_tool / gripper_tool (continued)
tool_3 = Tool(meshes=mesh_3, breps=brep_2, xline=rot3d_2.Geometry, yline=rot3d.Geometry)

# ----
filter = StreamFilter(Gate=tool_id_2, Stream0=tool_2, Stream1=tool, Stream2=tool_3)
py = PythonScript(tool=filter)  # -> tcp_frame, model
# ---------- py: Python ----------
from compas_ghpython import mesh_draw 

tcp_frame = tool.tcp_frame
model = map(mesh_draw, tool.model)
# ---------- end py ----------
tool_4 = Data(filter)
draw = PythonScript(frame=py.tcp_frame)  # -> G, C
# ---------- draw: Python ----------
import Rhino.Geometry as rg
from System.Drawing import Color

if not size:
    size = 100

if frame:
    plane = rg.Plane(rg.Point3d(*list(frame.point)), rg.Vector3d(*list(frame.xaxis)), rg.Vector3d(*list(frame.yaxis)))

    G = []
    G.append(rg.Line(plane.Origin, size * plane.XAxis))
    G.append(rg.Line(plane.Origin, size * plane.YAxis))
    G.append(rg.Line(plane.Origin, size * plane.ZAxis))
    
    C = []
    C.append(Color.FromArgb(255, 0, 0))
    C.append(Color.FromArgb(0, 255, 0))
    C.append(Color.FromArgb(0, 0, 255))
# ---------- end draw ----------
tool_5 = ClusterOutput(tool_4)
preview = CustomPreview(Geometry=draw.G, Shader=draw.C)
preview_2 = CustomPreview(Geometry=py.model, Shader=ColourSwatch(SwatchColor=RGB(141, 170, 178)))

# ==== cluster Send
script = ClusterInput()
send = ClusterInput()
send_2 = PythonScript(script=script, send=send)  # -> out
# ---------- send_2: Python ----------
import socket
from scriptcontext import sticky as st

ur_ip = st["ur_ip"]
ur_port = 30002

if send:
    s = socket.create_connection((ur_ip, ur_port), timeout=0.5) 
    s.send(script)
    s.close()
# ---------- end send_2 ----------
out = ClusterOutput(send_2)

# ==== cluster Draw
size = ClusterInput()
frame = ClusterInput()
draw = PythonScript(frame=frame, size=size)  # -> G, C
# ---------- draw: Python ----------
import Rhino.Geometry as rg
from System.Drawing import Color

if not size:
    size = 100

if frame:
    
    plane = rg.Plane(rg.Point3d(*frame.point), rg.Vector3d(*frame.xaxis), rg.Vector3d(*frame.yaxis))

    G = []
    G.append(rg.Line(plane.Origin, size * plane.XAxis))
    G.append(rg.Line(plane.Origin, size * plane.YAxis))
    G.append(rg.Line(plane.Origin, size * plane.ZAxis))
    
    C = []
    C.append(Color.FromArgb(255, 0, 0))
    C.append(Color.FromArgb(0, 255, 0))
    C.append(Color.FromArgb(0, 0, 255))
# ---------- end draw ----------
G = ClusterOutput(draw.G)
C = ClusterOutput(draw.C)

# ==== cluster Tool
breps = ClusterInput()
meshes = ClusterInput()
meshes_2 = Mesh(meshes)
xline = ClusterInput()
yline = ClusterInput()
mjoin = MeshJoin(Meshes=meshes_2)
tool = PythonScript(meshes=mjoin, breps=breps, xline=xline, yline=yline)  # -> tool; inputs meshes: list of Mesh, breps: list of Brep
# ---------- tool: Python ----------
import Rhino.Geometry as rg
from compas.geometry import Frame
from ur_online_control.ur.tool import Tool
from compas.datastructures import Mesh
from compas_rhino.helpers import mesh_from_guid

xaxis = rg.Line(xline.PointAtStart, xline.PointAtEnd)
yaxis = rg.Line(yline.PointAtStart, yline.PointAtEnd)

if xaxis.From.DistanceTo(yaxis.From) < 0.01:
    origin = xaxis.From
    xaxis = xaxis.Direction
    yaxis = yaxis.Direction
elif xaxis.To.DistanceTo(yaxis.To) < 0.01:
    origin = xaxis.To
    xaxis = -xaxis.Direction
    yaxis = -yaxis.Direction
elif xaxis.From.DistanceTo(yaxis.To) < 0.01:
    origin = xaxis.From
    xaxis = xaxis.Direction
    yaxis = -yaxis.Direction
elif xaxis.To.DistanceTo(yaxis.From) < 0.01:
    origin = xaxis.To
    xaxis = -xaxis.Direction
    yaxis = yaxis.Direction

xaxis.Unitize()
yaxis.Unitize()

print origin
print xaxis
print yaxis

tcp_frame = Frame(origin, xaxis, yaxis)

tool = Tool(tcp_frame)
tool.model = [mesh_from_guid(Mesh, mesh) for mesh in meshes]
#tool.model_xyz = tool.model.xyz
tool.breps = breps
# ---------- end tool ----------
tool_2 = ClusterOutput(tool)
