# Grasshopper definition unnamed.gh (Grasshopper 1.0.4)

# ---- group: load a file from json
panel = Panel("grasshopper\pt_1data.json")

# ----
python = GhPythonScript(toggle=Button())  # -> out, a
# ---------- python: Python ----------
__author__ = "ytakzk"
__version__ = "2019.01.21"

import geometry.beam as beam
import geometry.dowel as dowel
import geometry.hole as hole
import geometry.modular_beam as modular_beam
import geometry.module as module

if toggle:
    
    reload(beam)
    reload(dowel)
    reload(hole)
    reload(modular_beam)
    reload(module)
# ---------- end python ----------
python_2 = GhPythonScript(file_name=panel, scale=Slider(0.1, range=0..0.1))  # -> out, beams, dowel_breps, beam_breps
# ---------- python_2: Python ----------
__author__ = "ytakzk"
__version__ = "2019.02.05"

import Rhino.Geometry as rg
import json
import os
import scriptcontext as sc
from geometry.modular_beam import ModularBeam
from geometry.module import Module


path = ghenv.Component.OnPingDocument().FilePath
root_dir = os.path.dirname(os.path.dirname(path)) + os.sep

file_path = root_dir + file_name


with open(file_path) as f:
    
    data = f.read()
    d = json.loads(data)
    
    module_data = d['modules']
    beam_data   = d['beams']
    
    beams = []
    modules = []
    
    for data in beam_data:
        
        plane_data = data['plane']
        dx = float(data['dx']) * scale
        dy = float(data['dy']) * scale
        dz = float(data['dz']) * scale
        depth = int(data['depth'])
        
        origin = rg.Point3d(float(plane_data['x']) * scale, float(plane_data['y']) * scale, float(plane_data['z']) * scale)
        xaxis = rg.Vector3d(float(plane_data['xx']), float(plane_data['xy']), float(plane_data['xz']))
        yaxis = rg.Vector3d(float(plane_data['yx']), float(plane_data['yy']), float(plane_data['yz']))
        
        
        base_plane = rg.Plane(origin, xaxis, yaxis)
        beam = ModularBeam(base_plane, dx, dy, dz, 0.0, depth)

        beams.append(beam)
    
    for data in module_data:
        
       middle = int(data['middle'])
       side_1 = int(data['side_1'])
       side_2 = int(data['side_2'])
       depth  = int(data['depth'])
       
       module = Module(beams[middle], beams[side_1], beams[side_2], depth, scale)
       
       modules.append(module)

[m.add_dowels() for m in modules]

dowel_list = []
beam_breps = []
for b in beams:
    
    dowel_list.extend(b.dowel_list)
    
    beam_breps.append(b.brep_representation(make_holes=True))

dowel_list = list(set(dowel_list))

dowel_breps = []
for d in dowel_list:
    
    dowel_breps.append(d.brep_representation())
# ---------- end python_2 ----------
brep = Brep(python_2.dowel_breps)
brep_2 = Brep(python_2.beam_breps)
panel_2 = Panel("""True
True
True
True
True
True
True
True
True
True
True
True
True
True
True
True
True
True
True
True
True
True
True
True
True
True
True
True
True
True
True
True
True
True
True
True
True
True
True
True
True
True
True
True
True
True
True
True
True
True
True
True
True
True
True
True
True
True
True
True
True
True
True
True
True
True
True
True
True
True
True
True
True
True
True
True
True
True
True
True
True
True
True
True
True
True
True
True
True
True
True
True
True
True
True
True
True
True
True
True
True
True
True
True
True
True
True
True
True
True
True
True
True
True
True
True
True
True
True
True
True
False
False
True
True
True
True
True
True
True
True
False
True
True
True
True
True
True
True
True
True
True
True
True
True
True
False
False
True
True
False
True
False
True
False
False
True
True
False
True
True
True
True
True
True
True
True
False
True
True
True
True
True
False
False
True
True
True
True
True
True
True
True
True
True
True
True
True
True
True
True
True
True
True
True
True
False
True
True
False
True""")
dispatch = Dispatch(List=brep_2, DispatchPattern=panel_2)  # -> ListA, ListB
area = Area(Geometry=brep)  # -> Area, Centroid
python_3 = GhPythonScript(beam_family=python_2.beams)  # -> out, safe_planes, top_planes, bottom_planes, beam_breps, original_beam_breps, original_beam_planes, length_list; inputs drilling_plane: Plane, beam_family: list
# ---------- python_3: Python ----------
# import libraries
import Rhino.Geometry as rg
from geometry.beam import Beam
from geometry.dowel import Dowel
from geometry.hole import Hole

original_beam_breps = [b.brep_representation(make_holes=False) for b in beam_family]

original_beam_planes = [b.base_plane for b in beam_family]

length_list = []
for b in beam_family:
    length_list.append(b.dx)

safe_planes, top_planes, bottom_planes, beam_breps = Hole.get_tool_planes_as_tree(beam_family, target_plane=drilling_plane, safe_buffer=2, safe_plane_diff=150)
# ---------- end python_3 ----------
brep_3 = Brep(dispatch.ListA)
cullpt = CullDuplicates(Points=area.Centroid, Tolerance=0.1, CullMode=1)  # -> Points, Indices, Valence
lng = ListLength(List=python_3.original_beam_planes)
python_4 = GhPythonScript(x=brep, y=cullpt.Indices)  # -> out, a; inputs x: list of Brep, y: list of Int32
# ---------- python_4: Python ----------
__author__ = "ytakzk"
__version__ = "2019.02.06"

import rhinoscriptsyntax as rs

a = []

for i, b in enumerate(x):
    
    if i in y:
        a.append(b)
# ---------- end python_4 ----------
points = PointList(Points=python_3.original_beam_planes, Size=Slider(20, range=0..100))
dispatch_2 = Dispatch(List=python_3.original_beam_planes, DispatchPattern=panel_2)  # -> ListA, ListB
series = Series(Start=0, Step=1, Count=lng)
dispatch_3 = Dispatch(List=series, DispatchPattern=panel_2)  # -> ListA, ListB
brep_4 = Brep(python_4.a)
brep_5 = Brep(python_3.original_beam_breps)
tag = TextTag(Location=dispatch_2.ListA, Text=dispatch_3.ListA)
panel_3 = Panel(cullpt.Indices)
panel_4 = Panel(python_3.length_list)
bar_graph = BarGraph(python_3.length_list, BarColor=RGB(255, 0, 90))
pt = Point(python_3.original_beam_planes)
points_2 = PointList(Points=pt, Size=Slider(20, range=0..100))
multiplication = Multiplication(A=python_3.length_list)
