# Grasshopper definition ur_setup.gh (Grasshopper 1.0.4)

python = GhPythonScript(index="1")  # -> out, beams; inputs index: Int32
# ---------- python: Python ----------
__author__ = "ytakzk"
__version__ = "2019.02.26"

import geometry.fabricatable_beam as fabricatable_beam
reload(fabricatable_beam)

import os
from geometry.fabricatable_beam import FabricatableBeam

root_path  = ghenv.Component.OnPingDocument().FilePath
root_dir = os.path.dirname(os.path.realpath(root_path))
path = os.sep.join([root_dir, "data", "%d.json" % index])
print path
beams = FabricatableBeam.read_from_json(path)
# ---------- end python ----------
pt = ConstructPoint(XCoordinate="1000", YCoordinate="1000", ZCoordinate=0)
pt_2 = ConstructPoint(XCoordinate="10000", YCoordinate=0, ZCoordinate=0)
pt_3 = ConstructPoint(XCoordinate="1000", YCoordinate="1000", ZCoordinate=0)
pln = Plane(pt_2)
pln_2 = Plane(pt_3)
pln_3 = Plane(pt)
python_2 = GhPythonScript(beams=python.beams, target_plane=pln_3)  # -> out, beam_breps, dowel_lines, compas_beams, planes; inputs beams: list, target_plane: Plane
# ---------- python_2: Python ----------
__author__ = "ytakzk"
__version__ = "2019.02.27"

from geometry.fabricatable_beam import FabricatableBeam
import Grasshopper.Kernel.Data.GH_Path as ghpath
import Grasshopper.DataTree as datatree
import System
import math
import Rhino.Geometry as rg

beam_breps        = datatree[System.Object]()
transformed_beams = datatree[System.Object]()

for i, b in enumerate(beams):
    
    path = ghpath(i)
    
    for h in b.holes:
    
        beam = FabricatableBeam.orient_structure(b, h, target_plane)
        transformed_beams.Add(beam, path)
        beam_breps.Add(beam.create_brep(), path)
# ---------- end python_2 ----------
python_3 = GhPythonScript(beams=python.beams, target_plane=pln)  # -> out, beam_breps, dowel_lines, compas_beams, planes; inputs beams: list, target_plane: Plane
# ---------- python_3: Python ----------
__author__ = "ytakzk"
__version__ = "2019.02.27"

import Rhino.Geometry as rg
from geometry.fabricatable_beam import FabricatableBeam
import Grasshopper.Kernel.Data.GH_Path as ghpath
import Grasshopper.DataTree as datatree
import System

dowel_lines  = datatree[System.Object]()

transformed_beams = []

for b in beams:
    
    plane = rg.Plane(target_plane)
    """
    plane.Origin = rg.Point3d(
        plane.Origin.X,
        plane.Origin.Y + b.dx * 0.5,
        plane.Origin.Z
    )
    """
    plane.Translate(-plane.XAxis * b.dx * 0.5)
    
    transformed_beam = FabricatableBeam.orient_structure(b, b.base_plane, plane)
    transformed_beams.append(transformed_beam)
    
compas_beams = [b.create_compas_beam() for b in transformed_beams]

beam_breps = [b.create_brep() for b in transformed_beams]

lines = [b.get_dowel_lines() for b in transformed_beams]

for i, ls in enumerate(lines):
    
    path = ghpath(i)
    [dowel_lines.Add(l, path) for l in ls]

planes = [b.base_plane for b in transformed_beams]
# ---------- end python_3 ----------
python_4 = GhPythonScript(beams=python.beams, target_plane=pln_2)  # -> out, beam_breps, dowel_lines, compas_beams, planes; inputs beams: list, target_plane: Plane
# ---------- python_4: Python ----------
__author__ = "ytakzk"
__version__ = "2019.02.27"

from geometry.fabricatable_beam import FabricatableBeam
import Grasshopper.Kernel.Data.GH_Path as ghpath
import Grasshopper.DataTree as datatree
import System
import math
import Rhino.Geometry as rg


tmp_transformed_beams = FabricatableBeam.orient_structure(beams, beams[0].base_plane, target_plane)

beam_breps = [b.create_brep() for b in tmp_transformed_beams]

dowel_lines = datatree[System.Object]()

lines = [b.get_dowel_lines(0) for b in tmp_transformed_beams]

for i, ls in enumerate(lines):

    path = ghpath(i)
    
#    if i < first_layer_count:
#        extra_drill_lines, _ = transformed_beams[i].get_screw_holes()
#        [dowel_lines.Add(l, path) for l in extra_drill_lines]
    
    [dowel_lines.Add(l, path) for l in ls]

transformed_beams = []

# rotate by 180 degrees
for b in tmp_transformed_beams:
    
    local_target_plane = rg.Plane(b.base_plane)
    local_target_plane.Rotate(math.radians(180), local_target_plane.ZAxis, local_target_plane.Origin)
    
    new_beam = FabricatableBeam.orient_structure(b, b.base_plane, local_target_plane)

    transformed_beams.append(new_beam)

compas_beams = [b.create_compas_beam() for b in transformed_beams]

planes = [b.base_plane for b in transformed_beams]
# ---------- end python_4 ----------
brep = Brep(python_3.beam_breps)
brep_2 = Brep(python_4.beam_breps)
brep_3 = Brep(python_2.beam_breps)
